# Grasshopper definition ENERGY_ and comfort from configurator 18.04.2024.gh (Grasshopper 1.0.7)
# plug-ins: Human, LadybugGrasshopper, eleFront

# ----
# 4 MODEL NAME
# 5 FOLDER PATH
folder = Panel("C:\Users\gnoce\Desktop\Rossella")
name = Panel("test_ross")
concat = Concatenate(FragmentA=folder, FragmentB=name, JoinSeparator="\")
txt = Text(concat)

# ---- group: base settings
bldgvintages = HBBuildingVintages({"ASHRAE 90.1 2019  |  IECC 2021": "2019", "ASHRAE 90.1 2016  |  IECC 2018": "2016", "ASHRAE 90.1 2013  |  IECC 2015": "2013", "ASHRAE 90.1 2010  |  IECC 2012": "2010", "ASHRAE 90.1 2007  |  IECC 2009": "2007", "ASHRAE 90.1 2004  |  IECC 2006": "2004", "1980-2004 (CBECS)": "1980_2004", "Pre-1980 (CBECS)": "pre_1980"}, selected="ASHRAE 90.1 2010  |  IECC 2012")
constructiontypes = HBConstructionTypes({"SteelFramed", "WoodFramed", "Mass", "Metal Building"}, selected="Mass")
climatezones = HBClimateZones({"1 - Very Hot": "1", "2 - Hot": "2", "3 - Warm": "3", "4 - Mixed": "4", "5 - Cool": "5", "6 - Cold": "6", "7 - Very Cold": "7", "8 - Subarctic": "8"}, selected="4 - Mixed")

# ----
gfloor = ValueList({"Igloo concrete floor not insulated": 0, "Poorly insulated igloo concrete floor": 1, "Insulated igloo concrete floor": 2}, selected="Igloo concrete floor not insulated")
wall = ValueList({"Brick Masonry Not-Insulated": 0, "Brick Masonry Insulated": 1, "Brick Masonry Highly Insulated": 2, "Thermal Block Masonry Insulated": 3, "Thermal Block Masonry Highly Insulated": 4, "Concrete Masonry Not-Insulated": 5, "Concrete Masonry Medium Insulated External": 6, "Concrete Masonry Medium Insulated Internal": 7, "Concrete Masonry Highly Insulated": 8, "Stone Masonry Not-Insulated": 9, "Stone Masonry Medium Insulated": 10, "Stone Masonry Highly Insulated": 11, "Brick Masonry Not-Insulated": 12, "Brick Masonry Medium Insulated": 13, "Brick Masonry Highly Insulated": 14, "CONCRETE PACKAGE": 15, "VENTILATED WALL": 16, "WET WOOD PACKAGE": 17, "STEEL PACKAGE": 18, "DRY WOOD PACKAGE": 19}, selected="Concrete Masonry Medium Insulated Internal")
roof = ValueList({"Timber floor not insulated": 0, "Poorly insulated timber floor": 1, "Highly insulated timber floor": 2, "Lateral concrete floor not insulated": 3, "Poorly insulated lateral concrete floor": 4, "Highly insulated lateral concrete floor": 5, "Medium insulated lightweight concrete floor": 6, "Insulated lightweight concrete floor": 7, "Highly insulated lightweight concrete floor": 8, "Concrete roof": 9, "Steel roof": 10, "Wooden roof": 11, "Extensive green roof": 12}, selected="Timber floor not insulated")

# ----
# 1 EPW
path = FilePath("C:\Users\gnoce\Desktop\Giovanni\_PLINIVS - Copia\UCCRN\RIO\Rio Projections\epw\BRA_Rio.de.Janeiro.Forte.de.Copacabana_EC-Earth3_ssp585_2050-WARMER.epw")
panel = Panel(path)

# ---- group: ENVELOPE FEATURES
glazing_u = Slider(0.3, range=0.1..0.9)
wwr = Slider(0.2, range=0.1..1.1)

# ----
update = Button()

# ----
# Run The Simulation
lb_falsestarttoggle = LBFalseStartToggle(False)

# ----
# LAYER SETTING:
# before using this tool create these layers and sublayers
# 
# - Analysis Buildings
#    - Residential
#    - Offices
#    - .....(name according to building program)
# 
# - Context
#    - Buildings
#    - Trees
#    - Shadings
# :
c_script = CSharpScript(delete=update)  # inputs delete: Boolean
# ---------- c_script: C# usings ----------
using System.Linq;
# ---------- c_script: C# ----------
    if(delete)
    {
      var doc = this.Component.OnPingDocument();
      if(doc == null)return;
      var objs = doc.Objects;
      var deleteComs = objs.Where(o => o.GetType().ToString() == "Grasshopper.Kernel.Components.GH_PlaceholderComponent").ToList();
      if(deleteComs == null || deleteComs.Count == 0)return;
      doc.ScheduleSolution(20, (d) => doc.RemoveObjects(deleteComs, false));
    }
# ---------- end c_script ----------
list = ValueList({"Analysis Buildings", "Analysis Buildings::Non Residential", "Analysis Buildings::Residential", "Livello 01", "Livello 02", "Livello 03", "Livello 04", "Livello 05", "Predefinito"}, selected="Analysis Buildings::Non Residential")
list_2 = ValueList({"Analysis Buildings", "Analysis Buildings::Residential", "Livello 01", "Livello 02", "Livello 03", "Livello 04", "Livello 05", "Predefinito"}, selected="Analysis Buildings::Residential")

# ----
# BUILDING LAYERS FROM CONFIGURATOR
list_3 = ValueList({"a_Building name", "b_Wall_Stratigrafy", "c_Wall_u_fac", "d_Roof_Stratigrafy", "e_Roof_u_fac", "f_Floor_Stratigrafy", "g_Floor_u_fac", "h_Enviromental Cobenefit", "i_Social Cobenefit", "l_Economic Cobenefit", "m_GWP(kgCO2e/m2)", "n_GWP(kgCO2)", "o_DF_String"}, selected="o_DF_String")
reflay = ReferenceByLayer(LayerName=list_2, lightweight=False)
reflay_2 = ReferenceByLayer(LayerName=list, lightweight=False)
getuv = GetUserValue(Geometry=reflay, Key=list_3)
getuv_2 = GetUserValue(Geometry=reflay_2, Key=list_3)
strtoobj = DFStringToObject(df_str=getuv)  # -> df_obj; plug-in component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
context = Geometry([<brep referenced from the Rhino model> x2])
strtoobj_2 = DFStringToObject(df_str=getuv_2)  # -> df_obj; plug-in component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
merge = Merge(Data1=strtoobj, Data2=strtoobj_2)  # -> flatten(Result)

# ----
# Model Assembly
# connect if there are context geometries
context_2 = DFContextShade(geo=context)  # -> report, context; plug-in component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
model = DFModel(buildings=flatten(merge), name=name)  # -> report, model; plug-in component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

# ----
# CHECK 1
vizall = DFVisualizeAll(df_objs=flatten(model.model))  # -> geo; plug-in component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

# ----
# Visualize Model Properties
room2dattr = DFRoom2DAttributes({"Display Name": "display_name", "Simulation Name (Identifier)": "identifier", "Floor-To-Ceiling Height": "floor_to_ceiling_height", "Floor Elevation": "floor_height", "Ceiling Elevation": "ceiling_height", "Is Ground Contact": "is_ground_contact"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}, selected="Program": "properties.energy.program_type.display_name")
data = Data(flatten(model.model))
colorroom2dattr = DFColorRoom2DAttributes(df_obj=flatten(data), attribute=room2dattr)  # -> mesh, legend, wire_frame, values, colors; plug-in component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

# ----
# Simulation Parameters
toggle = BooleanToggle(True)
list_4 = ItemSelector({"Monthly", "Daily", "Hourly"}, selected="Monthly")
panel_2 = Panel("Monthly")
shadowcalc = HBShadowCalculation(solar_dist="FullExterior")  # -> shadow_calc; plug-in component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
simoutput = HBSimulationOutput(
    zone_energy_use=toggle,
    hvac_energy_use=toggle,
    gains_and_losses=toggle,
    comfort_metrics=toggle,
    surface_temperature=toggle,
    surface_energy_flow=toggle,
    report_frequency=list_4)  # -> report, sim_output; plug-in component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
simpar = HBSimulationParameter(output=simoutput.sim_output, timestep=6, shadow_calc=shadowcalc)  # -> sim_par; plug-in component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

# ----
# HONEYBEE WORKFLOW
panel_3 = Panel("""District
Building
Story""")
list_5 = ItemSelector(panel_3, {"District", "Building", "Story"}, selected="District")
bool = Boolean(lb_falsestarttoggle)
tohoneybee = DFModelToHoneybee(
    model=model.model,
    obj_per_model=list_5,
    use_multiplier=Toggle(True),
    add_plenum=Toggle(True),
    shade_dist="30",
    run=Toggle(True))  # -> report, hb_models; plug-in component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
txt_2 = Text(txt)
panel_4 = Panel(txt_2)
path_2 = FilePath(path)
modeltoosm = HBModelToOSM(model=tohoneybee.hb_models, epw_file=path_2, sim_par=simpar, folder=panel_4, write=bool, run=bool)  # -> report, jsons, osw, osm, idf, sql, zsz, rdd, html; plug-in component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

# ----
# CHECK 2
vizall_2 = HBVisualizeAll(hb_objs=flatten(tohoneybee.hb_models))  # -> geo; plug-in component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

# ----
# SQL PATH
panel_5 = Panel(": ")
split = TextSplit(Text=tohoneybee.hb_models, Separators=panel_5)
item = ListItem(List=split, Index=0, Wrap=True)  # -> Item1, Item
concat_2 = Concatenate(FragmentA=panel_4, FragmentB=item.Item1, FragmentC="openstudio\run\eplusout.sql", JoinSeparator="\")
txt_3 = Text(concat_2)
se_non_funziona_disabilitare_sola_lettur = Panel(txt_3)  # "SE NON FUNZIONA DISABILITARE \"SOLA LETTURA\" NELLA CARTELLA"

# ---- group: sql
file_path = FilePath(modeltoosm.sql)

# ----
# Compute EUI
eui = HBEndUseIntensity(sql=file_path)  # -> eui, eui_end_use, end_uses, gross_floor; plug-in component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
eui_kwh_m2 = Panel(eui.eui)
panel_6 = Panel(eui.eui_end_use)
panel_7 = Panel(eui.end_uses)

# ---- group: step 1
toggle_2 = BooleanToggle(False)

# ---- group: step 2
toggle_3 = BooleanToggle(False)

# ---- group: step 3
toggle_4 = BooleanToggle(False)

# ----
gridrooms = HBSensorGridFromRooms(rooms=tohoneybee.hb_models, grid_size=Slider(1, range=0..1), dist_floor=Slider(0.5, range=0..1))  # -> grid, points, mesh; plug-in component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
assigngridsviews = HBAssignGridsAndViews(model=tohoneybee.hb_models, grids=flatten(gridrooms.grid))  # -> model; plug-in component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
epwtoddy = LBEPWToDDY(weather_file=path_2, write=toggle_2)  # -> ddy_file; plug-in component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
recipesettings = HBRecipeSettings(folder=txt, reload_old=False)  # -> settings; plug-in component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
pmvmap = HBPMVComfortMap(model=assigngridsviews, epw=path_2, ddy=epwtoddy, run_settings=recipesettings, run=toggle_3)  # -> report, env_conds, temperature, condition, pmv, TCP, HSP, CSP; plug-in component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
thermalmtx = HBReadThermalMatrix(comf_result=pmvmap.pmv, load=toggle_4)  # -> comf_mtx; plug-in component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
analysisperiod = LBAnalysisPeriod(start_month=Slider(1, range=1..12), start_day=1, start_hour=0, end_month=Slider(12, range=0..100))  # -> period, hoys, dates; plug-in component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
panel_8 = Panel(thermalmtx)
vizthermalmap = HBVisualizeThermalMap(comf_mtx=thermalmtx, mesh=flatten(gridrooms.mesh), period=analysisperiod.period)  # -> report, mesh, legend, title, colors, values; plug-in component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

# ----
# Visualize Energy Use (check the end uses first then connect)
roomenergyresult = HBReadRoomEnergyResult(sql=file_path)  # -> cooling, heating, lighting, electric_equip, gas_equip, process, hot_water, fan_electric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; plug-in component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
massarithop = LBMassArithmeticOperation(data=flatten(roomenergyresult.cooling), type="Cooling")  # -> data; plug-in component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
massarithop_2 = LBMassArithmeticOperation(data=flatten(roomenergyresult.heating), type="Heating")  # -> data; plug-in component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
massarithop_3 = LBMassArithmeticOperation(data=flatten(roomenergyresult.lighting), type="Lighting")  # -> data; plug-in component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
massarithop_4 = LBMassArithmeticOperation(data=flatten(roomenergyresult.hot_water), type="Hot Water")  # -> data; plug-in component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
massarithop_5 = LBMassArithmeticOperation(data=flatten(roomenergyresult.electric_equip), type="Elecric equip")  # -> data; plug-in component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
merge_2 = Merge(Data1=massarithop, Data2=massarithop_2, Data3=massarithop_3, Data4=massarithop_5)
massarithop_6 = LBMassArithmeticOperation(data=flatten(merge_2), operator="+")  # -> data; plug-in component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
merge_3 = Merge(
    Data1=ColourSwatch(SwatchColor=RGB(36, 55, 145)),
    Data2=ColourSwatch(SwatchColor=RGB(212, 32, 32)),
    Data3=ColourSwatch(SwatchColor=RGB(217, 212, 67)),
    Data4=ColourSwatch(SwatchColor=RGB(205, 232, 176)),
    Data5=ColourSwatch(SwatchColor=RGB(204, 117, 35)))
tounit = LBToUnit(data=merge_2, to_unit="GJ")  # -> all_unit, data; plug-in component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
xdata = LBDeconstructData(data=massarithop_6)  # -> header, values; plug-in component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
ma = MassAddition(Input=xdata.values)  # -> Result, PartialResults
division = Division(A=ma.Result, B=Slider(1000000, range=0..1000000))
legendpar = LBLegendParameters(max=Slider(2000000, range=0..10000000), seg_count="5", colors=merge_3, num_decimals="0")  # -> leg_par; plug-in component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
num = Number(expr("Round(x,2)", division))
energy_consumption_gwh = Panel(num)
concat_3 = Concatenate(
    FragmentA="ANNUAL ENERGY CONSUMPTION",
    FragmentC="Total Energy consumption = ",
    FragmentD=energy_consumption_gwh,
    FragmentE=" (1 GWh = 1000000 kWh)",
    FragmentF="End Use Intensity = ",
    FragmentG=eui_kwh_m2,
    FragmentH=" kWh/m2")
monthlychart = LBMonthlyChart(data=merge_2, stack=Toggle(True), global_title=concat_3, legend_par=legendpar)  # -> report, data_mesh, data_lines, col_lines, legend, borders, labels, y_title, title, vis_set; plug-in component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

panel_9 = Panel(concat_3)

# ---- group: buildings with PV
merge_4 = Merge()
buildings = Geometry(merge_4)

# ---- group: Buildings without PV
merge_5 = Merge()
context_3 = Geometry(merge_5)

# ----
# PV panels IMPLEMENTATION
sunion = SolidUnion(Breps=vizall)
fmerge = MergeFaces(Brep=sunion)  # -> Breps, Before, After
brep = Brep(fmerge.Breps)
brep_2 = Brep(brep)
panel_10 = Panel(brep_2)
item_2 = ListItem(List=brep_2, Index=0, Wrap=True)  # -> Item, Item1, Item2, Item3, Item4
information_type = ValueList({"general information": 0, "Total energy producation in kwh/y": 1, "for each building in kwh/y": 2, "per m2 in kwh/m2": 3}, selected="Total energy producation in kwh/y")
roof_availibility = Slider(100, range=1..100)
module_type = ValueList({"Mono-Si": 0, "Poly-Si": 1, "CdS / CdTe": 2, "CIS / CIGS": 3}, selected="Mono-Si")
simulation = LBFalseStartToggle(False)
epw = FilePath(path)
cluster = Cluster_5(
    buildings=buildings,
    context=context_3,
    epw_file=epw,
    cpu_count=simulation,
    run=simulation,
    roof_availibility=roof_availibility,
    module_type=module_type,
    information_type=information_type)
production = Panel(cluster)

roomcomfortresult = HBReadRoomComfortResult(sql=modeltoosm.sql)  # -> oper_temp, air_temp, rad_temp, rel_humidity, unmet_heat, unmet_cool; plug-in component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
pmv = LBPMVComfort(
    air_temp=roomcomfortresult.air_temp,
    mrt=roomcomfortresult.rad_temp,
    rel_humid=roomcomfortresult.rel_humidity,
    run=Toggle(True))  # -> report, pmv, ppd, set, comfort, condition, heat_loss, comf_obj; plug-in component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

gross_floor_area = Number(eui.gross_floor)
division_2 = Division(A=production, B=gross_floor_area)
risparmio_pv_kwh_m2 = Panel(division_2)
eui_totale = Number(eui_kwh_m2)
subtraction = Subtraction(A=eui_totale, B=risparmio_pv_kwh_m2)
eui_pv = Panel(subtraction)

# ----
# risparmio percentuale
massarithop_7 = LBMassArithmeticOperation(data=flatten(merge_2))  # -> data; plug-in component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
produzione_pv_kwh = Panel(production)
xdata_2 = LBDeconstructData(data=massarithop_7)  # -> header, values; plug-in component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
mass_addition = MassAddition(Input=xdata_2.values)  # -> Result, PartialResults
multiplication = Multiplication(A=produzione_pv_kwh, B=Slider(100, range=0..100))
division_3 = Division(A=multiplication, B=mass_addition.Result)
risparmio_percentuale_consumi_totali_kwh = Panel(division_3)

xdata_3 = LBDeconstructData(data=pmv.pmv)  # -> header, values; plug-in component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
panel_11 = Panel(vizthermalmap.values)
panel_12 = Panel(xdata_3.values)
lng = ListLength(List=panel_7)
division_4 = Division(A=risparmio_percentuale_consumi_totali_kwh, B=lng)

# ----
# Visualize Energy Use + pv
roomenergyresult_2 = HBReadRoomEnergyResult(sql=file_path)  # -> cooling, heating, lighting, electric_equip, gas_equip, process, hot_water, fan_electric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; plug-in component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
massarithop_8 = LBMassArithmeticOperation(data=flatten(roomenergyresult_2.cooling), type="Cooling")  # -> data; plug-in component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
massarithop_9 = LBMassArithmeticOperation(data=flatten(roomenergyresult_2.heating), type="Heating")  # -> data; plug-in component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
massarithop_10 = LBMassArithmeticOperation(data=flatten(roomenergyresult_2.electric_equip), type="Elecric equip")  # -> data; plug-in component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
massarithop_11 = LBMassArithmeticOperation(data=flatten(roomenergyresult_2.lighting), type="Lighting")  # -> data; plug-in component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
massarithop_12 = LBMassArithmeticOperation(data=flatten(roomenergyresult_2.hot_water), type="Hot Water")  # -> data; plug-in component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
cluster_2 = Cluster(data=massarithop_10, risparmio_percentuale=division_4)
cluster_3 = Cluster(data=massarithop_11, risparmio_percentuale=division_4)
cluster_4 = Cluster(data=massarithop_12, risparmio_percentuale=division_4)
cluster_5 = Cluster(data=massarithop_9, risparmio_percentuale=division_4)
cluster_6 = Cluster(data=massarithop_8, risparmio_percentuale=division_4)
merge_6 = Merge(Data1=cluster_6, Data2=cluster_5, Data3=cluster_3, Data4=cluster_2)
merge_7 = Merge(
    Data1=ColourSwatch(SwatchColor=RGB(36, 55, 145)),
    Data2=ColourSwatch(SwatchColor=RGB(212, 32, 32)),
    Data3=ColourSwatch(SwatchColor=RGB(217, 212, 67)),
    Data4=ColourSwatch(SwatchColor=RGB(205, 232, 176)),
    Data5=ColourSwatch(SwatchColor=RGB(204, 117, 35)))
legendpar_2 = LBLegendParameters(max=Slider(1000000, range=80000..1000000), seg_count="5", colors=merge_7, num_decimals="0")  # -> leg_par; plug-in component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

risparmio_per_end_use = Panel(division_4)
massarithop_13 = LBMassArithmeticOperation(data=flatten(merge_6), operator="+")  # -> data; plug-in component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
xdata_4 = LBDeconstructData(data=massarithop_13)  # -> header, values; plug-in component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
ma_2 = MassAddition(Input=xdata_4.values)  # -> Result, PartialResults
division_5 = Division(A=ma_2.Result, B=Slider(1000000, range=0..1000000))
panel_13 = Panel(division_5)
concat_4 = Concatenate(
    FragmentA="ANNUAL ENERGY CONSUMPTION WITH PV",
    FragmentC="Total Energy consumption = ",
    FragmentD=panel_13,
    FragmentE=" (1 GWh = 1000000 kWh)",
    FragmentF="End Use Intensity = ",
    FragmentG=eui_pv,
    FragmentH=" kWh/m2")
monthlychart_2 = LBMonthlyChart(data=merge_6, stack=Toggle(True), global_title=concat_4, legend_par=legendpar)  # -> report, data_mesh, data_lines, col_lines, legend, borders, labels, y_title, title, vis_set; plug-in component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
floor = ValueList({"Solaio_legno_non_isolato": 0, "Solaio_legno_scarso_isolato": 1, "Solaio_legno_altamente_isolato": 2, "Solaio_laterocemento_non_isolato": 3, "Solaio_laterocemento_scarso_isolato": 4, "Solaio_laterocemento_altamente_isolato": 5, "Solaio_allegerito_eps_medio_isolato": 6, "Solaio_allegerito_eps_isolato": 7, "Solaio_allegerito_eps_altamente_isolato": 8, "Solaio_calcestruzzo_igloo_non_isolato": 9, "Solaio_calcestruzzo_igloo_scarso_isolato": 10, "Solaio_calcestruzzo_igloo_isolato": 11, "Copertura_calcestruzzo": 12, "Copertura_acciaio": 13, "Copertura_legno": 14, "Copertura_Verde_estensivo": 15}, selected="Copertura_calcestruzzo")
wall_2 = ValueList({"Muratura_laterizio_non_isolato": 0, "Muratura_laterizio_isolato": 1, "Muratura_lateerizio_altamente_isolato": 2, "Muratura_blocco_termico_isolato": 3, "Muratura_blocco_termico_altamente_isolato": 4, "Muratura_calcestruzzo_non_isolato": 5, "Muratura_calcestruzzo_medio_isolato_esterno": 6, "Muratura_calcestruzzo_medio_isolato_interno": 7, "Muratura_calcestruzzo_altamente_isolato": 8, "Muratura_pietra_non_isolato": 9, "Muratura_pietra_medio_isolato": 10, "Muratura_pietra_altamente_isolato": 11, "Muratura_mattoni_non_isolato": 12, "Muratura_mattoni_medio_isolato": 13, "Muratura_mattoni_altamente_isolato": 14, "PACCHETTO CALCESTRUZZO": 15, "PACCHETTO CALCESTRUZZO PARETE VENTILATA": 16, "PACCHETTO LEGNO A UMIDO": 17, "PACCHETTO ACCIAIO": 18, "PACCHETTO LEGNO A SECCO": 19}, selected="PACCHETTO CALCESTRUZZO")
wall_3 = ValueList({"Muratura_laterizio_non_isolato": 0, "Muratura_laterizio_isolato": 1, "Muratura_lateerizio_altamente_isolato": 2, "Muratura_blocco_termico_isolato": 3, "Muratura_blocco_termico_altamente_isolato": 4, "Muratura_calcestruzzo_non_isolato": 5, "Muratura_calcestruzzo_medio_isolato_esterno": 6, "Muratura_calcestruzzo_medio_isolato_interno": 7, "Muratura_calcestruzzo_altamente_isolato": 8, "Muratura_pietra_non_isolato": 9, "Muratura_pietra_medio_isolato": 10, "Muratura_pietra_altamente_isolato": 11, "Muratura_mattoni_non_isolato": 12, "Muratura_mattoni_medio_isolato": 13, "Muratura_mattoni_altamente_isolato": 14, "PACCHETTO CALCESTRUZZO": 15, "PACCHETTO CALCESTRUZZO PARETE VENTILATA": 16, "PACCHETTO LEGNO A UMIDO": 17, "PACCHETTO ACCIAIO": 18, "PACCHETTO LEGNO A SECCO": 19}, selected="PACCHETTO CALCESTRUZZO")
roof_2 = ValueList({"Solaio_legno_non_isolato": 0, "Solaio_legno_scarso_isolato": 1, "Solaio_legno_altamente_isolato": 2, "Solaio_laterocemento_non_isolato": 3, "Solaio_laterocemento_scarso_isolato": 4, "Solaio_laterocemento_altamente_isolato": 5, "Solaio_allegerito_eps_medio_isolato": 6, "Solaio_allegerito_eps_isolato": 7, "Solaio_allegerito_eps_altamente_isolato": 8, "Solaio_calcestruzzo_igloo_non_isolato": 9, "Solaio_calcestruzzo_igloo_scarso_isolato": 10, "Solaio_calcestruzzo_igloo_isolato": 11, "Copertura_calcestruzzo": 12, "Copertura_acciaio": 13, "Copertura_legno": 14, "Copertura_Verde_estensivo": 15}, selected="Copertura_Verde_estensivo")
floor_2 = ValueList({"Solaio_legno_non_isolato": 0, "Solaio_legno_scarso_isolato": 1, "Solaio_legno_altamente_isolato": 2, "Solaio_laterocemento_non_isolato": 3, "Solaio_laterocemento_scarso_isolato": 4, "Solaio_laterocemento_altamente_isolato": 5, "Solaio_allegerito_eps_medio_isolato": 6, "Solaio_allegerito_eps_isolato": 7, "Solaio_allegerito_eps_altamente_isolato": 8, "Solaio_calcestruzzo_igloo_non_isolato": 9, "Solaio_calcestruzzo_igloo_scarso_isolato": 10, "Solaio_calcestruzzo_igloo_isolato": 11, "Copertura_calcestruzzo": 12, "Copertura_acciaio": 13, "Copertura_legno": 14, "Copertura_Verde_estensivo": 15}, selected="Copertura_calcestruzzo")
wall_4 = ValueList({"Muratura_laterizio_non_isolato": 0, "Muratura_laterizio_isolato": 1, "Muratura_lateerizio_altamente_isolato": 2, "Muratura_blocco_termico_isolato": 3, "Muratura_blocco_termico_altamente_isolato": 4, "Muratura_calcestruzzo_non_isolato": 5, "Muratura_calcestruzzo_medio_isolato_esterno": 6, "Muratura_calcestruzzo_medio_isolato_interno": 7, "Muratura_calcestruzzo_altamente_isolato": 8, "Muratura_pietra_non_isolato": 9, "Muratura_pietra_medio_isolato": 10, "Muratura_pietra_altamente_isolato": 11, "Muratura_mattoni_non_isolato": 12, "Muratura_mattoni_medio_isolato": 13, "Muratura_mattoni_altamente_isolato": 14, "PACCHETTO CALCESTRUZZO": 15, "PACCHETTO CALCESTRUZZO PARETE VENTILATA": 16, "PACCHETTO LEGNO A UMIDO": 17, "PACCHETTO ACCIAIO": 18, "PACCHETTO LEGNO A SECCO": 19}, selected="PACCHETTO CALCESTRUZZO")
roof_3 = ValueList({"Solaio_legno_non_isolato": 0, "Solaio_legno_scarso_isolato": 1, "Solaio_legno_altamente_isolato": 2, "Solaio_laterocemento_non_isolato": 3, "Solaio_laterocemento_scarso_isolato": 4, "Solaio_laterocemento_altamente_isolato": 5, "Solaio_allegerito_eps_medio_isolato": 6, "Solaio_allegerito_eps_isolato": 7, "Solaio_allegerito_eps_altamente_isolato": 8, "Solaio_calcestruzzo_igloo_non_isolato": 9, "Solaio_calcestruzzo_igloo_scarso_isolato": 10, "Solaio_calcestruzzo_igloo_isolato": 11, "Copertura_calcestruzzo": 12, "Copertura_acciaio": 13, "Copertura_legno": 14, "Copertura_Verde_estensivo": 15}, selected="Copertura_Verde_estensivo")
floor_3 = ValueList({"Solaio_legno_non_isolato": 0, "Solaio_legno_scarso_isolato": 1, "Solaio_legno_altamente_isolato": 2, "Solaio_laterocemento_non_isolato": 3, "Solaio_laterocemento_scarso_isolato": 4, "Solaio_laterocemento_altamente_isolato": 5, "Solaio_allegerito_eps_medio_isolato": 6, "Solaio_allegerito_eps_isolato": 7, "Solaio_allegerito_eps_altamente_isolato": 8, "Solaio_calcestruzzo_igloo_non_isolato": 9, "Solaio_calcestruzzo_igloo_scarso_isolato": 10, "Solaio_calcestruzzo_igloo_isolato": 11, "Copertura_calcestruzzo": 12, "Copertura_acciaio": 13, "Copertura_legno": 14, "Copertura_Verde_estensivo": 15}, selected="Copertura_calcestruzzo")
wall_5 = ValueList({"Muratura_laterizio_non_isolato": 0, "Muratura_laterizio_isolato": 1, "Muratura_lateerizio_altamente_isolato": 2, "Muratura_blocco_termico_isolato": 3, "Muratura_blocco_termico_altamente_isolato": 4, "Muratura_calcestruzzo_non_isolato": 5, "Muratura_calcestruzzo_medio_isolato_esterno": 6, "Muratura_calcestruzzo_medio_isolato_interno": 7, "Muratura_calcestruzzo_altamente_isolato": 8, "Muratura_pietra_non_isolato": 9, "Muratura_pietra_medio_isolato": 10, "Muratura_pietra_altamente_isolato": 11, "Muratura_mattoni_non_isolato": 12, "Muratura_mattoni_medio_isolato": 13, "Muratura_mattoni_altamente_isolato": 14, "PACCHETTO CALCESTRUZZO": 15, "PACCHETTO CALCESTRUZZO PARETE VENTILATA": 16, "PACCHETTO LEGNO A UMIDO": 17, "PACCHETTO ACCIAIO": 18, "PACCHETTO LEGNO A SECCO": 19}, selected="PACCHETTO CALCESTRUZZO")
roof_4 = ValueList({"Solaio_legno_non_isolato": 0, "Solaio_legno_scarso_isolato": 1, "Solaio_legno_altamente_isolato": 2, "Solaio_laterocemento_non_isolato": 3, "Solaio_laterocemento_scarso_isolato": 4, "Solaio_laterocemento_altamente_isolato": 5, "Solaio_allegerito_eps_medio_isolato": 6, "Solaio_allegerito_eps_isolato": 7, "Solaio_allegerito_eps_altamente_isolato": 8, "Solaio_calcestruzzo_igloo_non_isolato": 9, "Solaio_calcestruzzo_igloo_scarso_isolato": 10, "Solaio_calcestruzzo_igloo_isolato": 11, "Copertura_calcestruzzo": 12, "Copertura_acciaio": 13, "Copertura_legno": 14, "Copertura_Verde_estensivo": 15}, selected="Copertura_Verde_estensivo")

# ----
# 3 ANALYSIS BUILDINGS MODELING
# Buildings editor (copy this group for each building that has different settings)
building_program = ValueList({"Residential": 0, "Non Residential": 1, "School": 2}, selected="Non Residential")
floortofloor_height_m = Slider(3, range=0..10)
building_typology_name = Panel("office1")
layer_name = Panel("Offices")

dispatch = Dispatch(List=building_typology_name, DispatchPattern=Button())  # -> ListA, ListB

building_creator = BuildingCreator(
    layer_name=layer_name,
    buildingtypology_name=dispatch.ListB,
    D=floortofloor_height_m,
    hb_climatezone=climatezones,
    hb_building_vintages=bldgvintages,
    hb_constructiontype=constructiontypes,
    envelope_selector=wall,
    roof_selector=roof,
    groundfloor_selector=gfloor,
    glazing_u_factor=glazing_u,
    program=building_program,
    wwr=wwr)  # -> envelope_name, envelope_u_fac, roof_name, roof_u_fac, groundfloor_name, groundfloorf_u_fac, building_2

panel_14 = Panel(building_creator.envelope_u_fac)

# ==== cluster Cluster
risparmio_percentuale = ClusterInput()
data = ClusterInput()
risparmio_percentuale_2 = Number(risparmio_percentuale)
xdata = LBDeconstructData(data=data)  # -> header, values; plug-in component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
percentage = Percentage(Number=xdata.values, Percent=risparmio_percentuale_2)
subtraction = Subtraction(A=xdata.values, B=percentage)
data_2 = LBConstructData(header=xdata.header, values=subtraction, interval="monthly")  # -> simplify(data); plug-in component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
data_3 = ClusterOutput(data_2)

# ==== cluster BuildingCreator
buildingtypology_name = ClusterInput()
D = ClusterInput()
hb_climatezone = ClusterInput()
hb_building_vintages = ClusterInput()
hb_constructiontype = ClusterInput()
envelope_selector = ClusterInput()
roof_selector = ClusterInput()
groundfloor_selector = ClusterInput()
glazing_u_factor = ClusterInput()
program = ClusterInput()
layer_name = ClusterInput()

building_definition = BuildingDefinition(
    layer_name=layer_name,
    buildingtypology_name=buildingtypology_name,
    floortofloor_height=D,
    hb_climatezone=hb_climatezone,
    hb_building_vintages=hb_building_vintages,
    hb_constructiontype=hb_constructiontype,
    envelope_selector=envelope_selector,
    roof_selector=roof_selector,
    groundfloor_selector=groundfloor_selector,
    glazing_u_factor=glazing_u_factor,
    program_boolean=program)  # -> number_of_stories_2, building_footprint_2, envelope_name_2, envelope_u_fac_2, constr_set_2, roof_name_2, roof_u_fac_2, groundfloor_name_2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
program_2 = Data(building_definition.program_2)
stories_num = Number(building_definition.number_of_stories_2)
footprint = Surface(building_definition.building_footprint_2)

groundfloorf_u_fac = ClusterOutput(building_definition.groundfloorf_u_fac_2)
groundfloor_name = ClusterOutput(building_definition.groundfloor_name_2)
roof_u_fac = ClusterOutput(building_definition.roof_u_fac_2)
roof_name = ClusterOutput(building_definition.roof_name_2)
envelope_u_fac = ClusterOutput(building_definition.envelope_u_fac_2)
envelope_name = ClusterOutput(building_definition.envelope_name_2)
constr_sert = Data(building_definition.constr_set_2)
flatten = FlattenTree(Tree=program_2, Path="{0}")
item = ListItem(List=flatten, Index=0, Wrap=True)
wwr = ClusterInput()
srf = Surface(footprint)
repeat = RepeatData(Data=D, Length=stories_num)
wwr_2 = Number(wwr)

# ----
# Create Buildings
buildingfootprint = DFBuildingFromFootprint(
    footprint_geo=srf,
    floor_to_floor=repeat,
    program=item,
    constr_set=constr_sert,
    conditioned=Toggle(True),
    run=Toggle(True))  # -> report, buildings; plug-in component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

# ----
# Assign Windows
window_ratio = Panel(wwr_2)
simpleratiopar = DFSimpleWindowRatioParameters(ratio=window_ratio)  # -> win_par; plug-in component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

topbottom = DFSeparateTopBottom(buildings=flatten(buildingfootprint.buildings))  # -> buildings; plug-in component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
applyfacadepar = DFApplyFacadeParameters(df_obj=topbottom, win_par=simpleratiopar)  # -> report, df_obj; plug-in component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

all_air = HBAllAirHVACTemplates({"VAV chiller with gas boiler reheat": "VAV_Chiller_Boiler", "VAV chiller with central air source heat pump reheat": "VAV_Chiller_ASHP", "VAV chiller with district hot water reheat": "VAV_Chiller_DHW", "VAV chiller with PFP boxes": "VAV_Chiller_PFP", "VAV chiller with gas coil reheat": "VAV_Chiller_GasCoil", "VAV air-cooled chiller with gas boiler reheat": "VAV_ACChiller_Boiler", "VAV air-cooled chiller with central air source heat pump reheat": "VAV_ACChiller_ASHP", "VAV air-cooled chiller with district hot water reheat": "VAV_ACChiller_DHW", "VAV air-cooled chiller with PFP boxes": "VAV_ACChiller_PFP", "VAV air-cooled chiller with gas coil reheat": "VAV_ACChiller_GasCoil"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}, selected="PSZ-AC with baseboard gas boiler": "PSZAC_BoilerBaseboard")
all_air_2 = HBAllAirHVACTemplates({"VAV chiller with gas boiler reheat": "VAV_Chiller_Boiler", "VAV chiller with central air source heat pump reheat": "VAV_Chiller_ASHP", "VAV chiller with district hot water reheat": "VAV_Chiller_DHW", "VAV chiller with PFP boxes": "VAV_Chiller_PFP", "VAV chiller with gas coil reheat": "VAV_Chiller_GasCoil", "VAV air-cooled chiller with gas boiler reheat": "VAV_ACChiller_Boiler", "VAV air-cooled chiller with central air source heat pump reheat": "VAV_ACChiller_ASHP", "VAV air-cooled chiller with district hot water reheat": "VAV_ACChiller_DHW", "VAV air-cooled chiller with PFP boxes": "VAV_ACChiller_PFP", "VAV air-cooled chiller with gas coil reheat": "VAV_ACChiller_GasCoil"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}, selected="VAV chiller with gas boiler reheat")
num = Number(building_definition.program_boolean_3)
hb_shw_templates = HBSHWTemplates({"Gas Water Heater": "Gas_WaterHeater", "Electric Water Heater": "Electric_WaterHeater", "Heat Pump Water Heater": "HeatPump_WaterHeater", "Gas Tankless Heater": "Gas_TanklessHeater", "Electric Tankless Heater": "Electric_TanklessHeater"}, selected="Electric Water Heater")
_0_residential_1_non_residential_generic = Panel(num)  # "0: Residential 1: Non Residential(generic) 2:school"
number_slider = Slider(0, range=0..2)
data = Data(applyfacadepar.df_obj)
filter = StreamFilter(Gate=_0_residential_1_non_residential_generic, Stream0=hb_shw_templates, Stream1=all_air, Stream2=all_air_2)
gate = StreamGate(Stream=filter, Gate=_0_residential_1_non_residential_generic)  # -> Target0, Target1, Target2
dfallairhvac = DFAllAirHVAC(df_objs=flatten(data), system_type=gate.Target2)  # -> report, df_objs; plug-in component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
dfidealair = DFIdealAir(df_objs=flatten(data), dcv=Toggle(True), heat_temp="65", cool_temp="16")  # -> out, df_objs; plug-in component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
dfallairhvac_2 = DFAllAirHVAC(df_objs=flatten(data), system_type=gate.Target1)  # -> report, df_objs; plug-in component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
shw = DFSHWSystem(df_objs=flatten(dfidealair.df_objs), system_type=gate.Target0)  # -> report, df_objs; plug-in component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
merge = Merge(Data1=shw.df_objs, Data2=dfallairhvac_2.df_objs, Data3=dfallairhvac.df_objs)  # -> flatten(Result)
clean_tree = CleanTree(RemoveNulls=True, RemoveInvalid=True, RemoveEmpty=True, Tree=merge)
building = Data(clean_tree)
building_2 = ClusterOutput(building)

# ==== cluster Cluster_5
buildings = ClusterInput()
context = ClusterInput()
epw_file = ClusterInput()
pv_panel = Data_Collector(buildings=buildings, context=context, epw_file=epw_file)  # -> roofs, context, required_data, location_epw, direct_rad, diffuse_rad; inputs buildings: list of Brep, context: list of Brep
# ---------- pv_panel: Python ----------
import ghpythonlib.components as gh
import ghpythonlib.component as ghc
import ladybug.epw as epw 
from ladybug_rhino.grasshopper import all_required_inputs
import ladybug_rhino.grasshopper as lady
from ladybug.datacollection import BaseCollection
                
# decription of the inputs 
ghenv.Component.Params.Input[0].Description = 'Rhino Breps representing for which PV panel output will be calculated'
ghenv.Component.Params.Input[1].Description = 'Rhino Breps representing the context that can block solar radiation to the building(s)'
ghenv.Component.Params.Input[2].Description = 'An epw file path on your system as a string'
        
ghenv.Component.Params.Output[0].Description = 'Picked roof(s) for which PV panel output will be calculated'
ghenv.Component.Params.Output[1].Description = 'Context that can block solar radiation to the building(s)'
ghenv.Component.Params.Output[2].Description = 'A package of data including essential information that should be connected to a calculator component'
ghenv.Component.Params.Output[3].Description = 'Location data for LB Cumulative Sky Matrix'
ghenv.Component.Params.Output[4].Description = 'Direct_rad for LB Cumulative Sky Matrix'
ghenv.Component.Params.Output[5].Description = 'Diffuse_rad data for LB Cumulative Sky Matrix'
         
                
#componenet introducation 
                
ghenv.Component.Name = 'Data_Collector'
ghenv.Component.NickName = 'PV_Panel'
ghenv.Component.Message = '11.4.2024'
ghenv.Component.Category = 'PV_panel_horizontal'
ghenv.Component.Description = 'This component offers information based on input and systematizes all inputs to prevent confusion.'
                
#required information
location_info = []
location_epw = []
_direct_rad = []
_diffuse_rad = []
global_horizontal_rad = []
modelyear_list_bound = []
roofs = []
context = []
roofs_area = []
required_data = [((location_info), (global_horizontal_rad), (modelyear_list_bound), roofs_area)]
                
#ladybug libarary is called here 
def all_required_inputs(EPW):
    if (_epw_file):
        epw_data = epw.EPW(_epw_file)
        #the information related to the location for information provider
        location = epw_data.location
        location_epw.append(location)
        #extracting data
        name = location.city
        latitude = location.latitude
        longitude = location.longitude
        #location info is an output
        location_info.append((name ,latitude, longitude))
        #the model year should be extracted from the information provided from EPW
        modelyear_list_bound.append(str(gh.Bounds((epw_data.years.values))))
        #the sum of GHI value 
        global_horizontal_rad.append((round(gh.MassAddition(epw_data.global_horizontal_radiation.values)[0]/1000)))
        # the data needed for simulation
        _direct_rad.append(epw_data.direct_normal_radiation)
        _diffuse_rad.append(epw_data.diffuse_horizontal_radiation)
    else:
        ghc.add_warning('EPW File is not inserted !')
                
#take the roof as object on whom the simulation will be done and take the building also by two following condition , if the geometery 
#as context building is inserted with user , the inputted geometries are context, whereas the building for simulation must be considered 
#shade producer source  
                
def roof_picker(BUI): 
        for brep in BUI:
            dec = gh.DeconstructBrep(brep)
            for i in range(len(dec[0])):
                cent = gh.Area(dec[0][i])[1]
                norm = gh.EvaluateSurface((dec[0][i]) ,cent)[1]
                if norm[2]==1:
                    if cent[2] > 0 :
                        roofs.append(dec[0][i])
                        roofs_area.append(gh.Area(dec[0][i])[0])
                if norm[2]==-1 and cent[2] > 0:
                    roofs.append(dec[0][i])
                    roofs_area.append(gh.Area(dec[0][i])[0])
                
# the main inputs 
                
def main():
    buil = _buildings
    if (gh.NullItem(buil)[0]) == True:
        buil = gh.CleanTree(1,1,1,buil)
        buil = ghc.add_warning('The input _building is failed to collect data !') 
    else :
        buil_len = gh.ListLength(_buildings)
        buil = _buildings
        ctx = _context_
        if (gh.NullItem(ctx)[0]) == True:
            [context.append(buil[i])  for i in range(buil_len)]
        else :
            [context.append(_context_[i])  for i in range(len(_context_))]
            [context.append(buil[i])  for i in range(len(buil))]
        roof_picker(buil)
        all_required_inputs(_epw_file != None)
                
#calling the functions 
                
main()
# ---------- end pv_panel ----------
skymatrix = LBCumulativeSkyMatrix(location=pv_panel.location_epw, direct_rad=pv_panel.direct_rad, diffuse_rad=pv_panel.diffuse_rad)  # -> report, sky_mtx; plug-in component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
cpu_count = ClusterInput()
run = ClusterInput()

the_accurancy_level = Panel("2")
incidentradiation = LBIncidentRadiation(
    sky_mtx=skymatrix.sky_mtx,
    geometry=flatten(pv_panel.roofs),
    context=flatten(pv_panel.context),
    grid_size=the_accurancy_level,
    offset_dist="1",
    irradiance=0,
    cpu_count=cpu_count,
    run=run)  # -> report, points, results, total, mesh, legend, title, int_mtx; plug-in component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

roof_availibility = ClusterInput()
module_type = ClusterInput()
information_type = ClusterInput()
pv_panel_calculation_output = Calculator(
    roofs=pv_panel.roofs,
    results=incidentradiation.results,
    points=incidentradiation.points,
    mesh=incidentradiation.mesh,
    required_data=pv_panel.required_data,
    Roof_availibility=roof_availibility,
    Module_type=module_type,
    Information_Type=information_type)  # -> information; inputs roofs: list of Brep, results: list, points: list of Point3d, mesh: Mesh, Roof_availibility: Int32
# ---------- pv_panel_calculation_output: Python ----------
import ghpythonlib.components as gh
import ghpythonlib.component as ghc

#basic descripation of the component
ghenv.Component.Name = 'calculator'
ghenv.Component.NickName = 'pv_panel_calculation_output'
ghenv.Component.Message = '11.4.2024'
ghenv.Component.Category = 'PV_panel'
                
                
# decription of the inputs and outputs  
ghenv.Component.Params.Input[0].Description = 'Picked roof(s) as Rhino brep'
ghenv.Component.Params.Input[1].Description = 'A list of numbers as result of simulation that aligns with the points.'
ghenv.Component.Params.Input[2].Description = 'The grid of points that is be used to perform the incident radiation analysis.'
ghenv.Component.Params.Input[3].Description = 'A colored mesh which demonstrates the cumulative incident radiation received by the input _geometry.\n'\
                                              'This would not affact the result of the simulation and calculation output.'
ghenv.Component.Params.Input[4].Description = 'A package of data including essential information deriven from data_collector component.'
#ghenv.Component.Params.Input[2].Description =



ghenv.Component.Params.Input[5].Description = 'The roof avalibility refers to the available area that pv panels can be installed ,'\
'the defualt value is set to 70 percentage '
ghenv.Component.Params.Input[6].Description = "Follow this list to indicate your PV panel system :"\
"where the final result will be affected by:\n"\
"0-Mono-Si = 0.2\n1-Poly-Si= 0.18\n"\
"2-CIS/CIGS= 0.14\n3-CdS/CdTe= 0.11"
ghenv.Component.Params.Input[7].Description = "The index refers to following options:\n0-General information"\
"\n1-Total energy producation in kwh/y\n"\
"2-For each building in kwh/y\n3-Per m2 in kwh/m2"
ghenv.Component.Params.Output[0].Description ='The result of the simulation based on requested data '
                
                
#Needed information trigger information 
information = []
sum_va = []

#This functions as provider data on shadow losses for each buildings 
def shadow(RES , PTS , ROF):
    for i in ROF:
        pat = []
        sum = []
        geo = gh.Extrude(i , gh.UnitZ(5))
        for x , pt  in enumerate (PTS) : 
            pat.append(gh.PointInBrep( geo , pt , True))
        for y in range(len(pat)-1):
            if pat[y] == 1:
                print RES[y]
                sum.append(RES[y])
        sum_va.append(round(gh.Average(sum)))
        
        
def requested_data_provider(Required_data, Res, Roof_ab, Type, Info):
    # General information
    solar_cells = {0: ["Mono-Si" ,0.20], 1: ["Poly-Si",0.18], 2:["CIS / CIGS",0.14] ,3: ["CdS / CdTe",0.11]}
    if Res:
        result = gh.Average(Res)
        total_area = round(gh.MassAddition(Required_data[3])[0])
        losses = (abs(Required_data[1][0] - result)/((Required_data[1][0] + result)/2)*100)/100 + 0.12
        if Info == 0:
            information.append(
                'Environemntal and Geographical data:\n'
                'location: {}\n'.format(Required_data[0][0][0]) +
                'latitude: {}\n'.format(Required_data[0][0][1]) +
                'longitude: {}\n'.format(Required_data[0][0][2]) +
                'The EPW file model year : {}-{} \n'.format((Required_data[2][0][:4]),(Required_data[2][0][5:9])) +
                'Global Horizontal Irradiance : {} KWh/m²\n'.format(Required_data[1][0]) +
                '\nPV panel(s) system data:\n'+
                'Total area of the panel {} m²\n'.format(round(total_area*Roof_ab)) +
                '{}% of the roof(s) is considered as available area\n'.format(int(Roof_ab*100)) +
                'Module type : {} with {} efficiency\n'.format(solar_cells[Type][0], solar_cells[Type][1]) +
                'Total losses value , considering an average value for the area : {:.3f}\n'.format(losses) +
                '\nThe total Estimated energy production is {:.3f} GWh/year.'.format(((total_area*Roof_ab) * (abs(losses-1)) * float(Required_data[1][0]) * float(
                    solar_cells[Type][1]))/1000000))
        #Total energy producation as a value  
        elif Info == 1:
            information.append(int((total_area*Roof_ab) * (abs(losses-1)) * float(Required_data[1][0]) * float(solar_cells[Type][1])))
        # Prod for each building
        elif Info == 2:
            for x, i in enumerate(Required_data[3]):
                loss = ((abs(Required_data[1][0] - sum_va[x])/((Required_data[1][0] + sum_va[x])/2)*100)/100) + 0.12
                information.append(int((i*Roof_ab) * float(Required_data[1][0]*(abs(1-loss))) * float(solar_cells[Type][1])))
        # Prod per m2
        else:
            information.append(int((total_area*Roof_ab) * (abs(losses-1)) * float(Required_data[1][0]) * float(solar_cells[Type][1])) / (total_area*Roof_ab)) 
                
#required_data is included location[0] , rad [1] , year[2] , area[3]
                
def main():
    #insert values 
     results = ghc.add_error('_result input  is failed to collect data !') if gh.ListLength(_results)== 0 else  _results
     points = ghc.add_error('_points input  is failed to collect data !') if gh.ListLength(_points)== 0 else  _points
     roofs = ghc.add_error('_roofs input  is failed to collect data !') if gh.ListLength(_roofs)== 0 else  _roofs
     mesh = ghc.add_warning('mesh_ input  is falied to collect data') if gh.ListLength(mesh_)== 0 else  mesh_
     required_data = ghc.add_error('required_data input is failed to collect data') if gh.ListLength(_required_data)== 0 else  _required_data
    #value in deafult 
     roof_ab = 0.7 if  Roof_availibility_ is None else (Roof_availibility_/100)
     Module_type = 0 if Module_type_ is None else Module_type_
     Info = 0 if Information_Type_ is None else Information_Type_
     #calling functions 
     shadow(results , points ,  roofs) 
     requested_data_provider(required_data, results, roof_ab, Module_type, Info)
     
     
main()
# ---------- end pv_panel_calculation_output ----------
information = ClusterOutput(pv_panel_calculation_output)

# ==== cluster BuildingDefinition

# ---- group: MIXED USE
hb_building_programs = HBBuildingPrograms({"LargeOffice", "MediumOffice", "SmallOffice", "MidriseApartment", "HighriseApartment", "Retail", "StripMall", "PrimarySchool", "SecondarySchool", "SmallHotel", "LargeHotel", "Hospital", "Outpatient", "Laboratory", "Warehouse", "SuperMarket", "FullServiceRestaurant", "QuickServiceRestaurant", "Courthouse", "LargeDataCenterHighITE", "LargeDataCenterLowITE", "SmallDataCenterHighITE", "SmallDataCenterLowITE"}, selected="SmallOffice")
hb_building_programs_2 = HBBuildingPrograms({"LargeOffice", "MediumOffice", "SmallOffice", "MidriseApartment", "HighriseApartment", "Retail", "StripMall", "PrimarySchool", "SecondarySchool", "SmallHotel", "LargeHotel", "Hospital", "Outpatient", "Laboratory", "Warehouse", "SuperMarket", "FullServiceRestaurant", "QuickServiceRestaurant", "Courthouse", "LargeDataCenterHighITE", "LargeDataCenterLowITE", "SmallDataCenterHighITE", "SmallDataCenterLowITE"}, selected="Retail")
hb_building_programs_3 = HBBuildingPrograms({"LargeOffice", "MediumOffice", "SmallOffice", "MidriseApartment", "HighriseApartment", "Retail", "StripMall", "PrimarySchool", "SecondarySchool", "SmallHotel", "LargeHotel", "Hospital", "Outpatient", "Laboratory", "Warehouse", "SuperMarket", "FullServiceRestaurant", "QuickServiceRestaurant", "Courthouse", "LargeDataCenterHighITE", "LargeDataCenterLowITE", "SmallDataCenterHighITE", "SmallDataCenterLowITE"}, selected="HighriseApartment")
panel = Panel("""0.70
0.15
0.15""")
blendprograms = HBBlendProgramTypes(name="Mixed use", programs=[hb_building_programs_3, hb_building_programs, hb_building_programs_2], ratios=panel)  # -> program; plug-in component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
merge = Merge(Data1=blendprograms)

# ----
layer_name = ClusterInput()
buildingtypology_name = ClusterInput()
floortofloor_height = ClusterInput()
layer_name_2 = Text(layer_name)
glazing_u_factor = ClusterInput()
buildingtypology_name_2 = Text(buildingtypology_name)
program_boolean = ClusterInput()
concat = Concatenate(FragmentA="Analysis Buildings", FragmentB=layer_name_2, JoinSeparator="::")
glazing_u_factor_2 = Number(glazing_u_factor)

# ----
# 8 INFISSI
panel_2 = Panel("infisso")
glazing_ufactor = Panel("0.3")
windowmat = HBWindowMaterial(name=panel_2, u_factor=glazing_u_factor_2, shgc="0.4", t_vis="0.4")  # -> mat; plug-in component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
windowconstr = HBWindowConstruction(materials=windowmat)  # -> constr; plug-in component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
subfacesubset = HBSubfaceSubset(window=windowconstr)  # -> subface_set; plug-in component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

custom_program_school = CustomProgram_school()
custom_program_non_residential = CustomProgramNonResidential()
custom_program_residential = CustomProgramResidential()
hb_climatezone = ClusterInput()
hb_building_vintages = ClusterInput()
hb_constructiontype = ClusterInput()
reflay = ReferenceByLayer(LayerName=concat, lightweight=False)
filtername = FilterByName(Name=buildingtypology_name_2, Geometry=reflay, invertFilter=False, returnNulls=False)  # -> ExcludedGeometry, IncludedGeometry
program_boolean_2 = Number(program_boolean)
hb_constructiontype_2 = Text(hb_constructiontype)
hb_building_vintages_2 = Text(hb_building_vintages)
hb_climatezone_2 = Text(hb_climatezone)
filter = StreamFilter(
    Gate=program_boolean_2,
    Stream0=custom_program_residential,
    Stream1=custom_program_non_residential,
    Stream2=custom_program_school)

# ----
# 1 INPUT
brep = Brep(filtername.IncludedGeometry)
item = ListItem(List=brep, Index=0, Wrap=True)
debrep = DeconstructBrep(Brep=brep)  # -> Faces, Edges, Vertices
floortofloor_height_2 = Number(floortofloor_height)
area = Area(Geometry=debrep.Faces)  # -> Area, Centroid
pdecon = Deconstruct(Point=area.Centroid)  # -> XComponent, YComponent, ZComponent
sort = SortList(Keys=pdecon.ZComponent, ValuesA=debrep.Faces, ValuesB=area.Centroid)  # -> Keys, ValuesA, ValuesB
item_2 = ListItem(List=sort.Keys, Index=0, Wrap=True)
item_3 = ListItem(List=sort.ValuesB, Index=0, Wrap=True)  # -> Item1, Item
dist = Distance(PointA=item_3.Item1, PointB=item_3.Item)
panel_3 = Panel(item_2)
division = Division(A=dist, B=floortofloor_height_2)  # -> simplify(Result)
item_4 = ListItem(List=sort.ValuesA, Index=0, Wrap=True)  # -> Item1, Item

# ----
# 6 SELEZIONE
constrsetclimate = HBConstructionSetByClimate(climate_zone=hb_climatezone_2, vintage=hb_building_vintages_2, constr_type=hb_constructiontype_2)  # -> constr_set; plug-in component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

program_boolean_3 = ClusterOutput(program_boolean_2)
program = Data(filter)
program_2 = ClusterOutput(program)

# ---- group: impronta dell'edificio
building_footprint = Surface(simplify(item_4.Item))

# ---- group: num piani
number_of_stories = Integer(division)

# ----
number_of_stories_2 = ClusterOutput(number_of_stories)
building_footprint_2 = ClusterOutput(building_footprint)

# ----
# 7 SELEZIONE STRATIGRAFIE
envelope_selector = ClusterInput()
roof_selector = ClusterInput()
groundfloor_selector = ClusterInput()

groundfloor_selector_2 = Number(groundfloor_selector)
envelope_selector_2 = Number(envelope_selector)
roof_selector_2 = Number(roof_selector)
cluster = Cluster_2(selector=envelope_selector_2)  # -> wall_stratigrafia_2, u_fac_si_2, selected_const_2, wall_albedo_2, wall_thermal_emissivity_2
cluster_2 = Cluster_3(selector=roof_selector_2)  # -> roof_stratigrafia_2, u_fac_si_2, selected_constr_2
cluster_3 = Cluster_4(selector=groundfloor_selector_2)  # -> gfloor_stratigrafia_2, u_fac_si_2, selected_constr_2
groundfloorf_u_fac = Text(cluster_3.u_fac_si_2)
groundfloor_name = Text(cluster_3.gfloor_stratigrafia_2)
roof_name = Text(cluster_2.roof_stratigrafia_2)
roof_u_fac = Text(cluster_2.u_fac_si_2)
envelope_name = Text(cluster.wall_stratigrafia_2)
envelope_u_fac = Text(cluster.u_fac_si_2)
roof_name_2 = ClusterOutput(roof_name)
roof_u_fac_2 = ClusterOutput(roof_u_fac)
groundfloor_name_2 = ClusterOutput(groundfloor_name)
groundfloorf_u_fac_2 = ClusterOutput(groundfloorf_u_fac)
envelope_name_2 = ClusterOutput(envelope_name)
envelope_u_fac_2 = ClusterOutput(envelope_u_fac)

groundsubset = HBGroundConstructionSubset(ground_floor=cluster_3.selected_constr_2)  # -> ground_set; plug-in component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
exteriorsubset = HBExteriorConstructionSubset(exterior_wall=cluster.selected_const_2, exterior_roof=cluster_2.selected_constr_2)  # -> exterior_set; plug-in component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

constructionset = HBConstructionSet(
    base_constr_set=constrsetclimate,
    exterior_subset=exteriorsubset,
    ground_subset=groundsubset,
    subface_subset=subfacesubset)  # -> constr_set; plug-in component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
constr_set = Data(constructionset)
constr_set_2 = ClusterOutput(constr_set)

# ==== cluster CustomProgramNonResidential
period_of_low_occupation = Panel("""Dec 24 to Jan 5
Aug 1 to Aug 31""")
national_holidays = Panel("""Jan 1
Jan 6
Apr 25
May 1
Jun 2
Aug 15
Nov 1
Dec 8
Dec 25
Dec 26""")

change_value = Slider(0, range=0..100)
gene_pool = GenePool(
    Decimals=2,
    Maximum=1,
    Minimum=0,
    Value=[0, 0, 0, 0, 0, 0, 0, 0, 0.6, 0.8, 0.8, 0.8, 0.8, 0.2, 0.65, 0.65, 0.65, 0.6, 0.2, 0, 0, 0, 0, 0])
occupancyschedule = OccupancySchedule(mon_fri=gene_pool, change_value=change_value, national_holiday=national_holidays, change_period=period_of_low_occupation)
m2_per_persona_ufficio = Slider(5, range=5..12)
division = Division(A="1", B=m2_per_persona_ufficio)
panel = Panel(division)

change_value_2 = Slider(0, range=0..100)
gene_pool_2 = GenePool(
    Decimals=2,
    Maximum=1,
    Minimum=0.3,
    Value=[0.3, 0.3, 0.3, 0.3, 0.3, 0.3, 0.3, 0.3, 0.7, 0.85, 0.85, 0.85, 0.85, 0.65, 0.75, 0.75, 0.75, 0.75, 0.45, 0.3, 0.3, 0.3, 0.3, 0.3])
ecquipmentschedule = EcquipmentSchedule(
    mon_fri=gene_pool_2,
    change_value=change_value_2,
    national_holiday=national_holidays,
    change_period=period_of_low_occupation)
equipment = HBEquipment(name="ecquipaggiamneto elettrico", watts_per_area=Slider(7, range=0..10), schedule=ecquipmentschedule)  # -> equip; plug-in component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

gene_pool_3 = GenePool(
    Decimals=2,
    Maximum=1,
    Minimum=0,
    Value=[0, 0, 0, 0, 0, 0, 0, 0, 0.35, 0.25, 0.25, 0.25, 0.25, 0.5, 0.5, 0.25, 0.25, 0.35, 0.15, 0, 0, 0, 0, 0])
hotwaterschedule = HotWaterSchedule(mon_fri=gene_pool_3, national_holiday=national_holidays)
servicehotwater = HBServiceHotWater(name="acqua calda", flow_per_area="0.05", schedule=hotwaterschedule)  # -> hot_water; plug-in component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

period_of_low_occupation_2 = Panel("Aug 1 to Aug 31")

change_value__summer = Slider(0, range=0..100)
gene_pool_4 = GenePool(
    Decimals=2,
    Maximum=1,
    Minimum=0.05,
    Value=[0.05, 0.05, 0.05, 0.05, 0.05, 0.05, 0.05, 0.05, 0.65, 0.85, 0.85, 0.85, 0.85, 0.7625, 0.85, 0.85, 0.85, 0.85, 0.525, 0.05, 0.05, 0.05, 0.05, 0.05])
lightingschedule = LightingSchedule(
    mon_fri=gene_pool_4,
    change_value__summer=change_value__summer,
    national_holiday=national_holidays,
    change_period=period_of_low_occupation_2)
lighting = HBLighting(name="luce", watts_per_area=Slider(5, range=0..10), schedule=lightingschedule)  # -> lighting; plug-in component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

period_of_low_occupation_3 = Panel("Dec 24 to Jan 5")
period_of_low_occupation_4 = Panel("Aug 1 to Aug 31")

gene_pool_5 = GenePool(
    Decimals=0,
    Maximum=22,
    Minimum=17,
    Value=[17, 17, 17, 17, 17, 17, 17, 17, 19, 21, 21, 21, 21, 21, 17, 21, 21, 21, 21, 20, 19, 17, 17, 17])
gene_pool_6 = GenePool(
    Decimals=0,
    Maximum=28,
    Minimum=24,
    Value=[28, 28, 28, 28, 28, 28, 28, 28, 28, 27.33333333, 26, 26, 26, 26, 26, 26, 26, 26, 26, 27.33333333, 28, 28, 28, 28])
coolingschedule = CoolingSchedule(data=gene_pool_6, data_3=national_holidays, data_2=period_of_low_occupation_4)
heatingschedule = HeatingSchedule(data=gene_pool_5, data_2=national_holidays, data_3=period_of_low_occupation_3)
setpoint = HBSetpoint(name="setpoint", heating_sch=heatingschedule, cooling_sch=coolingschedule)  # -> setpoint; plug-in component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

people = HBPeople(name="occupazione persone", ppl_per_area=division, occupancy_sch=occupancyschedule)  # -> people; plug-in component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
hb_building_programs = HBBuildingPrograms({"LargeOffice", "MediumOffice", "SmallOffice", "MidriseApartment", "HighriseApartment", "Retail", "StripMall", "PrimarySchool", "SecondarySchool", "SmallHotel", "LargeHotel", "Hospital", "Outpatient", "Laboratory", "Warehouse", "SuperMarket", "FullServiceRestaurant", "QuickServiceRestaurant", "Courthouse", "LargeDataCenterHighITE", "LargeDataCenterLowITE", "SmallDataCenterHighITE", "SmallDataCenterLowITE"}, selected="MediumOffice")
programtype = HBProgramType(
    name="program_NonResidential",
    base_program=hb_building_programs,
    people=people,
    lighting=lighting,
    electric_equip=equipment,
    hot_water=servicehotwater,
    setpoint=setpoint)  # -> program; plug-in component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
program = ClusterOutput(programtype)

# ==== cluster CustomProgramResidential

# ----
# riferimenti: peole_0,1_D.M. Sanità 5 luglio 1975 Art. 2 "Per ogni abitante deve essere assicurata una superficie abitabile non inferiore a mq 14, per i primi 4 abitanti, ed a mq 10, per ciascuno dei successivi"
# https://www.sorgenia.it/guida-energia/lumen-cosa-sono_ 4 W/m2
# 
# acqua calda_0,125_"si stima che in media il consumo di acqua calda giornaliero a persona oscilla tra i 20 e i 40 litri"_https://www.acea.it/guide/risparmiare-consumi-acqua-calda
consumo_medio_acqua_calda_l_g_per_person = Slider(30, range=0..100)  # "consumo medio acqua calda l/g per persona"
ore = Slider(24, range=0..100)
division = Division(A=Slider(1, range=0..1), B=Slider(10, range=0..10))
division_2 = Division(A=consumo_medio_acqua_calda_l_g_per_person, B=ore)
# RIFERIENTI
occupazione_p_m2 = Panel(division)
multiplication = Multiplication(A=division_2, B=division)
acqua_calda_l_m_m2 = Panel(multiplication)

# ----
# Una casa in condizioni “medie”, oggi, consuma circa 150-200 kWh/mq
# 
# https://www.immobilgreen.it/news/efficienza-energetica/quanto-consuma-la-tua-casa/
# ripartizione dei consumi
# 
# https://luce-gas.it/guida/consumo/elettrodomestici
number_slider = Slider(1000, range=0..1000)
kwh_m2_annui = Slider(150, range=0..1000)
multiplication_2 = Multiplication(A=kwh_m2_annui, B=number_slider)
wh_m2_annui = Panel(multiplication_2)
# SETPOINT: https://www.daikin.ch/it_ch/products/product.html/EKRTR.html_ inverno giorno 21 C notte 17 C, estate giorno 24 C e notte 28 C
number_slider_2 = Slider(6, range=0..10)
division_3 = Division(A=multiplication_2, B=Slider(360, range=0..1000))
division_4 = Division(A=division_3, B=Slider(24, range=0..100))
division_5 = Division(A=division_4, B=Slider(100, range=0..100))
w_m2_tot = Panel(division_4)
multiplication_3 = Multiplication(A=division_5, B=number_slider_2)
subtraction = Subtraction(A=division_4, B=multiplication_3)
luce = Panel(multiplication_3)
ecuipaggiamento_elettrico = Panel(subtraction)

gene_pool = GenePool(
    Decimals=0,
    Maximum=22,
    Minimum=17,
    Value=[17, 17, 17, 17, 17, 17, 17, 17, 20, 21, 21, 21, 21, 21, 21, 21, 21, 21, 21, 20, 20, 17, 17, 17])
gene_pool_2 = GenePool(
    Decimals=0,
    Maximum=28,
    Minimum=24,
    Value=[28, 28, 28, 28, 28, 28, 28, 28, 28, 27.33333333, 26, 26, 26, 26, 26, 26, 26, 26, 26, 27.33333333, 28, 28, 28, 28])
coolingschedule = CoolingSchedule_2(data=gene_pool_2)
heatingschedule = HeatingSchedule_2(data=gene_pool)
setpoint = HBSetpoint(name="setpoint", heating_sch=heatingschedule, cooling_sch=coolingschedule)  # -> setpoint; plug-in component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

gene_pool_3 = GenePool(
    Decimals=1,
    Maximum=1,
    Minimum=0,
    Value=[1, 1, 1, 1, 1, 1, 1, 0.7, 0.2, 0.2, 0.2, 0.2, 0.2, 0.3, 0.5, 0.5, 0.5, 0.5, 0.7, 0.7, 0.7, 1, 1, 1])
occupancyschedule = OccupancySchedule_2(mon_fri=gene_pool_3)

gene_pool_4 = GenePool(
    Decimals=1,
    Maximum=1,
    Minimum=0,
    Value=[0.2, 0, 0, 0, 0, 0, 0.8, 0.8, 0.8, 0.2, 0.2, 0.25, 0.25, 0.5, 0.5, 0.4, 0.4, 0.4, 0.8, 0.8, 0.8, 0.8, 0.8, 0.4])
hotwaterschedule = LightingSchedule_2(mon_fri=gene_pool_4)

gene_pool_5 = GenePool(
    Decimals=1,
    Maximum=1,
    Minimum=0.2,
    Value=[0.3, 0.2, 0.2, 0.2, 0.2, 0.2, 0.5, 0.5, 0.4, 0.4, 0.4, 0.4, 0.4, 0.4, 0.5, 0.6, 0.6, 0.7, 0.7, 0.7, 0.7, 0.7, 0.7, 0.5])
ecquipmentschedule = LightingSchedule_2(mon_fri=gene_pool_5)

gene_pool_6 = GenePool(
    Decimals=2,
    Maximum=1,
    Minimum=0.05,
    Value=[0.05, 0.05, 0.05, 0.05, 0.05, 0.05, 0.8, 0.8, 0.05, 0.05, 0.05, 0.05, 0.05, 0.05, 0.05, 0.05, 0.5, 0.5, 0.7, 0.8, 0.8, 0.8, 0.7, 0.5])
lightingschedule = LightingSchedule_2(mon_fri=gene_pool_6)

# ----
# PROGRAMMA_DESTINAZIONE_D’USO_RESIDENZIALE
occupazione_p_m2_2 = Panel(division)
acqua_calda_l_m_m2_2 = Panel(multiplication)
luce_2 = Panel(multiplication_3)
ecuipaggiamento_elettrico_2 = Panel(subtraction)
hb_building_programs = HBBuildingPrograms({"LargeOffice", "MediumOffice", "SmallOffice", "MidriseApartment", "HighriseApartment", "Retail", "StripMall", "PrimarySchool", "SecondarySchool", "SmallHotel", "LargeHotel", "Hospital", "Outpatient", "Laboratory", "Warehouse", "SuperMarket", "FullServiceRestaurant", "QuickServiceRestaurant", "Courthouse", "LargeDataCenterHighITE", "LargeDataCenterLowITE", "SmallDataCenterHighITE", "SmallDataCenterLowITE"}, selected="MidriseApartment")

servicehotwater = HBServiceHotWater(name="acqua calda", flow_per_area=acqua_calda_l_m_m2_2, schedule=hotwaterschedule)  # -> hot_water; plug-in component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

lighting = HBLighting(name="luce", watts_per_area=luce_2, schedule=lightingschedule)  # -> lighting; plug-in component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

equipment = HBEquipment(name="ecquipaggiamneto elettrico", watts_per_area=ecuipaggiamento_elettrico_2, schedule=ecquipmentschedule)  # -> equip; plug-in component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

people = HBPeople(name="occupazione persone", ppl_per_area=occupazione_p_m2_2, occupancy_sch=occupancyschedule)  # -> people; plug-in component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

programtype = HBProgramType(
    name="program_residential",
    base_program=hb_building_programs,
    people=people,
    lighting=lighting,
    electric_equip=equipment,
    hot_water=servicehotwater,
    setpoint=setpoint)  # -> program; plug-in component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

program = ClusterOutput(programtype)

# ==== cluster CustomProgram_school
national_holidays = Panel("""Jan 1
Jan 6
Apr 1
Apr 2
Apr 25
May 1
Jun 2
Aug 15
Nov 1
Dec 8
Dec 25
Dec 26""")
period_of_low_occupation = Panel("""Dec 24 to Jan 5
Jul 1 to 31 Jul
Aug 1 to Aug 31""")

gene_pool = GenePool(
    Decimals=0,
    Maximum=22,
    Minimum=17,
    Value=[17, 17, 17, 17, 17, 17, 17, 19, 20, 21, 21, 21, 21, 21, 21, 21, 21, 21, 21, 20, 19, 17, 17, 17])
gene_pool_2 = GenePool(
    Decimals=0,
    Maximum=28,
    Minimum=24,
    Value=[28, 28, 28, 28, 28, 28, 28, 28, 28, 27.33333333, 26, 26, 26, 26, 26, 26, 26, 26, 26, 27.33333333, 28, 28, 28, 28])
period_of_low_occupation_2 = Panel("""Jun 1 to Jun 31
Aug 1 to Aug 31""")
period_of_low_occupation_3 = Panel("Dec 24 to Jan 5")
cooling_sch = Heating_sch(mon_sat=gene_pool_2, change_period=period_of_low_occupation_2, national_holiday=national_holidays)
heating_sch = Heating_sch(mon_sat=gene_pool, change_period=period_of_low_occupation_3, national_holiday=national_holidays)
setpoint = HBSetpoint(name="setpoint", heating_sch=heating_sch, cooling_sch=cooling_sch)  # -> setpoint; plug-in component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

change_value = Slider(0, range=0..100)
gene_pool_3 = GenePool(
    Decimals=2,
    Maximum=1,
    Minimum=0,
    Value=[0, 0, 0, 0, 0, 0, 0, 0, 0.35, 0.25, 0.25, 0.25, 0.25, 0.5, 0.5, 0.25, 0.25, 0.35, 0.16, 0, 0, 0, 0, 0])
hotwater_sch = Occupancy_sch(
    mon_sat=gene_pool_3,
    change_value=change_value,
    change_period=period_of_low_occupation,
    national_holiday=national_holidays)
servicehotwater = HBServiceHotWater(name="acqua calda", flow_per_area="0.05", schedule=hotwater_sch)  # -> hot_water; plug-in component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

change_value_2 = Slider(0, range=0..100)
gene_pool_4 = GenePool(
    Decimals=2,
    Maximum=1,
    Minimum=0,
    Value=[0, 0, 0, 0, 0, 0, 0, 0, 0.8, 0.8, 0.8, 0.8, 0.8, 0.8, 0.8, 0.4, 0.4, 0.4, 0.4, 0, 0, 0, 0, 0])
m2_per_persona_ufficio = Slider(1.88, range=0..12)
occupancy_sch = Occupancy_sch(
    mon_sat=gene_pool_4,
    change_value=change_value_2,
    change_period=period_of_low_occupation,
    national_holiday=national_holidays)
division = Division(A="1", B=m2_per_persona_ufficio)
panel = Panel(division)
people = HBPeople(name="occupazione persone", ppl_per_area=division, occupancy_sch=occupancy_sch)  # -> people; plug-in component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

change_value__summer = Slider(0, range=0..100)
gene_pool_5 = GenePool(
    Decimals=2,
    Maximum=1,
    Minimum=0.05,
    Value=[0.17, 0.17, 0.17, 0.17, 0.17, 0.17, 0.17, 0.17, 0.7, 0.7, 0.7, 0.7, 0.7, 0.7, 0.7, 0.7, 0.7, 0.7, 0.525, 0.17, 0.17, 0.17, 0.17, 0.17])
lighting_sch = Occupancy_sch(
    mon_sat=gene_pool_5,
    change_value=change_value__summer,
    change_period=period_of_low_occupation,
    national_holiday=national_holidays)
lighting = HBLighting(name="illuminazione", watts_per_area=Slider(11, range=0..12), schedule=lighting_sch)  # -> lighting; plug-in component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

change_value_3 = Slider(0, range=0..100)
gene_pool_6 = GenePool(
    Decimals=2,
    Maximum=1,
    Minimum=0.28,
    Value=[0.28, 0.28, 0.28, 0.28, 0.28, 0.28, 0.28, 0.28, 0.85, 0.8457142857, 0.8457142857, 0.8457142857, 0.8457142857, 0.85, 0.85, 0.85, 0.85, 0.4, 0.4, 0.28, 0.28, 0.28, 0.28, 0.28])
equiment_sch = Occupancy_sch(
    mon_sat=gene_pool_6,
    change_value=change_value_3,
    change_period=period_of_low_occupation,
    national_holiday=national_holidays)
equipment = HBEquipment(name="equipaggiamento elettrico", watts_per_area=Slider(14, range=0..15), schedule=equiment_sch)  # -> equip; plug-in component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

programtype = HBProgramType(
    name="program_NonResidential-school",
    people=people,
    lighting=lighting,
    electric_equip=equipment,
    hot_water=servicehotwater,
    setpoint=setpoint)  # -> program; plug-in component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
program = ClusterOutput(programtype)

# ==== cluster Cluster_2
selector = ClusterInput()
# Muratura_laterizio_non_isolato              = 0
# Muratura_laterizio_isolato                  = 1
# Muratura_lateerizio_altamente_isolato       = 2
# Muratura_blocco_termico_isolato             = 3
# Muratura_blocco_termico_altamente_isolato   = 4
# Muratura_calcestruzzo_non_isolato           = 5
# Muratura_calcestruzzo_medio_isolato_esterno = 6
# Muratura_calcestruzzo_medio_isolato_interno = 7
# Muratura_calcestruzzo_altamente_isolato     = 8
# Muratura_pietra_non_isolato                 = 9
# Muratura_pietra_medio_isolato               = 10
# Muratura_pietra_altamente_isolato           = 11
# Muratura_mattoni_non_isolato                = 12
# Muratura_mattoni_medio_isolato              = 13
# Muratura_mattoni_altamente_isolato          = 14
# PACCHETTO CALCESTRUZZO                      = 15
# PACCHETTO CALCESTRUZZO PARETE VENTILATA     = 16
# PACCHETTO LEGNO A UMIDO                     = 17
# PACCHETTO ACCIAIO                           = 18
# PACCHETTO LEGNO A SECCO                     = 19
selector_2 = Number(selector)
muratura_blocco_termico_altamente_isolat = Muratura_blocco_termico_altamente_isolato()  # -> name_2, u_fac_si, constr, environmental_cobenefit_3, social_cobenefit_3, economic_cobenefit_2, albedo_7, thermalemissivity_3; "Muratura_blocco_termico_altamente_isolato"
# Brick Masonry Not-Insulated = 0
# Brick Masonry Insulated = 1
# Brick Masonry Highly Insulated =2
# Thermal Block Masonry Insulated = 3
# Thermal Block Masonry Highly Insulated = 4
# Concrete Masonry Non-Insulated = 5
# Concrete Masonry Medium Insulated External = 6
#  Concrete Masonry Medium Insulated Internal = 7
#  Concrete Masonry Highly Insulated = 8
# Stone Masonry Non-Insulated = 9
#  Stone Masonry Medium Insulated = 10
#  Stone Masonry Highly Insulated = 11
#  Brick Masonry Non-Insulated = 12
#  Brick Masonry Medium Insulated = 13
#  Brick Masonry Highly Insulated = 14
#  CONCRETE PACKAGE = 15
# VENTILATED WALL = 16
# WET WOOD PACKAGE = 17
# DRY WOOD PACKAGE = 18
muratura_laterizio_non_isolato = Muratura_laterizio_non_isolato()  # -> name_2, u_fac_si, constr, environmental_cobenefit_3, social_cobenefit_3, economic_cobenefit_2, albedo_6, thermalemissivity_3
muratura_blocco_termico_isolato = Muratura_blocco_termico_isolato()  # -> name_2, u_fac_si, constr, environmental_cobenefit_3, social_cobenefit_3, economic_cobenefit_2, albedo_7, thermalemissivity_3
muratura_lateerizio_altamente_isolato = Muratura_lateerizio_altamente_isolato()  # -> name_2, u_fac_si, constr, environmental_cobenefit_3, social_cobenefit_3, economic_cobenefit_2, albedo_7, thermalemissivity_3
pacchetto_acciaio = PACCHETTOACCIAIO()  # -> name_2, u_fac_si, constr, environmental_cobenefit_3, social_cobenefit_3, economic_cobenefit_2, albedo_3, thermalemissivity_3
muratura_laterizio_isolato = Muratura_laterizio_isolato()  # -> name_2, u_fac_si, constr, environmental_cobenefit_3, social_cobenefit_3, economic_cobenefit_2, albedo_7, thermalemissivity_3
pacchetto_calcestruzzo = PACCHETTOCALCESTRUZZO()  # -> name_2, u_fac_si, constr, environmental_cobenefit_3, social_cobenefit_3, economic_cobenefit_2, albedo_3, thermalemissivity_3
pacchetto_calcestruzzo_parete_ventilata = PACCHETTOCALCESTRUZZOPARETEVENTILATA()  # -> name_2, u_fac_si, constr, environmental_cobenefit_3, social_cobenefit_3, economic_cobenefit_2, albedo_3, thermalemissivity_3
muratura_calcestruzzo_medio_isolato_inte = Muratura_calcestruzzo_medio_isolato_interno()  # -> name_2, u_fac_si, constr, environmental_cobenefit_3, social_cobenefit_3, economic_cobenefit_2, albedo_8, thermalemissivity_3; "Muratura_calcestruzzo_medio_isolato_interno"
muratura_calcestruzzo_medio_isolato_este = Muratura_calcestruzzo_medio_isolato_esterno()  # -> name_2, u_fac_si, constr, environmental_cobenefit_3, social_cobenefit_3, economic_cobenefit_2, albedo_8, thermalemissivity_3; "Muratura_calcestruzzo_medio_isolato_esterno"
muratura_calcestruzzo_altamente_isolato = Muratura_calcestruzzo_altamente_isolato()  # -> name_2, u_fac_si, constr, environmental_cobenefit_3, social_cobenefit_3, economic_cobenefit_2, albedo_8, thermalemissivity_3
muratura_calcestruzzo_non_isolato = Muratura_calcestruzzo_non_isolato()  # -> name_2, u_fac_si, constr, environmental_cobenefit_3, social_cobenefit_3, economic_cobenefit_2, albedo_7, thermalemissivity_3
pacchetto_legno_a_secco = PACCHETTOLEGNOASECCO()  # -> name_2, u_fac_si, constr, environmental_cobenefit_3, social_cobenefit_3, economic_cobenefit_2, albedo_3, thermalemissivity_3
pacchetto_legno_a_umido = PACCHETTOLEGNOAUMIDO()  # -> name_2, u_fac_si, constr, environmental_cobenefit_3, social_cobenefit_3, economic_cobenefit_2, albedo_3, thermalemissivity_3
muratura_pietra_medio_isolato = Muratura_pietra_medio_isolato()  # -> name_2, u_fac_si, constr, environmental_cobenefit_3, social_cobenefit_3, economic_cobenefit_2, albedo_7, thermalemissivity_3
muratura_pietra_altamente_isolato = Muratura_pietra_altamente_isolato()  # -> name_2, u_fac_si, constr, environmental_cobenefit_3, social_cobenefit_3, economic_cobenefit_2, albedo_7, thermalemissivity_3
muratura_mattoni_altamente_isolato = Muratura_mattoni_altamente_isolato()  # -> name_2, u_fac_si, constr, environmental_cobenefit_3, social_cobenefit_3, economic_cobenefit_2, albedo_7, thermalemissivity_3
muratura_mattoni_non_isolato = Muratura_mattoni_non_isolato()  # -> name_2, u_fac_si, constr, environmental_cobenefit_3, social_cobenefit_3, economic_cobenefit_2, albedo_6, thermalemissivity_3
muratura_mattoni_medio_isolato = Muratura_mattoni_medio_isolato()  # -> name_2, u_fac_si, constr, environmental_cobenefit_3, social_cobenefit_3, economic_cobenefit_2, albedo_7, thermalemissivity_3
muratura_pietra_non_isolato = Muratura_pietra_non_isolato()  # -> name_2, u_fac_si, constr, environmental_cobenefit_3, social_cobenefit_3, economic_cobenefit_2, albedo_6, thermalemissivity_3
stream_filter = StreamFilter(
    Gate=selector_2,
    Stream0=muratura_laterizio_non_isolato.thermalemissivity_3,
    Stream1=muratura_laterizio_isolato.thermalemissivity_3,
    Stream2=muratura_lateerizio_altamente_isolato.thermalemissivity_3,
    Stream3=muratura_blocco_termico_isolato.thermalemissivity_3,
    Stream4=muratura_blocco_termico_altamente_isolat.thermalemissivity_3,
    Stream5=muratura_calcestruzzo_non_isolato.thermalemissivity_3,
    Stream6=muratura_calcestruzzo_medio_isolato_este.thermalemissivity_3,
    Stream7=muratura_calcestruzzo_medio_isolato_inte.thermalemissivity_3,
    Stream8=muratura_calcestruzzo_altamente_isolato.thermalemissivity_3,
    Stream9=muratura_pietra_non_isolato.thermalemissivity_3,
    Stream10=muratura_pietra_medio_isolato.thermalemissivity_3,
    Stream11=muratura_pietra_altamente_isolato.thermalemissivity_3,
    Stream12=muratura_mattoni_non_isolato.thermalemissivity_3,
    Stream13=muratura_mattoni_medio_isolato.thermalemissivity_3,
    Stream14=muratura_mattoni_altamente_isolato.thermalemissivity_3,
    Stream15=pacchetto_calcestruzzo.thermalemissivity_3,
    Stream16=pacchetto_calcestruzzo_parete_ventilata.thermalemissivity_3,
    Stream17=pacchetto_legno_a_umido.thermalemissivity_3,
    Stream18=pacchetto_legno_a_secco.thermalemissivity_3)
stream_filter_2 = StreamFilter(
    Gate=selector_2,
    Stream0=muratura_laterizio_non_isolato.albedo_6,
    Stream1=muratura_laterizio_isolato.albedo_7,
    Stream2=muratura_lateerizio_altamente_isolato.albedo_7,
    Stream3=muratura_blocco_termico_isolato.albedo_7,
    Stream4=muratura_blocco_termico_altamente_isolat.albedo_7,
    Stream5=muratura_calcestruzzo_non_isolato.albedo_7,
    Stream6=muratura_calcestruzzo_medio_isolato_este.albedo_8,
    Stream7=muratura_calcestruzzo_medio_isolato_inte.albedo_8,
    Stream8=muratura_calcestruzzo_altamente_isolato.albedo_8,
    Stream9=muratura_pietra_non_isolato.albedo_6,
    Stream10=muratura_pietra_medio_isolato.albedo_7,
    Stream11=muratura_pietra_altamente_isolato.albedo_7,
    Stream12=muratura_mattoni_non_isolato.albedo_6,
    Stream13=muratura_mattoni_medio_isolato.albedo_7,
    Stream14=muratura_mattoni_altamente_isolato.albedo_7,
    Stream15=pacchetto_calcestruzzo.albedo_3,
    Stream16=pacchetto_calcestruzzo_parete_ventilata.albedo_3,
    Stream17=pacchetto_legno_a_umido.albedo_3,
    Stream18=pacchetto_legno_a_secco.albedo_3)
stream_filter_3 = StreamFilter(
    Gate=selector_2,
    Stream0=muratura_laterizio_non_isolato.name_2,
    Stream1=muratura_laterizio_isolato.name_2,
    Stream2=muratura_lateerizio_altamente_isolato.name_2,
    Stream3=muratura_blocco_termico_isolato.name_2,
    Stream4=muratura_blocco_termico_altamente_isolat.name_2,
    Stream5=muratura_calcestruzzo_non_isolato.name_2,
    Stream6=muratura_calcestruzzo_medio_isolato_este.name_2,
    Stream7=muratura_calcestruzzo_medio_isolato_inte.name_2,
    Stream8=muratura_calcestruzzo_altamente_isolato.name_2,
    Stream9=muratura_pietra_non_isolato.name_2,
    Stream10=muratura_pietra_medio_isolato.name_2,
    Stream11=muratura_pietra_altamente_isolato.name_2,
    Stream12=muratura_mattoni_non_isolato.name_2,
    Stream13=muratura_mattoni_medio_isolato.name_2,
    Stream14=muratura_mattoni_altamente_isolato.name_2,
    Stream15=pacchetto_calcestruzzo.name_2,
    Stream16=pacchetto_calcestruzzo_parete_ventilata.name_2,
    Stream17=pacchetto_legno_a_umido.name_2,
    Stream18=pacchetto_legno_a_secco.name_2)
stream_filter_4 = StreamFilter(
    Gate=selector_2,
    Stream0=muratura_laterizio_non_isolato.constr,
    Stream1=muratura_laterizio_isolato.constr,
    Stream2=muratura_lateerizio_altamente_isolato.constr,
    Stream3=muratura_blocco_termico_isolato.constr,
    Stream4=muratura_blocco_termico_altamente_isolat.constr,
    Stream5=muratura_calcestruzzo_non_isolato.constr,
    Stream6=muratura_calcestruzzo_medio_isolato_este.constr,
    Stream7=muratura_calcestruzzo_medio_isolato_inte.constr,
    Stream8=muratura_calcestruzzo_altamente_isolato.constr,
    Stream9=muratura_pietra_non_isolato.constr,
    Stream10=muratura_pietra_medio_isolato.constr,
    Stream11=muratura_pietra_altamente_isolato.constr,
    Stream12=muratura_mattoni_non_isolato.constr,
    Stream13=muratura_mattoni_medio_isolato.constr,
    Stream14=muratura_mattoni_altamente_isolato.constr,
    Stream15=pacchetto_calcestruzzo.constr,
    Stream16=pacchetto_calcestruzzo_parete_ventilata.constr,
    Stream17=pacchetto_legno_a_umido.constr,
    Stream18=pacchetto_legno_a_secco.constr)
stream_filter_5 = StreamFilter(
    Gate=selector_2,
    Stream0=muratura_laterizio_non_isolato.u_fac_si,
    Stream1=muratura_laterizio_isolato.u_fac_si,
    Stream2=muratura_lateerizio_altamente_isolato.u_fac_si,
    Stream3=muratura_blocco_termico_isolato.u_fac_si,
    Stream4=muratura_blocco_termico_altamente_isolat.u_fac_si,
    Stream5=muratura_calcestruzzo_non_isolato.u_fac_si,
    Stream6=muratura_calcestruzzo_medio_isolato_este.u_fac_si,
    Stream7=muratura_calcestruzzo_medio_isolato_inte.u_fac_si,
    Stream8=muratura_calcestruzzo_altamente_isolato.u_fac_si,
    Stream9=muratura_pietra_non_isolato.u_fac_si,
    Stream10=muratura_pietra_medio_isolato.u_fac_si,
    Stream11=muratura_pietra_altamente_isolato.u_fac_si,
    Stream12=muratura_mattoni_non_isolato.u_fac_si,
    Stream13=muratura_mattoni_medio_isolato.u_fac_si,
    Stream14=muratura_mattoni_altamente_isolato.u_fac_si,
    Stream15=pacchetto_calcestruzzo.u_fac_si,
    Stream16=pacchetto_calcestruzzo_parete_ventilata.u_fac_si,
    Stream17=pacchetto_legno_a_umido.u_fac_si,
    Stream18=pacchetto_legno_a_secco.u_fac_si)
wall_thermal_emissivity = Data(stream_filter)
wall_albedo = Data(stream_filter_2)
selected_const = Data(stream_filter_4)
wall_stratigrafia = Data(stream_filter_3)
u_fac_si = Data(stream_filter_5)
wall_thermal_emissivity_2 = ClusterOutput(wall_thermal_emissivity)
wall_albedo_2 = ClusterOutput(wall_albedo)
wall_stratigrafia_2 = ClusterOutput(wall_stratigrafia)
selected_const_2 = ClusterOutput(selected_const)
u_fac_si_2 = ClusterOutput(u_fac_si)

# ==== cluster Cluster_3
# Solaio_legno_non_isolato                 = 0
# Solaio_legno_scarso_isolato              = 1
# Solaio_legno_altamente_isolato           = 2
# Solaio_laterocemento_non_isolato         = 3
# Solaio_laterocemento_scarso_isolato      = 4
# Solaio_laterocemento_altamente_isolato   = 5
# Solaio_allegerito_eps_medio_isolato      = 6
# Solaio_allegerito_eps_isolato            = 7
# Solaio_allegerito_eps_altamente_isolato  = 8
# Copertura_calcestruzzo                   = 9
# Copertura_acciaio                        = 10
# Copertura_legno                          = 11
# Copertura_Verde_estensivo                = 12
# Timber floor not insulated = 0
# Poorly insulated timber floor = 1
# Highly insulated timber floor = 2
# Lateral concrete floor not insulated = 3
# Poorly insulated lateral concrete floor = 4
#  Highly insulated lateral concrete floor = 5
# Medium insulated lightweight concrete floor = 6
#  Insulated lightweight concrete floor = 7
#  Highly insulated lightweight concrete floor = 8
#  Concrete roof = 9
#  Steel roof = 10
#  Wooden roof = 11
#  Extensive green roof = 12
selector = ClusterInput()
selector_2 = Number(selector)
solaio_laterocemento_altamente_isolato = Solaio_laterocemento_altamente_isolato()  # -> name_2, u_fac_si, constr, environmental_cobenefit_3, social_cobenefit_3, economic_cobenefit_2, albedo_3, thermalemissivity_3
solaio_legno_altamente_isolato = Solaio_legno_altamente_isolato()  # -> name_2, u_fac_si, constr, environmental_cobenefit_3, social_cobenefit_3, economic_cobenefit_2, albedo_3, thermalemissivity_3
solaio_laterocemento_scarso_isolato = Solaio_laterocemento_scarso_isolato()  # -> name_2, u_fac_si, constr, environmental_cobenefit_3, social_cobenefit_3, economic_cobenefit_2, albedo_3, thermalemissivity_3
solaio_legno_non_isolato = Solaio_legno_non_isolato()  # -> name_2, u_fac_si, constr, environmental_cobenefit_3, social_cobenefit_3, economic_cobenefit_2, albedo_3, thermalemissivity_3
solaio_laterocemento_non_isolato = Solaio_laterocemento_non_isolato()  # -> name_2, u_fac_si, constr, environmental_cobenefit_3, social_cobenefit_3, economic_cobenefit_2, albedo_3, thermalemissivity_3
solaio_legno_scarso_isolato = Solaio_legno_scarso_isolato()  # -> name_2, u_fac_si, constr, environmental_cobenefit_3, social_cobenefit_3, economic_cobenefit_2, albedo_3, thermalemissivity_3
solaio_allegerito_eps_altamente_isolato = Solaio_allegerito_eps_altamente_isolato()  # -> name_2, u_fac_si, constr, environmental_cobenefit_3, social_cobenefit_3, economic_cobenefit_2, albedo_3, thermalemissivity_3
copertura_calcestruzzo = Copertura_calcestruzzo()  # -> name_2, u_fac_si, constr, environmental_cobenefit_3, social_cobenefit_3, economic_cobenefit_2, albedo_3, thermalemissivity_3
copertura_acciaio = Copertura_acciaio()  # -> name_2, u_fac_si, constr, environmental_cobenefit_3, social_cobenefit_3, economic_cobenefit_2, albedo_3, thermalemissivity_3, gwp_kg_co2_m2_2
copertura_verde_estensivo = Copertura_Verde_estensivo()  # -> name_2, u_fac_si, constr, environmental_cobenefit_3, social_cobenefit_3, economic_cobenefit_2, albedo_3, thermalemissivity_3, gwp_kg_co2_m2_2
copertura_legno = Copertura_legno()  # -> name_2, u_fac_si, constr, environmental_cobenefit_3, social_cobenefit_3, economic_cobenefit_2, albedo_3, thermalemissivity_3
solaio_allegerito_eps_medio_isolato = Solaio_allegerito_eps_medio_isolato()  # -> name_2, u_fac_si, constr, environmental_cobenefit_3, social_cobenefit_3, economic_cobenefit_2, albedo_3, thermalemissivity_3
solaio_allegerito_eps_isolato = Solaio_allegerito_eps_isolato()  # -> name_2, u_fac_si, constr, environmental_cobenefit_3, social_cobenefit_3, economic_cobenefit_2, albedo_3, thermalemissivity_3
stream_filter = StreamFilter(
    Gate=selector_2,
    Stream0=solaio_legno_non_isolato.constr,
    Stream1=solaio_legno_scarso_isolato.constr,
    Stream2=solaio_legno_altamente_isolato.constr,
    Stream3=solaio_laterocemento_non_isolato.constr,
    Stream4=solaio_laterocemento_scarso_isolato.constr,
    Stream5=solaio_laterocemento_altamente_isolato.constr,
    Stream6=solaio_allegerito_eps_medio_isolato.constr,
    Stream7=solaio_allegerito_eps_isolato.constr,
    Stream8=solaio_allegerito_eps_altamente_isolato.constr,
    Stream9=copertura_calcestruzzo.constr,
    Stream10=copertura_acciaio.constr,
    Stream11=copertura_legno.constr,
    Stream12=copertura_verde_estensivo.constr)
stream_filter_2 = StreamFilter(
    Gate=selector_2,
    Stream0=solaio_legno_non_isolato.u_fac_si,
    Stream1=solaio_legno_scarso_isolato.u_fac_si,
    Stream2=solaio_legno_altamente_isolato.u_fac_si,
    Stream3=solaio_laterocemento_non_isolato.u_fac_si,
    Stream4=solaio_laterocemento_scarso_isolato.u_fac_si,
    Stream5=solaio_laterocemento_altamente_isolato.u_fac_si,
    Stream6=solaio_allegerito_eps_medio_isolato.u_fac_si,
    Stream7=solaio_allegerito_eps_isolato.u_fac_si,
    Stream8=solaio_allegerito_eps_altamente_isolato.u_fac_si,
    Stream9=copertura_calcestruzzo.u_fac_si,
    Stream10=copertura_acciaio.u_fac_si,
    Stream11=copertura_legno.u_fac_si,
    Stream12=copertura_verde_estensivo.u_fac_si)
stream_filter_3 = StreamFilter(
    Gate=selector_2,
    Stream0=solaio_legno_non_isolato.name_2,
    Stream1=solaio_legno_scarso_isolato.name_2,
    Stream2=solaio_legno_altamente_isolato.name_2,
    Stream3=solaio_laterocemento_non_isolato.name_2,
    Stream4=solaio_laterocemento_scarso_isolato.name_2,
    Stream5=solaio_laterocemento_altamente_isolato.name_2,
    Stream6=solaio_allegerito_eps_medio_isolato.name_2,
    Stream7=solaio_allegerito_eps_isolato.name_2,
    Stream8=solaio_allegerito_eps_altamente_isolato.name_2,
    Stream9=copertura_calcestruzzo.name_2,
    Stream10=copertura_acciaio.name_2,
    Stream11=copertura_legno.name_2,
    Stream12=copertura_verde_estensivo.name_2)
roof_stratigrafia = Data(stream_filter_3)
u_fac_si = Data(stream_filter_2)
selected_constr = Data(stream_filter)
u_fac_si_2 = ClusterOutput(u_fac_si)
roof_stratigrafia_2 = ClusterOutput(roof_stratigrafia)
selected_constr_2 = ClusterOutput(selected_constr)

# ==== cluster Cluster_4
selector = ClusterInput()
selector_2 = Number(selector)
solaio_calcestruzzo_igloo_scarso_isolato = Solaio_calcestruzzo_igloo_scarso_isolato()  # -> name_2, u_fac_si, constr, environmental_cobenefit_3, social_cobenefit_3, economic_cobenefit_2, albedo_3, thermalemissivity_3
# Solaio_calcestruzzo_igloo_non_isolato - Igloo concrete floor not insulated = 0
# Solaio_calcestruzzo_igloo_scarso_isolato - Poorly insulated igloo concrete floor = 1
# Solaio_calcestruzzo_igloo_isolato - Insulated igloo concrete floor = 2
solaio_calcestruzzo_igloo_non_isolato = Solaio_calcestruzzo_igloo_non_isolato()  # -> name_2, u_fac_si, constr, environmental_cobenefit_3, social_cobenefit_3, economic_cobenefit_2, albedo_3, thermalemissivity_3
solaio_calcestruzzo_igloo_isolato = Solaio_calcestruzzo_igloo_isolato()  # -> name_2, u_fac_si, constr, environmental_cobenefit_3, social_cobenefit_3, economic_cobenefit_2, albedo_3, thermalemissivity_3
stream_filter = StreamFilter(
    Gate=selector_2,
    Stream0=solaio_calcestruzzo_igloo_non_isolato.name_2,
    Stream1=solaio_calcestruzzo_igloo_scarso_isolato.name_2,
    Stream2=solaio_calcestruzzo_igloo_isolato.name_2)
stream_filter_2 = StreamFilter(
    Gate=selector_2,
    Stream0=solaio_calcestruzzo_igloo_non_isolato.u_fac_si,
    Stream1=solaio_calcestruzzo_igloo_scarso_isolato.u_fac_si,
    Stream2=solaio_calcestruzzo_igloo_isolato.u_fac_si)
stream_filter_3 = StreamFilter(
    Gate=selector_2,
    Stream0=solaio_calcestruzzo_igloo_non_isolato.constr,
    Stream1=solaio_calcestruzzo_igloo_scarso_isolato.constr,
    Stream2=solaio_calcestruzzo_igloo_isolato.constr)
gfloor_stratigrafia = Data(stream_filter)
u_fac_si = Data(stream_filter_2)
selected_constr = Data(stream_filter_3)
gfloor_stratigrafia_2 = ClusterOutput(gfloor_stratigrafia)
u_fac_si_2 = ClusterOutput(u_fac_si)
selected_constr_2 = ClusterOutput(selected_constr)

# ==== cluster OccupancySchedule
national_holiday = ClusterInput()
change_period = ClusterInput()
change_value = ClusterInput()
mon_fri = ClusterInput()
national_holiday_2 = Data(national_holiday)
change_period_2 = Data(change_period)
mon_fri_2 = Data(mon_fri)
change_value_2 = Data(change_value)
division = Division(A=mon_fri_2, B="100")
sort_list = SortList(Keys=mon_fri_2)  # -> Keys, ValuesValuesA
multiplication = Multiplication(A=division, B=change_value_2)
subtraction = Subtraction(A=mon_fri_2, B=multiplication)
list_length = ListLength(List=mon_fri_2)
list_item = ListItem(List=sort_list.Keys, Index="0", Wrap=True)
panel = Panel(list_item)
construct_domain = ConstructDomain(DomainStart=panel, DomainEnd="1")
panel_2 = Panel(mon_fri_2)
repeat_data = RepeatData(Data=list_item, Length=list_length)
remap_numbers = RemapNumbers(Value=subtraction, Source=construct_domain, Target=construct_domain)  # -> Mapped, Clipped
panel_3 = Panel(remap_numbers.Clipped)
weeklyschedule = HBWeeklySchedule(sun=list_item, mon=mon_fri_2, tue=mon_fri_2, wed=mon_fri_2, thu=mon_fri_2, fri=mon_fri_2, sat=list_item)  # -> out, schedule, idf_year, idf_week, idf_days; plug-in component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
weeklyschedule_2 = HBWeeklySchedule(
    sun=list_item,
    mon=remap_numbers.Clipped,
    tue=remap_numbers.Clipped,
    wed=remap_numbers.Clipped,
    thu=remap_numbers.Clipped,
    fri=remap_numbers.Clipped,
    sat=list_item)  # -> out, schedule, idf_year, idf_week, idf_days; plug-in component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
list_length_2 = ListLength(List=change_period_2)
holiday = Holiday(values=list_item, list=national_holiday_2, date=national_holiday_2)  # -> flatten(holiday), period, hoys, dates
periods = Periods(text=change_period_2)  # -> period, hoys, dates
repeat_data_2 = RepeatData(Data=weeklyschedule_2.schedule, Length=list_length_2)  # -> flatten(Data)
seasonalschedule = HBSeasonalSchedule(
    base_schedule=weeklyschedule.schedule,
    season_scheds=[repeat_data_2, holiday.holiday],
    analysis_periods=[holiday.period, periods.period])  # -> out, schedule, idf_year, idf_week, idf_days; plug-in component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
schedule = ClusterOutput(seasonalschedule.schedule)

# ==== cluster LightingSchedule
change_value__summer = ClusterInput()
change_value__winter = ClusterInput()
change_period = ClusterInput()
national_holiday = ClusterInput()
mon_fri = ClusterInput()
mon_fri_2 = Data(mon_fri)
change_value__winter_2 = Data(change_value__winter)
change_period_2 = Data(change_period)
national_holiday_2 = Data(national_holiday)
change_value__summer_2 = Data(change_value__summer)

sort_list = SortList(Keys=mon_fri_2)  # -> Keys, ValuesValuesA
list_item = ListItem(List=sort_list.Keys, Index="0", Wrap=True)
list_length = ListLength(List=mon_fri_2)
repeat_data = RepeatData(Data=list_item, Length=list_length)

division = Division(A=mon_fri_2, B="100")
multiplication = Multiplication(A=division, B=change_value__summer_2)
panel = Panel(list_item)
subtraction = Subtraction(A=mon_fri_2, B=multiplication)
construct_domain = ConstructDomain(DomainStart=panel, DomainEnd="1")
remap_numbers = RemapNumbers(Value=subtraction, Source=construct_domain, Target=construct_domain)  # -> Mapped, Clipped

panel_2 = Panel(mon_fri_2)
panel_3 = Panel(remap_numbers.Clipped)
weeklyschedule = HBWeeklySchedule(sun=repeat_data, mon=mon_fri_2, tue=mon_fri_2, wed=mon_fri_2, thu=mon_fri_2, fri=mon_fri_2, sat=repeat_data)  # -> out, schedule, idf_year, idf_week, idf_days; plug-in component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
weeklyschedule_2 = HBWeeklySchedule(
    sun=repeat_data,
    mon=remap_numbers.Clipped,
    tue=remap_numbers.Clipped,
    wed=remap_numbers.Clipped,
    thu=remap_numbers.Clipped,
    fri=remap_numbers.Clipped,
    sat=repeat_data)  # -> out, schedule, idf_year, idf_week, idf_days; plug-in component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
holiday = Holiday(values=list_item, list=national_holiday_2, date=national_holiday_2)  # -> holiday, period, hoys, dates
periods = Periods(text=change_period_2)  # -> period, hoys, dates
seasonalschedule = HBSeasonalSchedule(
    base_schedule=weeklyschedule.schedule,
    season_scheds=flatten([weeklyschedule_2.schedule, holiday.holiday]),
    analysis_periods=[periods.period, holiday.period])  # -> out, schedule, idf_year, idf_week, idf_days; plug-in component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
schedule = ClusterOutput(seasonalschedule.schedule)

# ==== cluster HotWaterSchedule
national_holiday = ClusterInput()
mon_fri = ClusterInput()
national_holiday_2 = Data(national_holiday)
mon_fri_2 = Data(mon_fri)

sort_list = SortList(Keys=mon_fri_2)  # -> Keys, ValuesValuesA
list_item = ListItem(List=sort_list.Keys, Index="0", Wrap=True)
list_length = ListLength(List=mon_fri_2)
repeat_data = RepeatData(Data=list_item, Length=list_length)

weeklyschedule = HBWeeklySchedule(sun=repeat_data, mon=mon_fri_2, tue=mon_fri_2, wed=mon_fri_2, thu=mon_fri_2, fri=mon_fri_2, sat=repeat_data)  # -> out, schedule, idf_year, idf_week, idf_days; plug-in component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
holiday = Holiday(values=list_item, list=national_holiday_2, date=national_holiday_2)  # -> holiday, period, hoys, dates
seasonalschedule = HBSeasonalSchedule(base_schedule=weeklyschedule.schedule, season_scheds=flatten(holiday.holiday), analysis_periods=holiday.period)  # -> out, schedule, idf_year, idf_week, idf_days; plug-in component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
schedule = ClusterOutput(seasonalschedule.schedule)

# ==== cluster EcquipmentSchedule
change_period = ClusterInput()
national_holiday = ClusterInput()
change_value = ClusterInput()
mon_fri = ClusterInput()
change_value_2 = Data(change_value)
national_holiday_2 = Data(national_holiday)
mon_fri_2 = Data(mon_fri)
change_period_2 = Data(change_period)

sort_list = SortList(Keys=mon_fri_2)  # -> Keys, ValuesValuesA
list_item = ListItem(List=sort_list.Keys, Index="0", Wrap=True)
list_length = ListLength(List=mon_fri_2)
repeat_data = RepeatData(Data=list_item, Length=list_length)

division = Division(A=mon_fri_2, B="100")
multiplication = Multiplication(A=division, B=change_value_2)
panel = Panel(list_item)
subtraction = Subtraction(A=mon_fri_2, B=multiplication)
construct_domain = ConstructDomain(DomainStart=panel, DomainEnd="1")
remap_numbers = RemapNumbers(Value=subtraction, Source=construct_domain, Target=construct_domain)  # -> Mapped, Clipped

weeklyschedule = HBWeeklySchedule(sun=repeat_data, mon=mon_fri_2, tue=mon_fri_2, wed=mon_fri_2, thu=mon_fri_2, fri=mon_fri_2, sat=repeat_data)  # -> out, schedule, idf_year, idf_week, idf_days; plug-in component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
weeklyschedule_2 = HBWeeklySchedule(
    sun=repeat_data,
    mon=remap_numbers.Clipped,
    tue=remap_numbers.Clipped,
    wed=remap_numbers.Clipped,
    thu=remap_numbers.Clipped,
    fri=remap_numbers.Clipped,
    sat=repeat_data)  # -> out, schedule, idf_year, idf_week, idf_days; plug-in component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
list_length_2 = ListLength(List=change_period_2)
repeat_data_2 = RepeatData(Data=weeklyschedule_2.schedule, Length=list_length_2)
periods = Periods(text=change_period_2)  # -> period, hoys, dates
holiday = Holiday(values=list_item, list=national_holiday_2, date=national_holiday_2)  # -> holiday, period, hoys, dates
seasonalschedule = HBSeasonalSchedule(
    base_schedule=weeklyschedule.schedule,
    season_scheds=flatten([repeat_data_2, holiday.holiday]),
    analysis_periods=[periods.period, holiday.period])  # -> out, schedule, idf_year, idf_week, idf_days; plug-in component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
schedule = ClusterOutput(seasonalschedule.schedule)

# ==== cluster HeatingSchedule
data = ClusterInput()
data_2 = ClusterInput()
data_3 = ClusterInput()
data_4 = Data(data)
data_5 = Data(data_2)
data_6 = Data(data_3)
units = LBUnitConverter(values=data_4, from_u="C", to_u="K")  # -> all_u, values; plug-in component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

sort_list = SortList(Keys=data_4)  # -> Keys, ValuesValuesA
list_item = ListItem(List=sort_list.Keys, Index="0", Wrap=True)
list_length = ListLength(List=data_4)
repeat_data = RepeatData(Data=list_item, Length=list_length)

typelimit = HBTypeLimit(name="Temperature", low_limit="0", unit_type="Temperature")  # -> out, type_limit; plug-in component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
weeklyschedule = HBWeeklySchedule(
    sun=repeat_data,
    mon=data_4,
    tue=data_4,
    wed=data_4,
    thu=data_4,
    fri=data_4,
    sat=repeat_data,
    type_limit=typelimit.type_limit)  # -> out, schedule, idf_year, idf_week, idf_days; plug-in component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
holiday = Holiday(values=repeat_data, list=data_5, date=data_5)  # -> holiday, period, hoys, dates
periods = Periods(text=data_6)  # -> period, hoys, dates
seasonalschedule = HBSeasonalSchedule(
    base_schedule=weeklyschedule.schedule,
    season_scheds=flatten([weeklyschedule.schedule, holiday.holiday]),
    analysis_periods=[periods.period, holiday.period])  # -> out, schedule, idf_year, idf_week, idf_days; plug-in component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
schedule = ClusterOutput(seasonalschedule.schedule)

# ==== cluster CoolingSchedule
data = ClusterInput()
data_2 = ClusterInput()
data_3 = ClusterInput()
data_4 = Data(data)
data_5 = Data(data_2)
data_6 = Data(data_3)
units = LBUnitConverter(values=data_4, from_u="C", to_u="K")  # -> all_u, values; plug-in component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
typelimit = HBTypeLimit(name="Temperature", low_limit="0", unit_type="Temperature")  # -> out, type_limit; plug-in component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

sort_list = SortList(Keys=data_4)  # -> Keys, ValuesValuesA
list_item = ListItem(List=sort_list.Keys, Index="0", Wrap=True)
list_length = ListLength(List=data_4)
repeat_data = RepeatData(Data=list_item, Length=list_length)

weeklyschedule = HBWeeklySchedule(
    sun=repeat_data,
    mon=data_4,
    tue=data_4,
    wed=data_4,
    thu=data_4,
    fri=data_4,
    sat=repeat_data,
    type_limit=typelimit.type_limit)  # -> out, schedule, idf_year, idf_week, idf_days; plug-in component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
holiday = Holiday(values=repeat_data, list=data_6, date=data_6)  # -> holiday, period, hoys, dates
periods = Periods(text=data_5)  # -> period, hoys, dates
seasonalschedule = HBSeasonalSchedule(
    base_schedule=weeklyschedule.schedule,
    season_scheds=flatten([weeklyschedule.schedule, holiday.holiday]),
    analysis_periods=[periods.period, holiday.period])  # -> out, schedule, idf_year, idf_week, idf_days; plug-in component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
schedule = ClusterOutput(seasonalschedule.schedule)

# ==== cluster OccupancySchedule_2
mon_fri = ClusterInput()
mon_fri_2 = Data(mon_fri)
panel = Panel(mon_fri_2)
weeklyschedule = HBWeeklySchedule(sun=mon_fri_2, mon=mon_fri_2, tue=mon_fri_2, wed=mon_fri_2, thu=mon_fri_2, fri=mon_fri_2, sat=mon_fri_2)  # -> out, schedule, idf_year, idf_week, idf_days; plug-in component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
schedule = ClusterOutput(weeklyschedule.schedule)

# ==== cluster LightingSchedule_2
mon_fri = ClusterInput()
mon_fri_2 = Data(mon_fri)
weeklyschedule = HBWeeklySchedule(sun=mon_fri_2, mon=mon_fri_2, tue=mon_fri_2, wed=mon_fri_2, thu=mon_fri_2, fri=mon_fri_2, sat=mon_fri_2)  # -> out, schedule, idf_year, idf_week, idf_days; plug-in component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
schedule = ClusterOutput(weeklyschedule.schedule)

# ==== cluster HeatingSchedule_2
data = ClusterInput()
data_2 = Data(data)
units = LBUnitConverter(values=data_2, from_u="C", to_u="K")  # -> all_u, values; plug-in component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
typelimit = HBTypeLimit(name="Temperature", low_limit="0", unit_type="Temperature")  # -> out, type_limit; plug-in component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
panel = Panel(data_2)
weeklyschedule = HBWeeklySchedule(sun=data_2, mon=data_2, tue=data_2, wed=data_2, thu=data_2, fri=data_2, sat=data_2, type_limit=typelimit.type_limit)  # -> out, schedule, idf_year, idf_week, idf_days; plug-in component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
schedule = ClusterOutput(weeklyschedule.schedule)

# ==== cluster CoolingSchedule_2
data = ClusterInput()
data_2 = Data(data)
units = LBUnitConverter(values=data_2, from_u="C", to_u="K")  # -> all_u, values; plug-in component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
typelimit = HBTypeLimit(name="Temperature", low_limit="0", unit_type="Temperature")  # -> out, type_limit; plug-in component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
weeklyschedule = HBWeeklySchedule(sun=data_2, mon=data_2, tue=data_2, wed=data_2, thu=data_2, fri=data_2, sat=data_2, type_limit=typelimit.type_limit)  # -> out, schedule, idf_year, idf_week, idf_days; plug-in component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
schedule = ClusterOutput(weeklyschedule.schedule)

# ==== cluster Occupancy_sch
mon_sat = ClusterInput()
change_value = ClusterInput()
change_period = ClusterInput()
mon_sat_2 = Data(mon_sat)
change_value_2 = Data(change_value)
change_period_2 = Data(change_period)
division = Division(A=mon_sat_2, B="100")
sort_list = SortList(Keys=mon_sat_2)  # -> Keys, ValuesValuesA
multiplication = Multiplication(A=division, B=change_value_2)
subtraction = Subtraction(A=mon_sat_2, B=multiplication)
list_length = ListLength(List=mon_sat_2)
list_item = ListItem(List=sort_list.Keys, Index="0", Wrap=True)
panel = Panel(list_item)
construct_domain = ConstructDomain(DomainStart=panel, DomainEnd="1")
panel_2 = Panel(mon_sat_2)
repeat_data = RepeatData(Data=list_item, Length=list_length)
remap_numbers = RemapNumbers(Value=subtraction, Source=construct_domain, Target=construct_domain)  # -> Mapped, Clipped
panel_3 = Panel(remap_numbers.Clipped)
weeklyschedule = HBWeeklySchedule(sun=list_item, mon=mon_sat_2, tue=mon_sat_2, wed=mon_sat_2, thu=mon_sat_2, fri=mon_sat_2, sat=mon_sat_2)  # -> out, schedule, idf_year, idf_week, idf_days; plug-in component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
weeklyschedule_2 = HBWeeklySchedule(
    sun=list_item,
    mon=remap_numbers.Clipped,
    tue=remap_numbers.Clipped,
    wed=remap_numbers.Clipped,
    thu=remap_numbers.Clipped,
    fri=remap_numbers.Clipped,
    sat=remap_numbers.Clipped)  # -> out, schedule, idf_year, idf_week, idf_days; plug-in component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
national_holiday = ClusterInput()
national_holiday_2 = Data(national_holiday)
list_length_2 = ListLength(List=change_period_2)
holiday = Holiday(values=list_item, list=national_holiday_2, date=national_holiday_2)  # -> flatten(holiday), period, hoys, dates
periods = Periods_2(text=change_period_2)  # -> period, hoys, dates
repeat_data_2 = RepeatData(Data=weeklyschedule_2.schedule, Length=list_length_2)  # -> flatten(Data)
seasonalschedule = HBSeasonalSchedule(
    base_schedule=weeklyschedule.schedule,
    season_scheds=[repeat_data_2, holiday.holiday],
    analysis_periods=[holiday.period, periods.period])  # -> out, schedule, idf_year, idf_week, idf_days; plug-in component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
schedule = ClusterOutput(seasonalschedule.schedule)

# ==== cluster Heating_sch
mon_sat = ClusterInput()
change_period = ClusterInput()
mon_sat_2 = Data(mon_sat)
change_period_2 = Data(change_period)
division = Division(A=mon_sat_2, B="100")
sort_list = SortList(Keys=mon_sat_2)  # -> Keys, ValuesValuesA
multiplication = Multiplication(A=division)
subtraction = Subtraction(A=mon_sat_2, B=multiplication)
list_length = ListLength(List=mon_sat_2)
list_item = ListItem(List=sort_list.Keys, Index="0", Wrap=True)
panel = Panel(list_item)
construct_domain = ConstructDomain(DomainStart=panel, DomainEnd="1")
panel_2 = Panel(mon_sat_2)
repeat_data = RepeatData(Data=list_item, Length=list_length)
remap_numbers = RemapNumbers(Value=subtraction, Source=construct_domain, Target=construct_domain)  # -> Mapped, Clipped
units = LBUnitConverter(values=mon_sat_2, from_u="C", to_u="K")  # -> all_u, values; plug-in component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
panel_3 = Panel(remap_numbers.Clipped)
typelimit = HBTypeLimit(name="Temperature", low_limit="0", unit_type="Temperature")  # -> out, type_limit; plug-in component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
weeklyschedule = HBWeeklySchedule(
    sun=list_item,
    mon=mon_sat_2,
    tue=mon_sat_2,
    wed=mon_sat_2,
    thu=mon_sat_2,
    fri=mon_sat_2,
    sat=mon_sat_2,
    type_limit=typelimit.type_limit)  # -> out, schedule, idf_year, idf_week, idf_days; plug-in component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
weeklyschedule_2 = HBWeeklySchedule(
    sun=list_item,
    mon=remap_numbers.Clipped,
    tue=remap_numbers.Clipped,
    wed=remap_numbers.Clipped,
    thu=remap_numbers.Clipped,
    fri=remap_numbers.Clipped,
    sat=remap_numbers.Clipped,
    type_limit=typelimit.type_limit)  # -> out, schedule, idf_year, idf_week, idf_days; plug-in component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
national_holiday = ClusterInput()
national_holiday_2 = Data(national_holiday)
list_length_2 = ListLength(List=change_period_2)
holiday = Holiday(values=list_item, list=national_holiday_2, date=national_holiday_2)  # -> flatten(holiday), period, hoys, dates
periods = Periods_2(text=change_period_2)  # -> period, hoys, dates
repeat_data_2 = RepeatData(Data=weeklyschedule_2.schedule, Length=list_length_2)  # -> flatten(Data)
seasonalschedule = HBSeasonalSchedule(
    base_schedule=weeklyschedule.schedule,
    season_scheds=[repeat_data_2, holiday.holiday],
    analysis_periods=[holiday.period, periods.period])  # -> out, schedule, idf_year, idf_week, idf_days; plug-in component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
schedule = ClusterOutput(seasonalschedule.schedule)

# ==== cluster Muratura_pietra_non_isolato
albedo = Panel("0.650")
albedo_2 = Panel("0.300")
albedo_3 = Panel("0.650")
subtraction = Subtraction(A="1", B=albedo_2)
subtraction_2 = Subtraction(A="1", B=albedo_3)
subtraction_3 = Subtraction(A="1", B=albedo)
opaquemat = HBOpaqueMaterial(
    name="Pietra",
    thickness="0.5",
    conductivity="2.4",
    density="2500",
    spec_heat="1000",
    therm_absp="0.92",
    sol_absp=subtraction,
    vis_absp=subtraction)  # -> mat; plug-in component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
opaquemat_2 = HBOpaqueMaterial(
    name="Intonaco_interno",
    thickness="0.02",
    conductivity="0.7",
    density="1500",
    spec_heat="1000",
    therm_absp="0.9",
    sol_absp=subtraction_2,
    vis_absp=subtraction_2)  # -> mat; plug-in component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
opaquemat_3 = HBOpaqueMaterial(
    name="Intonaco_esterno",
    thickness="0.02",
    conductivity="0.7",
    density="1500",
    spec_heat="1000",
    therm_absp="0.9",
    sol_absp=subtraction_3,
    vis_absp=subtraction_3)  # -> mat; plug-in component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
panel = Panel("Stone Masonry Not-Insulated")
economical_cobenefit = Panel("EMPLOYMENT AND INCOME GENERATION")
merge = Merge(Data1=opaquemat_3, Data2=opaquemat, Data3=opaquemat_2)
social_cobenefit = Panel("HEALTH IMPACTS")
environmental_cobenefit = Panel("AIR QUALITY")
thermalemissivity = Panel("0.90")
albedo_4 = Panel("0.65")
opaqueconstr = HBOpaqueConstruction(name=panel, materials=merge)  # -> constr; plug-in component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
name = Data(panel)
economic_cobenefit = Text(economical_cobenefit)
social_cobenefit_2 = Text(social_cobenefit)
thermalemissivity_2 = Number(thermalemissivity)
albedo_5 = Number(albedo_4)
name_2 = ClusterOutput(name)
environmental_cobenefit_2 = Text(environmental_cobenefit)
decnstrconstr = HBDeconstructConstruction(constr=opaqueconstr)  # -> materials, layers, r_val_si, r_val_ip, u_fac_si, u_fac_ip, shgc, t_sol, t_vis; plug-in component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
economic_cobenefit_2 = ClusterOutput(economic_cobenefit)
albedo_6 = ClusterOutput(albedo_5)
thermalemissivity_3 = ClusterOutput(thermalemissivity_2)
environmental_cobenefit_3 = ClusterOutput(environmental_cobenefit_2)
social_cobenefit_3 = ClusterOutput(social_cobenefit_2)
constr = ClusterOutput(opaqueconstr)
u_fac_si = ClusterOutput(decnstrconstr.u_fac_si)
panel_2 = Panel(decnstrconstr.u_fac_si)

# ==== cluster Muratura_pietra_medio_isolato
albedo = Panel("0.700")
albedo_2 = Panel("0.300")
albedo_3 = Panel("0.650")
albedo_4 = Panel("0.650")
subtraction = Subtraction(A="1", B=albedo)
subtraction_2 = Subtraction(A="1", B=albedo_2)
subtraction_3 = Subtraction(A="1", B=albedo_3)
subtraction_4 = Subtraction(A="1", B=albedo_4)
opaquemat = HBOpaqueMaterial(
    name="Intonaco_esterno",
    thickness="0.02",
    conductivity="0.7",
    density="1500",
    spec_heat="1000",
    therm_absp="0.9",
    sol_absp=subtraction_3,
    vis_absp=subtraction_3)  # -> mat; plug-in component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
opaquemat_2 = HBOpaqueMaterial(
    name="Isolante",
    thickness="0.05",
    conductivity="0.045",
    density="100",
    spec_heat="840",
    therm_absp="0.1",
    sol_absp=subtraction,
    vis_absp=subtraction)  # -> mat; plug-in component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
opaquemat_3 = HBOpaqueMaterial(
    name="Pietra",
    thickness="0.5",
    conductivity="2.4",
    density="2500",
    spec_heat="1000",
    therm_absp="0.92",
    sol_absp=subtraction_2,
    vis_absp=subtraction_2)  # -> mat; plug-in component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
opaquemat_4 = HBOpaqueMaterial(
    name="Intonaco_interno",
    thickness="0.02",
    conductivity="0.7",
    density="1500",
    spec_heat="1000",
    therm_absp="0.9",
    sol_absp=subtraction_4,
    vis_absp=subtraction_4)  # -> mat; plug-in component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
panel = Panel("Stone Masonry Medium Insulated")
economical_cobenefit = Panel("EMPLOYMENT AND INCOME GENERATION")
environmental_cobenefit = Panel("AIR QUALITY")
social_cobenefit = Panel("HEALTH IMPACTS")
merge = Merge(Data1=opaquemat, Data2=opaquemat_2, Data3=opaquemat_3, Data4=opaquemat_4)
albedo_5 = Panel("0.65")
thermalemissivity = Panel("0.90")
name = Data(panel)
name_2 = ClusterOutput(name)
opaqueconstr = HBOpaqueConstruction(name=panel, materials=merge)  # -> constr; plug-in component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
economic_cobenefit = Text(economical_cobenefit)
social_cobenefit_2 = Text(social_cobenefit)
thermalemissivity_2 = Number(thermalemissivity)
albedo_6 = Number(albedo_5)
environmental_cobenefit_2 = Text(environmental_cobenefit)
decnstrconstr = HBDeconstructConstruction(constr=opaqueconstr)  # -> materials, layers, r_val_si, r_val_ip, u_fac_si, u_fac_ip, shgc, t_sol, t_vis; plug-in component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
economic_cobenefit_2 = ClusterOutput(economic_cobenefit)
albedo_7 = ClusterOutput(albedo_6)
thermalemissivity_3 = ClusterOutput(thermalemissivity_2)
constr = ClusterOutput(opaqueconstr)
environmental_cobenefit_3 = ClusterOutput(environmental_cobenefit_2)
social_cobenefit_3 = ClusterOutput(social_cobenefit_2)
u_fac_si = ClusterOutput(decnstrconstr.u_fac_si)

# ==== cluster Muratura_pietra_altamente_isolato
albedo = Panel("0.300")
albedo_2 = Panel("0.700")
albedo_3 = Panel("0.650")
albedo_4 = Panel("0.650")
subtraction = Subtraction(A="1", B=albedo_2)
subtraction_2 = Subtraction(A="1", B=albedo)
subtraction_3 = Subtraction(A="1", B=albedo_3)
subtraction_4 = Subtraction(A="1", B=albedo_4)
opaquemat = HBOpaqueMaterial(
    name="Intonaco_esterno",
    thickness="0.02",
    conductivity="0.7",
    density="1500",
    spec_heat="1000",
    therm_absp="0.9",
    sol_absp=subtraction_3,
    vis_absp=subtraction_3)  # -> mat; plug-in component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
opaquemat_2 = HBOpaqueMaterial(
    name="Isolante",
    thickness="0.1",
    conductivity="0.032",
    density="30",
    spec_heat="1250",
    therm_absp="0.1",
    sol_absp=subtraction,
    vis_absp=subtraction)  # -> mat; plug-in component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
opaquemat_3 = HBOpaqueMaterial(
    name="Pietra",
    thickness="0.5",
    conductivity="2.4",
    density="2500",
    spec_heat="1000",
    therm_absp="0.92",
    sol_absp=subtraction_2,
    vis_absp=subtraction_2)  # -> mat; plug-in component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
opaquemat_4 = HBOpaqueMaterial(
    name="Intonaco_interno",
    thickness="0.02",
    conductivity="0.7",
    density="1500",
    spec_heat="1000",
    therm_absp="0.9",
    sol_absp=subtraction_4,
    vis_absp=subtraction_4)  # -> mat; plug-in component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
panel = Panel("Stone Masonry Highly Insulated")
economical_cobenefit = Panel("EMPLOYMENT AND INCOME GENERATION")
social_cobenefit = Panel("HEALTH IMPACTS")
environmental_cobenefit = Panel("AIR QUALITY")
merge = Merge(Data1=opaquemat, Data2=opaquemat_2, Data3=opaquemat_3, Data4=opaquemat_4)
albedo_5 = Panel("0.65")
thermalemissivity = Panel("0.90")
name = Data(panel)
name_2 = ClusterOutput(name)
opaqueconstr = HBOpaqueConstruction(name=panel, materials=merge)  # -> constr; plug-in component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
economic_cobenefit = Text(economical_cobenefit)
social_cobenefit_2 = Text(social_cobenefit)
thermalemissivity_2 = Number(thermalemissivity)
decnstrconstr = HBDeconstructConstruction(constr=opaqueconstr)  # -> materials, layers, r_val_si, r_val_ip, u_fac_si, u_fac_ip, shgc, t_sol, t_vis; plug-in component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
albedo_6 = Number(albedo_5)
environmental_cobenefit_2 = Text(environmental_cobenefit)
constr = ClusterOutput(opaqueconstr)
economic_cobenefit_2 = ClusterOutput(economic_cobenefit)
albedo_7 = ClusterOutput(albedo_6)
thermalemissivity_3 = ClusterOutput(thermalemissivity_2)
environmental_cobenefit_3 = ClusterOutput(environmental_cobenefit_2)
social_cobenefit_3 = ClusterOutput(social_cobenefit_2)
u_fac_si = ClusterOutput(decnstrconstr.u_fac_si)
panel_2 = Panel(decnstrconstr.u_fac_si)

# ==== cluster Muratura_mattoni_non_isolato
albedo = Panel("0.650")
albedo_2 = Panel("0.650")
albedo_3 = Panel("0.400")
subtraction = Subtraction(A="1", B=albedo_3)
subtraction_2 = Subtraction(A="1", B=albedo_2)
subtraction_3 = Subtraction(A="1", B=albedo)
opaquemat = HBOpaqueMaterial(
    name="Mattoni_pieni",
    thickness="0.4",
    conductivity="0.78",
    density="1800",
    spec_heat="840",
    therm_absp="0.95",
    sol_absp=subtraction,
    vis_absp=subtraction)  # -> mat; plug-in component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
opaquemat_2 = HBOpaqueMaterial(
    name="Intonaco_interno",
    thickness="0.02",
    conductivity="0.7",
    density="1500",
    spec_heat="1000",
    therm_absp="0.9",
    sol_absp=subtraction_2,
    vis_absp=subtraction_2)  # -> mat; plug-in component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
opaquemat_3 = HBOpaqueMaterial(
    name="Intonaco_esterno",
    thickness="0.02",
    conductivity="0.7",
    density="1500",
    spec_heat="1000",
    therm_absp="0.9",
    sol_absp=subtraction_3,
    vis_absp=subtraction_3)  # -> mat; plug-in component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
panel = Panel("Brick Masonry Not-Insulated")
merge = Merge(Data1=opaquemat_3, Data2=opaquemat, Data3=opaquemat_2)
economical_cobenefit = Panel("EMPLOYMENT AND INCOME GENERATION")
environmental_cobenefit = Panel("AIR QUALITY")
social_cobenefit = Panel("HEALTH IMPACTS")
name = Data(panel)
albedo_4 = Panel("0.65")
thermalemissivity = Panel("0.90")
name_2 = ClusterOutput(name)
opaqueconstr = HBOpaqueConstruction(name=panel, materials=merge)  # -> constr; plug-in component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
economic_cobenefit = Text(economical_cobenefit)
social_cobenefit_2 = Text(social_cobenefit)
thermalemissivity_2 = Number(thermalemissivity)
albedo_5 = Number(albedo_4)
environmental_cobenefit_2 = Text(environmental_cobenefit)
decnstrconstr = HBDeconstructConstruction(constr=opaqueconstr)  # -> materials, layers, r_val_si, r_val_ip, u_fac_si, u_fac_ip, shgc, t_sol, t_vis; plug-in component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
constr = ClusterOutput(opaqueconstr)
economic_cobenefit_2 = ClusterOutput(economic_cobenefit)
albedo_6 = ClusterOutput(albedo_5)
thermalemissivity_3 = ClusterOutput(thermalemissivity_2)
environmental_cobenefit_3 = ClusterOutput(environmental_cobenefit_2)
social_cobenefit_3 = ClusterOutput(social_cobenefit_2)
u_fac_si = ClusterOutput(decnstrconstr.u_fac_si)
panel_2 = Panel(decnstrconstr.u_fac_si)

# ==== cluster Muratura_mattoni_medio_isolato
panel = Panel("0.1")
albedo = Panel("0.400")
albedo_2 = Panel("0.650")
albedo_3 = Panel("0.700")
albedo_4 = Panel("0.650")
subtraction = Subtraction(A="1", B=albedo_3)
subtraction_2 = Subtraction(A="1", B=albedo)
subtraction_3 = Subtraction(A="1", B=albedo_2)
subtraction_4 = Subtraction(A="1", B=albedo_4)
opaquemat = HBOpaqueMaterial(
    name="Intonaco_esterno",
    thickness="0.02",
    conductivity="0.7",
    density="1500",
    spec_heat="1000",
    therm_absp="0.9",
    sol_absp=subtraction_3,
    vis_absp=subtraction_3)  # -> mat; plug-in component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
opaquemat_2 = HBOpaqueMaterial(
    name="Isolante",
    thickness="0.05",
    conductivity="0.045",
    density="100",
    spec_heat="840",
    therm_absp=albedo_3,
    sol_absp=subtraction,
    vis_absp=subtraction)  # -> mat; plug-in component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
opaquemat_3 = HBOpaqueMaterial(
    name="Mattoni_pieni",
    thickness="0.4",
    conductivity="0.78",
    density="1800",
    spec_heat="840",
    therm_absp="0.9",
    sol_absp=subtraction_2,
    vis_absp=subtraction_2)  # -> mat; plug-in component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
opaquemat_4 = HBOpaqueMaterial(
    name="Intonaco_interno",
    thickness="0.02",
    conductivity="0.7",
    density="1500",
    spec_heat="1000",
    therm_absp="0.9",
    sol_absp=subtraction_4,
    vis_absp=subtraction_4)  # -> mat; plug-in component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
panel_2 = Panel("Brick Masonry Medium Insulated")
economical_cobenefit = Panel("EMPLOYMENT AND INCOME GENERATION")
social_cobenefit = Panel("HEALTH IMPACTS")
environmental_cobenefit = Panel("AIR QUALITY")
merge = Merge(Data1=opaquemat, Data2=opaquemat_2, Data3=opaquemat_3, Data4=opaquemat_4)
name = Data(panel_2)
albedo_5 = Panel("0.65")
thermalemissivity = Panel("0.90")
name_2 = ClusterOutput(name)
opaqueconstr = HBOpaqueConstruction(name=panel_2, materials=merge)  # -> constr; plug-in component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
economic_cobenefit = Text(economical_cobenefit)
decnstrconstr = HBDeconstructConstruction(constr=opaqueconstr)  # -> materials, layers, r_val_si, r_val_ip, u_fac_si, u_fac_ip, shgc, t_sol, t_vis; plug-in component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
social_cobenefit_2 = Text(social_cobenefit)
thermalemissivity_2 = Number(thermalemissivity)
albedo_6 = Number(albedo_5)
environmental_cobenefit_2 = Text(environmental_cobenefit)
constr = ClusterOutput(opaqueconstr)
economic_cobenefit_2 = ClusterOutput(economic_cobenefit)
albedo_7 = ClusterOutput(albedo_6)
thermalemissivity_3 = ClusterOutput(thermalemissivity_2)
environmental_cobenefit_3 = ClusterOutput(environmental_cobenefit_2)
social_cobenefit_3 = ClusterOutput(social_cobenefit_2)
panel_3 = Panel(decnstrconstr.u_fac_si)
u_fac_si = ClusterOutput(decnstrconstr.u_fac_si)

# ==== cluster Muratura_mattoni_altamente_isolato
albedo = Panel("0.400")
albedo_2 = Panel("0.700")
albedo_3 = Panel("0.650")
albedo_4 = Panel("0.650")
subtraction = Subtraction(A="1", B=albedo_2)
subtraction_2 = Subtraction(A="1", B=albedo)
subtraction_3 = Subtraction(A="1", B=albedo_4)
subtraction_4 = Subtraction(A="1", B=albedo_3)
opaquemat = HBOpaqueMaterial(
    name="Intonaco_esterno",
    thickness="0.02",
    conductivity="0.7",
    density="1500",
    spec_heat="1000",
    therm_absp="0.9",
    sol_absp=subtraction_3,
    vis_absp=subtraction_3)  # -> mat; plug-in component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
opaquemat_2 = HBOpaqueMaterial(
    name="Isolante",
    thickness="0.1",
    conductivity="0.032",
    density="30",
    spec_heat="1250",
    therm_absp="0.1",
    sol_absp=subtraction,
    vis_absp=subtraction)  # -> mat; plug-in component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
opaquemat_3 = HBOpaqueMaterial(
    name="Mattoni_pieni",
    thickness="0.4",
    conductivity="0.78",
    density="1800",
    spec_heat="840",
    therm_absp="0.95",
    sol_absp=subtraction_2,
    vis_absp=subtraction_2)  # -> mat; plug-in component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
opaquemat_4 = HBOpaqueMaterial(
    name="Intonaco_interno",
    thickness="0.02",
    conductivity="0.7",
    density="1500",
    spec_heat="1000",
    therm_absp="0.9",
    sol_absp=subtraction_4,
    vis_absp=subtraction_4)  # -> mat; plug-in component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
panel = Panel("Brick Masonry Highly Insulated")
merge = Merge(Data1=opaquemat, Data2=opaquemat_2, Data3=opaquemat_3, Data4=opaquemat_4)
name = Data(panel)
name_2 = ClusterOutput(name)
economical_cobenefit = Panel("EMPLOYMENT AND INCOME GENERATION")
environmental_cobenefit = Panel("AIR QUALITY")
social_cobenefit = Panel("HEALTH IMPACTS")
opaqueconstr = HBOpaqueConstruction(name=panel, materials=merge)  # -> constr; plug-in component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
albedo_5 = Panel("0.65")
thermalemissivity = Panel("0.90")
decnstrconstr = HBDeconstructConstruction(constr=opaqueconstr)  # -> materials, layers, r_val_si, r_val_ip, u_fac_si, u_fac_ip, shgc, t_sol, t_vis; plug-in component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
constr = ClusterOutput(opaqueconstr)
economic_cobenefit = Text(economical_cobenefit)
social_cobenefit_2 = Text(social_cobenefit)
thermalemissivity_2 = Number(thermalemissivity)
albedo_6 = Number(albedo_5)
environmental_cobenefit_2 = Text(environmental_cobenefit)
u_fac_si = ClusterOutput(decnstrconstr.u_fac_si)
economic_cobenefit_2 = ClusterOutput(economic_cobenefit)
panel_2 = Panel(decnstrconstr.u_fac_si)
albedo_7 = ClusterOutput(albedo_6)
thermalemissivity_3 = ClusterOutput(thermalemissivity_2)
environmental_cobenefit_3 = ClusterOutput(environmental_cobenefit_2)
social_cobenefit_3 = ClusterOutput(social_cobenefit_2)

# ==== cluster Muratura_laterizio_non_isolato
albedo = Panel("0.400")
albedo_2 = Panel("0.650")
albedo_3 = Panel("0.650")
# ENVIRONMENTAL: AIR QUALITY
# GHG EMISSIONS
# WATER RECOLLECTION AND SECURITY
# WATER QUALITY
# BIODIVERSITY
# LANDSLIDES AND WEATHERING
# SOCIAL: HEALTH IMPACTS
# PUBBLIC SPACE ACCESS
# AESTHETIC VALUE
# COMMUUNITY INCLUSION
# CULTURAL
# ECONOMIC: EMPLOYMENT AND INCOME GENERATION
# SAVINGS
# INNOVATION AND INVESTIMENT
# PROPERTY VALUE
panel = Panel("1")
subtraction = Subtraction(A="1", B=albedo)
subtraction_2 = Subtraction(A=panel, B=albedo_3)
subtraction_3 = Subtraction(A="1", B=albedo_2)
opaquemat = HBOpaqueMaterial(
    name="Laterizio_forato",
    thickness="0.3",
    conductivity="0.305",
    density="755",
    spec_heat="840",
    therm_absp="0.95",
    sol_absp=subtraction,
    vis_absp=subtraction)  # -> mat; plug-in component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
opaquemat_2 = HBOpaqueMaterial(
    name="Intonaco_interno",
    thickness="0.02",
    conductivity="0.7",
    density="1500",
    spec_heat="1000",
    therm_absp="0.9",
    sol_absp=subtraction_2,
    vis_absp=subtraction_2)  # -> mat; plug-in component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
opaquemat_3 = HBOpaqueMaterial(
    name="Intonaco_esterno",
    thickness="0.02",
    conductivity="0.7",
    density="1500",
    spec_heat="1000",
    therm_absp="0.9",
    sol_absp=subtraction_3,
    vis_absp=subtraction_3)  # -> mat; plug-in component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
merge = Merge(Data1=opaquemat_3, Data2=opaquemat, Data3=opaquemat_2)
panel_2 = Panel("Brick Masonry Not-Insulated")
economical_cobenefit = Panel("EMPLOYMENT AND INCOME GENERATION")
social_cobenefit = Panel("HEALTH IMPACTS")
environmental_cobenefit = Panel("AIR QUALITY")
thermalemissivity = Panel("0.90")
albedo_4 = Panel("0.65")
opaqueconstr = HBOpaqueConstruction(name=panel_2, materials=merge)  # -> constr; plug-in component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
economic_cobenefit = Text(economical_cobenefit)
social_cobenefit_2 = Text(social_cobenefit)
thermalemissivity_2 = Number(thermalemissivity)
albedo_5 = Number(albedo_4)
environmental_cobenefit_2 = Text(environmental_cobenefit)
economic_cobenefit_2 = ClusterOutput(economic_cobenefit)
name = Data(panel_2)
albedo_6 = ClusterOutput(albedo_5)
thermalemissivity_3 = ClusterOutput(thermalemissivity_2)
constr = ClusterOutput(opaqueconstr)
environmental_cobenefit_3 = ClusterOutput(environmental_cobenefit_2)
social_cobenefit_3 = ClusterOutput(social_cobenefit_2)
name_2 = ClusterOutput(name)
decnstrconstr = HBDeconstructConstruction(constr=opaqueconstr)  # -> materials, layers, r_val_si, r_val_ip, u_fac_si, u_fac_ip, shgc, t_sol, t_vis; plug-in component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
panel_3 = Panel(decnstrconstr.u_fac_si)
u_fac_si = ClusterOutput(decnstrconstr.u_fac_si)

# ==== cluster Muratura_laterizio_isolato
albedo = Panel("0.7")
albedo_2 = Panel("0.650")
albedo_3 = Panel("0.650")
albedo_4 = Panel("0.400")
subtraction = Subtraction(A="1", B=albedo)
subtraction_2 = Subtraction(A="1", B=albedo_2)
subtraction_3 = Subtraction(A="1", B=albedo_4)
subtraction_4 = Subtraction(A="1", B=albedo_3)
opaquemat = HBOpaqueMaterial(
    name="Isolante",
    thickness="0.1",
    conductivity="0.032",
    density="30",
    spec_heat="1250",
    therm_absp="0.1",
    sol_absp=subtraction,
    vis_absp=subtraction)  # -> mat; plug-in component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
opaquemat_2 = HBOpaqueMaterial(
    name="Intonaco_esterno",
    thickness="0.02",
    conductivity="0.7",
    density="1500",
    spec_heat="1000",
    therm_absp="0.9",
    sol_absp=subtraction_2,
    vis_absp=subtraction_2)  # -> mat; plug-in component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
opaquemat_3 = HBOpaqueMaterial(
    name="Laterizio_forato",
    thickness="0.3",
    conductivity="0.305",
    density="755",
    spec_heat="840",
    therm_absp="0.95",
    sol_absp=subtraction_3,
    vis_absp=subtraction_3)  # -> mat; plug-in component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
opaquemat_4 = HBOpaqueMaterial(
    name="Intonaco_interno",
    thickness="0.02",
    conductivity="0.7",
    density="1500",
    spec_heat="1000",
    therm_absp="0.9",
    sol_absp=subtraction_4,
    vis_absp=subtraction_4)  # -> mat; plug-in component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
panel = Panel("Brick Masonry Insulated")
merge = Merge(Data1=opaquemat_2, Data2=opaquemat, Data3=opaquemat_3, Data4=opaquemat_4)
economical_cobenefit = Panel("EMPLOYMENT AND INCOME GENERATION")
environmental_cobenefit = Panel("AIR QUALITY")
social_cobenefit = Panel("HEALTH IMPACTS")
thermalemissivity = Panel("0.90")
albedo_5 = Panel("0.65")
opaqueconstr = HBOpaqueConstruction(name=panel, materials=merge)  # -> constr; plug-in component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
name = Data(panel)
decnstrconstr = HBDeconstructConstruction(constr=opaqueconstr)  # -> materials, layers, r_val_si, r_val_ip, u_fac_si, u_fac_ip, shgc, t_sol, t_vis; plug-in component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
economic_cobenefit = Text(economical_cobenefit)
social_cobenefit_2 = Text(social_cobenefit)
thermalemissivity_2 = Number(thermalemissivity)
constr = ClusterOutput(opaqueconstr)
albedo_6 = Number(albedo_5)
environmental_cobenefit_2 = Text(environmental_cobenefit)
economic_cobenefit_2 = ClusterOutput(economic_cobenefit)
albedo_7 = ClusterOutput(albedo_6)
thermalemissivity_3 = ClusterOutput(thermalemissivity_2)
environmental_cobenefit_3 = ClusterOutput(environmental_cobenefit_2)
social_cobenefit_3 = ClusterOutput(social_cobenefit_2)
u_fac_si = ClusterOutput(decnstrconstr.u_fac_si)
name_2 = ClusterOutput(name)
panel_2 = Panel(decnstrconstr.u_fac_si)

# ==== cluster Muratura_lateerizio_altamente_isolato
albedo = Panel("0.650")
albedo_2 = Panel("0.7")
albedo_3 = Panel("0.650")
albedo_4 = Panel("0.400")
subtraction = Subtraction(A="1", B=albedo_2)
subtraction_2 = Subtraction(A="1", B=albedo)
subtraction_3 = Subtraction(A="1", B=albedo_4)
subtraction_4 = Subtraction(A="1", B=albedo_3)
opaquemat = HBOpaqueMaterial(
    name="Isolante",
    thickness="0.14",
    conductivity="0.032",
    density="30",
    spec_heat="1250",
    therm_absp="0.1",
    sol_absp=subtraction,
    vis_absp=subtraction)  # -> mat; plug-in component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
opaquemat_2 = HBOpaqueMaterial(
    name="Intonaco_esterno",
    thickness="0.02",
    conductivity="0.7",
    density="1500",
    spec_heat="1000",
    therm_absp="0.9",
    sol_absp=subtraction_2,
    vis_absp=subtraction_2)  # -> mat; plug-in component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
opaquemat_3 = HBOpaqueMaterial(
    name="Laterizio_forato",
    thickness="0.3",
    conductivity="0.305",
    density="755",
    spec_heat="840",
    therm_absp="0.95",
    sol_absp=subtraction_3,
    vis_absp=subtraction_3)  # -> mat; plug-in component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
opaquemat_4 = HBOpaqueMaterial(
    name="Intonaco_interno",
    thickness="0.02",
    conductivity="0.7",
    density="1500",
    spec_heat="1000",
    therm_absp="0.9",
    sol_absp=subtraction_4,
    vis_absp=subtraction_4)  # -> mat; plug-in component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
panel = Panel("Brick Masonry Highly Insulated")
merge = Merge(Data1=opaquemat_2, Data2=opaquemat, Data3=opaquemat_3, Data4=opaquemat_4)
economical_cobenefit = Panel("EMPLOYMENT AND INCOME GENERATION")
social_cobenefit = Panel("HEALTH IMPACTS")
environmental_cobenefit = Panel("AIR QUALITY")
thermalemissivity = Panel("0.90")
albedo_5 = Panel("0.65")
opaqueconstr = HBOpaqueConstruction(name=panel, materials=merge)  # -> constr; plug-in component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
economic_cobenefit = Text(economical_cobenefit)
name = Data(panel)
social_cobenefit_2 = Text(social_cobenefit)
thermalemissivity_2 = Number(thermalemissivity)
albedo_6 = Number(albedo_5)
environmental_cobenefit_2 = Text(environmental_cobenefit)
decnstrconstr = HBDeconstructConstruction(constr=opaqueconstr)  # -> materials, layers, r_val_si, r_val_ip, u_fac_si, u_fac_ip, shgc, t_sol, t_vis; plug-in component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
constr = ClusterOutput(opaqueconstr)
name_2 = ClusterOutput(name)
economic_cobenefit_2 = ClusterOutput(economic_cobenefit)
albedo_7 = ClusterOutput(albedo_6)
thermalemissivity_3 = ClusterOutput(thermalemissivity_2)
environmental_cobenefit_3 = ClusterOutput(environmental_cobenefit_2)
social_cobenefit_3 = ClusterOutput(social_cobenefit_2)
panel_2 = Panel(decnstrconstr.u_fac_si)
u_fac_si = ClusterOutput(decnstrconstr.u_fac_si)

# ==== cluster Muratura_blocco_termico_isolato
albedo = Panel("0.650")
albedo_2 = Panel("0.400")
albedo_3 = Panel("0.7")
albedo_4 = Panel("0.650")
subtraction = Subtraction(A="1", B=albedo_3)
subtraction_2 = Subtraction(A="1", B=albedo)
subtraction_3 = Subtraction(A="1", B=albedo_2)
subtraction_4 = Subtraction(A="1", B=albedo_4)
opaquemat = HBOpaqueMaterial(
    name="Isolante",
    thickness="0.1",
    conductivity="0.032",
    density="30",
    spec_heat="1250",
    therm_absp="0.1",
    sol_absp=subtraction,
    vis_absp=subtraction)  # -> mat; plug-in component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
opaquemat_2 = HBOpaqueMaterial(
    name="Intonaco_esterno",
    thickness="0.02",
    conductivity="0.7",
    density="1500",
    spec_heat="1000",
    therm_absp="0.9",
    sol_absp=subtraction_2,
    vis_absp=subtraction_2)  # -> mat; plug-in component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
opaquemat_3 = HBOpaqueMaterial(
    name="Blocco_termico",
    thickness="0.3",
    conductivity="0.223",
    density="550",
    spec_heat="1000",
    therm_absp="0.95",
    sol_absp=subtraction_3,
    vis_absp=subtraction_3)  # -> mat; plug-in component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
opaquemat_4 = HBOpaqueMaterial(
    name="Intonaco_interno",
    thickness="0.02",
    conductivity="0.7",
    density="1500",
    spec_heat="1000",
    therm_absp="0.9",
    sol_absp=subtraction_4,
    vis_absp=subtraction_4)  # -> mat; plug-in component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
panel = Panel("Thermal Block Masonry Insulated")
economical_cobenefit = Panel("EMPLOYMENT AND INCOME GENERATION")
social_cobenefit = Panel("HEALTH IMPACTS")
environmental_cobenefit = Panel("AIR QUALITY")
merge = Merge(Data1=opaquemat_2, Data2=opaquemat, Data3=opaquemat_3, Data4=opaquemat_4)
albedo_5 = Panel("0.65")
thermalemissivity = Panel("0.90")
name = Data(panel)
opaqueconstr = HBOpaqueConstruction(name=panel, materials=merge)  # -> constr; plug-in component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
economic_cobenefit = Text(economical_cobenefit)
social_cobenefit_2 = Text(social_cobenefit)
thermalemissivity_2 = Number(thermalemissivity)
albedo_6 = Number(albedo_5)
environmental_cobenefit_2 = Text(environmental_cobenefit)
name_2 = ClusterOutput(name)
decnstrconstr = HBDeconstructConstruction(constr=opaqueconstr)  # -> materials, layers, r_val_si, r_val_ip, u_fac_si, u_fac_ip, shgc, t_sol, t_vis; plug-in component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
economic_cobenefit_2 = ClusterOutput(economic_cobenefit)
constr = ClusterOutput(opaqueconstr)
albedo_7 = ClusterOutput(albedo_6)
thermalemissivity_3 = ClusterOutput(thermalemissivity_2)
environmental_cobenefit_3 = ClusterOutput(environmental_cobenefit_2)
social_cobenefit_3 = ClusterOutput(social_cobenefit_2)
u_fac_si = ClusterOutput(decnstrconstr.u_fac_si)
panel_2 = Panel(decnstrconstr.u_fac_si)

# ==== cluster Muratura_blocco_termico_altamente_isolato
panel = Panel("0.95")
albedo = Panel("0.650")
albedo_2 = Panel("0.650")
albedo_3 = Panel("0.400")
albedo_4 = Panel("0.7")
subtraction = Subtraction(A="1", B=albedo_4)
subtraction_2 = Subtraction(A="1", B=albedo_2)
subtraction_3 = Subtraction(A="1", B=albedo_3)
subtraction_4 = Subtraction(A="1", B=albedo)
opaquemat = HBOpaqueMaterial(
    name="Isolante",
    thickness="0.14",
    conductivity="0.032",
    density="30",
    spec_heat="1250",
    therm_absp="0.1",
    sol_absp=subtraction,
    vis_absp=subtraction)  # -> mat; plug-in component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
opaquemat_2 = HBOpaqueMaterial(
    name="Intonaco_esterno",
    thickness="0.02",
    conductivity="0.7",
    density="1500",
    spec_heat="1000",
    therm_absp="0.9",
    sol_absp=subtraction_2,
    vis_absp=subtraction_2)  # -> mat; plug-in component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
opaquemat_3 = HBOpaqueMaterial(
    name="Blocco_termico_EPS",
    thickness="0.3",
    conductivity="0.065",
    density="550",
    spec_heat="1000",
    therm_absp=albedo_3,
    sol_absp=subtraction_3,
    vis_absp=subtraction_3)  # -> mat; plug-in component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
opaquemat_4 = HBOpaqueMaterial(
    name="Intonaco_interno",
    thickness="0.02",
    conductivity="0.7",
    density="1500",
    spec_heat="1000",
    therm_absp="0.9",
    sol_absp=subtraction_4,
    vis_absp=subtraction_4)  # -> mat; plug-in component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
panel_2 = Panel("Thermal Block Masonry Highly Insulated")
merge = Merge(Data1=opaquemat_2, Data2=opaquemat, Data3=opaquemat_3, Data4=opaquemat_4)
economical_cobenefit = Panel("EMPLOYMENT AND INCOME GENERATION")
environmental_cobenefit = Panel("AIR QUALITY")
social_cobenefit = Panel("HEALTH IMPACTS")
albedo_5 = Panel("0.65")
thermalemissivity = Panel("0.90")
name = Data(panel_2)
name_2 = ClusterOutput(name)
opaqueconstr = HBOpaqueConstruction(name=panel_2, materials=merge)  # -> constr; plug-in component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
economic_cobenefit = Text(economical_cobenefit)
social_cobenefit_2 = Text(social_cobenefit)
thermalemissivity_2 = Number(thermalemissivity)
albedo_6 = Number(albedo_5)
environmental_cobenefit_2 = Text(environmental_cobenefit)
decnstrconstr = HBDeconstructConstruction(constr=opaqueconstr)  # -> materials, layers, r_val_si, r_val_ip, u_fac_si, u_fac_ip, shgc, t_sol, t_vis; plug-in component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
constr = ClusterOutput(opaqueconstr)
economic_cobenefit_2 = ClusterOutput(economic_cobenefit)
albedo_7 = ClusterOutput(albedo_6)
thermalemissivity_3 = ClusterOutput(thermalemissivity_2)
environmental_cobenefit_3 = ClusterOutput(environmental_cobenefit_2)
social_cobenefit_3 = ClusterOutput(social_cobenefit_2)
panel_3 = Panel(decnstrconstr.u_fac_si)
u_fac_si = ClusterOutput(decnstrconstr.u_fac_si)

# ==== cluster Muratura_calcestruzzo_non_isolato
albedo = Panel("0.25")
albedo_2 = Panel("0.25")
albedo_3 = Panel("0.650")
albedo_4 = Panel("0.650")
subtraction = Subtraction(A="1", B=albedo_2)
subtraction_2 = Subtraction(A="1", B=albedo)
subtraction_3 = Subtraction(A="1", B=albedo_3)
subtraction_4 = Subtraction(A="1", B=albedo_4)
opaquemat = HBOpaqueMaterial(
    name="custom_air_gap",
    thickness="0.05",
    conductivity="0.278",
    density="1.28",
    spec_heat="1000",
    roughness="Smooth",
    therm_absp="0.9",
    sol_absp="0.7",
    vis_absp="0.7")  # -> mat; plug-in component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
opaquemat_2 = HBOpaqueMaterial(
    name="Calcestruzzo",
    thickness="0.2",
    conductivity="1.7",
    density="2400",
    spec_heat="1000",
    therm_absp="0.9",
    sol_absp=subtraction,
    vis_absp=subtraction)  # -> mat; plug-in component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
opaquemat_3 = HBOpaqueMaterial(
    name="Calcestruzzo",
    thickness="0.2",
    conductivity="1.7",
    density="2400",
    spec_heat="1000",
    therm_absp="0.9",
    sol_absp=subtraction_2,
    vis_absp=subtraction_2)  # -> mat; plug-in component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
opaquemat_4 = HBOpaqueMaterial(
    name="Intonaco_esterno",
    thickness="0.02",
    conductivity="0.7",
    density="1500",
    spec_heat="1000",
    therm_absp="0.9",
    sol_absp=subtraction_3,
    vis_absp=subtraction_3)  # -> mat; plug-in component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
opaquemat_5 = HBOpaqueMaterial(
    name="Intonaco_interno",
    thickness="0.02",
    conductivity="0.7",
    density="1500",
    spec_heat="1000",
    therm_absp="0.9",
    sol_absp=subtraction_4,
    vis_absp=subtraction_4)  # -> mat; plug-in component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
panel = Panel("Concrete Masonry Not-Insulated")
merge = Merge(Data1=opaquemat_4, Data2=opaquemat_3, Data3=opaquemat, Data4=opaquemat_2, Data5=opaquemat_5)
economical_cobenefit = Panel("EMPLOYMENT AND INCOME GENERATION")
environmental_cobenefit = Panel("AIR QUALITY")
social_cobenefit = Panel("HEALTH IMPACTS")
thermalemissivity = Panel("0.90")
albedo_5 = Panel("0.65")
name = Data(panel)
opaqueconstr = HBOpaqueConstruction(name=panel, materials=merge)  # -> constr; plug-in component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
name_2 = ClusterOutput(name)
economic_cobenefit = Text(economical_cobenefit)
decnstrconstr = HBDeconstructConstruction(constr=opaqueconstr)  # -> materials, layers, r_val_si, r_val_ip, u_fac_si, u_fac_ip, shgc, t_sol, t_vis; plug-in component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
constr = ClusterOutput(opaqueconstr)
social_cobenefit_2 = Text(social_cobenefit)
thermalemissivity_2 = Number(thermalemissivity)
albedo_6 = Number(albedo_5)
environmental_cobenefit_2 = Text(environmental_cobenefit)
economic_cobenefit_2 = ClusterOutput(economic_cobenefit)
albedo_7 = ClusterOutput(albedo_6)
thermalemissivity_3 = ClusterOutput(thermalemissivity_2)
environmental_cobenefit_3 = ClusterOutput(environmental_cobenefit_2)
social_cobenefit_3 = ClusterOutput(social_cobenefit_2)
u_fac_si = ClusterOutput(decnstrconstr.u_fac_si)
panel_2 = Panel(decnstrconstr.u_fac_si)

# ==== cluster Muratura_calcestruzzo_medio_isolato_esterno
albedo = Panel("0.650")
albedo_2 = Panel("0.7")
albedo_3 = Panel("0.25")
albedo_4 = Panel("0.25")
albedo_5 = Panel("0.650")
subtraction = Subtraction(A="1", B=albedo_2)
subtraction_2 = Subtraction(A="1", B=albedo)
subtraction_3 = Subtraction(A="1", B=albedo_3)
subtraction_4 = Subtraction(A="1", B=albedo_4)
subtraction_5 = Subtraction(A="1", B=albedo_5)
opaquemat = HBOpaqueMaterial(
    name="Isolante",
    thickness="0.05",
    conductivity="0.045",
    density="100",
    spec_heat="840",
    therm_absp="0.1",
    sol_absp=subtraction,
    vis_absp=subtraction)  # -> mat; plug-in component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
opaquemat_2 = HBOpaqueMaterial(
    name="Calcestruzzo",
    thickness="0.2",
    conductivity="1.7",
    density="2400",
    spec_heat="1000",
    therm_absp="0.9",
    sol_absp=subtraction_4,
    vis_absp=subtraction_4)  # -> mat; plug-in component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
opaquemat_3 = HBOpaqueMaterial(
    name="Intonaco_esterno",
    thickness="0.02",
    conductivity="0.7",
    density="1500",
    spec_heat="1000",
    therm_absp="0.9",
    sol_absp=subtraction_2,
    vis_absp=subtraction_2)  # -> mat; plug-in component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
opaquemat_4 = HBOpaqueMaterial(
    name="custom_air_gap",
    thickness="0.05",
    conductivity="0.278",
    density="1.28",
    spec_heat="1000",
    roughness="Smooth",
    therm_absp="0.9",
    sol_absp="0.7",
    vis_absp="0.7")  # -> mat; plug-in component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
opaquemat_5 = HBOpaqueMaterial(
    name="Calcestruzzo",
    thickness="0.2",
    conductivity="1.7",
    density="2400",
    spec_heat="1000",
    therm_absp="0.9",
    sol_absp=subtraction_3,
    vis_absp=subtraction_3)  # -> mat; plug-in component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
opaquemat_6 = HBOpaqueMaterial(
    name="Intonaco_interno",
    thickness="0.02",
    conductivity="0.7",
    density="1500",
    spec_heat="1000",
    therm_absp="0.9",
    sol_absp=subtraction_5,
    vis_absp=subtraction_5)  # -> mat; plug-in component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
panel = Panel("Concrete Masonry Medium Insulated External")
economical_cobenefit = Panel("EMPLOYMENT AND INCOME GENERATION")
environmental_cobenefit = Panel("AIR QUALITY")
social_cobenefit = Panel("HEALTH IMPACTS")
merge = Merge(Data1=opaquemat_3, Data2=opaquemat, Data3=opaquemat_2, Data4=opaquemat_4, Data5=opaquemat_5, Data6=opaquemat_6)
thermalemissivity = Panel("0.90")
albedo_6 = Panel("0.65")
opaqueconstr = HBOpaqueConstruction(name=panel, materials=merge)  # -> constr; plug-in component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
name = Data(panel)
economic_cobenefit = Text(economical_cobenefit)
name_2 = ClusterOutput(name)
social_cobenefit_2 = Text(social_cobenefit)
thermalemissivity_2 = Number(thermalemissivity)
albedo_7 = Number(albedo_6)
decnstrconstr = HBDeconstructConstruction(constr=opaqueconstr)  # -> materials, layers, r_val_si, r_val_ip, u_fac_si, u_fac_ip, shgc, t_sol, t_vis; plug-in component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
environmental_cobenefit_2 = Text(environmental_cobenefit)
constr = ClusterOutput(opaqueconstr)
economic_cobenefit_2 = ClusterOutput(economic_cobenefit)
albedo_8 = ClusterOutput(albedo_7)
thermalemissivity_3 = ClusterOutput(thermalemissivity_2)
environmental_cobenefit_3 = ClusterOutput(environmental_cobenefit_2)
social_cobenefit_3 = ClusterOutput(social_cobenefit_2)
u_fac_si = ClusterOutput(decnstrconstr.u_fac_si)
panel_2 = Panel(decnstrconstr.u_fac_si)

# ==== cluster Muratura_calcestruzzo_medio_isolato_interno
albedo = Panel("0.650")
albedo_2 = Panel("0.25")
albedo_3 = Panel("0.7")
albedo_4 = Panel("0.650")
albedo_5 = Panel("0.25")
subtraction = Subtraction(A="1", B=albedo_2)
subtraction_2 = Subtraction(A="1", B=albedo)
subtraction_3 = Subtraction(A="1", B=albedo_3)
subtraction_4 = Subtraction(A="1", B=albedo_5)
subtraction_5 = Subtraction(A="1", B=albedo_4)
opaquemat = HBOpaqueMaterial(
    name="Calcestruzzo",
    thickness="0.2",
    conductivity="1.7",
    density="2400",
    spec_heat="1000",
    therm_absp="0.9",
    sol_absp=subtraction,
    vis_absp=subtraction)  # -> mat; plug-in component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
opaquemat_2 = HBOpaqueMaterial(
    name="Intonaco_esterno",
    thickness="0.02",
    conductivity="0.7",
    density="1500",
    spec_heat="1000",
    therm_absp="0.9",
    sol_absp=subtraction_2,
    vis_absp=subtraction_2)  # -> mat; plug-in component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
opaquemat_3 = HBOpaqueMaterial(
    name="Isolante",
    thickness="0.05",
    conductivity="0.045",
    density="100",
    spec_heat="840",
    therm_absp="0.1",
    sol_absp=subtraction_3,
    vis_absp=subtraction_3)  # -> mat; plug-in component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
opaquemat_4 = HBOpaqueMaterial(
    name="Calcestruzzo",
    thickness="0.2",
    conductivity="1.7",
    density="2400",
    spec_heat="1000",
    therm_absp="0.9",
    sol_absp=subtraction_4,
    vis_absp=subtraction_4)  # -> mat; plug-in component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
opaquemat_5 = HBOpaqueMaterial(
    name="Intonaco_interno",
    thickness="0.02",
    conductivity="0.7",
    density="1500",
    spec_heat="1000",
    therm_absp="0.9",
    sol_absp=subtraction_5,
    vis_absp=subtraction_5)  # -> mat; plug-in component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
panel = Panel("Concrete Masonry Medium Insulated Internal")
economical_cobenefit = Panel("EMPLOYMENT AND INCOME GENERATION")
environmental_cobenefit = Panel("AIR QUALITY")
social_cobenefit = Panel("HEALTH IMPACTS")
merge = Merge(Data1=opaquemat_2, Data2=opaquemat, Data3=opaquemat_3, Data4=opaquemat_4, Data5=opaquemat_5)
albedo_6 = Panel("0.65")
thermalemissivity = Panel("0.90")
name = Data(panel)
opaqueconstr = HBOpaqueConstruction(name=panel, materials=merge)  # -> constr; plug-in component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
name_2 = ClusterOutput(name)
economic_cobenefit = Text(economical_cobenefit)
social_cobenefit_2 = Text(social_cobenefit)
thermalemissivity_2 = Number(thermalemissivity)
albedo_7 = Number(albedo_6)
environmental_cobenefit_2 = Text(environmental_cobenefit)
decnstrconstr = HBDeconstructConstruction(constr=opaqueconstr)  # -> materials, layers, r_val_si, r_val_ip, u_fac_si, u_fac_ip, shgc, t_sol, t_vis; plug-in component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
economic_cobenefit_2 = ClusterOutput(economic_cobenefit)
albedo_8 = ClusterOutput(albedo_7)
constr = ClusterOutput(opaqueconstr)
thermalemissivity_3 = ClusterOutput(thermalemissivity_2)
environmental_cobenefit_3 = ClusterOutput(environmental_cobenefit_2)
social_cobenefit_3 = ClusterOutput(social_cobenefit_2)
panel_2 = Panel(decnstrconstr.u_fac_si)
u_fac_si = ClusterOutput(decnstrconstr.u_fac_si)

# ==== cluster Muratura_calcestruzzo_altamente_isolato
albedo = Panel("0.7")
albedo_2 = Panel("0.25")
albedo_3 = Panel("0.650")
albedo_4 = Panel("0.650")
albedo_5 = Panel("0.25")
subtraction = Subtraction(A="1", B=albedo_2)
subtraction_2 = Subtraction(A="1", B=albedo)
subtraction_3 = Subtraction(A="1", B=albedo_3)
subtraction_4 = Subtraction(A="1", B=albedo_5)
subtraction_5 = Subtraction(A="1", B=albedo_4)
opaquemat = HBOpaqueMaterial(
    name="custom_air_gap",
    thickness="0.05",
    conductivity="0.278",
    density="1.28",
    spec_heat="1000",
    roughness="Smooth",
    therm_absp="0.9",
    sol_absp="0.7",
    vis_absp="0.7")  # -> mat; plug-in component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
opaquemat_2 = HBOpaqueMaterial(
    name="Calcestruzzo",
    thickness="0.2",
    conductivity="1.7",
    density="2400",
    spec_heat="1000",
    therm_absp="0.9",
    sol_absp=subtraction,
    vis_absp=subtraction)  # -> mat; plug-in component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
opaquemat_3 = HBOpaqueMaterial(
    name="Isolante",
    thickness="0.1",
    conductivity="0.032",
    density="30",
    spec_heat="1250",
    therm_absp="0.1",
    sol_absp=subtraction_2,
    vis_absp=subtraction_2)  # -> mat; plug-in component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
opaquemat_4 = HBOpaqueMaterial(
    name="Calcestruzzo",
    thickness="0.2",
    conductivity="1.7",
    density="2400",
    spec_heat="1000",
    therm_absp="0.9",
    sol_absp=subtraction_4,
    vis_absp=subtraction_4)  # -> mat; plug-in component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
opaquemat_5 = HBOpaqueMaterial(
    name="Intonaco_esterno",
    thickness="0.02",
    conductivity="0.7",
    density="1500",
    spec_heat="1000",
    therm_absp="0.9",
    sol_absp=subtraction_3,
    vis_absp=subtraction_3)  # -> mat; plug-in component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
opaquemat_6 = HBOpaqueMaterial(
    name="Intonaco_interno",
    thickness="0.02",
    conductivity="0.7",
    density="1500",
    spec_heat="1000",
    therm_absp="0.9",
    sol_absp=subtraction_5,
    vis_absp=subtraction_5)  # -> mat; plug-in component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
economical_cobenefit = Panel("EMPLOYMENT AND INCOME GENERATION")
social_cobenefit = Panel("HEALTH IMPACTS")
environmental_cobenefit = Panel("AIR QUALITY")
panel = Panel("Concrete Masonry Highly Insulated")
thermalemissivity = Panel("0.90")
albedo_6 = Panel("0.65")
merge = Merge(Data1=opaquemat_5, Data2=opaquemat_3, Data3=opaquemat_4, Data4=opaquemat, Data5=opaquemat_2, Data6=opaquemat_6)
name = Data(panel)
name_2 = ClusterOutput(name)
opaqueconstr = HBOpaqueConstruction(name=panel, materials=merge)  # -> constr; plug-in component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
economic_cobenefit = Text(economical_cobenefit)
social_cobenefit_2 = Text(social_cobenefit)
thermalemissivity_2 = Number(thermalemissivity)
albedo_7 = Number(albedo_6)
environmental_cobenefit_2 = Text(environmental_cobenefit)
economic_cobenefit_2 = ClusterOutput(economic_cobenefit)
albedo_8 = ClusterOutput(albedo_7)
thermalemissivity_3 = ClusterOutput(thermalemissivity_2)
environmental_cobenefit_3 = ClusterOutput(environmental_cobenefit_2)
social_cobenefit_3 = ClusterOutput(social_cobenefit_2)
constr = ClusterOutput(opaqueconstr)
decnstrconstr = HBDeconstructConstruction(constr=opaqueconstr)  # -> materials, layers, r_val_si, r_val_ip, u_fac_si, u_fac_ip, shgc, t_sol, t_vis; plug-in component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
u_fac_si = ClusterOutput(decnstrconstr.u_fac_si)
panel_2 = Panel(decnstrconstr.u_fac_si)

# ==== cluster PACCHETTOLEGNOASECCO
subtraction = Subtraction(A="1", B="0.7")
opaquemat = HBOpaqueMaterial(
    name="Tavolato legno grezzo",
    thickness="0.024",
    conductivity="0.26",
    density="1350",
    spec_heat="1880",
    sol_absp=subtraction,
    vis_absp=subtraction)  # -> mat; plug-in component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
opaquemat_2 = HBOpaqueMaterial(name="Fibra di legno Fibertherm® Protect 230", thickness="0.06", conductivity="0.046", density="230", spec_heat="2100")  # -> mat; plug-in component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
opaquemat_3 = HBOpaqueMaterial(name="Fibra di legno Fibertherm® Protect 230", thickness="0.06", conductivity="0.046", density="230", spec_heat="2100")  # -> mat; plug-in component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
opaquemat_4 = HBOpaqueMaterial(name="Lastra in gessofibra", thickness="0.0125", conductivity="0.32", density="1180", spec_heat="1100")  # -> mat; plug-in component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
opaquemat_5 = HBOpaqueMaterial(name="XLAM", thickness="0.12", conductivity="0.12", density="470", spec_heat="1600")  # -> mat; plug-in component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
economical_cobenefit = Panel("EMPLOYMENT AND INCOME GENERATION")
environmental_cobenefit = Panel("AIR QUALITY")
social_cobenefit = Panel("HEALTH IMPACTS")
merge = Merge(Data1=opaquemat, Data2=opaquemat_2, Data3=opaquemat_5, Data4=opaquemat_3, Data5=opaquemat_4)
albedo = Panel("0.65")
thermalemissivity = Panel("0.90")
opaqueconstr = HBOpaqueConstruction(name="DRY WOOD PACKAGE", materials=merge)  # -> constr; plug-in component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
economic_cobenefit = Text(economical_cobenefit)
social_cobenefit_2 = Text(social_cobenefit)
thermalemissivity_2 = Number(thermalemissivity)
constr = ClusterOutput(opaqueconstr)
name = Text("DRY WOOD PACKAGE")
albedo_2 = Number(albedo)
environmental_cobenefit_2 = Text(environmental_cobenefit)
decnstrconstr = HBDeconstructConstruction(constr=opaqueconstr)  # -> materials, layers, r_val_si, r_val_ip, u_fac_si, u_fac_ip, shgc, t_sol, t_vis; plug-in component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
economic_cobenefit_2 = ClusterOutput(economic_cobenefit)
albedo_3 = ClusterOutput(albedo_2)
name_2 = ClusterOutput(name)
thermalemissivity_3 = ClusterOutput(thermalemissivity_2)
environmental_cobenefit_3 = ClusterOutput(environmental_cobenefit_2)
social_cobenefit_3 = ClusterOutput(social_cobenefit_2)
panel = Panel(decnstrconstr.u_fac_si)
u_fac_si = ClusterOutput(decnstrconstr.u_fac_si)

# ==== cluster PACCHETTOACCIAIO
subtraction = Subtraction(A="1", B="0.5")
opaquemat = HBOpaqueMaterial(
    name="PACCHETTO ACCIAIO",
    thickness="0.252",
    conductivity="0.0665",
    density="72.5",
    spec_heat="2000",
    sol_absp=subtraction,
    vis_absp=subtraction)  # -> mat; plug-in component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
economical_cobenefit = Panel("EMPLOYMENT AND INCOME GENERATION")
social_cobenefit = Panel("HEALTH IMPACTS")
environmental_cobenefit = Panel("AIR QUALITY")
thermalemissivity = Panel("0.90")
albedo = Panel("0.50")
opaqueconstr = HBOpaqueConstruction(name="STEEL PACKAGE", materials=opaquemat)  # -> constr; plug-in component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
name = Text("STEEL PACKAGE")
economic_cobenefit = Text(economical_cobenefit)
name_2 = ClusterOutput(name)
constr = ClusterOutput(opaqueconstr)
social_cobenefit_2 = Text(social_cobenefit)
thermalemissivity_2 = Number(thermalemissivity)
albedo_2 = Number(albedo)
environmental_cobenefit_2 = Text(environmental_cobenefit)
decnstrconstr = HBDeconstructConstruction(constr=opaqueconstr)  # -> materials, layers, r_val_si, r_val_ip, u_fac_si, u_fac_ip, shgc, t_sol, t_vis; plug-in component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
economic_cobenefit_2 = ClusterOutput(economic_cobenefit)
albedo_3 = ClusterOutput(albedo_2)
thermalemissivity_3 = ClusterOutput(thermalemissivity_2)
environmental_cobenefit_3 = ClusterOutput(environmental_cobenefit_2)
social_cobenefit_3 = ClusterOutput(social_cobenefit_2)
panel = Panel(decnstrconstr.u_fac_si)
u_fac_si = ClusterOutput(decnstrconstr.u_fac_si)

# ==== cluster PACCHETTOLEGNOAUMIDO
subtraction = Subtraction(A="1", B="0.7")

# ---- group: LEGNO
opaquemat = HBOpaqueMaterial(name="XLAM", thickness="0.15", conductivity="0.12", density="470", spec_heat="1600")  # -> mat; plug-in component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
opaquemat_2 = HBOpaqueMaterial(name="Mapetherm ar1gg", thickness="0.01", conductivity="0.32", density="1400", spec_heat="700")  # -> mat; plug-in component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
opaquemat_3 = HBOpaqueMaterial(name="Fibra di legno Fibertherm® Protect 230", thickness="0.12", conductivity="0.046", density="230", spec_heat="2100")  # -> mat; plug-in component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
opaquemat_4 = HBOpaqueMaterial(name="Mapetherm ar1gg", thickness="0.01", conductivity="0.32", density="1400", spec_heat="700")  # -> mat; plug-in component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
opaquemat_5 = HBOpaqueMaterial(
    name="Quarzolite Tonachino",
    thickness="0.02",
    conductivity="0.89",
    density="1650",
    spec_heat="1000",
    sol_absp=subtraction,
    vis_absp=subtraction)  # -> mat; plug-in component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

# ----
economical_cobenefit = Panel("EMPLOYMENT AND INCOME GENERATION")
environmental_cobenefit = Panel("AIR QUALITY")
social_cobenefit = Panel("HEALTH IMPACTS")
merge = Merge(Data1=opaquemat_5, Data2=opaquemat_4, Data3=opaquemat_3, Data4=opaquemat_2, Data5=opaquemat)
thermalemissivity = Panel("0.90")
albedo = Panel("0.70")
opaqueconstr = HBOpaqueConstruction(name="WET WOOD PACKAGE", materials=merge)  # -> constr; plug-in component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
name = Text("WET WOOD PACKAGE")
economic_cobenefit = Text(economical_cobenefit)
social_cobenefit_2 = Text(social_cobenefit)
name_2 = ClusterOutput(name)
thermalemissivity_2 = Number(thermalemissivity)
albedo_2 = Number(albedo)
constr = ClusterOutput(opaqueconstr)
environmental_cobenefit_2 = Text(environmental_cobenefit)
decnstrconstr = HBDeconstructConstruction(constr=opaqueconstr)  # -> materials, layers, r_val_si, r_val_ip, u_fac_si, u_fac_ip, shgc, t_sol, t_vis; plug-in component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
economic_cobenefit_2 = ClusterOutput(economic_cobenefit)
albedo_3 = ClusterOutput(albedo_2)
thermalemissivity_3 = ClusterOutput(thermalemissivity_2)
environmental_cobenefit_3 = ClusterOutput(environmental_cobenefit_2)
social_cobenefit_3 = ClusterOutput(social_cobenefit_2)
u_fac_si = ClusterOutput(decnstrconstr.u_fac_si)

# ==== cluster PACCHETTOCALCESTRUZZOPARETEVENTILATA
subtraction = Subtraction(A="1", B="0.6")

# ---- group: PACCHETTO CALCESTRUZZO CON PARETE VENTILATA
opaquemat = HBOpaqueMaterial(name="intonaco interno", thickness="0.02", conductivity="0.7", density="1500", spec_heat="1000")  # -> mat; plug-in component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
opaquemat_2 = HBOpaqueMaterial(name="Blocco Termico", thickness="0.3", conductivity="0.223", density="550", spec_heat="1000")  # -> mat; plug-in component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
opaquemat_3 = HBOpaqueMaterial(name="Quarzolite Base Coat", thickness="0.002", conductivity="1", density="1580", spec_heat="1000")  # -> mat; plug-in component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
opaquemat_4 = HBOpaqueMaterial(name="Quarzolite Tonachino", thickness="0.02", conductivity="0.89", density="1650", spec_heat="1000", sol_absp="0.7")  # -> mat; plug-in component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
opaquemat_5 = HBOpaqueMaterial(
    name="Acquapanel outdoor",
    thickness="0.0125",
    conductivity="0.35",
    density="1150",
    spec_heat="1000",
    sol_absp=subtraction,
    vis_absp=subtraction)  # -> mat; plug-in component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
opaquemat_6 = HBOpaqueMaterial(name="Mapetherm EPS 100 CAM", thickness="0.1", conductivity="0.035", density="1000", spec_heat="1260")  # -> mat; plug-in component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
opaquemat_7 = HBOpaqueMaterial(name="Camera d'aria", thickness="0.1", conductivity="0.08", density="1225", spec_heat="1005")  # -> mat; plug-in component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

# ----
economical_cobenefit = Panel("EMPLOYMENT AND INCOME GENERATION")
environmental_cobenefit = Panel("AIR QUALITY")
social_cobenefit = Panel("HEALTH IMPACTS")
merge = Merge(
    Data1=opaquemat_5,
    Data2=opaquemat_7,
    Data3=opaquemat_6,
    Data4=opaquemat_4,
    Data5=opaquemat_3,
    Data6=opaquemat_2,
    Data7=opaquemat)
albedo = Panel("0.60")
thermalemissivity = Panel("0.90")
opaqueconstr = HBOpaqueConstruction(name="VENTILATED WALL", materials=merge)  # -> constr; plug-in component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
economic_cobenefit = Text(economical_cobenefit)
social_cobenefit_2 = Text(social_cobenefit)
thermalemissivity_2 = Number(thermalemissivity)
name = Text("VENTILATED WALL")
albedo_2 = Number(albedo)
environmental_cobenefit_2 = Text(environmental_cobenefit)
constr = ClusterOutput(opaqueconstr)
economic_cobenefit_2 = ClusterOutput(economic_cobenefit)
albedo_3 = ClusterOutput(albedo_2)
thermalemissivity_3 = ClusterOutput(thermalemissivity_2)
name_2 = ClusterOutput(name)
environmental_cobenefit_3 = ClusterOutput(environmental_cobenefit_2)
social_cobenefit_3 = ClusterOutput(social_cobenefit_2)
decnstrconstr = HBDeconstructConstruction(constr=opaqueconstr)  # -> materials, layers, r_val_si, r_val_ip, u_fac_si, u_fac_ip, shgc, t_sol, t_vis; plug-in component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
u_fac_si = ClusterOutput(decnstrconstr.u_fac_si)

# ==== cluster PACCHETTOCALCESTRUZZO
economical_cobenefit = Panel("EMPLOYMENT AND INCOME GENERATION")
environmental_cobenefit = Panel("AIR QUALITY")
social_cobenefit = Panel("HEALTH IMPACTS")
albedo = Panel("0.70")
thermalemissivity = Panel("0.90")
name = Text("CONCRETE PACKAGE")
economic_cobenefit = Text(economical_cobenefit)
social_cobenefit_2 = Text(social_cobenefit)
thermalemissivity_2 = Number(thermalemissivity)
albedo_2 = Number(albedo)
name_2 = ClusterOutput(name)
environmental_cobenefit_2 = Text(environmental_cobenefit)
economic_cobenefit_2 = ClusterOutput(economic_cobenefit)
albedo_3 = ClusterOutput(albedo_2)
thermalemissivity_3 = ClusterOutput(thermalemissivity_2)
environmental_cobenefit_3 = ClusterOutput(environmental_cobenefit_2)
social_cobenefit_3 = ClusterOutput(social_cobenefit_2)

# ---- group: PACCHETTO CALCESTRUZZO
panel = Panel("0.7")
panel_2 = Panel("0.002")
opaquemat = HBOpaqueMaterial(name="Quarzolite Base Coat", thickness=panel_2, conductivity="1", density="1580", spec_heat="1000")  # -> mat; plug-in component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
opaquemat_2 = HBOpaqueMaterial(name="Mapetherm ar1gg", thickness="0.01", conductivity="0.32", density="1400", spec_heat="700")  # -> mat; plug-in component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
opaquemat_3 = HBOpaqueMaterial(name="Blocco Termico", thickness="0.3", conductivity="0.223", density="550", spec_heat="1000")  # -> mat; plug-in component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
opaquemat_4 = HBOpaqueMaterial(name="Nivoplan+Planicrete", thickness="0.02", conductivity="0.95", density="1830", spec_heat="700")  # -> mat; plug-in component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
opaquemat_5 = HBOpaqueMaterial(name="Mapetherm ar1gg", thickness="0.01", conductivity="0.32", density="1400", spec_heat="700")  # -> mat; plug-in component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
opaquemat_6 = HBOpaqueMaterial(name="Mapetherm EPS 100 CAM", thickness="0.1", conductivity="0.035", density="1000", spec_heat="1260")  # -> mat; plug-in component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
opaquemat_7 = HBOpaqueMaterial(name="intonaco interno", thickness="0.02", conductivity="0.7", density="1500", spec_heat="1000")  # -> mat; plug-in component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

# ----
subtraction = Subtraction(A="1", B=panel)
num = Number(panel_2)

# ---- group: PACCHETTO CALCESTRUZZO (continued)
opaquemat_8 = HBOpaqueMaterial(
    name="Quarzolite Tonachino",
    thickness="0.02",
    conductivity="0.89",
    density="1650",
    spec_heat="1000",
    sol_absp=subtraction,
    vis_absp=subtraction)  # -> mat; plug-in component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

# ----
merge = Merge(
    Data1=opaquemat_8,
    Data2=opaquemat,
    Data3=opaquemat_2,
    Data4=opaquemat_6,
    Data5=opaquemat_5,
    Data6=opaquemat_4,
    Data7=opaquemat_3,
    Data8=opaquemat_7)
opaqueconstr = HBOpaqueConstruction(name="CONCRETE PACKAGE", materials=merge)  # -> constr; plug-in component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
constr = ClusterOutput(opaqueconstr)
decnstrconstr = HBDeconstructConstruction(constr=opaqueconstr)  # -> materials, layers, r_val_si, r_val_ip, u_fac_si, u_fac_ip, shgc, t_sol, t_vis; plug-in component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
u_fac_si = ClusterOutput(decnstrconstr.u_fac_si)
panel_3 = Panel(decnstrconstr.u_fac_si)

# ==== cluster Solaio_legno_non_isolato
subtraction = Subtraction(A="1", B="0.15")
subtraction_2 = Subtraction(A="1", B="0.4")
opaquemat = HBOpaqueMaterial(
    name="custom_air_gap",
    thickness="0.02",
    conductivity="0.125",
    density="1.28",
    spec_heat="1000",
    roughness="Smooth",
    therm_absp="0.9",
    sol_absp="0.7",
    vis_absp="0.7")  # -> mat; plug-in component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
opaquemat_2 = HBOpaqueMaterial(
    name="Tavolato_legno",
    thickness="0.04",
    conductivity="0.120",
    density="450",
    spec_heat="2200",
    therm_absp="0.85",
    sol_absp=subtraction,
    vis_absp=subtraction)  # -> mat; plug-in component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
opaquemat_3 = HBOpaqueMaterial(
    name="Tegole",
    thickness="0.02",
    conductivity="0.575",
    density="1350",
    spec_heat="840",
    therm_absp="0.91",
    sol_absp=subtraction_2,
    vis_absp=subtraction_2)  # -> mat; plug-in component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
panel = Panel("Timber floor not insulated")
merge = Merge(Data1=opaquemat_3, Data2=opaquemat, Data3=opaquemat_2)
economical_cobenefit = Panel("")
environmental_cobenefit = Panel("")
social_cobenefit = Panel("")
albedo = Panel("0.4")
thermalemissivity = Panel("0.91")
opaqueconstr = HBOpaqueConstruction(name=panel, materials=merge)  # -> constr; plug-in component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
name = Text(panel)
economic_cobenefit = Text(economical_cobenefit)
social_cobenefit_2 = Text(social_cobenefit)
thermalemissivity_2 = Number(thermalemissivity)
decnstrconstr = HBDeconstructConstruction(constr=opaqueconstr)  # -> materials, layers, r_val_si, r_val_ip, u_fac_si, u_fac_ip, shgc, t_sol, t_vis; plug-in component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
albedo_2 = Number(albedo)
environmental_cobenefit_2 = Text(environmental_cobenefit)
constr = ClusterOutput(opaqueconstr)
name_2 = ClusterOutput(name)
economic_cobenefit_2 = ClusterOutput(economic_cobenefit)
albedo_3 = ClusterOutput(albedo_2)
thermalemissivity_3 = ClusterOutput(thermalemissivity_2)
environmental_cobenefit_3 = ClusterOutput(environmental_cobenefit_2)
social_cobenefit_3 = ClusterOutput(social_cobenefit_2)
u_fac_si = ClusterOutput(decnstrconstr.u_fac_si)
panel_2 = Panel(decnstrconstr.u_fac_si)

# ==== cluster Solaio_legno_scarso_isolato
subtraction = Subtraction(A="1", B="0.4")
subtraction_2 = Subtraction(A="1", B="0.15")
subtraction_3 = Subtraction(A="1", B="0.15")
subtraction_4 = Subtraction(A="1", B="0.7")
opaquemat = HBOpaqueMaterial(
    name="Tegole",
    thickness="0.02",
    conductivity="0.575",
    density="1350",
    spec_heat="840",
    therm_absp="0.91",
    sol_absp=subtraction,
    vis_absp=subtraction)  # -> mat; plug-in component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
opaquemat_2 = HBOpaqueMaterial(
    name="custom_air_gap",
    thickness="0.02",
    conductivity="0.125",
    density="1.28",
    spec_heat="1000",
    roughness="Smooth",
    therm_absp="0.9",
    sol_absp="0.7",
    vis_absp="0.7")  # -> mat; plug-in component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
opaquemat_3 = HBOpaqueMaterial(
    name="Tavolato_legno",
    thickness="0.02",
    conductivity="0.120",
    density="450",
    spec_heat="2200",
    therm_absp="0.85",
    sol_absp=subtraction_2,
    vis_absp=subtraction_2)  # -> mat; plug-in component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
opaquemat_4 = HBOpaqueMaterial(
    name="Tavolato_legno",
    thickness="0.02",
    conductivity="0.120",
    density="450",
    spec_heat="2200",
    therm_absp="0.85",
    sol_absp=subtraction_3,
    vis_absp=subtraction_3)  # -> mat; plug-in component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
opaquemat_5 = HBOpaqueMaterial(
    name="Isolante",
    thickness="0.02",
    conductivity="0.045",
    density="100",
    spec_heat="840",
    therm_absp="0.1",
    sol_absp=subtraction_4,
    vis_absp=subtraction_4)  # -> mat; plug-in component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
panel = Panel("Poorly insulated timber floor")
economical_cobenefit = Panel("")
social_cobenefit = Panel("")
environmental_cobenefit = Panel("")
albedo = Panel("0.40")
thermalemissivity = Panel("0.91")
merge = Merge(Data1=opaquemat, Data2=opaquemat_2, Data3=opaquemat_4, Data4=opaquemat_5, Data5=opaquemat_3)
opaqueconstr = HBOpaqueConstruction(name=panel, materials=merge)  # -> constr; plug-in component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
name = Text(panel)
economic_cobenefit = Text(economical_cobenefit)
social_cobenefit_2 = Text(social_cobenefit)
thermalemissivity_2 = Number(thermalemissivity)
name_2 = ClusterOutput(name)
albedo_2 = Number(albedo)
environmental_cobenefit_2 = Text(environmental_cobenefit)
constr = ClusterOutput(opaqueconstr)
decnstrconstr = HBDeconstructConstruction(constr=opaqueconstr)  # -> materials, layers, r_val_si, r_val_ip, u_fac_si, u_fac_ip, shgc, t_sol, t_vis; plug-in component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
economic_cobenefit_2 = ClusterOutput(economic_cobenefit)
albedo_3 = ClusterOutput(albedo_2)
thermalemissivity_3 = ClusterOutput(thermalemissivity_2)
environmental_cobenefit_3 = ClusterOutput(environmental_cobenefit_2)
social_cobenefit_3 = ClusterOutput(social_cobenefit_2)
u_fac_si = ClusterOutput(decnstrconstr.u_fac_si)
panel_2 = Panel(decnstrconstr.u_fac_si)

# ==== cluster Solaio_legno_altamente_isolato
subtraction = Subtraction(A="1", B="0.4")
subtraction_2 = Subtraction(A="1", B="0.15")
subtraction_3 = Subtraction(A="1", B="0.15")
subtraction_4 = Subtraction(A="1", B="0.7")
opaquemat = HBOpaqueMaterial(
    name="Tegole",
    thickness="0.02",
    conductivity="0.575",
    density="1350",
    spec_heat="840",
    therm_absp="0.91",
    sol_absp=subtraction,
    vis_absp=subtraction)  # -> mat; plug-in component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
opaquemat_2 = HBOpaqueMaterial(
    name="custom_air_gap",
    thickness="0.02",
    conductivity="0.125",
    density="1.28",
    spec_heat="1000",
    roughness="Smooth",
    therm_absp="0.9",
    sol_absp="0.7",
    vis_absp="0.7")  # -> mat; plug-in component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
opaquemat_3 = HBOpaqueMaterial(
    name="Tavolato_legno",
    thickness="0.02",
    conductivity="0.120",
    density="450",
    spec_heat="2200",
    therm_absp="0.85",
    sol_absp=subtraction_2,
    vis_absp=subtraction_2)  # -> mat; plug-in component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
opaquemat_4 = HBOpaqueMaterial(
    name="Tavolato_legno",
    thickness="0.02",
    conductivity="0.120",
    density="450",
    spec_heat="2200",
    therm_absp="0.85",
    sol_absp=subtraction_3,
    vis_absp=subtraction_3)  # -> mat; plug-in component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
opaquemat_5 = HBOpaqueMaterial(
    name="Isolante",
    thickness="0.18",
    conductivity="0.032",
    density="30",
    spec_heat="1250",
    therm_absp="0.1",
    sol_absp=subtraction_4,
    vis_absp=subtraction_4)  # -> mat; plug-in component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
panel = Panel("Highly insulated timber floor")
merge = Merge(Data1=opaquemat, Data2=opaquemat_2, Data3=opaquemat_4, Data4=opaquemat_5, Data5=opaquemat_3)
opaqueconstr = HBOpaqueConstruction(name=panel, materials=merge)  # -> constr; plug-in component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
name = Text(panel)
economical_cobenefit = Panel("")
social_cobenefit = Panel("")
environmental_cobenefit = Panel("")
thermalemissivity = Panel("0.90")
albedo = Panel("0.4")
name_2 = ClusterOutput(name)
decnstrconstr = HBDeconstructConstruction(constr=opaqueconstr)  # -> materials, layers, r_val_si, r_val_ip, u_fac_si, u_fac_ip, shgc, t_sol, t_vis; plug-in component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
constr = ClusterOutput(opaqueconstr)
economic_cobenefit = Text(economical_cobenefit)
social_cobenefit_2 = Text(social_cobenefit)
thermalemissivity_2 = Number(thermalemissivity)
albedo_2 = Number(albedo)
environmental_cobenefit_2 = Text(environmental_cobenefit)
panel_2 = Panel(decnstrconstr.u_fac_si)
economic_cobenefit_2 = ClusterOutput(economic_cobenefit)
u_fac_si = ClusterOutput(decnstrconstr.u_fac_si)
albedo_3 = ClusterOutput(albedo_2)
thermalemissivity_3 = ClusterOutput(thermalemissivity_2)
environmental_cobenefit_3 = ClusterOutput(environmental_cobenefit_2)
social_cobenefit_3 = ClusterOutput(social_cobenefit_2)

# ==== cluster Solaio_laterocemento_non_isolato
subtraction = Subtraction(A="1", B="0.4")
subtraction_2 = Subtraction(A="1", B="0.250")
subtraction_3 = Subtraction(A="1", B="0.650")
opaquemat = HBOpaqueMaterial(
    name="Tegole",
    thickness="0.02",
    conductivity="0.575",
    density="1350",
    spec_heat="840",
    therm_absp="0.91",
    sol_absp=subtraction,
    vis_absp=subtraction)  # -> mat; plug-in component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
opaquemat_2 = HBOpaqueMaterial(
    name="Solaio_laterocemento",
    thickness="0.3",
    conductivity="0.720",
    density="1800",
    spec_heat="840",
    therm_absp="0.54",
    sol_absp=subtraction_2,
    vis_absp=subtraction_2)  # -> mat; plug-in component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
opaquemat_3 = HBOpaqueMaterial(
    name="custom_air_gap",
    thickness="0.02",
    conductivity="0.125",
    density="1.28",
    spec_heat="1000",
    roughness="Smooth",
    therm_absp="0.9",
    sol_absp="0.7",
    vis_absp="0.7")  # -> mat; plug-in component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
opaquemat_4 = HBOpaqueMaterial(
    name="Intonaco_interno",
    thickness="0.02",
    conductivity="0.700",
    density="1500",
    spec_heat="1000",
    therm_absp="0.9",
    sol_absp=subtraction_3,
    vis_absp=subtraction_3)  # -> mat; plug-in component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
panel = Panel("Lateral concrete floor not insulated")
merge = Merge(Data1=opaquemat, Data2=opaquemat_3, Data3=opaquemat_2, Data4=opaquemat_4)
economical_cobenefit = Panel("")
social_cobenefit = Panel("")
environmental_cobenefit = Panel("")
thermalemissivity = Panel("0.90")
albedo = Panel("0.65")
opaqueconstr = HBOpaqueConstruction(name=panel, materials=merge)  # -> constr; plug-in component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
name = Text(panel)
economic_cobenefit = Text(economical_cobenefit)
social_cobenefit_2 = Text(social_cobenefit)
thermalemissivity_2 = Number(thermalemissivity)
albedo_2 = Number(albedo)
name_2 = ClusterOutput(name)
environmental_cobenefit_2 = Text(environmental_cobenefit)
constr = ClusterOutput(opaqueconstr)
economic_cobenefit_2 = ClusterOutput(economic_cobenefit)
albedo_3 = ClusterOutput(albedo_2)
thermalemissivity_3 = ClusterOutput(thermalemissivity_2)
decnstrconstr = HBDeconstructConstruction(constr=opaqueconstr)  # -> materials, layers, r_val_si, r_val_ip, u_fac_si, u_fac_ip, shgc, t_sol, t_vis; plug-in component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
environmental_cobenefit_3 = ClusterOutput(environmental_cobenefit_2)
social_cobenefit_3 = ClusterOutput(social_cobenefit_2)
panel_2 = Panel(decnstrconstr.u_fac_si)
u_fac_si = ClusterOutput(decnstrconstr.u_fac_si)

# ==== cluster Solaio_laterocemento_scarso_isolato
subtraction = Subtraction(A="1", B="0.7")
subtraction_2 = Subtraction(A="1", B="0.4")
subtraction_3 = Subtraction(A="1", B="0.250")
subtraction_4 = Subtraction(A="1", B="0.650")
opaquemat = HBOpaqueMaterial(
    name="Isolante",
    thickness="0.02",
    conductivity="0.045",
    density="100",
    spec_heat="840",
    therm_absp="0.1",
    sol_absp=subtraction,
    vis_absp=subtraction)  # -> mat; plug-in component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
opaquemat_2 = HBOpaqueMaterial(
    name="Tegole",
    thickness="0.02",
    conductivity="0.575",
    density="1350",
    spec_heat="840",
    therm_absp="0.91",
    sol_absp=subtraction_2,
    vis_absp=subtraction_2)  # -> mat; plug-in component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
opaquemat_3 = HBOpaqueMaterial(
    name="custom_air_gap",
    thickness="0.02",
    conductivity="0.125",
    density="1.28",
    spec_heat="1000",
    roughness="Smooth",
    therm_absp="0.9",
    sol_absp="0.7",
    vis_absp="0.7")  # -> mat; plug-in component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
opaquemat_4 = HBOpaqueMaterial(
    name="Solaio_laterocemento",
    thickness="0.3",
    conductivity="0.720",
    density="1800",
    spec_heat="840",
    therm_absp="0.54",
    sol_absp=subtraction_3,
    vis_absp=subtraction_3)  # -> mat; plug-in component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
opaquemat_5 = HBOpaqueMaterial(
    name="Intonaco_interno",
    thickness="0.02",
    conductivity="0.700",
    density="1500",
    spec_heat="1000",
    therm_absp="0.9",
    sol_absp=subtraction_4,
    vis_absp=subtraction_4)  # -> mat; plug-in component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
panel = Panel("Poorly insulated lateral concrete floor")
merge = Merge(Data1=opaquemat_2, Data2=opaquemat_3, Data3=opaquemat, Data4=opaquemat_4, Data5=opaquemat_5)
economical_cobenefit = Panel("")
social_cobenefit = Panel("")
environmental_cobenefit = Panel("")
albedo = Panel("0.65")
thermalemissivity = Panel("0.90")
opaqueconstr = HBOpaqueConstruction(name=panel, materials=merge)  # -> constr; plug-in component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
economic_cobenefit = Text(economical_cobenefit)
social_cobenefit_2 = Text(social_cobenefit)
name = Text(panel)
thermalemissivity_2 = Number(thermalemissivity)
albedo_2 = Number(albedo)
decnstrconstr = HBDeconstructConstruction(constr=opaqueconstr)  # -> materials, layers, r_val_si, r_val_ip, u_fac_si, u_fac_ip, shgc, t_sol, t_vis; plug-in component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
environmental_cobenefit_2 = Text(environmental_cobenefit)
constr = ClusterOutput(opaqueconstr)
economic_cobenefit_2 = ClusterOutput(economic_cobenefit)
albedo_3 = ClusterOutput(albedo_2)
thermalemissivity_3 = ClusterOutput(thermalemissivity_2)
name_2 = ClusterOutput(name)
environmental_cobenefit_3 = ClusterOutput(environmental_cobenefit_2)
social_cobenefit_3 = ClusterOutput(social_cobenefit_2)
panel_2 = Panel(decnstrconstr.u_fac_si)
u_fac_si = ClusterOutput(decnstrconstr.u_fac_si)

# ==== cluster Solaio_laterocemento_altamente_isolato
subtraction = Subtraction(A="1", B="0.7")
panel = Panel("0.1")
subtraction_2 = Subtraction(A="1", B="0.4")
subtraction_3 = Subtraction(A="1", B="0.250")
subtraction_4 = Subtraction(A="1", B="0.650")
opaquemat = HBOpaqueMaterial(
    name="custom_air_gap",
    thickness="0.02",
    conductivity="0.125",
    density="1.28",
    spec_heat="1000",
    roughness="Smooth",
    therm_absp="0.9",
    sol_absp="0.7",
    vis_absp="0.7")  # -> mat; plug-in component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
opaquemat_2 = HBOpaqueMaterial(
    name="Isolante",
    thickness="0.14",
    conductivity="0.032",
    density="30",
    spec_heat="1250",
    therm_absp="0.7",
    sol_absp=subtraction,
    vis_absp=subtraction)  # -> mat; plug-in component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
opaquemat_3 = HBOpaqueMaterial(
    name="Tegole",
    thickness="0.02",
    conductivity="0.575",
    density="1350",
    spec_heat="840",
    therm_absp="0.91",
    sol_absp=subtraction_2,
    vis_absp=subtraction_2)  # -> mat; plug-in component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
opaquemat_4 = HBOpaqueMaterial(
    name="Solaio_laterocemento",
    thickness="0.3",
    conductivity="0.720",
    density="1800",
    spec_heat="840",
    therm_absp="0.54",
    sol_absp=subtraction_3,
    vis_absp=subtraction_3)  # -> mat; plug-in component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
opaquemat_5 = HBOpaqueMaterial(
    name="Intonaco_interno",
    thickness="0.02",
    conductivity="0.700",
    density="1500",
    spec_heat="1000",
    therm_absp="0.9",
    sol_absp=subtraction_4,
    vis_absp=subtraction_4)  # -> mat; plug-in component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
panel_2 = Panel("Highly insulated lateral concrete floor")
economical_cobenefit = Panel("")
environmental_cobenefit = Panel("")
social_cobenefit = Panel("")
thermalemissivity = Panel("0.90")
albedo = Panel("0.65")
merge = Merge(Data1=opaquemat_3, Data2=opaquemat, Data3=opaquemat_2, Data4=opaquemat_4, Data5=opaquemat_5)
opaqueconstr = HBOpaqueConstruction(name=panel_2, materials=merge)  # -> constr; plug-in component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
economic_cobenefit = Text(economical_cobenefit)
name = Text(panel_2)
social_cobenefit_2 = Text(social_cobenefit)
thermalemissivity_2 = Number(thermalemissivity)
albedo_2 = Number(albedo)
decnstrconstr = HBDeconstructConstruction(constr=opaqueconstr)  # -> materials, layers, r_val_si, r_val_ip, u_fac_si, u_fac_ip, shgc, t_sol, t_vis; plug-in component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
environmental_cobenefit_2 = Text(environmental_cobenefit)
constr = ClusterOutput(opaqueconstr)
economic_cobenefit_2 = ClusterOutput(economic_cobenefit)
albedo_3 = ClusterOutput(albedo_2)
name_2 = ClusterOutput(name)
thermalemissivity_3 = ClusterOutput(thermalemissivity_2)
environmental_cobenefit_3 = ClusterOutput(environmental_cobenefit_2)
social_cobenefit_3 = ClusterOutput(social_cobenefit_2)
panel_3 = Panel(decnstrconstr.u_fac_si)
u_fac_si = ClusterOutput(decnstrconstr.u_fac_si)

# ==== cluster Solaio_allegerito_eps_medio_isolato
subtraction = Subtraction(A="1", B="0.4")
subtraction_2 = Subtraction(A="1", B="0.7")
subtraction_3 = Subtraction(A="1", B="0.250")
subtraction_4 = Subtraction(A="1", B="0.650")
opaquemat = HBOpaqueMaterial(
    name="custom_air_gap",
    thickness="0.02",
    conductivity="0.125",
    density="1.28",
    spec_heat="1000",
    roughness="Smooth",
    therm_absp="0.9",
    sol_absp="0.7",
    vis_absp="0.7")  # -> mat; plug-in component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
opaquemat_2 = HBOpaqueMaterial(
    name="Tegole",
    thickness="0.02",
    conductivity="0.575",
    density="1350",
    spec_heat="840",
    therm_absp="0.91",
    sol_absp=subtraction,
    vis_absp=subtraction)  # -> mat; plug-in component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
opaquemat_3 = HBOpaqueMaterial(
    name="Isolante",
    thickness="0.05",
    conductivity="0.045",
    density="100",
    spec_heat="840",
    therm_absp="0.1",
    sol_absp=subtraction_2,
    vis_absp=subtraction_2)  # -> mat; plug-in component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
opaquemat_4 = HBOpaqueMaterial(
    name="Solaio_alleggerito_EPS",
    thickness="0.3",
    conductivity="0.220",
    density="800",
    spec_heat="1000",
    therm_absp="0.54",
    sol_absp=subtraction_3,
    vis_absp=subtraction_3)  # -> mat; plug-in component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
opaquemat_5 = HBOpaqueMaterial(
    name="Intonaco_interno",
    thickness="0.02",
    conductivity="0.700",
    density="1500",
    spec_heat="1000",
    therm_absp="0.9",
    sol_absp=subtraction_4,
    vis_absp=subtraction_4)  # -> mat; plug-in component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
panel = Panel("Medium insulated lightweight concrete floor")
merge = Merge(Data1=opaquemat_2, Data2=opaquemat, Data3=opaquemat_3, Data4=opaquemat_4, Data5=opaquemat_5)
economical_cobenefit = Panel("")
social_cobenefit = Panel("")
environmental_cobenefit = Panel("")
thermalemissivity = Panel("0.90")
albedo = Panel("0.40")
opaqueconstr = HBOpaqueConstruction(name=panel, materials=merge)  # -> constr; plug-in component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
name = Text(panel)
decnstrconstr = HBDeconstructConstruction(constr=opaqueconstr)  # -> materials, layers, r_val_si, r_val_ip, u_fac_si, u_fac_ip, shgc, t_sol, t_vis; plug-in component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
economic_cobenefit = Text(economical_cobenefit)
name_2 = ClusterOutput(name)
social_cobenefit_2 = Text(social_cobenefit)
constr = ClusterOutput(opaqueconstr)
thermalemissivity_2 = Number(thermalemissivity)
albedo_2 = Number(albedo)
environmental_cobenefit_2 = Text(environmental_cobenefit)
economic_cobenefit_2 = ClusterOutput(economic_cobenefit)
albedo_3 = ClusterOutput(albedo_2)
thermalemissivity_3 = ClusterOutput(thermalemissivity_2)
environmental_cobenefit_3 = ClusterOutput(environmental_cobenefit_2)
social_cobenefit_3 = ClusterOutput(social_cobenefit_2)
u_fac_si = ClusterOutput(decnstrconstr.u_fac_si)
panel_2 = Panel(decnstrconstr.u_fac_si)

# ==== cluster Copertura_Verde_estensivo
subtraction = Subtraction(A="1", B="0.15")
vegetationmat = HBVegetationMaterial(
    name="GRASS",
    plant_height="0.06",
    leaf_area_ind="0.30",
    leaf_reflect="0.22",
    leaf_emiss="0.95",
    soil_reflect="0.4",
    soil_emiss="0.6",
    stomat_resist="180",
    thickness="1",
    conductivity="0.3",
    density="1100",
    spec_heat="1200")  # -> mat; plug-in component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
opaquemat = HBOpaqueMaterial(
    name="DAKU ROOF SOIL",
    thickness="0.08",
    conductivity="0.2",
    density="980",
    spec_heat="836.8",
    therm_absp="0.3",
    sol_absp=subtraction,
    vis_absp=subtraction)  # -> mat; plug-in component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
opaquemat_2 = HBOpaqueMaterial(name="DAKU FSD 10", thickness="0.047", conductivity="0.1", density="25", spec_heat="1338")  # -> mat; plug-in component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
opaquemat_3 = HBOpaqueMaterial(name="Mapetherm EPS 100 CAM", thickness="0.1", conductivity="0.035", density="1000", spec_heat="1260")  # -> mat; plug-in component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
opaquemat_4 = HBOpaqueMaterial(name="Intonaco interno", thickness="0.02", conductivity="0.7", density="1500", spec_heat="1000")  # -> mat; plug-in component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
opaquemat_5 = HBOpaqueMaterial(name="Solaio in laterocemento ", thickness="0.3", conductivity="0.72", density="1800", spec_heat="840")  # -> mat; plug-in component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
merge = Merge(Data1=vegetationmat, Data2=opaquemat, Data3=opaquemat_2, Data4=opaquemat_3, Data5=opaquemat_5, Data6=opaquemat_4)
economical_cobenefit = Panel("")
social_cobenefit = Panel("")
environmental_cobenefit = Panel("")
thermalemissivity = Panel("0.95")
albedo = Panel("0.25")
gwp = Panel("12")
opaqueconstr = HBOpaqueConstruction(name="Extensive green roof", materials=merge)  # -> constr; plug-in component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
name = Text("Extensive green roof")
economic_cobenefit = Text(economical_cobenefit)
constr = ClusterOutput(opaqueconstr)
social_cobenefit_2 = Text(social_cobenefit)
thermalemissivity_2 = Number(thermalemissivity)
gwp_kg_co2_m2 = Number(gwp)
albedo_2 = Number(albedo)
environmental_cobenefit_2 = Text(environmental_cobenefit)
name_2 = ClusterOutput(name)
decnstrconstr = HBDeconstructConstruction(constr=opaqueconstr)  # -> materials, layers, r_val_si, r_val_ip, u_fac_si, u_fac_ip, shgc, t_sol, t_vis; plug-in component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
economic_cobenefit_2 = ClusterOutput(economic_cobenefit)
albedo_3 = ClusterOutput(albedo_2)
thermalemissivity_3 = ClusterOutput(thermalemissivity_2)
environmental_cobenefit_3 = ClusterOutput(environmental_cobenefit_2)
social_cobenefit_3 = ClusterOutput(social_cobenefit_2)
gwp_kg_co2_m2_2 = ClusterOutput(gwp_kg_co2_m2)
panel = Panel(decnstrconstr.u_fac_si)
u_fac_si = ClusterOutput(decnstrconstr.u_fac_si)

# ==== cluster Solaio_allegerito_eps_isolato
subtraction = Subtraction(A="1", B="0.4")
subtraction_2 = Subtraction(A="1", B="0.7")
subtraction_3 = Subtraction(A="1", B="0.250")
subtraction_4 = Subtraction(A="1", B="0.650")
opaquemat = HBOpaqueMaterial(
    name="custom_air_gap",
    thickness="0.02",
    conductivity="0.125",
    density="1.28",
    spec_heat="1000",
    roughness="Smooth",
    therm_absp="0.9",
    sol_absp="0.7",
    vis_absp="0.7")  # -> mat; plug-in component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
opaquemat_2 = HBOpaqueMaterial(
    name="Tegole",
    thickness="0.02",
    conductivity="0.575",
    density="1350",
    spec_heat="840",
    therm_absp="0.91",
    sol_absp=subtraction,
    vis_absp=subtraction)  # -> mat; plug-in component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
opaquemat_3 = HBOpaqueMaterial(
    name="Isolante",
    thickness="0.1",
    conductivity="0.045",
    density="100",
    spec_heat="840",
    therm_absp="0.1",
    sol_absp=subtraction_2,
    vis_absp=subtraction_2)  # -> mat; plug-in component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
opaquemat_4 = HBOpaqueMaterial(
    name="Solaio_alleggerito_EPS",
    thickness="0.3",
    conductivity="0.220",
    density="800",
    spec_heat="1000",
    therm_absp="0.54",
    sol_absp=subtraction_3,
    vis_absp=subtraction_3)  # -> mat; plug-in component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
opaquemat_5 = HBOpaqueMaterial(
    name="Intonaco_interno",
    thickness="0.02",
    conductivity="0.700",
    density="1500",
    spec_heat="1000",
    therm_absp="0.9",
    sol_absp=subtraction_4,
    vis_absp=subtraction_4)  # -> mat; plug-in component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
panel = Panel("Insulated lightweight concrete floor")
economical_cobenefit = Panel("")
environmental_cobenefit = Panel("")
social_cobenefit = Panel("")
albedo = Panel("0.40")
thermalemissivity = Panel("0.90")
merge = Merge(Data1=opaquemat_2, Data2=opaquemat, Data3=opaquemat_3, Data4=opaquemat_4, Data5=opaquemat_5)
opaqueconstr = HBOpaqueConstruction(name=panel, materials=merge)  # -> constr; plug-in component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
economic_cobenefit = Text(economical_cobenefit)
social_cobenefit_2 = Text(social_cobenefit)
thermalemissivity_2 = Number(thermalemissivity)
albedo_2 = Number(albedo)
environmental_cobenefit_2 = Text(environmental_cobenefit)
name = Text(panel)
constr = ClusterOutput(opaqueconstr)
decnstrconstr = HBDeconstructConstruction(constr=opaqueconstr)  # -> materials, layers, r_val_si, r_val_ip, u_fac_si, u_fac_ip, shgc, t_sol, t_vis; plug-in component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
economic_cobenefit_2 = ClusterOutput(economic_cobenefit)
albedo_3 = ClusterOutput(albedo_2)
thermalemissivity_3 = ClusterOutput(thermalemissivity_2)
environmental_cobenefit_3 = ClusterOutput(environmental_cobenefit_2)
social_cobenefit_3 = ClusterOutput(social_cobenefit_2)
name_2 = ClusterOutput(name)
panel_2 = Panel(decnstrconstr.u_fac_si)
u_fac_si = ClusterOutput(decnstrconstr.u_fac_si)

# ==== cluster Copertura_legno
subtraction = Subtraction(A="1", B="0.7")
opaquemat = HBOpaqueMaterial(
    name="tavolato di legno grezzo",
    thickness="0.024",
    conductivity="0.26",
    density="1350",
    spec_heat="1880",
    therm_absp="0.69",
    sol_absp=subtraction,
    vis_absp=subtraction)  # -> mat; plug-in component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
opaquemat_2 = HBOpaqueMaterial(name="Fibra di legno Fibertherm Protect 230", thickness="0.06", conductivity="0.046", density="230", spec_heat="2100")  # -> mat; plug-in component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
opaquemat_3 = HBOpaqueMaterial(name="X-LAM", thickness="0.12", conductivity="0.12", density="470", spec_heat="1600")  # -> mat; plug-in component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
opaquemat_4 = HBOpaqueMaterial(name="Lastra gessofibra fermacell", thickness="0.0125", conductivity="0.32", density="1180", spec_heat="1100")  # -> mat; plug-in component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
opaquemat_5 = HBOpaqueMaterial(name="Fibra di legno Fibertherm Protect 230", thickness="0.06", conductivity="0.046", density="230", spec_heat="2100")  # -> mat; plug-in component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
merge = Merge(Data1=opaquemat, Data2=opaquemat_2, Data3=opaquemat_3, Data4=opaquemat_5, Data5=opaquemat_4)
economical_cobenefit = Panel("")
social_cobenefit = Panel("")
environmental_cobenefit = Panel("")
thermalemissivity = Panel("0.69")
albedo = Panel("0.70")
opaqueconstr = HBOpaqueConstruction(name="Wooden roof", materials=merge)  # -> constr; plug-in component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
name = Text("Wooden roof")
constr = ClusterOutput(opaqueconstr)
economic_cobenefit = Text(economical_cobenefit)
social_cobenefit_2 = Text(social_cobenefit)
thermalemissivity_2 = Number(thermalemissivity)
albedo_2 = Number(albedo)
environmental_cobenefit_2 = Text(environmental_cobenefit)
name_2 = ClusterOutput(name)
decnstrconstr = HBDeconstructConstruction(constr=opaqueconstr)  # -> materials, layers, r_val_si, r_val_ip, u_fac_si, u_fac_ip, shgc, t_sol, t_vis; plug-in component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
economic_cobenefit_2 = ClusterOutput(economic_cobenefit)
albedo_3 = ClusterOutput(albedo_2)
thermalemissivity_3 = ClusterOutput(thermalemissivity_2)
environmental_cobenefit_3 = ClusterOutput(environmental_cobenefit_2)
social_cobenefit_3 = ClusterOutput(social_cobenefit_2)
panel = Panel(decnstrconstr.u_fac_si)
u_fac_si = ClusterOutput(decnstrconstr.u_fac_si)

# ==== cluster Solaio_allegerito_eps_altamente_isolato
subtraction = Subtraction(A="1", B="0.4")
subtraction_2 = Subtraction(A="1", B="0.7")
subtraction_3 = Subtraction(A="1", B="0.250")
subtraction_4 = Subtraction(A="1", B="0.650")
opaquemat = HBOpaqueMaterial(
    name="custom_air_gap",
    thickness="0.02",
    conductivity="0.125",
    density="1.28",
    spec_heat="1000",
    roughness="Smooth",
    therm_absp="0.9",
    sol_absp="0.7",
    vis_absp="0.7")  # -> mat; plug-in component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
opaquemat_2 = HBOpaqueMaterial(
    name="Tegole",
    thickness="0.02",
    conductivity="0.575",
    density="1350",
    spec_heat="840",
    therm_absp="0.91",
    sol_absp=subtraction,
    vis_absp=subtraction)  # -> mat; plug-in component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
opaquemat_3 = HBOpaqueMaterial(
    name="Isolante",
    thickness="0.14",
    conductivity="0.032",
    density="30",
    spec_heat="1250",
    therm_absp="0.1",
    sol_absp=subtraction_2,
    vis_absp=subtraction_2)  # -> mat; plug-in component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
opaquemat_4 = HBOpaqueMaterial(
    name="Solaio_alleggerito_EPS",
    thickness="0.3",
    conductivity="0.220",
    density="800",
    spec_heat="1000",
    therm_absp="0.54",
    sol_absp=subtraction_3,
    vis_absp=subtraction_3)  # -> mat; plug-in component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
opaquemat_5 = HBOpaqueMaterial(
    name="Intonaco_interno",
    thickness="0.02",
    conductivity="0.700",
    density="1500",
    spec_heat="1000",
    therm_absp="0.9",
    sol_absp=subtraction_4,
    vis_absp=subtraction_4)  # -> mat; plug-in component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
panel = Panel("Highly insulated lightweight concrete floor")
merge = Merge(Data1=opaquemat_2, Data2=opaquemat, Data3=opaquemat_3, Data4=opaquemat_4, Data5=opaquemat_5)
economical_cobenefit = Panel("")
environmental_cobenefit = Panel("")
social_cobenefit = Panel("")
name = Text(panel)
opaqueconstr = HBOpaqueConstruction(name=panel, materials=merge)  # -> constr; plug-in component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
albedo = Panel("0.40")
thermalemissivity = Panel("0.90")
name_2 = ClusterOutput(name)
decnstrconstr = HBDeconstructConstruction(constr=opaqueconstr)  # -> materials, layers, r_val_si, r_val_ip, u_fac_si, u_fac_ip, shgc, t_sol, t_vis; plug-in component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
constr = ClusterOutput(opaqueconstr)
economic_cobenefit = Text(economical_cobenefit)
social_cobenefit_2 = Text(social_cobenefit)
thermalemissivity_2 = Number(thermalemissivity)
albedo_2 = Number(albedo)
environmental_cobenefit_2 = Text(environmental_cobenefit)
u_fac_si = ClusterOutput(decnstrconstr.u_fac_si)
economic_cobenefit_2 = ClusterOutput(economic_cobenefit)
panel_2 = Panel(decnstrconstr.u_fac_si)
albedo_3 = ClusterOutput(albedo_2)
thermalemissivity_3 = ClusterOutput(thermalemissivity_2)
environmental_cobenefit_3 = ClusterOutput(environmental_cobenefit_2)
social_cobenefit_3 = ClusterOutput(social_cobenefit_2)

# ==== cluster Copertura_acciaio
opaquemat = HBOpaqueMaterial(name="Glass fibre quilt", thickness="0.1", conductivity="0.04", density="12,5", spec_heat="1030")  # -> mat; plug-in component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
opaquemat_2 = HBOpaqueMaterial(name="RW3 rock fibre slab", thickness="0.11", conductivity="0.039", density="60", spec_heat="1030")  # -> mat; plug-in component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
merge = Merge(Data1=opaquemat, Data2=opaquemat_2)
economical_cobenefit = Panel("")
social_cobenefit = Panel("")
environmental_cobenefit = Panel("")
thermalemissivity = Panel("0.90")
albedo = Panel("0.65")
gwp = Panel("25.4")
opaqueconstr = HBOpaqueConstruction(name="Steel roof", materials=merge)  # -> constr; plug-in component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
economic_cobenefit = Text(economical_cobenefit)
social_cobenefit_2 = Text(social_cobenefit)
thermalemissivity_2 = Number(thermalemissivity)
gwp_kg_co2_m2 = Number(gwp)
albedo_2 = Number(albedo)
environmental_cobenefit_2 = Text(environmental_cobenefit)
name = Text("Steel roof")
constr = ClusterOutput(opaqueconstr)
decnstrconstr = HBDeconstructConstruction(constr=opaqueconstr)  # -> materials, layers, r_val_si, r_val_ip, u_fac_si, u_fac_ip, shgc, t_sol, t_vis; plug-in component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
economic_cobenefit_2 = ClusterOutput(economic_cobenefit)
albedo_3 = ClusterOutput(albedo_2)
thermalemissivity_3 = ClusterOutput(thermalemissivity_2)
name_2 = ClusterOutput(name)
environmental_cobenefit_3 = ClusterOutput(environmental_cobenefit_2)
social_cobenefit_3 = ClusterOutput(social_cobenefit_2)
gwp_kg_co2_m2_2 = ClusterOutput(gwp_kg_co2_m2)
panel = Panel(decnstrconstr.u_fac_si)
u_fac_si = ClusterOutput(decnstrconstr.u_fac_si)

# ==== cluster Copertura_calcestruzzo
subtraction = Subtraction(A="1", B="0.4")
opaquemat = HBOpaqueMaterial(name="Mapetherm EPS 100 CAM", thickness="0.1", conductivity="0.035", density="1000", spec_heat="1260")  # -> mat; plug-in component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
opaquemat_2 = HBOpaqueMaterial(name="Solaio in laterocemento", thickness="0.3", conductivity="0.72", density="1800", spec_heat="840")  # -> mat; plug-in component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
opaquemat_3 = HBOpaqueMaterial(name="Intonaco interno", thickness="0.02", conductivity="0.7", density="1500", spec_heat="1000")  # -> mat; plug-in component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
opaquemat_4 = HBOpaqueMaterial(
    name="Tegole",
    thickness="0.02",
    conductivity="0.575",
    density="1350",
    spec_heat="840",
    therm_absp="0.91",
    sol_absp=subtraction,
    vis_absp=subtraction)  # -> mat; plug-in component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
merge = Merge(Data1=opaquemat_4, Data2=opaquemat, Data3=opaquemat_2, Data4=opaquemat_3)
economical_cobenefit = Panel("")
social_cobenefit = Panel("")
environmental_cobenefit = Panel("")
thermalemissivity = Panel("0.90")
albedo = Panel("0.40")
opaqueconstr = HBOpaqueConstruction(name="Concrete roof", materials=merge)  # -> constr; plug-in component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
name = Text("Concrete roof")
constr = ClusterOutput(opaqueconstr)
economic_cobenefit = Text(economical_cobenefit)
social_cobenefit_2 = Text(social_cobenefit)
thermalemissivity_2 = Number(thermalemissivity)
decnstrconstr = HBDeconstructConstruction(constr=opaqueconstr)  # -> materials, layers, r_val_si, r_val_ip, u_fac_si, u_fac_ip, shgc, t_sol, t_vis; plug-in component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
albedo_2 = Number(albedo)
environmental_cobenefit_2 = Text(environmental_cobenefit)
name_2 = ClusterOutput(name)
economic_cobenefit_2 = ClusterOutput(economic_cobenefit)
albedo_3 = ClusterOutput(albedo_2)
thermalemissivity_3 = ClusterOutput(thermalemissivity_2)
environmental_cobenefit_3 = ClusterOutput(environmental_cobenefit_2)
social_cobenefit_3 = ClusterOutput(social_cobenefit_2)
panel = Panel(decnstrconstr.u_fac_si)
u_fac_si = ClusterOutput(decnstrconstr.u_fac_si)

# ==== cluster Solaio_calcestruzzo_igloo_non_isolato
subtraction = Subtraction(A="1", B="0.250")
subtraction_2 = Subtraction(A="1", B="0.250")
subtraction_3 = Subtraction(A="1", B="0.2")
opaquemat = HBOpaqueMaterial(
    name="custom_air_gap",
    thickness="0.22",
    conductivity="1.22",
    density="1.28",
    spec_heat="1000",
    roughness="Smooth",
    therm_absp="0.9",
    sol_absp="0.7",
    vis_absp="0.7")  # -> mat; plug-in component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
opaquemat_2 = HBOpaqueMaterial(
    name="Calcestruzzo",
    thickness="0.3",
    conductivity="1.7",
    density="2400",
    spec_heat="1000",
    therm_absp="0.9",
    sol_absp=subtraction,
    vis_absp=subtraction)  # -> mat; plug-in component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
opaquemat_3 = HBOpaqueMaterial(
    name="massetto_calcestruzzo",
    thickness="0.05",
    conductivity="2.02",
    density="2200",
    spec_heat="1000",
    therm_absp="0.9",
    sol_absp=subtraction_2,
    vis_absp=subtraction_2)  # -> mat; plug-in component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
opaquemat_4 = HBOpaqueMaterial(
    name="pavimentazione",
    thickness="0.01",
    conductivity="1.300",
    density="2300",
    spec_heat="840",
    therm_absp="0.85",
    sol_absp=subtraction_3,
    vis_absp=subtraction_3)  # -> mat; plug-in component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
panel = Panel("Igloo concrete floor not insulated")
merge = Merge(Data1=opaquemat, Data2=opaquemat_2, Data3=opaquemat_3, Data4=opaquemat_4)
economical_cobenefit = Panel("")
social_cobenefit = Panel("")
environmental_cobenefit = Panel("")
thermalemissivity = Panel("0.90")
albedo = Panel("0.40")
opaqueconstr = HBOpaqueConstruction(name=panel, materials=merge)  # -> constr; plug-in component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
economic_cobenefit = Text(economical_cobenefit)
social_cobenefit_2 = Text(social_cobenefit)
thermalemissivity_2 = Number(thermalemissivity)
albedo_2 = Number(albedo)
environmental_cobenefit_2 = Text(environmental_cobenefit)
constr = ClusterOutput(opaqueconstr)
decnstrconstr = HBDeconstructConstruction(constr=opaqueconstr)  # -> materials, layers, r_val_si, r_val_ip, u_fac_si, u_fac_ip, shgc, t_sol, t_vis; plug-in component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
name = Text(panel)
economic_cobenefit_2 = ClusterOutput(economic_cobenefit)
albedo_3 = ClusterOutput(albedo_2)
thermalemissivity_3 = ClusterOutput(thermalemissivity_2)
environmental_cobenefit_3 = ClusterOutput(environmental_cobenefit_2)
social_cobenefit_3 = ClusterOutput(social_cobenefit_2)
name_2 = ClusterOutput(name)
u_fac_si = ClusterOutput(decnstrconstr.u_fac_si)
panel_2 = Panel(decnstrconstr.u_fac_si)

# ==== cluster Solaio_calcestruzzo_igloo_scarso_isolato
subtraction = Subtraction(A="1", B="0.250")
subtraction_2 = Subtraction(A="1", B="0.250")
subtraction_3 = Subtraction(A="1", B="0.250")
subtraction_4 = Subtraction(A="1", B="0.2")
subtraction_5 = Subtraction(A="1", B="0.7")
panel = Panel("0.1")
opaquemat = HBOpaqueMaterial(
    name="Calcestruzzo",
    thickness="0.3",
    conductivity="1.7",
    density="2400",
    spec_heat="1000",
    therm_absp="0.9",
    sol_absp=subtraction_2,
    vis_absp=subtraction_2)  # -> mat; plug-in component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
opaquemat_2 = HBOpaqueMaterial(
    name="massetto_calcestruzzo",
    thickness="0.05",
    conductivity="2.02",
    density="2200",
    spec_heat="1000",
    therm_absp="0.9",
    sol_absp=subtraction,
    vis_absp=subtraction)  # -> mat; plug-in component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
opaquemat_3 = HBOpaqueMaterial(
    name="massetto_calcestruzzo",
    thickness="0.05",
    conductivity="2.02",
    density="2200",
    spec_heat="1000",
    therm_absp="0.9",
    sol_absp=subtraction_3,
    vis_absp=subtraction_3)  # -> mat; plug-in component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
opaquemat_4 = HBOpaqueMaterial(
    name="custom_air_gap",
    thickness="0.22",
    conductivity="1.22",
    density="1.28",
    spec_heat="1000",
    roughness="Smooth",
    therm_absp="0.9",
    sol_absp="0.7",
    vis_absp="0.7")  # -> mat; plug-in component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
opaquemat_5 = HBOpaqueMaterial(
    name="pavimentazione",
    thickness="0.01",
    conductivity="1.300",
    density="2300",
    spec_heat="840",
    therm_absp="0.85",
    sol_absp=subtraction_4,
    vis_absp=subtraction_4)  # -> mat; plug-in component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
opaquemat_6 = HBOpaqueMaterial(
    name="isolante",
    thickness="0.02",
    conductivity="0.045",
    density="100",
    spec_heat="840",
    therm_absp="0.7",
    sol_absp=subtraction_5,
    vis_absp=subtraction_5)  # -> mat; plug-in component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
panel_2 = Panel("Poorly insulated igloo concrete floor")
merge = Merge(Data1=opaquemat_4, Data2=opaquemat, Data3=opaquemat_3, Data4=opaquemat_6, Data5=opaquemat_2, Data6=opaquemat_5)
economical_cobenefit = Panel("")
environmental_cobenefit = Panel("")
social_cobenefit = Panel("")
albedo = Panel("0.40")
thermalemissivity = Panel("0.90")
opaqueconstr = HBOpaqueConstruction(name=panel_2, materials=merge)  # -> constr; plug-in component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
constr = ClusterOutput(opaqueconstr)
decnstrconstr = HBDeconstructConstruction(constr=opaqueconstr)  # -> materials, layers, r_val_si, r_val_ip, u_fac_si, u_fac_ip, shgc, t_sol, t_vis; plug-in component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
economic_cobenefit = Text(economical_cobenefit)
social_cobenefit_2 = Text(social_cobenefit)
thermalemissivity_2 = Number(thermalemissivity)
albedo_2 = Number(albedo)
environmental_cobenefit_2 = Text(environmental_cobenefit)
name = Text(panel_2)
economic_cobenefit_2 = ClusterOutput(economic_cobenefit)
albedo_3 = ClusterOutput(albedo_2)
thermalemissivity_3 = ClusterOutput(thermalemissivity_2)
environmental_cobenefit_3 = ClusterOutput(environmental_cobenefit_2)
social_cobenefit_3 = ClusterOutput(social_cobenefit_2)
name_2 = ClusterOutput(name)
panel_3 = Panel(decnstrconstr.u_fac_si)
u_fac_si = ClusterOutput(decnstrconstr.u_fac_si)

# ==== cluster Solaio_calcestruzzo_igloo_isolato
subtraction = Subtraction(A="1", B="0.250")
subtraction_2 = Subtraction(A="1", B="0.250")
subtraction_3 = Subtraction(A="1", B="0.250")
subtraction_4 = Subtraction(A="1", B="0.2")
subtraction_5 = Subtraction(A="1", B="0.7")
opaquemat = HBOpaqueMaterial(
    name="custom_air_gap",
    thickness="0.22",
    conductivity="1.22",
    density="1.28",
    spec_heat="1000",
    roughness="Smooth",
    therm_absp="0.9",
    sol_absp="0.7",
    vis_absp="0.7")  # -> mat; plug-in component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
opaquemat_2 = HBOpaqueMaterial(
    name="Calcestruzzo",
    thickness="0.3",
    conductivity="1.7",
    density="2400",
    spec_heat="1000",
    therm_absp="0.9",
    sol_absp=subtraction_2,
    vis_absp=subtraction_2)  # -> mat; plug-in component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
opaquemat_3 = HBOpaqueMaterial(
    name="massetto_calcestruzzo",
    thickness="0.05",
    conductivity="2.02",
    density="2200",
    spec_heat="1000",
    therm_absp="0.9",
    sol_absp=subtraction,
    vis_absp=subtraction)  # -> mat; plug-in component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
opaquemat_4 = HBOpaqueMaterial(
    name="massetto_calcestruzzo",
    thickness="0.05",
    conductivity="2.02",
    density="2200",
    spec_heat="1000",
    therm_absp="0.9",
    sol_absp=subtraction_3,
    vis_absp=subtraction_3)  # -> mat; plug-in component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
opaquemat_5 = HBOpaqueMaterial(
    name="pavimentazione",
    thickness="0.01",
    conductivity="1.300",
    density="2300",
    spec_heat="840",
    therm_absp="0.85",
    sol_absp=subtraction_4,
    vis_absp=subtraction_4)  # -> mat; plug-in component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
opaquemat_6 = HBOpaqueMaterial(
    name="isolante",
    thickness="0.1",
    conductivity="0.032",
    density="30",
    spec_heat="1250",
    therm_absp="0.1",
    sol_absp=subtraction_5,
    vis_absp=subtraction_5)  # -> mat; plug-in component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
panel = Panel("Insulated igloo concrete floor")
economical_cobenefit = Panel("")
environmental_cobenefit = Panel("")
social_cobenefit = Panel("")
albedo = Panel("0.40")
thermalemissivity = Panel("0.90")
merge = Merge(Data1=opaquemat, Data2=opaquemat_2, Data3=opaquemat_4, Data4=opaquemat_6, Data5=opaquemat_3, Data6=opaquemat_5)
opaqueconstr = HBOpaqueConstruction(name=panel, materials=merge)  # -> constr; plug-in component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
economic_cobenefit = Text(economical_cobenefit)
social_cobenefit_2 = Text(social_cobenefit)
thermalemissivity_2 = Number(thermalemissivity)
name = Text(panel)
albedo_2 = Number(albedo)
environmental_cobenefit_2 = Text(environmental_cobenefit)
constr = ClusterOutput(opaqueconstr)
decnstrconstr = HBDeconstructConstruction(constr=opaqueconstr)  # -> materials, layers, r_val_si, r_val_ip, u_fac_si, u_fac_ip, shgc, t_sol, t_vis; plug-in component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
economic_cobenefit_2 = ClusterOutput(economic_cobenefit)
albedo_3 = ClusterOutput(albedo_2)
thermalemissivity_3 = ClusterOutput(thermalemissivity_2)
name_2 = ClusterOutput(name)
environmental_cobenefit_3 = ClusterOutput(environmental_cobenefit_2)
social_cobenefit_3 = ClusterOutput(social_cobenefit_2)
panel_2 = Panel(decnstrconstr.u_fac_si)
u_fac_si = ClusterOutput(decnstrconstr.u_fac_si)

# ==== cluster Holiday
date = ClusterInput()
values = ClusterInput()

deconstruct_date = DeconstructDate(Date=date)  # -> Year, Month, Day, Hour, Minute, Second
panel = Panel(deconstruct_date.Month)
panel_2 = Panel(deconstruct_date.Day)
analysisperiod = LBAnalysisPeriod(
    start_month=deconstruct_date.Month,
    start_day=deconstruct_date.Day,
    start_hour=0,
    end_month=deconstruct_date.Month,
    end_day=deconstruct_date.Day)  # -> period, hoys, dates; plug-in component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

panel_3 = Panel(values)
list = ClusterInput()

constantschedule = HBConstantSchedule(values=values, name="festività nazionali")  # -> out, schedule, idf_text; plug-in component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
list_length = ListLength(List=list)
repeat_data = RepeatData(Data=constantschedule.schedule, Length=list_length)

panel_4 = Panel(repeat_data)
holiday = ClusterOutput(repeat_data)
hoys = ClusterOutput(analysisperiod.hoys)
dates = ClusterOutput(analysisperiod.dates)
period = ClusterOutput(analysisperiod.period)

# ==== cluster Periods
text = ClusterInput()
replace_text = ReplaceText(Text=text, Find=" to ", Replace=" ", RecursiveReplace=False)
text_split = TextSplit(Text=replace_text, Separators=" ")  # -> simplify(Result)
panel = Panel(text_split)
list_item = ListItem(List=panel, Index="2", Wrap=True)  # -> flatten(Item)
list_item_2 = ListItem(List=panel, Index="0", Wrap=True)  # -> flatten(Item)
series = Series(Start="1", Step=1, Count="12")  # -> flatten(Series)
panel_2 = Panel(series)
panel_3 = Panel("""Jan
Feb
Mar
Apr
May
Jun
Jul
Aug
Sep
Oct
Nov
Dec""")
replace_members = ReplaceMembers(Set=list_item, Find=panel_3, Replace=series)  # -> flatten(Result)
replace_members_2 = ReplaceMembers(Set=list_item_2, Find=panel_3, Replace=series)  # -> flatten(Result)
list_item_3 = ListItem(List=panel, Index="1", Wrap=True)  # -> flatten(Item)
list_item_4 = ListItem(List=panel, Index="3", Wrap=True)  # -> flatten(Item)
analysisperiod = LBAnalysisPeriod(start_month=replace_members_2, start_day=list_item_3, start_hour=0, end_month=replace_members, end_day=list_item_4)  # -> period, hoys, dates; plug-in component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
period = ClusterOutput(analysisperiod.period)
dates = ClusterOutput(analysisperiod.dates)
hoys = ClusterOutput(analysisperiod.hoys)

# ==== cluster Periods_2
text = ClusterInput()
replace_text = ReplaceText(Text=text, Find=" to ", Replace=" ", RecursiveReplace=False)
text_split = TextSplit(Text=replace_text, Separators=" ")  # -> simplify(Result)
panel = Panel(text_split)
list_item = ListItem(List=panel, Index="0", Wrap=False)  # -> flatten(Item)
list_item_2 = ListItem(List=panel, Index="0", Wrap=False)  # -> flatten(Item)
series = Series(Start="1", Step=1, Count="12")  # -> flatten(Series)
panel_2 = Panel(list_item)
panel_3 = Panel("""Jan
Feb
Mar
Apr
May
Jun
Jul
Aug
Sep
Oct
Nov
Dec""")
panel_4 = Panel(series)
replace_members = ReplaceMembers(Set=list_item, Find=panel_3, Replace=series)  # -> flatten(Result)
replace_members_2 = ReplaceMembers(Set=list_item_2, Find=panel_3, Replace=series)  # -> flatten(Result)
list_item_3 = ListItem(List=panel, Index="1", Wrap=True)  # -> flatten(Item)
list_item_4 = ListItem(List=panel, Index="1", Wrap=True)  # -> flatten(Item)
analysisperiod = LBAnalysisPeriod(start_month=replace_members_2, start_day=list_item_3, start_hour=0, end_month=replace_members, end_day=list_item_4)  # -> period, hoys, dates; plug-in component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
period = ClusterOutput(analysisperiod.period)
dates = ClusterOutput(analysisperiod.dates)
hoys = ClusterOutput(analysisperiod.hoys)
