# Grasshopper definition Tree Co2 Stored calculator.gh (Grasshopper 1.0.7)
# plug-ins: eleFront, LunchBox

list = ValueList({"Analysis Buildings", "Analysis Buildings::Non Residential", "Predefinito", "Trees"}, selected="Trees")
list_2 = ValueList({"1_Species", "2_height class", "3_Tolerance to drought", "3_tree height [m]", "4_Uses", "5_CO2 stored [kgCO2eq]"}, selected="5_CO2 stored [kgCO2eq]")
reflay = ReferenceByLayer(LayerName=list, lightweight=False)
getuv = GetUserValue(Geometry=reflay, Key=list_2)
list_3 = ValueList({"1_Species", "2_height class", "3_Tolerance to drought", "3_tree height [m]", "4_Uses", "5_CO2 stored [kgCO2eq]"}, selected="1_Species")
list_4 = ValueList({"1_Species", "2_height class", "3_Tolerance to drought", "3_tree height [m]", "4_Uses", "5_CO2 stored [kgCO2eq]"}, selected="5_CO2 stored [kgCO2eq]")
detatt = DetachAttributes(Geometry=reflay)  # -> Geometry, Attributes
num = Number(expr("Round(x,2)", getuv))
ma = MassAddition(Input=flatten(num))  # -> Result, PartialResults
kgco2e_y_stock = Panel(ma.Result)
sortkey = SortByKey(Attributes=detatt.Geometry, Key1=list_3)  # -> simplify(SortedObjects), Values
getuv_2 = GetUserValue(Geometry=sortkey.SortedObjects, Key=list_4)

# ----
# TITLE
panel = Panel(" tCO2eq")
concat = Concatenate(FragmentA="CO2 stored by trees [tCO2eq]", FragmentB="Total = ", FragmentC=kgco2e_y_stock, FragmentD=panel)
title = Panel(concat)

shiftm = ShiftMatch(GuideTree=sortkey.SortedObjects, SecondaryData1=getuv_2, shiftFromStart=False)  # -> GuideTree, SecondaryData1
ma_2 = MassAddition(Input=shiftm.SecondaryData1)  # -> Result, PartialResults
co2_stored_totale_per_specie = Panel(ma_2.Result)
specie = Panel(sortkey.Values)
txt = Text(flatten(specie))
graft = GraftTree(Tree=co2_stored_totale_per_specie, IncludeEmptyLists=True, IncludeNullItems=True)
txt_2 = Text(title)
chart = CreateChart(ChartName=txt_2, ChartSeries=txt, ValueTree=graft, Chart_Theme="Bright Pastel", Chart_Type="Column")
