# Grasshopper definition UTCI_TMRT_simulation outdoor_HB1.6 for configurator.gh (Grasshopper 1.0.7)
# plug-ins: eleFront

# ----
# 1 SET THE .epw
path = FilePath("C:\ITA_Napoli-Capodichino.162890_IGDG.epw")
importepw = LBImportEPW(epw_file=path)  # -> location, dry_bulb_temperature, dew_point_temperature, relative_humidity, wind_speed, wind_direction, direct_normal_rad, diffuse_horizontal_rad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; plug-in component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
xdata = LBDeconstructData(data=importepw.model_year)  # -> header, values; plug-in component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
panel = Panel(importepw.location)
xdata_2 = LBDeconstructData(data=importepw.dry_bulb_temperature)  # -> header, values; plug-in component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
cset = CreateSet(List=xdata.values)  # -> Set, Map
sort = SortList(Keys=xdata_2.values)  # -> reverse(Keys), ValuesA
panel_2 = Panel(cset.Set)
item = ListItem(List=sort.Keys, Index=0, Wrap=True)
mindex = MemberIndex(Set=xdata_2.values, Member=item)  # -> Index, Count
datetime = LBHOYToDateTime(hoy=mindex.Index)  # -> month, day, hour, minute, date; plug-in component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

# ----
# 3 ROAD
list = ValueList({"One": 1, "Two": 2, "Three": 2² - 1, "Four": Sqrt(16)}, selected="One")
value_list = ValueList({"No valid keys found"}, selected="No valid keys found")
reflay = ReferenceByLayer(lightweight=False)
road = Brep(reflay)
cluster = Cluster_3()  # -> flatten(hb_name_2)
getuv = GetUserValue(Geometry=reflay, Key=value_list)
panel_3 = Panel(cluster)
strtoobj = HBStringToObject(hb_str=getuv)  # -> hb_obj; plug-in component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
roomsolid = HBRoomFromSolid(geo=flatten(road), name=panel_3, conditioned=Toggle(False))  # -> report, rooms; plug-in component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
item_2 = ListItem(List=flatten(strtoobj), Index=0, Wrap=True)
ground = HBGround(rooms=roomsolid.rooms, soil_constr=item_2)  # -> rooms; plug-in component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

# ----
# 2 LANDUSE
# create a copy of this group for every different landuse layer
list_2 = ValueList({"One": 1, "Two": 2, "Three": 2² - 1, "Four": Sqrt(16)}, selected="One")
value_list_2 = ValueList({"No valid keys found"}, selected="No valid keys found")
reflay_2 = ReferenceByLayer(lightweight=False)
cluster_2 = Cluster_3(elefrontlayer=reflay_2)  # -> flatten(hb_name_2)
getuv_2 = GetUserValue(Geometry=reflay_2, Key=value_list_2)
panel_4 = Panel(cluster_2)
landuse = Brep(reflay_2)
strtoobj_2 = HBStringToObject(hb_str=getuv_2)  # -> hb_obj; plug-in component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
roomsolid_2 = HBRoomFromSolid(geo=flatten(landuse), name=panel_4, conditioned=Toggle(False))  # -> report, rooms; plug-in component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
item_3 = ListItem(List=flatten(strtoobj_2), Index=0, Wrap=True)
ground_2 = HBGround(rooms=roomsolid_2.rooms, soil_constr=item_3)  # -> rooms; plug-in component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

# ----
# 5 IMPOSTA PERIODO DI ANALISI
number_slider = Slider(8, range=1..12)
number_slider_2 = Slider(10, range=1..31)
analysisperiod = LBAnalysisPeriod(start_month=number_slider, start_day=number_slider_2, start_hour=0, end_month=number_slider, end_day=number_slider_2)  # -> period, hoys, dates; plug-in component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

# ----
# 6 NAME AND FOLDER
# Nome modello
# Percorso cartella
percorso_cartella = Panel("")
nome_modello = Panel("")

reflay_3 = ReferenceByLayer(lightweight=False)
reflay_4 = ReferenceByLayer(lightweight=False)
reflay_5 = ReferenceByLayer(lightweight=False)
constantschedule = HBConstantSchedule(values=Slider(0.1, range=0..1), name="TREES_schedule_summer")  # -> report, schedule, idf_text; plug-in component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
constantschedule_2 = HBConstantSchedule(values=Slider(0.8, range=0..1), name="TREES_schedule_winter")  # -> report, schedule, idf_text; plug-in component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
data = Data(analysisperiod.period)

# ----
# 10  RUN THE SIMULATION
toggle = BooleanToggle(False)

vegetationmat = HBVegetationMaterial(
    name="grass",
    plant_height="0.2",
    leaf_area_ind="2",
    leaf_reflect="0.22",
    leaf_emiss="0.95",
    soil_reflect="0.4",
    soil_emiss="0.6",
    stomat_resist="180",
    thickness="1",
    conductivity="0.6",
    density="1100",
    spec_heat="1200")  # -> mat; plug-in component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
opaqueconstr = HBOpaqueConstruction(name="grass", materials=vegetationmat)  # -> constr; plug-in component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

# ----
# GREEN AREAS
# collega
list_3 = ValueList({"One": 1, "Two": 2, "Three": 2² - 1, "Four": Sqrt(16)}, selected="One")
reflay_6 = ReferenceByLayer(lightweight=False)
cluster_3 = Cluster_3()  # -> flatten(hb_name_2)
green = Brep(reflay_6)
roomsolid_3 = HBRoomFromSolid(geo=flatten(green), name="GREEN_AREAS", conditioned=Toggle(False))  # -> report, rooms; plug-in component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
ground_3 = HBGround(rooms=roomsolid_3.rooms, soil_constr=opaqueconstr)  # -> rooms; plug-in component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

seasonalschedule = HBSeasonalSchedule(base_schedule=constantschedule_2.schedule, season_scheds=constantschedule.schedule, analysis_periods=data)  # -> out, schedule, idf_year, idf_week, idf_days; plug-in component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

# ----
# 4 BUILDINGS/CANOPIES/TREE
list_4 = ValueList({"One": 1, "Two": 2, "Three": 2² - 1, "Four": Sqrt(16)}, selected="One")
list_5 = ValueList({"One": 1, "Two": 2, "Three": 2² - 1, "Four": Sqrt(16)}, selected="One")
list_6 = ValueList({"One": 1, "Two": 2, "Three": 2² - 1, "Four": Sqrt(16)}, selected="One")
num = Number(number_slider)
subtraction = Subtraction(A=num, B=1)
panel_5 = Panel(subtraction)
panel_6 = Panel(num)
tree_canopy = Brep(reflay_5)
shade = HBShade(geo=reflay_4, name="Canopies")  # -> report, shades; plug-in component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
python = GhPythonScript(st_month=panel_5, end_month=panel_6)  # -> values; inputs st_month: Int32, end_month: Int32
# ---------- python: Python ----------
from ladybug.analysisperiod import AnalysisPeriod


winter_value = 0.8
summer_value = 0
trans_hours = 1000
increment = (winter_value - summer_value) / trans_hours


if st_month and end_month:
    values = [winter_value] * 8760
    a_per = AnalysisPeriod(st_month=st_month, end_month=end_month)
    insert_list = [summer_value] * len(a_per)
    v_i = summer_value
    for i in range(trans_hours):
        insert_list[i] = winter_value - v_i
        insert_list[-i - 1] = winter_value - v_i
        v_i += increment
    values[a_per.st_time.int_hoy - 1:a_per.end_time.int_hoy] = insert_list
# ---------- end python ----------
shade_2 = HBShade(geo=reflay_3, name="Buildings")  # -> report, shades; plug-in component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
trees_simplifier = TreesSimplifier(trees_from_configurator=tree_canopy)
fixedintervalschedule = HBFixedIntervalSchedule(values=python, name="TREES")  # -> report, schedule; plug-in component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
shade_3 = HBShade(geo=trees_simplifier, ep_trans_sch=seasonalschedule.schedule)  # -> report, shades; plug-in component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
merge = Merge(Data1=shade_2.shades, Data2=shade.shades, Data3=shade_3.shades)  # -> flatten(Result)

# ----
# LINKS
concat = Concatenate(FragmentA=percorso_cartella, FragmentB=nome_modello, JoinSeparator="_")
simulation_results_folder = Panel(concat)
utci = Panel("\utci_comfort_map\results\temperature")
env_cond = Panel("\utci_comfort_map\initial_results\conditions")
concat_2 = Concatenate(FragmentA=simulation_results_folder, FragmentB=env_cond)
concat_3 = Concatenate(FragmentA=simulation_results_folder, FragmentB=utci)
link_results_utci = Panel(concat_3)
link_results_env_cond = Panel(concat_2)

# ----
# Highest temp in the .epw
temperature = Panel(item)
date = Panel(datetime.date)

# ----
# shading
data_2 = Data(merge)

# ----
# 7_join and check 1
# Join Landuses
merge_2 = Merge()

# ----
# MODEL ASSEMBLY
txt = Text(nome_modello)
model = HBModel(rooms=flatten(merge_2), shades=flatten(data_2), name=txt)  # -> report, model; plug-in component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

# ---- group: cliccami
vizwiref = HBVisualizeWireframe(hb_objs=flatten(model.model))  # -> geo; plug-in component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

# ----
# ANALYSIS GRID
vizall = HBVisualizeAll(hb_objs=flatten(merge_2))  # -> geo; plug-in component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
bbox = BoundingBox(Content=vizall, Plane=PlaneXY(0, 0, 0), UnionBox=True)  # -> Box, Box_2
debrep = DeconstructBrep(Brep=bbox.Box)  # -> Faces, Edges, Vertices
item_4 = ListItem(List=debrep.Faces, Index=0, Wrap=True)  # -> Item2, Item1, Item

cluster_4 = Cluster_2(landuses_from_the_model=vizall)  # -> test_srf_2, centerpt_2, normal_2
txt_2 = Text(txt)

evaluation_surface = Brep(item_4.Item1)
genpts = LBGeneratePointGrid(geometry=evaluation_surface, grid_size="5", offset_dist=Slider(0.2, range=0..1), quad_only=Toggle(False))  # -> points, vectors, face_areas, mesh; plug-in component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
concat_4 = Concatenate(FragmentA="grid", FragmentB=txt_2, JoinSeparator="_")
mjoin = MeshJoin(Meshes=flatten(genpts.mesh))
sensorgrid = HBSensorGrid(name=concat_4, positions=genpts.points, directions=genpts.vectors)  # -> grid; plug-in component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
assigngridsviews = HBAssignGridsAndViews(model=simplify(model.model), grids=flatten(sensorgrid))  # -> model; plug-in component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

# ----
# se le frecce non puntano in alto collega in geometry
flip = Flip(Surface=evaluation_surface)  # -> Surface, Result

# ----
# CHECK THE NORMALS!
vdis = VectorDisplay(Anchor=cluster_4.centerpt_2, Vector=cluster_4.normal_2)
# 8_check 2
vdis_2 = VectorDisplay(Anchor=genpts.points, Vector=genpts.vectors)

# ----
# 9_check 3
vizall_2 = HBVisualizeAll(hb_objs=assigngridsviews)  # -> geo; plug-in component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

# ----
# SIMULATION
txt_3 = Text(percorso_cartella)
txt_4 = Text(txt)
concat_5 = Concatenate(FragmentA=txt_3, FragmentB=txt_4, JoinSeparator="_")
panel_7 = Panel(concat_5)
recipesettings = HBRecipeSettings(folder=panel_7, reload_old=False)  # -> settings; plug-in component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
area = Area(Geometry=item_4.Item1)  # -> Area, Centroid
path_2 = FilePath(path)
bool = Boolean(toggle)
data_3 = Data(analysisperiod.period)
division = Division(A=area.Area, B=1000000)
utcimap = HBUTCIComfortMap(model=assigngridsviews, epw=path_2, run_period=data_3, run_settings=recipesettings, run=bool)  # -> report, env_conds, utci, condition, category, TCP, HSP, CSP; plug-in component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
area_km2 = Panel(division)

# ----
# 11
utci_2 = FilePath(link_results_utci)
env_cond_2 = FilePath(link_results_env_cond)

merge_3 = Merge(
    Data1=ColourSwatch(SwatchColor=RGB(230, 99, 105)),
    Data2=ColourSwatch(SwatchColor=RGB(255, 183, 115)),
    Data3=ColourSwatch(SwatchColor=RGB(254, 255, 184)),
    Data4=ColourSwatch(SwatchColor=RGB(149, 219, 88)),
    Data5=ColourSwatch(SwatchColor=RGB(39, 150, 93)))  # -> reverse(Result)

# ---- group: LINK TO "SIMSTEP" TO HAVE AN ANIMATED GIF OF HOURLY VALUES
# GIF
trigger = Trigger(Interval=1000, TimerInterval=1000, Target=num_2)  # disabled
list_7 = ValueList({"0", "23"}, selected="23")  # disabled
num_2 = Number(1)
smooth = SmoothNumbers(Numbers=list_7, SmoothDelay=5000)  # -> expr("Int(x)", Numbers); disabled
series = Series(Start=0, Step=1, Count="23")
rec = DataRecorder(num_2, DataLimit=-10, RecordData=False)
smooth_2 = SmoothNumbers(Numbers=smooth, SmoothDelay=5000)  # -> expr("Int(x)", Numbers); disabled
item_5 = ListItem(List=rec, Index=series, Wrap=invert(True))
smooth_3 = SmoothNumbers(Numbers=smooth_2, SmoothDelay=5000)  # -> expr("Int(x)", Numbers); disabled
ma = MassAddition(Input=item_5)  # -> Result, PartialResults
panel_8 = Panel(smooth_3)
num_3 = Number(ma.Result)

# ---- group: ANALISI SINGOLA ORA
number_slider_3 = Slider(10, range=0..23)

# ----
utci_3 = LBUTCIComfort()  # -> report, utci, comfort, condition, category, comf_obj; plug-in component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

list_8 = ValueList({"MRT": 0, "AIR TEMPERATURE": 1, "LONGWAVE MRT": 2, "SHORTWAVE MRT DELTA": 3, "RELATIVE HUMIDITY": 4}, selected="MRT")
# VISUALIZATION
toggle_2 = BooleanToggle(False)
thermalmtx = HBReadThermalMatrix(comf_result=utci_2, load=toggle_2)  # -> comf_mtx; plug-in component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
python_2 = GhPythonScript()  # -> utci, condition, category, TCP, HSP, CSP
# ---------- python_2: Python ----------
try:
    from lbt_recipes.recipe import Recipe
except ImportError as e:
    raise ImportError('\nFailed to import lbt_recipes:\n\t{}'.format(e))

try:
    from ladybug_rhino.grasshopper import all_required_inputs, recipe_result
except ImportError as e:
    raise ImportError('\nFailed to import ladybug_rhino:\n\t{}'.format(e))

if all_required_inputs(ghenv.Component) and _run:
    recipe = Recipe('utci_comfort_map')
    # load the results
    try:
        env_conds = recipe_result(recipe.output_value_by_name('environmental-conditions', project_folder))
        utci = recipe_result(recipe.output_value_by_name('utci', project_folder))
        condition = recipe_result(recipe.output_value_by_name('condition', project_folder))
        category = recipe_result(recipe.output_value_by_name('category', project_folder))
        TCP = recipe_result(recipe.output_value_by_name('tcp', project_folder))
        HSP = recipe_result(recipe.output_value_by_name('hsp', project_folder))
        CSP = recipe_result(recipe.output_value_by_name('csp', project_folder))
    except Exception:
        raise Exception(recipe.failure_message(project_folder))
# ---------- end python_2 ----------
envmtx = HBReadEnvironmentMatrix(env_conds=env_cond_2, metric=list_8, load=Toggle(False))  # -> comf_mtx; plug-in component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
merge_4 = Merge(
    Data1=ColourSwatch(SwatchColor=RGB(143, 19, 0)),
    Data2=ColourSwatch(SwatchColor=RGB(247, 4, 0)),
    Data3=ColourSwatch(SwatchColor=RGB(255, 153, 0)),
    Data4=ColourSwatch(SwatchColor=RGB(255, 234, 0)),
    Data5=ColourSwatch(SwatchColor=RGB(147, 209, 109)))  # -> reverse(Result)
number_slider_4 = Slider(0.7, range=0..1)
legendpar = LBLegendParameters(
    min="26",
    max="46",
    seg_count=Slider(7, range=0..10),
    colors=merge_4,
    continuous_leg=Toggle(False),
    num_decimals=Slider(0, range=0..100))  # -> leg_par; plug-in component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
legendpar_2 = LBLegendParameters(min="30", max="60", seg_count=Slider(7, range=0..10), colors=merge_3)  # -> leg_par; plug-in component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
mesh = Mesh(mjoin)
vizthermalmap = HBVisualizeThermalMap(comf_mtx=envmtx, mesh=mesh, legend_par=legendpar_2)  # -> report, mesh, legend, title, colors, values; plug-in component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

# ---- group: MEDIA INTERVALLO ORE
month = Number(number_slider)
day = Number(number_slider_2)
analysisperiod_2 = LBAnalysisPeriod(
    start_month=month,
    start_day=day,
    start_hour=Slider(17, range=0..23),
    end_month=month,
    end_day=day,
    end_hour=Slider(18, range=0..23))  # -> period, hoys, dates; plug-in component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

# ----
vizthermalmap_2 = HBVisualizeThermalMap(comf_mtx=thermalmtx, mesh=mesh, period=analysisperiod_2.period, legend_par=legendpar)  # -> report, mesh, legend, title, colors, values; plug-in component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
avr = Average(Input=vizthermalmap_2.values)
panel_9 = Panel(avr)

# ----
# UTCI LEGEND
cluster_5 = Cluster(L=vizthermalmap_2.legend)  # -> number_slider, L_2, swatch, R
tag = TextTag3D(Location=cluster_5.L_2, Text=cluster_5.R, Size=cluster_5.number_slider, Colour=cluster_5.swatch, Justification=7)

# ==== cluster Cluster
L = ClusterInput()
item = ListItem(List=L, Index=0, Wrap=True)
faceb = FaceBoundaries(Mesh=item)
explode = Explode(Curve=faceb, Recursive=True)  # -> Segments, Vertices
item_2 = ListItem(List=explode.Vertices, Index=0, Wrap=True)  # -> Item, Item1
vec2pt = Vector2Pt(PointA=item_2.Item, PointB=item_2.Item1, Unitize=False)  # -> Vector, Length
pt = Point(item_2.Item1)
amp = Amplitude(Vector=vec2pt.Vector, Amplitude=Slider(14, range=0..100))
move = Move(Geometry=pt, Motion=amp)  # -> flatten(Geometry), Transform
panel = Panel("""3
5""")
panel_2 = Panel("""Slight Heat Stress
Moderate Heat Stress
Strong Heat Stress
Very Strong Heat Stress
Extreme Heat Stress""")
cull_i = CullIndex(List=move.Geometry, Indices=panel, Wrap=True)
L_2 = ClusterOutput(cull_i)
concat = Concatenate(FragmentA="__", FragmentB=panel_2)
number_slider = ClusterOutput(Slider(10, range=0..1000))
swatch = ClusterOutput(ColourSwatch(SwatchColor=RGB(0, 0, 0)))
R = ClusterOutput(concat)

# ==== cluster Cluster_2
landuses_from_the_model = ClusterInput()
landuses_from_the_model_2 = Brep(landuses_from_the_model)
debrep = DeconstructBrep(Brep=landuses_from_the_model_2)  # -> Faces, Edges, Vertices
area = Area(Geometry=debrep.Faces)  # -> Area, Centroid
pdecon = Deconstruct(Point=area.Centroid)  # -> XComponent, YComponent, ZComponent
sort = SortList(Keys=pdecon.ZComponent, ValuesA=debrep.Faces)  # -> Keys, reverse(ValuesA)
item = ListItem(List=sort.ValuesA, Index=0, Wrap=True)  # -> flatten(Item)
join = BrepJoin(Breps=item)  # -> Breps, Closed
shrinktrimsrf = ShrinkTrimmedSurface(Surface=join.Breps)  # -> Shrunken, Underlying, R
edges = BrepEdges(Brep=shrinktrimsrf.Shrunken)  # -> Naked, Interior, NonManifold
join_2 = JoinCurves(Curves=edges.Naked, Preserve=False)
len = Length(Curve=join_2)
sort_2 = SortList(Keys=len, ValuesA=join_2)  # -> Keys, reverse(ValuesA)
md_slider = MDSlider(SliderMode=0, slider_value=Point(0.5, 0.5, 0.5), x_domain=Domain(0, 1), y_domain=Domain(0, 1), z_domain=Domain(0, 1))
item_2 = ListItem(List=sort_2.ValuesA, Index=0, Wrap=True)
crv = Curve(item_2)
boundary = BoundarySurfaces(Edges=crv)
evalsrf = EvaluateSurface(Surface=reparameterize(boundary), Point=md_slider)  # -> Point, Normal, UDirection, VDirection, Frame
devec = DeconstructVector(Vector=evalsrf.Normal)  # -> XComponent, YComponent, ZComponent
panel = Panel(evalsrf.Normal)
srf = Surface(boundary)
flip = Flip(Surface=boundary)  # -> Surface, Result
smaller = SmallerThan(FirstNumber=devec.ZComponent, SecondNumber=0)  # -> SmallerThan, OrEqualTo
filter = StreamFilter(Gate=smaller.SmallerThan, Stream0=srf, Stream1=flip.Surface)
test_srf = Surface(filter)
evalsrf_2 = EvaluateSurface(Surface=reparameterize(test_srf), Point=md_slider)  # -> Point, Normal, UDirection, VDirection, Frame
normal = Vector(evalsrf_2.Normal)
centerpt = Point(evalsrf_2.Point)
test_srf_2 = ClusterOutput(test_srf)
centerpt_2 = ClusterOutput(centerpt)
normal_2 = ClusterOutput(normal)

# ==== cluster Cluster_3
elefrontlayer = ClusterInput()
elefrontlayer_2 = Text(elefrontlayer)
split = TextSplit(Text=elefrontlayer_2, Separators="::")
item = ListItem(List=split, Index=0, Wrap=True)  # -> Item1, Item
rep = ReplaceText(Text=item.Item1, Find=" ", Replace="_", RecursiveReplace=False)
hb_name = Text(rep)
hb_name_2 = ClusterOutput(hb_name)

# ==== cluster TreesSimplifier
trees_from_configurator = ClusterInput()
trees_from_configurator_2 = Brep(trees_from_configurator)
debrep = DeconstructBrep(Brep=trees_from_configurator_2)  # -> Faces, Edges, Vertices
area = Area(Geometry=debrep.Faces)  # -> Area, Centroid
pdecon = Deconstruct(Point=area.Centroid)  # -> XComponent, YComponent, ZComponent
sort = SortList(Keys=pdecon.ZComponent, ValuesA=debrep.Faces, ValuesB=area.Centroid)  # -> Keys, ValuesA, ValuesB
md_slider = MDSlider(SliderMode=0, slider_value=Point(0.5, 0.5, 0.5), x_domain=Domain(0, 1), y_domain=Domain(0, 1), z_domain=Domain(0, 1))
item = ListItem(List=sort.ValuesB, Index=0, Wrap=True)  # -> Item1, Item
item_2 = ListItem(List=sort.ValuesA, Index=0, Wrap=True)  # -> Item1, Item
iso = IsoCurve(Surface=reparameterize(item_2.Item1), UVPoint=md_slider)  # -> UIsocurve, VIsocurve
dist = Distance(PointA=item.Item1, PointB=item.Item)
Z = UnitZ(Factor=expr("-x", dist))
extr = Extrude(Base=iso.UIsocurve, Direction=Z)
extr_2 = Extrude(Base=iso.VIsocurve, Direction=Z)
merge = Merge(Data1=extr, Data2=extr_2)
output_srf = Surface(merge)
output_srf_2 = ClusterOutput(output_srf)
