# Grasshopper definition WORKERBEE_1.04.gh (Grasshopper 1.0.7)

# ---- group: SET THE LOCATION
pt = Point([<point referenced from the Rhino model> x310])

# ---- group: SET THE BASECRV
crv = Curve(<curve referenced from the Rhino model>)

# ---- group: SET THE LOCATION
pt_2 = Point(<point referenced from the Rhino model>)

# ---- group: BAKE!!!
button = Button()

# ----
# CANOPIES
canopies_typology = ValueList({"Canopy": 0, "photovoltaic canopy": 1, "Pergola": 2, "tensile structure": 3}, selected="tensile structure")
canopy_data = CANOPYDATA(
    canopy_height=Slider(8, range=0..20),
    canopy_length=Slider(6, range=0..100),
    canopy_width=Slider(16, range=0..100),
    location=pt_2,
    slope_degrees=Slider(19, range=0..90),
    color_selection=canopies_typology)  # -> canopy_brep_2, environmental_co_benefits_2, social_co_benefits_2, economic_co_benefits_2, layer_2
canopy_bake = CANOPYBAKE(
    canopy=canopy_data.canopy_brep_2,
    environmental_co_benefits=canopy_data.environmental_co_benefits_2,
    social_co_benefits=canopy_data.social_co_benefits_2,
    economic_co_benefits=canopy_data.economic_co_benefits_2,
    layer=canopy_data.layer_2,
    bake=button)

# ---- group: BAKE!!!
button_2 = Button()

# ----
# ROADS
roads = ValueList({"ASPHALT": 0, "ASPHALT_COOL": 1, "TERRE_BATTUE": 2, "BRICK_ROAD_RED_STONES": 3, "BRICK_ROAD_YELLOW_STONES": 4}, selected="TERRE_BATTUE")
road_data = ROADDATA(basepolyline=crv, flip=Toggle(True), width=Slider(16, range=3..20), roads=roads)  # -> road_brep, construction_string_2, environmental_cobenefit, social_cobenefit, economical_cobenefit, albedo, thermalemissivity, colour, name
road_bake = ROADBAKE(
    ground_brep=road_data.road_brep,
    hb_string=road_data.construction_string_2,
    environmental_co_benefits=road_data.environmental_cobenefit,
    social_co_benefits=road_data.social_cobenefit,
    economic_co_benefits=road_data.economical_cobenefit,
    albedo=road_data.albedo,
    thermalemissivity=road_data.thermalemissivity,
    colour=road_data.colour,
    layer=road_data.name,
    bake=button_2)

# ---- group: BAKE!!!
button_3 = Button()

# ----
# TREES
crown_coefficient = ValueList({"ZERO MAINTENANCE": 0, "ORDINARY MAINTENANCE": 1, "EXTRAORDINARY MAINTENANCE": 2}, selected="EXTRAORDINARY MAINTENANCE")
roots_coefficient = ValueList({"OPTIMAL PLANTING SITE": 0, "DISCRETE PLANTING SITE": 1, "REDUCED PLANTING SITE": 2}, selected="OPTIMAL PLANTING SITE")
trees = ValueList({"Acer Platanoides": 0, "Fraxinus Excelsior": 1, "Prunus Cerasifera Pissardi": 2}, selected="Acer Platanoides")
age = Slider(50, range=1..50)
cluster = Cluster_5(tree=trees, age=age, crown_coefficient=crown_coefficient, roots_coefficient=roots_coefficient, location=pt)  # -> specie_2, order_of_size_2, drought_tolerance_2, urban_space_type_2, co2_stored_2, geometry_4, tree_height_2
cluster_2 = Cluster_6(
    specie=cluster.specie_2,
    order_of_size=cluster.order_of_size_2,
    drought_tolerance=cluster.drought_tolerance_2,
    urban_space_type=cluster.urban_space_type_2,
    co2_stored=cluster.co2_stored_2,
    tree_height=cluster.tree_height_2,
    geometry=cluster.geometry_4,
    bake=button_3)

# ---- group: BAKE!!!
button_4 = Button()

# ---- group: SET THE CURVE
curve = Curve(<curve referenced from the Rhino model>)

# ---- group: BAKE!!!
button_5 = Button()

# ----
# GROUNDS
landcovers = ValueList({"LOAMY_SOIL": 0, "SAND": 1, "WOOD": 2, "COBBLESTONE": 3, "PORPHYRY": 4, "GRANITE": 5, "BASALT": 6, "CONCRETE_PAVEMENT_DARK": 7, "CONCRETE_PAVEMENT_MEDIUM": 8, "CONCRETE_PAVEMENT_LIGHT": 9, "GRASS": 10, "HIGH_GRASS": 11, "AGRICULTURE": 12, "GRASSY_JOINT_FLOORING": 13, "ASPHALT": 14, "ASPHALT_COOL": 15, "TERRE_BATTUE": 16, "BRICK_ROAD_RED_STONES": 17, "BRICK_ROAD_YELLOW_STONES": 18, "WATER": 19}, selected="WATER")
round_data = ROUNDDATA(location=curve, lancovers=landcovers)  # -> groundbrep, construction_string_2, environmental_cobenefit, social_cobenefit, economic_cobenefit, albedo, thermalemissivity, colour, name
ground_bake = GROUNDBAKE(
    ground_brep=round_data.groundbrep,
    hb_string=round_data.construction_string_2,
    environmental_co_benefits=round_data.environmental_cobenefit,
    social_co_benefits=round_data.social_cobenefit,
    economic_co_benefits=round_data.economic_cobenefit,
    albedo=round_data.albedo,
    thermalemissivity=round_data.thermalemissivity,
    colour=round_data.colour,
    layer=round_data.name,
    bake=button_5)

# ----
# BUILDINGS
constructiontypes = HBConstructionTypes({"SteelFramed", "WoodFramed", "Mass", "Metal Building"}, selected="WoodFramed")
building_program = ValueList({"Residential": 0, "Non Residential": 1, "School": 2}, selected="Non Residential")
bldgvintages = HBBuildingVintages({"ASHRAE 90.1 2019  |  IECC 2021": "2019", "ASHRAE 90.1 2016  |  IECC 2018": "2016", "ASHRAE 90.1 2013  |  IECC 2015": "2013", "ASHRAE 90.1 2010  |  IECC 2012": "2010", "ASHRAE 90.1 2007  |  IECC 2009": "2007", "ASHRAE 90.1 2004  |  IECC 2006": "2004", "1980-2004 (CBECS)": "1980_2004", "Pre-1980 (CBECS)": "pre_1980"}, selected="ASHRAE 90.1 2013  |  IECC 2015")
climatezones = HBClimateZones({"1 - Very Hot": "1", "2 - Hot": "2", "3 - Warm": "3", "4 - Mixed": "4", "5 - Cool": "5", "6 - Cold": "6", "7 - Very Cold": "7", "8 - Subarctic": "8"}, selected="4 - Mixed")
gfloor = ValueList({"Igloo concrete floor not insulated": 0, "Poorly insulated igloo concrete floor": 1, "Insulated igloo concrete floor": 2}, selected="Igloo concrete floor not insulated")
roof = ValueList({"Timber floor not insulated": 0, "Poorly insulated timber floor": 1, "Highly insulated timber floor": 2, "Lateral concrete floor not insulated": 3, "Poorly insulated lateral concrete floor": 4, "Highly insulated lateral concrete floor": 5, "Medium insulated lightweight concrete floor": 6, "Insulated lightweight concrete floor": 7, "Highly insulated lightweight concrete floor": 8, "Concrete roof": 9, "Wooden roof": 10, "Extensive green roof": 11}, selected="Timber floor not insulated")
wall = ValueList({"Brick Masonry Not-Insulated": 0, "Brick Masonry Insulated": 1, "Brick Masonry Highly Insulated": 2, "Thermal Block Masonry Insulated": 3, "Thermal Block Masonry Highly Insulated": 4, "Concrete Masonry Not-Insulated": 5, "Concrete Masonry Medium Insulated External": 6, "Concrete Masonry Medium Insulated Internal": 7, "Concrete Masonry Highly Insulated": 8, "Stone Masonry Not-Insulated": 9, "Stone Masonry Medium Insulated": 10, "Stone Masonry Highly Insulated": 11, "Brick Masonry Not-Insulated": 12, "Brick Masonry Medium Insulated": 13, "Brick Masonry Highly Insulated": 14, "CONCRETE PACKAGE": 15, "VENTILATED WALL": 16, "WET WOOD PACKAGE": 17, "DRY WOOD PACKAGE": 19}, selected="Brick Masonry Not-Insulated")
floortofloor_height_m = Slider(2, range=0..10)
heigth = Slider(6, range=0..10)
glazing_u = Slider(0.3, range=0.1..0.9)
name_object = Panel("Office1")
layer_name_according_to_building_program = Panel("""Residential
Non Residential
School""")
wwr = Slider(0.2, range=0.1..1.1)
crv_2 = Curve(<curve referenced from the Rhino model>)
building_data = BUILDINGDATA(
    building_name=name_object,
    location=crv_2,
    height=heigth,
    floortofloor_height=floortofloor_height_m,
    hb_climatezone=climatezones,
    hb_building_vintages=bldgvintages,
    hb_constructiontype=constructiontypes,
    envelope_selector=wall,
    roof_selector=roof,
    groundfloor_selector=gfloor,
    wwr=wwr,
    glazing_u_factor=glazing_u,
    program_boolean=building_program)  # -> building_name_2, brep, wall_stratigraphy, wall_u_fac, roof_stratigraphy, roof_u_fac, floor_stratigraphy, floor_u_fac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

item = ListItem(List=layer_name_according_to_building_program, Index=building_program, Wrap=True)

# ----
# da fare
# -GWP spazi aperti
# -GWP/m2 e GWP totale come output |OK FATTO|
# -Acqua in python |OK FATTO|
# -Inserire materiale acqua (come loamy soil)|OK FATTO|
# -Aggiungere tre alberature al componente trees
# -Cambiare geometria di input al componente Ground |OK FATTO|
# -aggiungere emissioni co2 nel calcolo dei consumi energetici(altro tool)
# -dare un occhiata al tool outdoor e inserire script in python per l'acqua
# -sostituire stratigrafie nell'energy consumption
# -
building_bake = BUILDINGBAKE(
    building_name=building_data.building_name_2,
    brep=building_data.brep,
    wall_stratigraphy=building_data.wall_stratigraphy,
    wall_u_fac=building_data.wall_u_fac,
    roof_stratigraphy=building_data.roof_stratigraphy,
    roof_u_fac=building_data.roof_u_fac,
    floor_stratigraphy=building_data.floor_stratigraphy,
    floor_u_fac=building_data.floor_u_fac,
    enviromental_cobenefit=building_data.enviromental_cobenefit,
    social_cobenefit=building_data.social_cobenefit,
    economic_cobenefit=building_data.economic_cobenefit,
    gwp_kgco2e_m2=building_data.gwp_kgco2e_m2,
    gwp_kgco2=building_data.gwp_kgco2e,
    string=building_data.df_building_2,
    layer_name=item,
    bake=button_4)

# ==== cluster ROADDATA
roads = ClusterInput()
basepolyline = ClusterInput()
flip = ClusterInput()
width = ClusterInput()
cluster = Cluster_2(basepolyline=basepolyline, flip=flip, width=width)
roads_2 = Number(roads)
cluster_2 = Cluster(roads=roads_2)  # -> name_2, construction_string_2, selected_constr_2, environmental_cobenefit_2, social_cobenefit_2, economic_cobenefit_2, albedo_2, thermalemissivity_2, colour_2
road_brep = ClusterOutput(cluster)
environmental_cobenefit = ClusterOutput(cluster_2.environmental_cobenefit_2)
social_cobenefit = ClusterOutput(cluster_2.social_cobenefit_2)
economical_cobenefit = ClusterOutput(cluster_2.economic_cobenefit_2)
albedo = ClusterOutput(cluster_2.albedo_2)
thermalemissivity = ClusterOutput(cluster_2.thermalemissivity_2)
colour = ClusterOutput(cluster_2.colour_2)
name = ClusterOutput(cluster_2.name_2)
construction_string = Data(cluster_2.construction_string_2)
construction_string_2 = ClusterOutput(construction_string)

# ==== cluster ROUNDDATA
location = ClusterInput()
lancovers = ClusterInput()
cluster = Cluster_3(lancovers=lancovers)  # -> name_2, construction_string_2, selected_constr_2, environmental_cobenefit_2, social_cobenefit_2, economic_cobenefit_2, albedo_2, thermalemissivity_2, colour_2
cluster_2 = Cluster_4(location=location)
environmental_cobenefit = ClusterOutput(cluster.environmental_cobenefit_2)
social_cobenefit = ClusterOutput(cluster.social_cobenefit_2)
economic_cobenefit = ClusterOutput(cluster.economic_cobenefit_2)
albedo = ClusterOutput(cluster.albedo_2)
thermalemissivity = ClusterOutput(cluster.thermalemissivity_2)
name = ClusterOutput(cluster.name_2)
colour = ClusterOutput(cluster.colour_2)
construction_string = Data(cluster.construction_string_2)
construction_string_2 = ClusterOutput(construction_string)
groundbrep = ClusterOutput(cluster_2)

# ==== cluster CANOPYDATA
canopy_height = ClusterInput()
canopy_width = ClusterInput()
canopy_length = ClusterInput()
slope_degrees = ClusterInput()
location = ClusterInput()
canopy_height_2 = Number(canopy_height)
canopy_width_2 = Number(canopy_width)
canopy_length_2 = Number(canopy_length)
slope_degrees_2 = Number(slope_degrees)
location_2 = Point(location)

# ----
# Co-Benefits
# DATABASE
social = Panel("""HEALTH IMPACTS
PUBBLIC SPACE ACCESS
AESTHETIC VALUE
COMMUUNITY INCLUSION
CULTURAL""")
environmental = Panel("""AIR QUALITY
GHG EMISSIONS
WATER RECOLLECTION AND SECURITY
WATER QUALITY
BIODIVERSITY
LANDSLIDES AND WEATHERING""")
economic = Panel("""EMPLOYMENT AND INCOME GENERATION
SAVINGS
INNOVATION AND INVESTIMENT
PROPERTY VALUE""")
lng = ListLength(List=environmental)
lng_2 = ListLength(List=social)
lng_3 = ListLength(List=economic)
total_economic = Panel(lng)
total_social = Panel(lng_2)
total_environmental = Panel(lng_3)
canopies_co_benefits = CanopiesCoBenefits()  # -> environmental_3, social_3, economic_3
item = ListItem(List=environmental, Index=canopies_co_benefits.environmental_3, Wrap=invert(True))
item_2 = ListItem(List=social, Index=canopies_co_benefits.social_3, Wrap=invert(True))
item_3 = ListItem(List=economic, Index=canopies_co_benefits.economic_3, Wrap=invert(True))
economic_2 = Panel(item_3)
social_2 = Panel(item_2)
environmental_2 = Panel(item)

color_selection = ClusterInput()
color_selection_2 = Number(color_selection)
canopy_typology = Panel("""Canopy
photovoltaic canopy
Pergola
tensile structure""")
list_item = ListItem(List=canopy_typology, Index=color_selection_2, Wrap=True)
economic_co_benefits = Data(item_3)
social_co_benefits = Data(item_2)
environmental_co_benefits = Data(item)
economic_co_benefits_2 = ClusterOutput(economic_co_benefits)
layer = Text(list_item)
social_co_benefits_2 = ClusterOutput(social_co_benefits)
environmental_co_benefits_2 = ClusterOutput(environmental_co_benefits)
layer_2 = ClusterOutput(layer)

# ---- group: geometry for test
pdecon = Deconstruct(Point=location_2)  # -> XComponent, YComponent, ZComponent
pt = ConstructPoint(XCoordinate=pdecon.XComponent, YCoordinate=pdecon.YComponent, ZCoordinate=canopy_height_2)
division = Division(A=canopy_length_2, B=2)
division_2 = Division(A=canopy_width_2, B=2)
xy = XYPlane(Origin=pt)
neg = Negative(Value=division)
neg_2 = Negative(Value=division_2)
dom = ConstructDomain(DomainStart=neg, DomainEnd=division)
dom_2 = ConstructDomain(DomainStart=neg_2, DomainEnd=division_2)
rectangle = Rectangle(Plane=xy, XSize=dom_2, YSize=dom, Radius=0)  # -> Rectangle, Length
area = Area(Geometry=rectangle.Rectangle)  # -> Area, Centroid

# ----
deplane = DeconstructPlane(Plane=xy)  # -> Origin, XAxis, YAxis, ZAxis
pl = PlaneNormal(Origin=deplane.Origin, ZAxis=deplane.XAxis)
explode = Explode(Curve=rectangle.Rectangle, Recursive=True)  # -> Segments, Vertices
item_4 = ListItem(List=explode.Segments, Index=0, Wrap=True)  # -> Item, Item1, Item2, Item3
midpt = CurveMiddle(Curve=item_4.Item1)
midpt_2 = CurveMiddle(Curve=item_4.Item3)
vec = Vector(deplane.XAxis)
rev = Reverse(Vector=vec)
line = LineSDL(Start=[midpt, midpt_2], Direction=expr("-x", Vector(0, 0, 1)), Length=canopy_height_2)
amp = Amplitude(Vector=vec, Amplitude="0.3")
amp_2 = Amplitude(Vector=rev, Amplitude="0.3")
extr = Extrude(Base=graft(line), Direction=graft([amp_2, amp]))
vec_2 = Vector(deplane.YAxis)
amp_3 = Amplitude(Vector=vec_2, Amplitude="0.3")
extr_2 = Extrude(Base=flatten(extr), Direction=amp_3)

# ---- group: geometry for test (continued)
rotate = Rotate(Geometry=rectangle.Rectangle, Angle=degrees(slope_degrees_2), Plane=pl)  # -> Geometry, Transform
boundary = BoundarySurfaces(Edges=rotate.Geometry)
canopy_brep = Brep(boundary)

# ----
canopy_brep_2 = ClusterOutput(canopy_brep)

# ==== cluster ROADBAKE
layer = ClusterInput()
layer_2 = Data(layer)
thermalemissivity = ClusterInput()
ground_brep = ClusterInput()
hb_string = ClusterInput()
economic_co_benefits = ClusterInput()
social_co_benefits = ClusterInput()
environmental_co_benefits = ClusterInput()
albedo = ClusterInput()
concatenate = Concatenate(FragmentA="Roads", FragmentB=layer_2, JoinSeparator="::")
bake = ClusterInput()
ground_brep_2 = Geometry(ground_brep)
economic_co_benefits_2 = Data(economic_co_benefits)
social_co_benefits_2 = Data(social_co_benefits)
environmental_co_benefits_2 = Data(environmental_co_benefits)
thermalemissivity_2 = Data(thermalemissivity)
albedo_2 = Data(albedo)
hb_string_2 = Text(hb_string)
layer_3 = Text(concatenate)
bake_2 = Boolean(bake)
join = TextJoin(Text=economic_co_benefits_2)
join_2 = TextJoin(Text=environmental_co_benefits_2)
join_3 = TextJoin(Text=social_co_benefits_2)
update = Button()
merge = Merge(Data1=albedo_2, Data2=thermalemissivity_2, Data3=join_2, Data4=join_3, Data5=join, Data6=hb_string_2)
panel = Panel(merge)
c_script = CSharpScript(delete=update)  # inputs delete: Boolean
# ---------- c_script: C# usings ----------
using System.Linq;
# ---------- c_script: C# ----------
    if(delete)
    {
      var doc = this.Component.OnPingDocument();
      if(doc == null)return;
      var objs = doc.Objects;
      var deleteComs = objs.Where(o => o.GetType().ToString() == "Grasshopper.Kernel.Components.GH_PlaceholderComponent").ToList();
      if(deleteComs == null || deleteComs.Count == 0)return;
      doc.ScheduleSolution(20, (d) => doc.RemoveObjects(deleteComs, false));
    }
# ---------- end c_script ----------
panel_2 = Panel("""Albedo
Thermal Emissivity
Environmental Co-benefits
Social Co-benefits
Economic Co-benefits
HB STRING""")
colour = ClusterInput()
list = ValueList({"Layer", "Material", "Object", "Parent"}, selected="Object")
colour_2 = Colour(colour)
ef_att = EleFrontAttributes(Keys=panel_2, Values=panel, Layer=layer_3, ColourSource=list, ObjectColour=colour_2)  # -> Attributes, Keys, Values, Name, Layer, ColourSource, DisplayColour, MaterialSource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
bake_3 = BakeObjects(Geometry=ground_brep_2, Attributes=ef_att.Attributes, Bake=bake_2, createGroups=False)  # -> Message, Ghosts

# ==== cluster GROUNDBAKE
layer = ClusterInput()
environmental_co_benefits = ClusterInput()
economic_co_benefits = ClusterInput()
ground_brep = ClusterInput()
social_co_benefits = ClusterInput()
layer_2 = Data(layer)
thermalemissivity = ClusterInput()
hb_string = ClusterInput()
albedo = ClusterInput()
environmental_co_benefits_2 = Data(environmental_co_benefits)
economic_co_benefits_2 = Data(economic_co_benefits)
social_co_benefits_2 = Data(social_co_benefits)
bake = ClusterInput()
concat = Concatenate(FragmentA="Landcovers", FragmentB=layer_2, JoinSeparator="::")
thermalemissivity_2 = Data(thermalemissivity)
hb_string_2 = Data(hb_string)
ground_brep_2 = Geometry(ground_brep)
albedo_2 = Data(albedo)
layer_3 = Text(concat)
bake_2 = Boolean(bake)
join = TextJoin(Text=economic_co_benefits_2)
join_2 = TextJoin(Text=environmental_co_benefits_2)
join_3 = TextJoin(Text=social_co_benefits_2)
merge = Merge(Data1=albedo_2, Data2=thermalemissivity_2, Data3=join_2, Data4=join_3, Data5=join, Data6=hb_string_2)
panel = Panel("""Albedo
Thermal Emissivity
Environmental Co-benefits
Social Co-benefits
Economic Co-benefits
HB STRING""")
panel_2 = Panel(merge)
colour = ClusterInput()
list = ValueList({"Layer", "Material", "Object", "Parent"}, selected="Object")
colour_2 = Colour(colour)
ef_att = EleFrontAttributes(Keys=panel, Values=panel_2, Layer=layer_3, ColourSource=list, ObjectColour=colour_2)  # -> Attributes, Keys, Values, Name, Layer, ColourSource, DisplayColour, MaterialSource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
bake_3 = BakeObjects(Geometry=ground_brep_2, Attributes=ef_att.Attributes, Bake=bake_2, createGroups=False)  # -> Message, Ghosts

# ==== cluster CANOPYBAKE
layer = ClusterInput()
layer_2 = Data(layer)
concat = Concatenate(FragmentA="Canopies", FragmentB=layer_2, JoinSeparator="::")
economic_co_benefits = ClusterInput()
social_co_benefits = ClusterInput()
canopy = ClusterInput()
environmental_co_benefits = ClusterInput()
economic_co_benefits_2 = Data(economic_co_benefits)
canopy_2 = Geometry(canopy)
social_co_benefits_2 = Data(social_co_benefits)
canopy_typology = Data(concat)
environmental_co_benefits_2 = Data(environmental_co_benefits)
bake = ClusterInput()
join = TextJoin(Text=economic_co_benefits_2)
join_2 = TextJoin(Text=environmental_co_benefits_2)
join_3 = TextJoin(Text=canopy_typology)
join_4 = TextJoin(Text=social_co_benefits_2)
bake_2 = Boolean(bake)
merge = Merge(Data1=join_2, Data2=join_4, Data3=join, Data4=join_3)
panel = Panel("""Environmental Co-benefits
Social Co-benefits
Economic Co-benefits
Canopy typology""")
panel_2 = Panel(merge)
list = ValueList({"Layer", "Material", "Object", "Parent"}, selected="Object")
layer_3 = Text(concat)
color = DefineColor(Color=ColourSwatch(SwatchColor=RGB(228, 14, 0)), Source=list)
ef_att = EleFrontAttributes(Keys=panel, Values=panel_2, Layer=layer_3, ColourSource=list, ObjectColour=color)  # -> Attributes, Keys, Values, Name, Layer, ColourSource, DisplayColour, MaterialSource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
bake_3 = BakeObjects(Geometry=canopy_2, Attributes=ef_att.Attributes, Bake=bake_2, createGroups=False)  # -> Message, Ghosts

# ==== cluster Cluster_5
age = ClusterInput()
tree = ClusterInput()
age_2 = Integer(age)
tree_2 = Number(tree)
acero_riccio = AceroRiccio(first_number=age_2)  # -> specie_di_riferimento_3, ordine_di_grandezza_3, tolleranza_alla_siccità_3, usi_3, densità_3, dbh_2, height_2, crown_diameter_2
frassino = Frassino(first_number=age_2)  # -> specie_di_riferimento_3, ordine_di_grandezza_3, tolleranza_alla_siccità_3, usi_3, densità_3, dbh_2, height_2, crown_diameter_2
prunus = Prunus(first_number=age_2)  # -> specie_di_riferimento_3, ordine_di_grandezza_3, tolleranza_alla_siccità_3, usi_3, densità_3, dbh_2, height_2, crown_diameter_2
crown_coefficient = ClusterInput()
roots_coefficient = ClusterInput()
stream_filter = StreamFilter(Gate=tree_2, Stream0=acero_riccio.usi_3, Stream1=frassino.usi_3, Stream2=prunus.usi_3)
stream_filter_2 = StreamFilter(
    Gate=tree_2,
    Stream0=acero_riccio.tolleranza_alla_siccità_3,
    Stream1=frassino.tolleranza_alla_siccità_3,
    Stream2=prunus.tolleranza_alla_siccità_3)
stream_filter_3 = StreamFilter(
    Gate=tree_2,
    Stream0=acero_riccio.specie_di_riferimento_3,
    Stream1=frassino.specie_di_riferimento_3,
    Stream2=prunus.specie_di_riferimento_3)
stream_filter_4 = StreamFilter(
    Gate=tree_2,
    Stream0=acero_riccio.ordine_di_grandezza_3,
    Stream1=frassino.ordine_di_grandezza_3,
    Stream2=prunus.ordine_di_grandezza_3)
stream_filter_5 = StreamFilter(Gate=tree_2, Stream0=acero_riccio.crown_diameter_2, Stream1=frassino.crown_diameter_2, Stream2=prunus.crown_diameter_2)
stream_filter_6 = StreamFilter(Gate=tree_2, Stream0=acero_riccio.dbh_2, Stream1=frassino.dbh_2, Stream2=prunus.dbh_2)
stream_filter_7 = StreamFilter(Gate=tree_2, Stream0=acero_riccio.height_2, Stream1=frassino.height_2, Stream2=prunus.height_2)
stream_filter_8 = StreamFilter(Gate=tree_2, Stream0=acero_riccio.densità_3, Stream1=frassino.densità_3, Stream2=prunus.densità_3)
location = ClusterInput()
crown_coefficient_2 = Number(crown_coefficient)
roots_coefficient_2 = Number(roots_coefficient)
specie = Data(stream_filter_3)
order_of_size = Data(stream_filter_4)
drought_tolerance = Data(stream_filter_2)
densità = Data(stream_filter_8)
crown_diameter = Data(stream_filter_5)
urban_space_type = Data(stream_filter)
height = Data(stream_filter_7)
specie_2 = ClusterOutput(specie)
order_of_size_2 = ClusterOutput(order_of_size)
dhb = Data(stream_filter_6)
drought_tolerance_2 = ClusterOutput(drought_tolerance)
urban_space_type_2 = ClusterOutput(urban_space_type)
location_2 = Point(location)
ghpython_script = GhPythonScript(
    coef_crown=crown_coefficient_2,
    coef_root=roots_coefficient_2,
    tempo=age_2,
    dhb=dhb,
    H=height,
    densità=densità,
    crown=crown_diameter,
    point=graft(location_2))  # -> co2, geomtery, geomtery1
# ---------- ghpython_script: Python ----------
import rhinoscriptsyntax as rs
#information for germotry and co2
coef_crown_value = { 0 : 1.48 , 1 : 0.98 , 2 : 0.68 } 
coef_root_value = { 0 : 1.40 , 1 : 0.90 ,  2: 0.60 }

Dbh = (dhb/100)
h = H

print H
den = densità 
h_crown = crown
print h
v = (((Dbh**2) / 4)  * 3.14 ) * (h *0.7)
v_t = v * (coef_crown_value[coef_crown] + coef_root_value[coef_root] ) 
co2 = (v_t * den * 917)

#generating geometries 
point = point_
guidline = rs.AddLine(rs.PointCoordinates(point) , (rs.PointCoordinates(point)[0] , \
rs.PointCoordinates(point)[1] ,h*0.3 ))
curve = rs.AddRectangle(rs.WorldXYPlane(),Dbh,Dbh)
surface = rs.ExtrudeSurface((rs.AddPlanarSrf(curve)), guidline , True )
geomtery = rs.MoveObject(surface , point)
print Dbh
#generating geomtery for crown 

endpoint = rs.CurveEndPoint(guidline , -1)
guidline1 = rs.AddLine(endpoint , (endpoint[0] , endpoint [1] , h_crown * 0.7 +endpoint [2]))
curve1 = rs.AddRectangle(rs.WorldXYPlane(),crown,crown)

cent = rs.CurveAreaCentroid(curve1)[0]
curve1_moved = rs.MoveObject(curve1 , ((endpoint[0]- cent[0]),(endpoint[1]- cent[1] ),\
(endpoint[2]- cent[2])))
geomtery1 = rs.ExtrudeSurface((rs.AddPlanarSrf(curve1)), guidline1 , True )
# ---------- end ghpython_script ----------
co2_stored = Number(expr("Round (x,2)", flatten(ghpython_script.co2)))
geometry = Geometry(ghpython_script.geomtery)
geometry_2 = Geometry(ghpython_script.geomtery1)
brep_join = BrepJoin(Breps=[geometry_2, geometry])  # -> Breps, Closed
co2_stored_2 = ClusterOutput(co2_stored)
solid_union = SolidUnion(Breps=brep_join.Breps)  # -> flatten(Result)
geometry_3 = Data(solid_union)
bbox = BoundingBox(Content=geometry_3, Plane=PlaneXY(0, 0, 0))  # -> Box, Box_2
debrep = DeconstructBrep(Brep=bbox.Box)  # -> Faces, Edges, Vertices
geometry_4 = ClusterOutput(geometry_3)
pdecon = Deconstruct(Point=debrep.Vertices)  # -> XComponent, YComponent, ZComponent
cset = CreateSet(List=pdecon.ZComponent)  # -> Set, Map
item = ListItem(List=cset.Set, Index=0, Wrap=True)  # -> Item, flatten(Item1)
tree_height = Number(expr("Round(x,2)", item.Item1))
tree_height_2 = ClusterOutput(tree_height)

# ==== cluster Cluster_6
drought_tolerance = ClusterInput()
order_of_size = ClusterInput()
urban_space_type = ClusterInput()
tree_height = ClusterInput()
specie = ClusterInput()
co2_stored = ClusterInput()
geometry = ClusterInput()
drought_tolerance_2 = Data(drought_tolerance)
co2_stored_2 = Data(co2_stored)
tree_height_2 = Number(tree_height)
urban_space_type_2 = Data(urban_space_type)
order_of_size_2 = Data(order_of_size)
specie_2 = Data(specie)
geometry_2 = Brep(geometry)
weave = Weave(
    Pattern=[0, 1, 5, 2, 3, 4],
    Stream0=specie_2,
    Stream1=order_of_size_2,
    Stream2=drought_tolerance_2,
    Stream3=urban_space_type_2,
    Stream4=graft(co2_stored_2),
    Stream5=graft(tree_height_2),
    NullGaps=False)
panel = Panel("""1_Species
2_height class
3_tree height [m]
3_Tolerance to drought
4_Uses
5_CO2 stored [kgCO2eq]""")
panel_2 = Panel(weave)
panel_3 = Panel(specie_2)
concatenate = Concatenate(FragmentA="Trees", FragmentB=specie_2, JoinSeparator="::")
update = Button()
list = ValueList({"Layer", "Material", "Object", "Parent"}, selected="Object")
bake = ClusterInput()
c_script = CSharpScript(delete=update)  # inputs delete: Boolean; same code as c_script
layer = Text("Trees")
bake_2 = Boolean(bake)
color = DefineColor(Color=ColourSwatch(SwatchColor=RGB(32, 130, 39)), Source="object")
ef_att = EleFrontAttributes(Keys=panel, Values=panel_2, Name=panel_3, Layer=layer, ColourSource=list, ObjectColour=color)  # -> Attributes, Keys, Values, Name, Layer, ColourSource, DisplayColour, MaterialSource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
clone = CloneStructure(List=geometry_2, Structure=ef_att.Attributes)
bake_3 = BakeObjects(Geometry=clone, Attributes=ef_att.Attributes, Bake=bake_2, createGroups=False)  # -> Message, Ghosts

# ==== cluster BUILDINGDATA
floortofloor_height = ClusterInput()
building_name = ClusterInput()
groundfloor_selector = ClusterInput()
location = ClusterInput()
height = ClusterInput()
program_boolean = ClusterInput()
roof_selector = ClusterInput()
wwr = ClusterInput()
hb_climatezone = ClusterInput()
hb_building_vintages = ClusterInput()
hb_constructiontype = ClusterInput()
glazing_u_factor = ClusterInput()
envelope_selector = ClusterInput()
geometry = GEOMETRY(building_name=building_name, location=location, height=height, floortofloor_height=floortofloor_height)  # -> building_name_4, brep_3, number_of_stories_2, building_footprint_2, wall_area_m2_2, floor_area_m2_2
consruction_set = CONSRUCTIONSET(
    hb_climatezone=hb_climatezone,
    hb_building_vintages=hb_building_vintages,
    hb_constructiontype=hb_constructiontype,
    envelope_selector=envelope_selector,
    wall_area_m2=geometry.wall_area_m2_2,
    roof_selector=roof_selector,
    wwr=wwr,
    floor_area_m2=geometry.floor_area_m2_2,
    groundfloor_selector=groundfloor_selector,
    glazing_u_factor=glazing_u_factor,
    program_boolean=program_boolean)  # -> wall_stratigraphy_2, wall_u_fac_2, roof_stratigraphy_2, roof_u_fac_2, floor_stratigraphy_2, floor_u_fac_2, enviromental_cobenefit_2, constr_set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

# ---- group: Output
wall_stratigraphy = ClusterOutput(consruction_set.wall_stratigraphy_2)
wall_u_fac = ClusterOutput(consruction_set.wall_u_fac_2)
roof_stratigraphy = ClusterOutput(consruction_set.roof_stratigraphy_2)
building_name_2 = ClusterOutput(geometry.building_name_4)
roof_u_fac = ClusterOutput(consruction_set.roof_u_fac_2)
social_cobenefit = ClusterOutput(consruction_set.social_cobenefit_2)
enviromental_cobenefit = ClusterOutput(consruction_set.enviromental_cobenefit_2)
brep = ClusterOutput(geometry.brep_3)
floor_stratigraphy = ClusterOutput(consruction_set.floor_stratigraphy_2)
economic_cobenefit = ClusterOutput(consruction_set.economic_cobenefit_2)
floor_u_fac = ClusterOutput(consruction_set.floor_u_fac_2)
gwp_kgco2e_m2 = ClusterOutput(consruction_set.gwp_kgco2e_m2_2)
gwp_kgco2e = ClusterOutput(consruction_set.gwp_kgco2e_2)

# ----
program = Data(consruction_set.program_2)
flatten = FlattenTree(Tree=program, Path="{0}")
item = ListItem(List=flatten, Index=0, Wrap=True)
srf = Surface(geometry.building_footprint_2)
repeat = RepeatData(Data=floortofloor_height, Length=geometry.number_of_stories_2)

# ----
# Create Buildings
buildingfootprint = DFBuildingFromFootprint(
    footprint_geo=srf,
    floor_to_floor=repeat,
    program=item,
    constr_set=consruction_set.constr_set,
    conditioned=Toggle(True),
    run=Toggle(True))  # -> report, buildings; plug-in component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

wwr_2 = Number(wwr)
_0_residential_1_non_residential_generic = Panel(consruction_set.program_boolean_3)  # "0: Residential 1: Non Residential(generic) 2:school"

# ----
# Assign Windows
window_ratio = Panel(wwr_2)
simpleratiopar = DFSimpleWindowRatioParameters(ratio=window_ratio)  # -> win_par; plug-in component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

topbottom = DFSeparateTopBottom(buildings=flatten(buildingfootprint.buildings))  # -> buildings; plug-in component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
applyfacadepar = DFApplyFacadeParameters(df_obj=topbottom, win_par=simpleratiopar)  # -> report, df_obj; plug-in component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
all_air = HBAllAirHVACTemplates({"VAV chiller with gas boiler reheat": "VAV_Chiller_Boiler", "VAV chiller with central air source heat pump reheat": "VAV_Chiller_ASHP", "VAV chiller with district hot water reheat": "VAV_Chiller_DHW", "VAV chiller with PFP boxes": "VAV_Chiller_PFP", "VAV chiller with gas coil reheat": "VAV_Chiller_GasCoil", "VAV air-cooled chiller with gas boiler reheat": "VAV_ACChiller_Boiler", "VAV air-cooled chiller with central air source heat pump reheat": "VAV_ACChiller_ASHP", "VAV air-cooled chiller with district hot water reheat": "VAV_ACChiller_DHW", "VAV air-cooled chiller with PFP boxes": "VAV_ACChiller_PFP", "VAV air-cooled chiller with gas coil reheat": "VAV_ACChiller_GasCoil"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}, selected="PSZ-AC with baseboard gas boiler": "PSZAC_BoilerBaseboard")
all_air_2 = HBAllAirHVACTemplates({"VAV chiller with gas boiler reheat": "VAV_Chiller_Boiler", "VAV chiller with central air source heat pump reheat": "VAV_Chiller_ASHP", "VAV chiller with district hot water reheat": "VAV_Chiller_DHW", "VAV chiller with PFP boxes": "VAV_Chiller_PFP", "VAV chiller with gas coil reheat": "VAV_Chiller_GasCoil", "VAV air-cooled chiller with gas boiler reheat": "VAV_ACChiller_Boiler", "VAV air-cooled chiller with central air source heat pump reheat": "VAV_ACChiller_ASHP", "VAV air-cooled chiller with district hot water reheat": "VAV_ACChiller_DHW", "VAV air-cooled chiller with PFP boxes": "VAV_ACChiller_PFP", "VAV air-cooled chiller with gas coil reheat": "VAV_ACChiller_GasCoil"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}, selected="VAV chiller with gas boiler reheat")
num = Number(_0_residential_1_non_residential_generic)
hb_shw_templates = HBSHWTemplates({"Gas Water Heater": "Gas_WaterHeater", "Electric Water Heater": "Electric_WaterHeater", "Heat Pump Water Heater": "HeatPump_WaterHeater", "Gas Tankless Heater": "Gas_TanklessHeater", "Electric Tankless Heater": "Electric_TanklessHeater"}, selected="Electric Water Heater")
_0_residential_1_non_residential_generic_2 = Panel(num)  # "0: Residential 1: Non Residential(generic) 2:school"
number_slider = Slider(0, range=0..2)
data = Data(applyfacadepar.df_obj)
filter = StreamFilter(Gate=_0_residential_1_non_residential_generic_2, Stream0=hb_shw_templates, Stream1=all_air, Stream2=all_air_2)
gate = StreamGate(Stream=filter, Gate=_0_residential_1_non_residential_generic_2)  # -> Target0, Target1, Target2
dfallairhvac = DFAllAirHVAC(df_objs=flatten(data), system_type=gate.Target2)  # -> report, df_objs; plug-in component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
dfallairhvac_2 = DFAllAirHVAC(df_objs=flatten(data), system_type=gate.Target1)  # -> report, df_objs; plug-in component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
dfidealair = DFIdealAir(df_objs=flatten(data), dcv=Toggle(True), heat_temp="65", cool_temp="16")  # -> report, df_objs; plug-in component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
shw = DFSHWSystem(df_objs=flatten(dfidealair.df_objs), system_type=gate.Target0)  # -> report, df_objs; plug-in component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
merge = Merge(Data1=shw.df_objs, Data2=dfallairhvac_2.df_objs, Data3=dfallairhvac.df_objs)  # -> flatten(Result)
clean_tree = CleanTree(RemoveNulls=True, RemoveInvalid=True, RemoveEmpty=True, Tree=merge)
objtostr = DFObjectToString(df_obj=clean_tree)  # -> df_str; plug-in component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
df_building = Data(objtostr)
df_building_2 = ClusterOutput(df_building)

# ==== cluster BUILDINGBAKE
string = ClusterInput()
string_2 = Data(string)
enviromental_cobenefit = ClusterInput()
economic_cobenefit = ClusterInput()
social_cobenefit = ClusterInput()
gwp_kgco2e_m2 = ClusterInput()
enviromental_cobenefit_2 = Data(enviromental_cobenefit)
economic_cobenefit_2 = Data(economic_cobenefit)
wall_stratigraphy = ClusterInput()
gwp_kgco2 = ClusterInput()
social_cobenefit_2 = Data(social_cobenefit)
roof_stratigraphy = ClusterInput()
wall_u_fac = ClusterInput()
roof_u_fac = ClusterInput()
floor_stratigraphy = ClusterInput()
floor_u_fac = ClusterInput()
wall_stratigraphy_2 = Data(wall_stratigraphy)
roof_stratigraphy_2 = Data(roof_stratigraphy)
wall_u_fac_2 = Data(wall_u_fac)
building_name = ClusterInput()
roof_u_fac_2 = Data(roof_u_fac)
gwp_kgco2_2 = Data(flatten(gwp_kgco2))
gwp_kgco2e_m2_2 = Data(flatten(gwp_kgco2e_m2))
floor_stratigraphy_2 = Data(floor_stratigraphy)
floor_u_fac_2 = Data(floor_u_fac)
text_join = TextJoin(Text=economic_cobenefit_2)
text = Text(string_2)
text_join_2 = TextJoin(Text=enviromental_cobenefit_2)
brep = ClusterInput()
text_join_3 = TextJoin(Text=social_cobenefit_2)
building_name_2 = Data(building_name)
brep_2 = Brep(brep)
merge = Merge(
    Data1=building_name_2,
    Data2=wall_stratigraphy_2,
    Data3=wall_u_fac_2,
    Data4=roof_stratigraphy_2,
    Data5=roof_u_fac_2,
    Data6=floor_stratigraphy_2,
    Data7=floor_u_fac_2,
    Data8=text_join_2,
    Data9=text_join_3,
    Data10=text_join,
    Data11=gwp_kgco2e_m2_2,
    Data12=gwp_kgco2_2,
    Data13=text)
panel = Panel(merge)
layer_name = ClusterInput()
layer_name_2 = Text(layer_name)
panel_2 = Panel("""Building name
Wall_Stratigrafy
Wall_u_fac
Roof_Stratigrafy
Roof_u_fac
Floor_Stratigrafy
Floor_u_fac
Enviromental Cobenefit
Social Cobenefit
Economic Cobenefit
GWP(kgCO2e/m2)
GWP(kgCO2)
DF_String""")
concatenate = Concatenate(FragmentA="Analysis Buildings", FragmentB=layer_name_2, JoinSeparator="::")
list_length = ListLength(List=panel_2)
layer = Text(concatenate)
series = Series(Start=0, Step=1, Count=list_length)
bake = ClusterInput()
sort_text = SortText(Keys=["a", "b", "c", "d", "e", "f", "g", "h", "i", "l", "m", "n", "o"], Culture=127)  # -> Keys, Values
bake_2 = Boolean(bake)
list_item = ListItem(List=sort_text.Keys, Index=series, Wrap=True)
concatenate_2 = Concatenate(FragmentA=list_item, FragmentB=panel_2, JoinSeparator="_")
panel_3 = Panel(concatenate_2)
ef_att = EleFrontAttributes(Keys=panel_3, Values=panel, Name=building_name_2, Layer=layer)  # -> Attributes, Keys, Values, Name, Layer, ColourSource, DisplayColour, MaterialSource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
bake_3 = BakeObjects(Geometry=brep_2, Attributes=ef_att.Attributes, Bake=bake_2, createGroups=False)  # -> Message, Ghosts

# ==== cluster Cluster
roads = ClusterInput()
roads_2 = Number(roads)
terre_battue = TERRE_BATTUE()  # -> name_2, construction_2, environmental_cobenefit_3, social_cobenefit_3, economic_cobenefit_3, albedo_4, thermalemissivity_2, colour_2
brick_road_red_stones = BRICK_ROAD_RED_STONES()  # -> name_2, construction_2, environmental_cobenefit_3, social_cobenefit_3, economic_cobenefit_3, albedo_4, thermalemissivity_2, colour_2
cool_asphalt = COOL_ASPHALT()  # -> name_2, construction_2, environmental_cobenefit_3, social_cobenefit_3, economic_cobenefit_2, albedo_4, thermalemissivity_2, colour_2
brick_road_yellow_stones = BRICK_ROAD_YELLOW_STONES()  # -> name_2, construction_2, environmental_cobenefit_3, social_cobenefit_3, economic_cobenefit_3, albedo_4, thermalemissivity_2, colour_2
asphalt = ASPHALT()  # -> name_2, construction_2, environmental_cobenefit_3, social_cobenefit_3, economic_cobenefit_2, albedo_4, thermalemissivity_3, colour_2
stream_filter = StreamFilter(
    Gate=roads_2,
    Stream0=asphalt.social_cobenefit_3,
    Stream1=cool_asphalt.social_cobenefit_3,
    Stream2=terre_battue.social_cobenefit_3,
    Stream3=brick_road_red_stones.social_cobenefit_3,
    Stream4=brick_road_yellow_stones.social_cobenefit_3)
stream_filter_2 = StreamFilter(
    Gate=roads_2,
    Stream0=asphalt.environmental_cobenefit_3,
    Stream1=cool_asphalt.environmental_cobenefit_3,
    Stream2=terre_battue.environmental_cobenefit_3,
    Stream3=brick_road_red_stones.environmental_cobenefit_3,
    Stream4=brick_road_yellow_stones.environmental_cobenefit_3)
stream_filter_3 = StreamFilter(
    Gate=roads_2,
    Stream0=asphalt.economic_cobenefit_2,
    Stream1=cool_asphalt.economic_cobenefit_2,
    Stream2=terre_battue.economic_cobenefit_3,
    Stream3=brick_road_red_stones.economic_cobenefit_3,
    Stream4=brick_road_yellow_stones.economic_cobenefit_3)
stream_filter_4 = StreamFilter(
    Gate=roads_2,
    Stream0=asphalt.construction_2,
    Stream1=cool_asphalt.construction_2,
    Stream2=terre_battue.construction_2,
    Stream3=brick_road_red_stones.construction_2,
    Stream4=brick_road_yellow_stones.construction_2)
stream_filter_5 = StreamFilter(
    Gate=roads_2,
    Stream0=asphalt.albedo_4,
    Stream1=cool_asphalt.albedo_4,
    Stream2=terre_battue.albedo_4,
    Stream3=brick_road_red_stones.albedo_4,
    Stream4=brick_road_yellow_stones.albedo_4)
stream_filter_6 = StreamFilter(
    Gate=roads_2,
    Stream0=asphalt.name_2,
    Stream1=cool_asphalt.name_2,
    Stream2=terre_battue.name_2,
    Stream3=brick_road_red_stones.name_2,
    Stream4=brick_road_yellow_stones.name_2)
stream_filter_7 = StreamFilter(
    Gate=roads_2,
    Stream0=asphalt.thermalemissivity_3,
    Stream1=cool_asphalt.thermalemissivity_2,
    Stream2=terre_battue.thermalemissivity_2,
    Stream3=brick_road_red_stones.thermalemissivity_2,
    Stream4=brick_road_yellow_stones.thermalemissivity_2)
stream_filter_8 = StreamFilter(
    Gate=roads_2,
    Stream0=asphalt.colour_2,
    Stream1=cool_asphalt.colour_2,
    Stream2=terre_battue.colour_2,
    Stream3=brick_road_red_stones.colour_2,
    Stream4=brick_road_yellow_stones.colour_2)
social_cobenefit = Data(stream_filter)
economic_cobenefit = Data(stream_filter_3)
selected_constr = Data(stream_filter_4)
albedo = Data(stream_filter_5)
thermalemissivity = Data(stream_filter_7)
environmental_cobenefit = Data(stream_filter_2)
name = Data(stream_filter_6)
colour = Data(stream_filter_8)
environmental_cobenefit_2 = ClusterOutput(environmental_cobenefit)
social_cobenefit_2 = ClusterOutput(social_cobenefit)
economic_cobenefit_2 = ClusterOutput(economic_cobenefit)
objtostr = HBObjectToString(hb_obj=selected_constr)  # -> hb_str; plug-in component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
selected_constr_2 = ClusterOutput(selected_constr)
albedo_2 = ClusterOutput(albedo)
colour_2 = ClusterOutput(colour)
name_2 = ClusterOutput(name)
construction_string = Data(objtostr)
thermalemissivity_2 = ClusterOutput(thermalemissivity)
construction_string_2 = ClusterOutput(construction_string)

# ==== cluster Cluster_2
width = ClusterInput()
flip = ClusterInput()
width_2 = Number(width)
flip_2 = Boolean(flip)
neg = Negative(Value=width_2)
filter = StreamFilter(Gate=flip_2, Stream0=width_2, Stream1=neg)
basepolyline = ClusterInput()
basepolyline_2 = Curve(basepolyline)
offset_curve = OffsetCurve(Curve=basepolyline_2, Distance=filter, Plane=PlaneXY(0, 0, 0), Corners=1)
loft = Loft(
    Curves=flatten([basepolyline_2, offset_curve]),
    Options={Adjust=False, Closed=False, LoftEnds=0, LoftSimp=0, LoftType=0, Rebuild=10, Refit=0.01})
Z = UnitZ(Factor=-1)
fmerge = MergeFaces(Brep=loft)  # -> Breps, Before, After
extr = Extrude(Base=fmerge.Breps, Direction=Z)
road_brep = Brep(extr)
road_brep_2 = ClusterOutput(road_brep)

# ==== cluster Cluster_3
lancovers = ClusterInput()
lancovers_2 = Number(lancovers)
brick_road_yellow_stones = BRICK_ROAD_YELLOW_STONES_2()  # -> name_2, construction_2, environmental_cobenefit_3, social_cobenefit_3, economic_cobenefit_3, albedo_4, thermalemissivity_2, colour_2
fake_water = FakeWater()  # -> name_2, construction_2, environmental_cobenefit_3, social_cobenefit_3, economic_cobenefit_3, albedo_4, thermalemissivity_2, colour_2
grassy_joint_flooring = GRASSY_JOINT_FLOORING()  # -> name_2, construction_2, environmental_cobenefit_3, social_cobenefit_3, economic_cobenefit_3, albedo_4, thermalemissivity_2, colour_2
terre_battue = TERRE_BATTUE_2()  # -> name_2, construction_2, environmental_cobenefit_3, social_cobenefit_3, economic_cobenefit_3, albedo_4, thermalemissivity_2, colour_2
brick_road_red_stones = BRICK_ROAD_RED_STONES_2()  # -> name_2, construction_2, environmental_cobenefit_3, social_cobenefit_3, economic_cobenefit_3, albedo_4, thermalemissivity_2, colour_2
cool_asphalt = COOL_ASPHALT_2()  # -> name_2, construction_2, environmental_cobenefit_3, social_cobenefit_3, economic_cobenefit_2, albedo_4, thermalemissivity_2, colour_2
basalto = BASALTO()  # -> name_2, construction_2, environmental_cobenefit_3, social_cobenefit_3, economic_cobenefit_3, albedo_4, thermalemissivity_2, colour_2
concrete_pavement_dark = CONCRETE_PAVEMENT_DARK()  # -> name_2, construction_2, environmental_cobenefit_3, social_cobenefit_3, economic_cobenefit_3, albedo_4, thermalemissivity_2, colour_2
agriculture = AGRICULTURE()  # -> name_2, construction_2, environmental_cobenefit_3, social_cobenefit_3, economic_cobenefit_3, albedo_3, thermalemissivity_2, colour_2
asphalt = ASPHALT_2()  # -> name_2, construction_2, environmental_cobenefit_3, social_cobenefit_3, economic_cobenefit_2, albedo_4, thermalemissivity_3, colour_2
porfido = PORFIDO()  # -> name_2, construction_2, environmental_cobenefit_3, social_cobenefit_3, economic_cobenefit_3, albedo_4, thermalemissivity_2, colour_2
granito = GRANITO()  # -> name_2, construction_2, environmental_cobenefit_3, social_cobenefit_3, economic_cobenefit_3, albedo_4, thermalemissivity_2, colour_2
pebbles = PEBBLES()  # -> name_2, construction_2, environmental_cobenefit_3, social_cobenefit_3, economic_cobenefit_3, albedo_4, thermalemissivity_2, colour_2
concrete_pavement_medium = CONCRETE_PAVEMENT_MEDIUM()  # -> name_2, construction_2, environmental_cobenefit_3, social_cobenefit_3, economic_cobenefit_3, albedo_4, thermalemissivity_2, colour_2
wood = WOOD()  # -> name_2, construction_2, environmental_cobenefit_3, social_cobenefit_3, economic_cobenefit_3, albedo_4, thermalemissivity_2, colour_2
high_grass = HIGH_GRASS()  # -> name_2, construction_2, environmental_cobenefit_3, social_cobenefit_3, economic_cobenefit_3, albedo_3, thermalemissivity_2, colour_2
sand = SAND()  # -> name_2, construction_2, environmental_cobenefit_3, social_cobenefit_3, economic_cobenefit_3, albedo_4, thermalemissivity_2, colour_2
grass = GRASS()  # -> name_2, construction_2, environmental_cobenefit_3, social_cobenefit_3, economic_cobenefit_3, albedo_3, thermalemissivity_2, colour_2
loamy_soil = LOAMY_SOIL()  # -> name_2, construction_2, environmental_cobenefit_3, social_cobenefit_3, economic_cobenefit_3, albedo_4, thermalemissivity_2, colour_2
concrete_pavement_light = CONCRETE_PAVEMENT_LIGHT()  # -> name_2, construction_2, environmental_cobenefit_3, social_cobenefit_3, economic_cobenefit_3, albedo_4, thermalemissivity_2, colour_2
stream_filter = StreamFilter(
    Gate=lancovers_2,
    Stream0=loamy_soil.colour_2,
    Stream1=sand.colour_2,
    Stream2=wood.colour_2,
    Stream3=pebbles.colour_2,
    Stream4=porfido.colour_2,
    Stream5=granito.colour_2,
    Stream6=basalto.colour_2,
    Stream7=concrete_pavement_dark.colour_2,
    Stream8=concrete_pavement_medium.colour_2,
    Stream9=concrete_pavement_light.colour_2,
    Stream10=grass.colour_2,
    Stream11=high_grass.colour_2,
    Stream12=agriculture.colour_2,
    Stream13=grassy_joint_flooring.colour_2,
    Stream14=asphalt.colour_2,
    Stream15=cool_asphalt.colour_2,
    Stream16=terre_battue.colour_2,
    Stream17=brick_road_red_stones.colour_2,
    Stream18=brick_road_yellow_stones.colour_2,
    Stream19=fake_water.colour_2)
stream_filter_2 = StreamFilter(
    Gate=lancovers_2,
    Stream0=loamy_soil.environmental_cobenefit_3,
    Stream1=sand.environmental_cobenefit_3,
    Stream2=wood.environmental_cobenefit_3,
    Stream3=pebbles.environmental_cobenefit_3,
    Stream4=porfido.environmental_cobenefit_3,
    Stream5=granito.environmental_cobenefit_3,
    Stream6=basalto.environmental_cobenefit_3,
    Stream7=concrete_pavement_dark.environmental_cobenefit_3,
    Stream8=concrete_pavement_medium.environmental_cobenefit_3,
    Stream9=concrete_pavement_light.environmental_cobenefit_3,
    Stream10=grass.environmental_cobenefit_3,
    Stream11=high_grass.environmental_cobenefit_3,
    Stream12=agriculture.environmental_cobenefit_3,
    Stream13=grassy_joint_flooring.environmental_cobenefit_3,
    Stream14=asphalt.environmental_cobenefit_3,
    Stream15=cool_asphalt.environmental_cobenefit_3,
    Stream16=terre_battue.environmental_cobenefit_3,
    Stream17=brick_road_red_stones.environmental_cobenefit_3,
    Stream18=brick_road_yellow_stones.environmental_cobenefit_3,
    Stream19=fake_water.environmental_cobenefit_3)
stream_filter_3 = StreamFilter(
    Gate=lancovers_2,
    Stream0=loamy_soil.name_2,
    Stream1=sand.name_2,
    Stream2=wood.name_2,
    Stream3=pebbles.name_2,
    Stream4=porfido.name_2,
    Stream5=granito.name_2,
    Stream6=basalto.name_2,
    Stream7=concrete_pavement_dark.name_2,
    Stream8=concrete_pavement_medium.name_2,
    Stream9=concrete_pavement_light.name_2,
    Stream10=grass.name_2,
    Stream11=high_grass.name_2,
    Stream12=agriculture.name_2,
    Stream13=grassy_joint_flooring.name_2,
    Stream14=asphalt.name_2,
    Stream15=cool_asphalt.name_2,
    Stream16=terre_battue.name_2,
    Stream17=brick_road_red_stones.name_2,
    Stream18=brick_road_yellow_stones.name_2,
    Stream19=fake_water.name_2)
stream_filter_4 = StreamFilter(
    Gate=lancovers_2,
    Stream0=loamy_soil.albedo_4,
    Stream1=sand.albedo_4,
    Stream2=wood.albedo_4,
    Stream3=pebbles.albedo_4,
    Stream4=porfido.albedo_4,
    Stream5=granito.albedo_4,
    Stream6=basalto.albedo_4,
    Stream7=concrete_pavement_dark.albedo_4,
    Stream8=concrete_pavement_medium.albedo_4,
    Stream9=concrete_pavement_light.albedo_4,
    Stream10=grass.albedo_3,
    Stream11=high_grass.albedo_3,
    Stream12=agriculture.albedo_3,
    Stream13=grassy_joint_flooring.albedo_4,
    Stream14=asphalt.albedo_4,
    Stream15=cool_asphalt.albedo_4,
    Stream16=terre_battue.albedo_4,
    Stream17=brick_road_red_stones.albedo_4,
    Stream18=brick_road_yellow_stones.albedo_4,
    Stream19=fake_water.albedo_4)
stream_filter_5 = StreamFilter(
    Gate=lancovers_2,
    Stream0=loamy_soil.thermalemissivity_2,
    Stream1=sand.thermalemissivity_2,
    Stream2=wood.thermalemissivity_2,
    Stream3=pebbles.thermalemissivity_2,
    Stream4=porfido.thermalemissivity_2,
    Stream5=granito.thermalemissivity_2,
    Stream6=basalto.thermalemissivity_2,
    Stream7=concrete_pavement_dark.thermalemissivity_2,
    Stream8=concrete_pavement_medium.thermalemissivity_2,
    Stream9=concrete_pavement_light.thermalemissivity_2,
    Stream10=grass.thermalemissivity_2,
    Stream11=high_grass.thermalemissivity_2,
    Stream12=agriculture.thermalemissivity_2,
    Stream13=grassy_joint_flooring.thermalemissivity_2,
    Stream14=asphalt.thermalemissivity_3,
    Stream15=cool_asphalt.thermalemissivity_2,
    Stream16=terre_battue.thermalemissivity_2,
    Stream17=brick_road_red_stones.thermalemissivity_2,
    Stream18=brick_road_yellow_stones.thermalemissivity_2,
    Stream19=fake_water.thermalemissivity_2)
stream_filter_6 = StreamFilter(
    Gate=lancovers_2,
    Stream0=loamy_soil.economic_cobenefit_3,
    Stream1=sand.economic_cobenefit_3,
    Stream2=wood.economic_cobenefit_3,
    Stream3=pebbles.economic_cobenefit_3,
    Stream4=porfido.economic_cobenefit_3,
    Stream5=granito.economic_cobenefit_3,
    Stream6=basalto.economic_cobenefit_3,
    Stream7=concrete_pavement_dark.economic_cobenefit_3,
    Stream8=concrete_pavement_medium.economic_cobenefit_3,
    Stream9=concrete_pavement_light.economic_cobenefit_3,
    Stream10=grass.economic_cobenefit_3,
    Stream11=high_grass.economic_cobenefit_3,
    Stream12=agriculture.economic_cobenefit_3,
    Stream13=grassy_joint_flooring.economic_cobenefit_3,
    Stream14=asphalt.economic_cobenefit_2,
    Stream15=cool_asphalt.economic_cobenefit_2,
    Stream16=terre_battue.economic_cobenefit_3,
    Stream17=brick_road_red_stones.economic_cobenefit_3,
    Stream18=brick_road_yellow_stones.economic_cobenefit_3,
    Stream19=fake_water.economic_cobenefit_3)
stream_filter_7 = StreamFilter(
    Gate=lancovers_2,
    Stream0=loamy_soil.construction_2,
    Stream1=sand.construction_2,
    Stream2=wood.construction_2,
    Stream3=pebbles.construction_2,
    Stream4=porfido.construction_2,
    Stream5=granito.construction_2,
    Stream6=basalto.construction_2,
    Stream7=concrete_pavement_dark.construction_2,
    Stream8=concrete_pavement_medium.construction_2,
    Stream9=concrete_pavement_light.construction_2,
    Stream10=grass.construction_2,
    Stream11=high_grass.construction_2,
    Stream12=agriculture.construction_2,
    Stream13=grassy_joint_flooring.construction_2,
    Stream14=asphalt.construction_2,
    Stream15=cool_asphalt.construction_2,
    Stream16=terre_battue.construction_2,
    Stream17=brick_road_red_stones.construction_2,
    Stream18=brick_road_yellow_stones.construction_2,
    Stream19=fake_water.construction_2)
stream_filter_8 = StreamFilter(
    Gate=lancovers_2,
    Stream0=loamy_soil.social_cobenefit_3,
    Stream1=sand.social_cobenefit_3,
    Stream2=wood.social_cobenefit_3,
    Stream3=pebbles.social_cobenefit_3,
    Stream4=porfido.social_cobenefit_3,
    Stream5=granito.social_cobenefit_3,
    Stream6=basalto.social_cobenefit_3,
    Stream7=concrete_pavement_dark.social_cobenefit_3,
    Stream8=concrete_pavement_medium.social_cobenefit_3,
    Stream9=concrete_pavement_light.social_cobenefit_3,
    Stream10=grass.social_cobenefit_3,
    Stream11=high_grass.social_cobenefit_3,
    Stream12=agriculture.social_cobenefit_3,
    Stream13=grassy_joint_flooring.social_cobenefit_3,
    Stream14=asphalt.social_cobenefit_3,
    Stream15=cool_asphalt.social_cobenefit_3,
    Stream16=terre_battue.social_cobenefit_3,
    Stream17=brick_road_red_stones.social_cobenefit_3,
    Stream18=brick_road_yellow_stones.social_cobenefit_3,
    Stream19=fake_water.social_cobenefit_3)
colour = Data(stream_filter)
environmental_cobenefit = Data(stream_filter_2)
economic_cobenefit = Data(stream_filter_6)
selected_constr = Data(stream_filter_7)
social_cobenefit = Data(stream_filter_8)
albedo = Data(stream_filter_4)
thermalemissivity = Data(stream_filter_5)
name = Data(stream_filter_3)
environmental_cobenefit_2 = ClusterOutput(environmental_cobenefit)
economic_cobenefit_2 = ClusterOutput(economic_cobenefit)
social_cobenefit_2 = ClusterOutput(social_cobenefit)
objtostr = HBObjectToString(hb_obj=selected_constr)  # -> hb_str; plug-in component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
selected_constr_2 = ClusterOutput(selected_constr)
name_2 = ClusterOutput(name)
thermalemissivity_2 = ClusterOutput(thermalemissivity)
colour_2 = ClusterOutput(colour)
albedo_2 = ClusterOutput(albedo)
construction_string = Data(objtostr)
construction_string_2 = ClusterOutput(construction_string)

# ==== cluster Cluster_4
location = ClusterInput()
location_2 = Curve(location)
surface = Surface(location_2)
Z = UnitZ(Factor="-1")
extr = Extrude(Base=surface, Direction=Z)
cap = CapHoles(Brep=extr)
groundbrep = Brep(cap)
groundbrep_2 = ClusterOutput(groundbrep)

# ==== cluster CanopiesCoBenefits
# SOCIAL: HEALTH IMPACTS
# PUBBLIC SPACE ACCESS
# AESTHETIC VALUE
# COMMUUNITY INCLUSION
# CULTURAL
social = Panel("""0
1
2""")
# ENVIRONMENTAL: AIR QUALITY
# GHG EMISSIONS
# WATER RECOLLECTION AND SECURITY
# WATER QUALITY
# BIODIVERSITY
# LANDSLIDES AND WEATHERING
environmental = Panel("""1
2
5""")
# ECONOMIC: EMPLOYMENT AND INCOME GENERATION
# SAVINGS
# INNOVATION AND INVESTIMENT
# PROPERTY VALUE
economic = Panel("""2
3""")
environmental_2 = Number(environmental)
social_2 = Number(social)
economic_2 = Number(economic)
environmental_3 = ClusterOutput(environmental_2)
social_3 = ClusterOutput(social_2)
economic_3 = ClusterOutput(economic_2)

# ==== cluster AceroRiccio
panel = Panel("""0
1
2""")
first_number = ClusterInput()
specie_di_riferimento = Panel("""Acer Platanoides
(Acero riccio\Norway Maple)""")
ordine_di_grandezza = Panel("I")
tolleranza_alla_siccità = Panel("mid")
densità = Panel("0.51")
usi = Panel("Garden, street, park")
usi_2 = Text(usi)
ordine_di_grandezza_2 = Text(ordine_di_grandezza)
specie_di_riferimento_2 = Text(specie_di_riferimento)
densità_2 = Number(densità)
tolleranza_alla_siccità_2 = Text(tolleranza_alla_siccità)
ordine_di_grandezza_3 = ClusterOutput(ordine_di_grandezza_2)
specie_di_riferimento_3 = ClusterOutput(specie_di_riferimento_2)
tolleranza_alla_siccità_3 = ClusterOutput(tolleranza_alla_siccità_2)
usi_3 = ClusterOutput(usi_2)
densità_3 = ClusterOutput(densità_2)

# ---- group: CROWN DIAMETER
larger_than = LargerThan(FirstNumber=first_number, SecondNumber="25")  # -> LargerThan, OrEqualTo
larger_than_2 = LargerThan(FirstNumber=first_number, SecondNumber="15")  # -> LargerThan, OrEqualTo
boolean = Boolean(flatten([larger_than_2.LargerThan, larger_than.LargerThan]))
mass_addition = MassAddition(Input=boolean)  # -> Result, PartialResults
panel_2 = Panel("""0.417
0.39
0.195""")
panel_3 = Panel(mass_addition.Result)
list_item = ListItem(List=panel_2, Index=panel_3, Wrap=True)

# ----
ghpython_script = GhPythonScript(x=first_number, y=panel_2)  # -> h_tempo; inputs y: list
# ---------- ghpython_script: Python ----------
import rhinoscriptsyntax as rs
tempo = x
h = y
h_tempo = 0
if 0 < tempo and tempo < 15  :
    h_tempo = h[0]* tempo
elif 15 < tempo and tempo < 26 :
    h_tempo = h[0] * 15 + h[1] * (tempo - 15) 
else:
    h_tempo = (h[0]  * 15) + (h [1] * 10) + (h [2] * (tempo-25))
# ---------- end ghpython_script ----------

# ---- group: CROWN DIAMETER (continued)
crown_diameter = Number(ghpython_script)
crown_diameter_2 = ClusterOutput(crown_diameter)

# ---- group: HEIGHT
larger_than_3 = LargerThan(FirstNumber=first_number, SecondNumber="25")  # -> LargerThan, OrEqualTo
larger_than_4 = LargerThan(FirstNumber=first_number, SecondNumber="15")  # -> LargerThan, OrEqualTo
boolean_2 = Boolean(flatten([larger_than_4.LargerThan, larger_than_3.LargerThan]))
mass_addition_2 = MassAddition(Input=boolean_2)  # -> Result, PartialResults
panel_4 = Panel("""0.53
0.305
0.152""")
panel_5 = Panel(mass_addition_2.Result)
list_item_2 = ListItem(List=panel_4, Index=panel_5, Wrap=True)
panel_6 = Panel(list_item_2)

# ----
ghpython_script_2 = GhPythonScript(x=first_number, y=panel_4)  # -> h_tempo; inputs y: list; same code as ghpython_script

# ---- group: HEIGHT (continued)
height = Number(ghpython_script_2)
height_2 = ClusterOutput(height)

# ---- group: DBH
larger_than_5 = LargerThan(FirstNumber=first_number, SecondNumber="15")  # -> LargerThan, OrEqualTo
larger_than_6 = LargerThan(FirstNumber=first_number, SecondNumber="25")  # -> LargerThan, OrEqualTo
boolean_3 = Boolean(flatten([larger_than_5.LargerThan, larger_than_6.LargerThan]))
mass_addition_3 = MassAddition(Input=boolean_3)  # -> Result, PartialResults
panel_7 = Panel(mass_addition_3.Result)
panel_8 = Panel("""1.25
1.93
0.965""")
list_item_3 = ListItem(List=panel_8, Index=panel_7, Wrap=True)
panel_9 = Panel(list_item_3)

# ----
ghpython_script_3 = GhPythonScript(x=first_number, y=panel_8)  # -> h_tempo; inputs y: list; same code as ghpython_script

# ---- group: DBH (continued)
dbh = Number(ghpython_script_3)
dbh_2 = ClusterOutput(dbh)

# ==== cluster Frassino
first_number = ClusterInput()
panel = Panel("""0
1
2""")
specie_di_riferimento = Panel("Fraxinus angustifolia")
ordine_di_grandezza = Panel("II")
usi = Panel("Garden, street, park")
densità = Panel("0.60")
tolleranza_alla_siccità = Panel("mid")
ordine_di_grandezza_2 = Text(ordine_di_grandezza)
specie_di_riferimento_2 = Text(specie_di_riferimento)
usi_2 = Text(usi)
densità_2 = Number(densità)
tolleranza_alla_siccità_2 = Text(tolleranza_alla_siccità)
ordine_di_grandezza_3 = ClusterOutput(ordine_di_grandezza_2)
specie_di_riferimento_3 = ClusterOutput(specie_di_riferimento_2)
tolleranza_alla_siccità_3 = ClusterOutput(tolleranza_alla_siccità_2)
usi_3 = ClusterOutput(usi_2)
densità_3 = ClusterOutput(densità_2)

# ---- group: HEIGHT
larger_than = LargerThan(FirstNumber=first_number, SecondNumber="25")  # -> LargerThan, OrEqualTo
larger_than_2 = LargerThan(FirstNumber=first_number, SecondNumber="15")  # -> LargerThan, OrEqualTo
boolean = Boolean(flatten([larger_than_2.LargerThan, larger_than.LargerThan]))
mass_addition = MassAddition(Input=boolean)  # -> Result, PartialResults
panel_2 = Panel("""0.458
0.178
0.089""")
panel_3 = Panel(mass_addition.Result)
list_item = ListItem(List=panel_2, Index=panel_3, Wrap=True)
panel_4 = Panel(list_item)

# ----
ghpython_script = GhPythonScript(x=first_number, y=panel_2)  # -> h_tempo; inputs y: list; same code as ghpython_script

# ---- group: HEIGHT (continued)
height = Number(ghpython_script)
height_2 = ClusterOutput(height)

# ---- group: DBH
larger_than_3 = LargerThan(FirstNumber=first_number, SecondNumber="15")  # -> LargerThan, OrEqualTo
larger_than_4 = LargerThan(FirstNumber=first_number, SecondNumber="25")  # -> LargerThan, OrEqualTo
boolean_2 = Boolean(flatten([larger_than_3.LargerThan, larger_than_4.LargerThan]))
mass_addition_2 = MassAddition(Input=boolean_2)  # -> Result, PartialResults
panel_5 = Panel("""1.15
1.46
0.715""")
panel_6 = Panel(mass_addition_2.Result)
list_item_2 = ListItem(List=panel_5, Index=panel_6, Wrap=True)
panel_7 = Panel(list_item_2)

# ----
ghpython_script_2 = GhPythonScript(x=first_number, y=panel_5)  # -> h_tempo; inputs y: list; same code as ghpython_script

# ---- group: DBH (continued)
dbh = Number(ghpython_script_2)
dbh_2 = ClusterOutput(dbh)

# ---- group: CROWN DIAMETER
larger_than_5 = LargerThan(FirstNumber=first_number, SecondNumber="25")  # -> LargerThan, OrEqualTo
larger_than_6 = LargerThan(FirstNumber=first_number, SecondNumber="15")  # -> LargerThan, OrEqualTo
boolean_3 = Boolean(flatten([larger_than_6.LargerThan, larger_than_5.LargerThan]))
mass_addition_3 = MassAddition(Input=boolean_3)  # -> Result, PartialResults
panel_8 = Panel("""0.298
0.158
0.079""")
panel_9 = Panel(mass_addition_3.Result)
list_item_3 = ListItem(List=panel_8, Index=panel_9, Wrap=True)
panel_10 = Panel(list_item_3)

# ----
ghpython_script_3 = GhPythonScript(x=first_number, y=panel_8)  # -> h_tempo; inputs y: list; same code as ghpython_script

# ---- group: CROWN DIAMETER (continued)
crown_diameter = Number(ghpython_script_3)
crown_diameter_2 = ClusterOutput(crown_diameter)

# ==== cluster Prunus
first_number = ClusterInput()
panel = Panel("""0
1
2""")
specie_di_riferimento = Panel("Prunus cerasifera")
ordine_di_grandezza = Panel("III")
tolleranza_alla_siccità = Panel("mid")
usi = Panel("Garden, street, park")
densità = Panel("0.534")
ordine_di_grandezza_2 = Text(ordine_di_grandezza)
specie_di_riferimento_2 = Text(specie_di_riferimento)
usi_2 = Text(usi)
densità_2 = Number(densità)
tolleranza_alla_siccità_2 = Text(tolleranza_alla_siccità)
ordine_di_grandezza_3 = ClusterOutput(ordine_di_grandezza_2)
specie_di_riferimento_3 = ClusterOutput(specie_di_riferimento_2)
tolleranza_alla_siccità_3 = ClusterOutput(tolleranza_alla_siccità_2)
usi_3 = ClusterOutput(usi_2)
densità_3 = ClusterOutput(densità_2)

# ---- group: DBH
larger_than = LargerThan(FirstNumber=first_number, SecondNumber="15")  # -> LargerThan, OrEqualTo
larger_than_2 = LargerThan(FirstNumber=first_number, SecondNumber="25")  # -> LargerThan, OrEqualTo
boolean = Boolean(flatten([larger_than.LargerThan, larger_than_2.LargerThan]))
mass_addition = MassAddition(Input=boolean)  # -> Result, PartialResults
panel_2 = Panel("""0.694
0.288
0.144""")
panel_3 = Panel(mass_addition.Result)
list_item = ListItem(List=panel_2, Index=panel_3, Wrap=True)
panel_4 = Panel(list_item)

# ----
ghpython_script = GhPythonScript(x=first_number, y=panel_2)  # -> h_tempo; inputs y: list; same code as ghpython_script

# ---- group: DBH (continued)
dbh = Number(ghpython_script)
dbh_2 = ClusterOutput(dbh)

# ---- group: CROWN DIAMETER
larger_than_3 = LargerThan(FirstNumber=first_number, SecondNumber="25")  # -> LargerThan, OrEqualTo
larger_than_4 = LargerThan(FirstNumber=first_number, SecondNumber="15")  # -> LargerThan, OrEqualTo
boolean_2 = Boolean(flatten([larger_than_4.LargerThan, larger_than_3.LargerThan]))
mass_addition_2 = MassAddition(Input=boolean_2)  # -> Result, PartialResults
panel_5 = Panel("""0.29
0.089
0.044""")
panel_6 = Panel(mass_addition_2.Result)
list_item_2 = ListItem(List=panel_5, Index=panel_6, Wrap=True)
panel_7 = Panel(list_item_2)

# ----
ghpython_script_2 = GhPythonScript(x=first_number, y=panel_5)  # -> h_tempo; inputs y: list; same code as ghpython_script

# ---- group: CROWN DIAMETER (continued)
crown_diameter = Number(ghpython_script_2)
crown_diameter_2 = ClusterOutput(crown_diameter)

# ---- group: HEIGHT
larger_than_5 = LargerThan(FirstNumber=first_number, SecondNumber="25")  # -> LargerThan, OrEqualTo
larger_than_6 = LargerThan(FirstNumber=first_number, SecondNumber="15")  # -> LargerThan, OrEqualTo
boolean_3 = Boolean(flatten([larger_than_6.LargerThan, larger_than_5.LargerThan]))
mass_addition_3 = MassAddition(Input=boolean_3)  # -> Result, PartialResults
panel_8 = Panel("""0.235
0.01
0.01""")
panel_9 = Panel(mass_addition_3.Result)
list_item_3 = ListItem(List=panel_8, Index=panel_9, Wrap=True)
panel_10 = Panel(list_item_3)

# ----
ghpython_script_3 = GhPythonScript(x=first_number, y=panel_8)  # -> h_tempo; inputs y: list; same code as ghpython_script

# ---- group: HEIGHT (continued)
height = Number(ghpython_script_3)
height_2 = ClusterOutput(height)

# ==== cluster CONSRUCTIONSET

# ---- group: Wall area (m2)
wall_area_m2 = ClusterInput()
wwr = ClusterInput()
wall_area_m2_2 = Data(wall_area_m2)
wwr_2 = Data(wwr)
multiplication = Multiplication(A=wall_area_m2_2, B=wwr_2)
areawindow = Data(multiplication)
subtraction = Subtraction(A=wall_area_m2_2, B=areawindow)
wall = Data(subtraction)

# ----
floor_area_m2 = ClusterInput()
floor_area_m2_2 = Data(floor_area_m2)
glazing_u_factor = ClusterInput()
hb_constructiontype = ClusterInput()
hb_climatezone = ClusterInput()
hb_building_vintages = ClusterInput()

# ---- group: Windows
glazing_u_factor_2 = Number(glazing_u_factor)
windowmat = HBWindowMaterial(name="infisso", u_factor=glazing_u_factor_2, shgc="0.4", t_vis="0.4")  # -> mat; plug-in component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
windowconstr = HBWindowConstruction(materials=windowmat)  # -> constr; plug-in component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
subfacesubset = HBSubfaceSubset(window=windowconstr)  # -> subface_set; plug-in component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

# ----
groundfloor_selector = ClusterInput()
envelope_selector = ClusterInput()
roof_selector = ClusterInput()

# ---- group: program
hb_building_programs = HBBuildingPrograms({"LargeOffice", "MediumOffice", "SmallOffice", "MidriseApartment", "HighriseApartment", "Retail", "StripMall", "PrimarySchool", "SecondarySchool", "SmallHotel", "LargeHotel", "Hospital", "Outpatient", "Laboratory", "Warehouse", "SuperMarket", "FullServiceRestaurant", "QuickServiceRestaurant", "Courthouse", "LargeDataCenterHighITE", "LargeDataCenterLowITE", "SmallDataCenterHighITE", "SmallDataCenterLowITE"}, selected="SmallOffice")
hb_building_programs_2 = HBBuildingPrograms({"LargeOffice", "MediumOffice", "SmallOffice", "MidriseApartment", "HighriseApartment", "Retail", "StripMall", "PrimarySchool", "SecondarySchool", "SmallHotel", "LargeHotel", "Hospital", "Outpatient", "Laboratory", "Warehouse", "SuperMarket", "FullServiceRestaurant", "QuickServiceRestaurant", "Courthouse", "LargeDataCenterHighITE", "LargeDataCenterLowITE", "SmallDataCenterHighITE", "SmallDataCenterLowITE"}, selected="Retail")
hb_building_programs_3 = HBBuildingPrograms({"LargeOffice", "MediumOffice", "SmallOffice", "MidriseApartment", "HighriseApartment", "Retail", "StripMall", "PrimarySchool", "SecondarySchool", "SmallHotel", "LargeHotel", "Hospital", "Outpatient", "Laboratory", "Warehouse", "SuperMarket", "FullServiceRestaurant", "QuickServiceRestaurant", "Courthouse", "LargeDataCenterHighITE", "LargeDataCenterLowITE", "SmallDataCenterHighITE", "SmallDataCenterLowITE"}, selected="HighriseApartment")
panel = Panel("""0.70
0.15
0.15""")
blendprograms = HBBlendProgramTypes(name="Mixed use", programs=[hb_building_programs_3, hb_building_programs, hb_building_programs_2], ratios=panel)  # -> program; plug-in component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
merge = Merge(Data1=blendprograms)

# ----
program_boolean = ClusterInput()
roof_selector_2 = Number(roof_selector)
groundfloor_selector_2 = Number(groundfloor_selector)
custom_program_school = CustomProgram_school()
hb_constructiontype_2 = Text(hb_constructiontype)
hb_climatezone_2 = Text(hb_climatezone)
hb_building_vintages_2 = Text(hb_building_vintages)
envelope_selector_2 = Number(envelope_selector)
custom_program_non_residential = CustomProgramNonResidential()
custom_program_residential = CustomProgramResidential()
cluster = Cluster_9(gfloor=groundfloor_selector_2, m2_solaio=floor_area_m2_2)  # -> floor_stratigrafia_2, gf_u_fac_2, selected_constr_2, environmental_cobenefit_2, social_cobenefit_2, economic_cobenefit_2, floor_albedo_2, floor_thermalemissivity_2, floor_gwp_kgco2e_m2_2, gfloor_gwp_kgco2e_2
cluster_2 = Cluster_8(roof=roof_selector_2, m2_solaio=floor_area_m2_2)  # -> roof_stratigrafia_2, roof_u_fac_2, selected_constr_2, environmental_cobenefit_2, social_cobenefit_2, economic_cobenefit_2, roof_albedo_2, roof_thermalemissivity_2, roof_gwp_kg_co2_m2_2, roof_gwp_kgco2_2
cluster_3 = Cluster_7(wall=envelope_selector_2, m2_pareti=wall)  # -> wall_stratigrafia_2, wall_u_fac_2, selected_const_2, enviromental_cobenefit_2, social_cobenefit_2, economic_cobenefit_2, wall_albedo_2, wall_thermal_emissivity_2, wall_gwp_kg_co2_m2_2, wall_gwp_kgco2e_2
constrsetclimate = HBConstructionSetByClimate(climate_zone=hb_climatezone_2, vintage=hb_building_vintages_2, constr_type=hb_constructiontype_2)  # -> constr_set; plug-in component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
program_boolean_2 = Number(program_boolean)
filter = StreamFilter(
    Gate=program_boolean_2,
    Stream0=custom_program_residential,
    Stream1=custom_program_non_residential,
    Stream2=custom_program_school)
groundsubset = HBGroundConstructionSubset(ground_floor=cluster.selected_constr_2)  # -> ground_set; plug-in component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
exteriorsubset = HBExteriorConstructionSubset(exterior_wall=cluster_3.selected_const_2, exterior_roof=cluster_2.selected_constr_2)  # -> exterior_set; plug-in component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
program_boolean_3 = ClusterOutput(program_boolean_2)
program = Data(filter)
constructionset = HBConstructionSet(
    base_constr_set=constrsetclimate,
    exterior_subset=exteriorsubset,
    ground_subset=groundsubset,
    subface_subset=subfacesubset)  # -> constr_set; plug-in component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
program_2 = ClusterOutput(program)
constr_set = ClusterOutput(constructionset)

# ---- group: GWP(kgCO2e)
merge_2 = Merge(Data1=cluster_3.wall_gwp_kgco2e_2, Data2=cluster_2.roof_gwp_kgco2_2, Data3=cluster.gfloor_gwp_kgco2e_2)
mass_addition = MassAddition(Input=merge_2)  # -> Result, PartialResults
gwp_kgco2e = Data(mass_addition.Result)
gwp_kgco2e_2 = ClusterOutput(gwp_kgco2e)

# ---- group: GWP TOTAL (kgCO2e/m2)
merge_3 = Merge(Data1=cluster_3.wall_gwp_kg_co2_m2_2, Data2=cluster_2.roof_gwp_kg_co2_m2_2, Data3=cluster.floor_gwp_kgco2e_m2_2)
mass_addition_2 = MassAddition(Input=merge_3)  # -> Result, PartialResults
gwp_kgco2e_m2 = Data(mass_addition_2.Result)
gwp_kgco2e_m2_2 = ClusterOutput(gwp_kgco2e_m2)

# ---- group: cobenefits
merge_4 = Merge(Data1=cluster_3.economic_cobenefit_2, Data2=cluster_2.economic_cobenefit_2, Data3=cluster.economic_cobenefit_2)
merge_5 = Merge(Data1=cluster_3.social_cobenefit_2, Data2=cluster_2.social_cobenefit_2, Data3=cluster.social_cobenefit_2)
merge_6 = Merge(
    Data1=cluster_3.enviromental_cobenefit_2,
    Data2=cluster_2.environmental_cobenefit_2,
    Data3=cluster.environmental_cobenefit_2)

# ----
wall_stratigraphy = Data(cluster_3.wall_stratigrafia_2)
wall_u_fac = Data(cluster_3.wall_u_fac_2)
floor_u_fac = Data(cluster.gf_u_fac_2)
roof_stratigraphy = Data(cluster_2.roof_stratigrafia_2)
roof_u_fac = Data(cluster_2.roof_u_fac_2)
floor_stratigraphy = Data(cluster.floor_stratigrafia_2)
floor_stratigraphy_2 = ClusterOutput(floor_stratigraphy)
roof_stratigraphy_2 = ClusterOutput(roof_stratigraphy)
wall_stratigraphy_2 = ClusterOutput(wall_stratigraphy)
roof_u_fac_2 = ClusterOutput(roof_u_fac)
floor_u_fac_2 = ClusterOutput(floor_u_fac)
wall_u_fac_2 = ClusterOutput(wall_u_fac)
social_cobenefit = Data(merge_5)
economic_cobenefit = Data(merge_4)
enviromental_cobenefit = Data(merge_6)
enviromental_cobenefit_2 = ClusterOutput(enviromental_cobenefit)
social_cobenefit_2 = ClusterOutput(social_cobenefit)
economic_cobenefit_2 = ClusterOutput(economic_cobenefit)

# ==== cluster GEOMETRY
location = ClusterInput()
building_name = ClusterInput()
height = ClusterInput()
floortofloor_height = ClusterInput()
height_2 = Number(height)

# ---- group: Typology name
building_name_2 = Text(building_name)
rep = ReplaceText(Text=building_name_2, Find=" ", Replace="_", RecursiveReplace=False)
building_name_3 = Text(rep)

# ----
location_2 = Curve(location)
multiplication = Multiplication(B=height_2)
Z = UnitZ(Factor=multiplication)
surface = Surface(location_2)
extr = Extrude(Base=surface, Direction=Z)
building_name_4 = ClusterOutput(building_name_3)
cap = CapHoles(Brep=extr)
brep = Brep(cap)

# ---- group: Deconstruction
brep_2 = Brep(brep)
list_item = ListItem(List=brep_2, Index=0, Wrap=True)
debrep = DeconstructBrep(Brep=brep_2)  # -> Faces, Edges, Vertices
floortofloor_height_2 = Number(floortofloor_height)
area = Area(Geometry=debrep.Faces)  # -> Area, Centroid
pdecon = Deconstruct(Point=area.Centroid)  # -> XComponent, YComponent, ZComponent
sort = SortList(Keys=pdecon.ZComponent, ValuesA=debrep.Faces, ValuesB=area.Centroid)  # -> Keys, ValuesA, ValuesB
item = ListItem(List=sort.Keys, Index=0, Wrap=True)
item_2 = ListItem(List=sort.ValuesB, Index=0, Wrap=True)  # -> Item1, Item
dist = Distance(PointA=item_2.Item1, PointB=item_2.Item)
panel = Panel(item)
division = Division(A=dist, B=floortofloor_height_2)  # -> simplify(Result)
item_3 = ListItem(List=sort.ValuesA, Index=0, Wrap=True)  # -> Item1, Item

# ---- group: Deconstruction / impronta dell'edificio
building_footprint = Surface(simplify(item_3.Item))

# ----
building_footprint_2 = ClusterOutput(building_footprint)

# ---- group: Deconstruction / num piani
number_of_stories = Integer(division)

# ----
number_of_stories_2 = ClusterOutput(number_of_stories)
brep_3 = ClusterOutput(brep)
area_2 = Area(Geometry=building_footprint)  # -> Area, Centroid

# ---- group: Floor Area
area_3 = Area(Geometry=building_footprint)  # -> Area, Centroid
panel_2 = Panel(area_2.Area)
floor_area_m2 = Data(panel_2)
floor_area_m2_2 = ClusterOutput(floor_area_m2)

# ---- group: Wall area
deconstruct_brep = DeconstructBrep(Brep=brep)  # -> Faces, Edges, Vertices
area_4 = Area(Geometry=deconstruct_brep.Faces)  # -> Area, Centroid

# ----
area_5 = Area(Geometry=deconstruct_brep.Faces)  # -> Area, Centroid

# ---- group: Wall area (continued)
evaluate_surface = EvaluateSurface(Surface=deconstruct_brep.Faces, Point=area_5.Centroid)  # -> Point, Normal, UDirection, VDirection, Frame
deconstruct = Deconstruct(Point=evaluate_surface.Normal)  # -> XComponent, YComponent, ZComponent
equality = Equality(FirstNumber=deconstruct.ZComponent, SecondNumber="0")  # -> Equality, Inequality
cull_pattern = CullPattern(List=deconstruct_brep.Faces, CullPattern=equality.Equality)
area_6 = Area(Geometry=cull_pattern)  # -> Area, Centroid

# ----
area_7 = Area(Geometry=cull_pattern)  # -> Area, Centroid

# ---- group: Wall area (continued)
mass_addition = MassAddition(Input=area_7.Area)  # -> Result, PartialResults
m2wall = Panel(mass_addition.Result)
wall_area_m2 = Data(m2wall)
wall_area_m2_2 = ClusterOutput(wall_area_m2)

# ==== cluster ASPHALT
# SOCIAL: HEALTH IMPACTS
# PUBBLIC SPACE ACCESS
# AESTHETIC VALUE
# COMMUUNITY INCLUSION
# CULTURAL
panel = Panel("1")
# ECONOMIC: EMPLOYMENT AND INCOME GENERATION
# SAVINGS
# INNOVATION AND INVESTIMENT
# PROPERTY VALUE
albedo = Panel("0.15")
# ENVIRONMENTAL: AIR QUALITY
# GHG EMISSIONS
# WATER RECOLLECTION AND SECURITY
# WATER QUALITY
# BIODIVERSITY
# LANDSLIDES AND WEATHERING
panel_2 = Panel("1.16")
subtraction = Subtraction(A=panel, B=albedo)
economical_cobenefit = Panel("""EMPLOYMENT AND INCOME GENERATION
SAVINGS
INNOVATION AND INVESTIMENT
PROPERTY VALUE""")
environmental_cobenefit = Panel("")
social_cobenefit = Panel("PUBBLIC SPACE ACCESS")
albedo_2 = Panel("0.15")
thermalemissivity = Panel("0.90")
opaquemat = HBOpaqueMaterial(
    name="ASPHALT",
    thickness="1",
    conductivity=panel_2,
    density="2300",
    spec_heat="1700",
    therm_absp="0.90",
    sol_absp=subtraction,
    vis_absp=subtraction)  # -> mat; plug-in component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
color = DefineColor(Color=ColourSwatch(SwatchColor=RGB(0, 0, 0)), Source="object")
economic_cobenefit = Text(economical_cobenefit)
social_cobenefit_2 = Text(social_cobenefit)
albedo_3 = Number(albedo_2)
environmental_cobenefit_2 = Text(environmental_cobenefit)
thermalemissivity_2 = Number(thermalemissivity)
economic_cobenefit_2 = ClusterOutput(economic_cobenefit)
opaqueconstr = HBOpaqueConstruction(name="ASPHALT", materials=opaquemat)  # -> constr; plug-in component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
albedo_4 = ClusterOutput(albedo_3)
thermalemissivity_3 = ClusterOutput(thermalemissivity_2)
colour = Colour(color)
environmental_cobenefit_3 = ClusterOutput(environmental_cobenefit_2)
social_cobenefit_3 = ClusterOutput(social_cobenefit_2)
colour_2 = ClusterOutput(colour)
name = Data("ASPHALT")
construction = Data(opaqueconstr)
name_2 = ClusterOutput(name)
construction_2 = ClusterOutput(construction)

# ==== cluster COOL_ASPHALT
# SOCIAL: HEALTH IMPACTS
# PUBBLIC SPACE ACCESS
# AESTHETIC VALUE
# COMMUUNITY INCLUSION
# CULTURAL
panel = Panel("1")
# ECONOMIC: EMPLOYMENT AND INCOME GENERATION
# SAVINGS
# INNOVATION AND INVESTIMENT
# PROPERTY VALUE
albedo = Panel("0.6")
# ENVIRONMENTAL: AIR QUALITY
# GHG EMISSIONS
# WATER RECOLLECTION AND SECURITY
# WATER QUALITY
# BIODIVERSITY
# LANDSLIDES AND WEATHERING
panel_2 = Panel("0.70")
subtraction = Subtraction(A=panel, B=albedo)
opaquemat = HBOpaqueMaterial(
    name="COOL_ASPHALT",
    thickness="1",
    conductivity=panel_2,
    density="1460",
    spec_heat="879",
    therm_absp="0.93",
    sol_absp=subtraction,
    vis_absp=subtraction)  # -> mat; plug-in component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
economical_cobenefit = Panel("""EMPLOYMENT AND INCOME GENERATION
SAVINGS
INNOVATION AND INVESTIMENT
PROPERTY VALUE""")
social_cobenefit = Panel("""HEALTH IMPACTS
PUBBLIC SPACE ACCESS""")
environmental_cobenefit = Panel("""AIR QUALITY
GHG EMISSIONS""")
albedo_2 = Panel("0.60")
thermal_emissivity = Panel("0.93")
color = DefineColor(Color=ColourSwatch(SwatchColor=RGB(176, 162, 162)), Source="object")
opaqueconstr = HBOpaqueConstruction(name="COOL_ASPHALT", materials=opaquemat)  # -> constr; plug-in component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
economic_cobenefit = Text(economical_cobenefit)
social_cobenefit_2 = Text(social_cobenefit)
environmental_cobenefit_2 = Text(environmental_cobenefit)
albedo_3 = Number(albedo_2)
thermalemissivity = Number(thermal_emissivity)
colour = Colour(color)
name = Data("COOL_ASPHALT")
economic_cobenefit_2 = ClusterOutput(economic_cobenefit)
social_cobenefit_3 = ClusterOutput(social_cobenefit_2)
environmental_cobenefit_3 = ClusterOutput(environmental_cobenefit_2)
albedo_4 = ClusterOutput(albedo_3)
thermalemissivity_2 = ClusterOutput(thermalemissivity)
colour_2 = ClusterOutput(colour)
name_2 = ClusterOutput(name)
construction = Data(opaqueconstr)
construction_2 = ClusterOutput(construction)

# ==== cluster TERRE_BATTUE
# SOCIAL: HEALTH IMPACTS
# PUBBLIC SPACE ACCESS
# AESTHETIC VALUE
# COMMUUNITY INCLUSION
# CULTURAL
# ECONOMIC: EMPLOYMENT AND INCOME GENERATION
# SAVINGS
# INNOVATION AND INVESTIMENT
# PROPERTY VALUE
albedo = Panel("0.40")
# ENVIRONMENTAL: AIR QUALITY
# GHG EMISSIONS
# WATER RECOLLECTION AND SECURITY
# WATER QUALITY
# BIODIVERSITY
# LANDSLIDES AND WEATHERING
panel = Panel("1")
subtraction = Subtraction(A="1", B=albedo)
social_cobenefit = Panel("""HEALTH IMPACTS
PUBBLIC SPACE ACCESS
COMMUUNITY INCLUSION""")
economic_cobenefit = Panel("""SAVINGS
INNOVATION AND INVESTIMENT""")
environmental_cobenefit = Panel("""AIR QUALITY
GHG EMISSIONS
WATER RECOLLECTION AND SECURITY
WATER QUALITY""")
opaquemat = HBOpaqueMaterial(
    name="TERRE_BATTUE",
    thickness=panel,
    conductivity="0.82",
    density="2180",
    spec_heat="720",
    therm_absp="0.9",
    sol_absp=subtraction,
    vis_absp=subtraction)  # -> mat; plug-in component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
albedo_2 = Panel("0.40")
thermal_emissivity = Panel("0.90")
color = DefineColor(Color=ColourSwatch(SwatchColor=RGB(152, 104, 6)), Source="object")
environmental_cobenefit_2 = Text(environmental_cobenefit)
social_cobenefit_2 = Text(social_cobenefit)
economic_cobenefit_2 = Text(economic_cobenefit)
albedo_3 = Number(albedo_2)
colour = Colour(color)
thermalemissivity = Number(thermal_emissivity)
environmental_cobenefit_3 = ClusterOutput(environmental_cobenefit_2)
social_cobenefit_3 = ClusterOutput(social_cobenefit_2)
economic_cobenefit_3 = ClusterOutput(economic_cobenefit_2)
opaqueconstr = HBOpaqueConstruction(name="TERRE_BATTUE", materials=opaquemat)  # -> constr; plug-in component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
albedo_4 = ClusterOutput(albedo_3)
colour_2 = ClusterOutput(colour)
thermalemissivity_2 = ClusterOutput(thermalemissivity)
name = Data("TERRE_BATTUE")
name_2 = ClusterOutput(name)
construction = Data(opaqueconstr)
construction_2 = ClusterOutput(construction)

# ==== cluster BRICK_ROAD_RED_STONES
# SOCIAL: HEALTH IMPACTS
# PUBBLIC SPACE ACCESS
# AESTHETIC VALUE
# COMMUUNITY INCLUSION
# CULTURAL
panel = Panel("1")
# ECONOMIC: EMPLOYMENT AND INCOME GENERATION
# SAVINGS
# INNOVATION AND INVESTIMENT
# PROPERTY VALUE
albedo = Panel("0.30")
# ENVIRONMENTAL: AIR QUALITY
# GHG EMISSIONS
# WATER RECOLLECTION AND SECURITY
# WATER QUALITY
# BIODIVERSITY
# LANDSLIDES AND WEATHERING
panel_2 = Panel("1")
subtraction = Subtraction(A=panel, B=albedo)
albedo_2 = Panel("0.30")
thermal_emissivity = Panel("0.95")
economic_cobenefit = Panel("SAVINGS")
social_cobenefit = Panel("PUBBLIC SPACE ACCESS")
environmental_cobenefit = Panel("""AIR QUALITY
GHG EMISSIONS""")
opaquemat = HBOpaqueMaterial(
    name="BRICK_ROAD_RED_STONES",
    thickness=panel_2,
    conductivity="0.90",
    density="2000",
    spec_heat="840",
    therm_absp="0.95",
    sol_absp=subtraction,
    vis_absp=subtraction)  # -> mat; plug-in component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
color = DefineColor(Color=ColourSwatch(SwatchColor=RGB(128, 32, 0)), Source="object")
albedo_3 = Number(albedo_2)
thermalemissivity = Number(thermal_emissivity)
colour = Colour(color)
opaqueconstr = HBOpaqueConstruction(name="BRICK_ROAD_RED_STONES", materials=opaquemat)  # -> constr; plug-in component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
environmental_cobenefit_2 = Text(environmental_cobenefit)
economic_cobenefit_2 = Text(economic_cobenefit)
social_cobenefit_2 = Text(social_cobenefit)
albedo_4 = ClusterOutput(albedo_3)
thermalemissivity_2 = ClusterOutput(thermalemissivity)
colour_2 = ClusterOutput(colour)
economic_cobenefit_3 = ClusterOutput(economic_cobenefit_2)
environmental_cobenefit_3 = ClusterOutput(environmental_cobenefit_2)
name = Data("BRICK_ROAD_RED_STONES")
social_cobenefit_3 = ClusterOutput(social_cobenefit_2)
name_2 = ClusterOutput(name)
construction = Data(opaqueconstr)
construction_2 = ClusterOutput(construction)

# ==== cluster BRICK_ROAD_YELLOW_STONES
# SOCIAL: HEALTH IMPACTS
# PUBBLIC SPACE ACCESS
# AESTHETIC VALUE
# COMMUUNITY INCLUSION
# CULTURAL
panel = Panel("1")
# ECONOMIC: EMPLOYMENT AND INCOME GENERATION
# SAVINGS
# INNOVATION AND INVESTIMENT
# PROPERTY VALUE
albedo = Panel("0.40")
# ENVIRONMENTAL: AIR QUALITY
# GHG EMISSIONS
# WATER RECOLLECTION AND SECURITY
# WATER QUALITY
# BIODIVERSITY
# LANDSLIDES AND WEATHERING
panel_2 = Panel("0.90")
subtraction = Subtraction(A=panel, B=albedo)
opaquemat = HBOpaqueMaterial(
    name="BRICK_ROAD_YELLOW_STONES",
    thickness="1",
    conductivity=panel_2,
    density="2000",
    spec_heat="840",
    therm_absp="0.95",
    sol_absp=subtraction,
    vis_absp=subtraction)  # -> mat; plug-in component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
economic_cobenefit = Panel("SAVINGS")
social_cobenefit = Panel("PUBBLIC SPACE ACCESS")
environmental_cobenefit = Panel("""AIR QUALITY
GHG EMISSIONS""")
panel_3 = Panel("BRICK_ROAD_YELLOW_STONES")
albedo_2 = Panel("0.40")
thermal_emissivity = Panel("0.95")
color = DefineColor(Color=ColourSwatch(SwatchColor=RGB(205, 171, 0)), Source="object")
opaqueconstr = HBOpaqueConstruction(name=panel_3, materials=opaquemat)  # -> constr; plug-in component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
environmental_cobenefit_2 = Text(environmental_cobenefit)
social_cobenefit_2 = Text(social_cobenefit)
economic_cobenefit_2 = Text(economic_cobenefit)
colour = Colour(color)
environmental_cobenefit_3 = ClusterOutput(environmental_cobenefit_2)
albedo_3 = Number(albedo_2)
name = Data(panel_3)
economic_cobenefit_3 = ClusterOutput(economic_cobenefit_2)
thermalemissivity = Number(thermal_emissivity)
social_cobenefit_3 = ClusterOutput(social_cobenefit_2)
colour_2 = ClusterOutput(colour)
name_2 = ClusterOutput(name)
construction = Data(opaqueconstr)
albedo_4 = ClusterOutput(albedo_3)
thermalemissivity_2 = ClusterOutput(thermalemissivity)
construction_2 = ClusterOutput(construction)

# ==== cluster LOAMY_SOIL
# SOCIAL: HEALTH IMPACTS
# PUBBLIC SPACE ACCESS
# AESTHETIC VALUE
# COMMUUNITY INCLUSION
# CULTURAL
panel = Panel("1")
# ECONOMIC: EMPLOYMENT AND INCOME GENERATION
# SAVINGS
# INNOVATION AND INVESTIMENT
# PROPERTY VALUE
albedo = Panel("0.15")
# ENVIRONMENTAL: AIR QUALITY
# GHG EMISSIONS
# WATER RECOLLECTION AND SECURITY
# WATER QUALITY
# BIODIVERSITY
# LANDSLIDES AND WEATHERING
panel_2 = Panel("2")
subtraction = Subtraction(A=panel, B=albedo)
social_cobenefit = Panel("""HEALTH IMPACTS
AESTHETIC VALUE
COMMUNITY INCLUSION
CULTURAL""")
economic_cobenefit = Panel("""SAVINGS
INNOVATION AND INVESTIMENT
PROPERTY VALUE""")
environmental_cobenefit = Panel("""AIR QUALITY
GHG EMISSIONS
WATER RECOLLECTION AND SECURITY
WATER QUALITY
BIODIVERSITY
LANDSLIDES AND WEATHERING""")
opaquemat = HBOpaqueMaterial(
    name="LOAMY_SOIL",
    thickness="1",
    conductivity=panel_2,
    density="1460",
    spec_heat="879",
    therm_absp="0.9",
    sol_absp=subtraction,
    vis_absp=subtraction)  # -> mat; plug-in component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
thermal_emissivity = Panel("0.90")
albedo_2 = Panel("0.15")
color = DefineColor(Color=ColourSwatch(SwatchColor=RGB(174, 110, 0)), Source="object")
economic_cobenefit_2 = Text(economic_cobenefit)
social_cobenefit_2 = Text(social_cobenefit)
environmental_cobenefit_2 = Text(environmental_cobenefit)
colour = Colour(color)
albedo_3 = Number(albedo_2)
thermalemissivity = Number(thermal_emissivity)
economic_cobenefit_3 = ClusterOutput(economic_cobenefit_2)
social_cobenefit_3 = ClusterOutput(social_cobenefit_2)
environmental_cobenefit_3 = ClusterOutput(environmental_cobenefit_2)
albedo_4 = ClusterOutput(albedo_3)
thermalemissivity_2 = ClusterOutput(thermalemissivity)
colour_2 = ClusterOutput(colour)
opaqueconstr = HBOpaqueConstruction(name="LOAMY_SOIL", materials=opaquemat)  # -> constr; plug-in component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
name = Data("LOAMY_SOIL")
construction = Data(opaqueconstr)
name_2 = ClusterOutput(name)
construction_2 = ClusterOutput(construction)

# ==== cluster SAND
# ENVIRONMENTAL: AIR QUALITY
# GHG EMISSIONS
# WATER RECOLLECTION AND SECURITY
# WATER QUALITY
# BIODIVERSITY
# LANDSLIDES AND WEATHERING
panel = Panel("1")
# SOCIAL: HEALTH IMPACTS
# PUBBLIC SPACE ACCESS
# AESTHETIC VALUE
# COMMUUNITY INCLUSION
# CULTURAL
# ECONOMIC: EMPLOYMENT AND INCOME GENERATION
# SAVINGS
# INNOVATION AND INVESTIMENT
# PROPERTY VALUE
albedo = Panel("0.30")
subtraction = Subtraction(A=panel, B=albedo)
albedo_2 = Panel("0.30")
thermal_emissivity = Panel("0.90")
social_cobenefit = Panel("""HEALTH IMPACTS
AESTHETIC VALUE
COMMUNITY INCLUSION
CULTURAL""")
economic_cobenefit = Panel("""EMPLOYMENT AND INCOME GENERATION
SAVINGS
INNOVATION AND INVESTIMENT
PROPERTY VALUE""")
environmental_cobenefit = Panel("""AIR QUALITY
GHG EMISSIONS
WATER RECOLLECTION AND SECURITY
WATER QUALITY
BIODIVERSITY
LANDSLIDES AND WEATHERING""")
opaquemat = HBOpaqueMaterial(
    name="SAND",
    thickness="1",
    conductivity="0.35",
    density="1460",
    spec_heat="879",
    therm_absp="0.9",
    sol_absp=subtraction,
    vis_absp=subtraction)  # -> mat; plug-in component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
color = DefineColor(Color=ColourSwatch(SwatchColor=RGB(217, 226, 0)), Source="object")
colour = Colour(color)
albedo_3 = Number(albedo_2)
thermalemissivity = Number(thermal_emissivity)
economic_cobenefit_2 = Text(economic_cobenefit)
environmental_cobenefit_2 = Text(environmental_cobenefit)
social_cobenefit_2 = Text(social_cobenefit)
albedo_4 = ClusterOutput(albedo_3)
thermalemissivity_2 = ClusterOutput(thermalemissivity)
colour_2 = ClusterOutput(colour)
environmental_cobenefit_3 = ClusterOutput(environmental_cobenefit_2)
economic_cobenefit_3 = ClusterOutput(economic_cobenefit_2)
social_cobenefit_3 = ClusterOutput(social_cobenefit_2)
opaqueconstr = HBOpaqueConstruction(name="SAND", materials=opaquemat)  # -> constr; plug-in component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
name = Data("SAND")
name_2 = ClusterOutput(name)
construction = Data(opaqueconstr)
construction_2 = ClusterOutput(construction)

# ==== cluster WOOD
# SOCIAL: HEALTH IMPACTS
# PUBBLIC SPACE ACCESS
# AESTHETIC VALUE
# COMMUUNITY INCLUSION
# CULTURAL
panel = Panel("1")
# ECONOMIC: EMPLOYMENT AND INCOME GENERATION
# SAVINGS
# INNOVATION AND INVESTIMENT
# PROPERTY VALUE
albedo = Panel("0.35")
# ENVIRONMENTAL: AIR QUALITY
# GHG EMISSIONS
# WATER RECOLLECTION AND SECURITY
# WATER QUALITY
# BIODIVERSITY
# LANDSLIDES AND WEATHERING
panel_2 = Panel("WOOD")
subtraction = Subtraction(A=panel, B=albedo)
social_cobenefit = Panel("""HEALTH IMPACTS
PUBBLIC SPACE ACCESS
AESTHETIC VALUE
COMMUNITY INCLUSION""")
economic_cobenefit = Panel("""EMPLOYMENT AND INCOME GENERATION
SAVINGS
INNOVATION AND INVESTIMENT
PROPERTY VALUE""")
environmental_cobenefit = Panel("""AIR QUALITY
GHG EMISSIONS
BIODIVERSITY""")
opaquemat = HBOpaqueMaterial(
    name=panel_2,
    thickness="1",
    conductivity="0.22",
    density="650",
    spec_heat="1660",
    therm_absp="0.9",
    sol_absp=subtraction,
    vis_absp=subtraction)  # -> mat; plug-in component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
thermal_emissivity = Panel("0.90")
albedo_2 = Panel("0.35")
color = DefineColor(Color=ColourSwatch(SwatchColor=RGB(146, 68, 0)), Source="object")
colour = Colour(color)
albedo_3 = Number(albedo_2)
economic_cobenefit_2 = Text(economic_cobenefit)
thermalemissivity = Number(thermal_emissivity)
social_cobenefit_2 = Text(social_cobenefit)
environmental_cobenefit_2 = Text(environmental_cobenefit)
colour_2 = ClusterOutput(colour)
opaqueconstr = HBOpaqueConstruction(name="WOOD", materials=opaquemat)  # -> constr; plug-in component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
economic_cobenefit_3 = ClusterOutput(economic_cobenefit_2)
albedo_4 = ClusterOutput(albedo_3)
thermalemissivity_2 = ClusterOutput(thermalemissivity)
environmental_cobenefit_3 = ClusterOutput(environmental_cobenefit_2)
social_cobenefit_3 = ClusterOutput(social_cobenefit_2)
name = Data("WOOD")
construction = Data(opaqueconstr)
name_2 = ClusterOutput(name)
construction_2 = ClusterOutput(construction)

# ==== cluster PEBBLES
# ECONOMIC: EMPLOYMENT AND INCOME GENERATION
# SAVINGS
# INNOVATION AND INVESTIMENT
# PROPERTY VALUE
albedo = Panel("0.45")
# SOCIAL: HEALTH IMPACTS
# PUBBLIC SPACE ACCESS
# AESTHETIC VALUE
# COMMUUNITY INCLUSION
# CULTURAL
panel = Panel("1")
# ENVIRONMENTAL: AIR QUALITY
# GHG EMISSIONS
# WATER RECOLLECTION AND SECURITY
# WATER QUALITY
# BIODIVERSITY
# LANDSLIDES AND WEATHERING
panel_2 = Panel("0.70")
subtraction = Subtraction(A=panel, B=albedo)
social_cobenefit = Panel("""HEALTH IMPACTS
AESTHETIC VALUE""")
economic_cobenefit = Panel("""EMPLOYMENT AND INCOME GENERATION
SAVINGS
PROPERTY VALUE""")
environmental_cobenefit = Panel("""AIR QUALITY
GHG EMISSIONS
WATER QUALITY
BIODIVERSITY""")
albedo_2 = Panel("0.45")
thermal_emissivity = Panel("0.75")
opaquemat = HBOpaqueMaterial(
    name="PEBBLES",
    thickness="1",
    conductivity=panel_2,
    density="500",
    spec_heat="840",
    therm_absp="0.75",
    sol_absp=subtraction,
    vis_absp=subtraction)  # -> mat; plug-in component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
color = DefineColor(Color=ColourSwatch(SwatchColor=RGB(214, 207, 182)), Source="object")
colour = Colour(color)
albedo_3 = Number(albedo_2)
thermalemissivity = Number(thermal_emissivity)
social_cobenefit_2 = Text(social_cobenefit)
economic_cobenefit_2 = Text(economic_cobenefit)
environmental_cobenefit_2 = Text(environmental_cobenefit)
colour_2 = ClusterOutput(colour)
albedo_4 = ClusterOutput(albedo_3)
thermalemissivity_2 = ClusterOutput(thermalemissivity)
economic_cobenefit_3 = ClusterOutput(economic_cobenefit_2)
environmental_cobenefit_3 = ClusterOutput(environmental_cobenefit_2)
opaqueconstr = HBOpaqueConstruction(name="PEBBLES", materials=opaquemat)  # -> constr; plug-in component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
social_cobenefit_3 = ClusterOutput(social_cobenefit_2)
name = Data("PEBBLES")
construction = Data(opaqueconstr)
name_2 = ClusterOutput(name)
construction_2 = ClusterOutput(construction)

# ==== cluster PORFIDO
# SOCIAL: HEALTH IMPACTS
# PUBBLIC SPACE ACCESS
# AESTHETIC VALUE
# COMMUUNITY INCLUSION
# CULTURAL
panel = Panel("1")
# ECONOMIC: EMPLOYMENT AND INCOME GENERATION
# SAVINGS
# INNOVATION AND INVESTIMENT
# PROPERTY VALUE
albedo = Panel("0.1")
# ENVIRONMENTAL: AIR QUALITY
# GHG EMISSIONS
# WATER RECOLLECTION AND SECURITY
# WATER QUALITY
# BIODIVERSITY
# LANDSLIDES AND WEATHERING
panel_2 = Panel("1")
subtraction = Subtraction(A=panel, B=albedo)
opaquemat = HBOpaqueMaterial(
    name="PORFIDO",
    thickness=panel_2,
    conductivity="2.90",
    density="2200",
    spec_heat="700",
    therm_absp="0.72",
    sol_absp=subtraction,
    vis_absp=subtraction)  # -> mat; plug-in component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
environmental_cobenefit = Panel("")
social_cobenefit = Panel("""PUBBLIC SPACE ACCESS
COMMUNITY INCLUSION
CULTURAL""")
economic_cobenefit = Panel("""EMPLOYMENT AND INCOME GENERATION
SAVINGS
INNOVATION AND INVESTIMENT
PROPERTY VALUE""")
albedo_2 = Panel("0.10")
thermal_emissivity = Panel("0.72")
color = DefineColor(Color=ColourSwatch(SwatchColor=RGB(69, 68, 61)), Source="object")
colour = Colour(color)
opaqueconstr = HBOpaqueConstruction(name="PORFIDO", materials=opaquemat)  # -> constr; plug-in component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
social_cobenefit_2 = Text(social_cobenefit)
economic_cobenefit_2 = Text(economic_cobenefit)
albedo_3 = Number(albedo_2)
thermalemissivity = Number(thermal_emissivity)
environmental_cobenefit_2 = Text(environmental_cobenefit)
colour_2 = ClusterOutput(colour)
economic_cobenefit_3 = ClusterOutput(economic_cobenefit_2)
albedo_4 = ClusterOutput(albedo_3)
social_cobenefit_3 = ClusterOutput(social_cobenefit_2)
thermalemissivity_2 = ClusterOutput(thermalemissivity)
environmental_cobenefit_3 = ClusterOutput(environmental_cobenefit_2)
construction = Data(opaqueconstr)
name = Data("PORFIDO")
construction_2 = ClusterOutput(construction)
name_2 = ClusterOutput(name)

# ==== cluster GRANITO
# ECONOMIC: EMPLOYMENT AND INCOME GENERATION
# SAVINGS
# INNOVATION AND INVESTIMENT
# PROPERTY VALUE
albedo = Panel("0.45")
# SOCIAL: HEALTH IMPACTS
# PUBBLIC SPACE ACCESS
# AESTHETIC VALUE
# COMMUUNITY INCLUSION
# CULTURAL
panel = Panel("1")
# ENVIRONMENTAL: AIR QUALITY
# GHG EMISSIONS
# WATER RECOLLECTION AND SECURITY
# WATER QUALITY
# BIODIVERSITY
# LANDSLIDES AND WEATHERING
panel_2 = Panel("1")
subtraction = Subtraction(A=panel, B=albedo)
environmental_cobenefit = Panel("""AIR QUALITY
GHG EMISSIONS""")
social_cobenefit = Panel("""HEALTH IMPACTS
PUBBLIC SPACE ACCESS
AESTHETIC VALUE
COMMUNITY INCLUSION
CULTURAL""")
economic_cobenefit = Panel("""EMPLOYMENT AND INCOME GENERATION
SAVINGS
INNOVATION AND INVESTIMENT
PROPERTY VALUE""")
opaquemat = HBOpaqueMaterial(
    name="GRANITO",
    thickness=panel_2,
    conductivity="4.61",
    density="2650",
    spec_heat="900",
    therm_absp="0.90",
    sol_absp=subtraction,
    vis_absp=subtraction)  # -> mat; plug-in component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
thermal_emissivity = Panel("0.90")
albedo_2 = Panel("0.45")
color = DefineColor(Color=ColourSwatch(SwatchColor=RGB(61, 61, 60)), Source="object")
colour = Colour(color)
opaqueconstr = HBOpaqueConstruction(name="GRANITO", materials=opaquemat)  # -> constr; plug-in component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
albedo_3 = Number(albedo_2)
social_cobenefit_2 = Text(social_cobenefit)
thermalemissivity = Number(thermal_emissivity)
environmental_cobenefit_2 = Text(environmental_cobenefit)
economic_cobenefit_2 = Text(economic_cobenefit)
albedo_4 = ClusterOutput(albedo_3)
thermalemissivity_2 = ClusterOutput(thermalemissivity)
social_cobenefit_3 = ClusterOutput(social_cobenefit_2)
colour_2 = ClusterOutput(colour)
economic_cobenefit_3 = ClusterOutput(economic_cobenefit_2)
environmental_cobenefit_3 = ClusterOutput(environmental_cobenefit_2)
construction = Data(opaqueconstr)
name = Data("GRANITO")
construction_2 = ClusterOutput(construction)
name_2 = ClusterOutput(name)

# ==== cluster BASALTO
# ECONOMIC: EMPLOYMENT AND INCOME GENERATION
# SAVINGS
# INNOVATION AND INVESTIMENT
# PROPERTY VALUE
albedo = Panel("0.15")
# SOCIAL: HEALTH IMPACTS
# PUBBLIC SPACE ACCESS
# AESTHETIC VALUE
# COMMUUNITY INCLUSION
# CULTURAL
panel = Panel("1")
# ENVIRONMENTAL: AIR QUALITY
# GHG EMISSIONS
# WATER RECOLLECTION AND SECURITY
# WATER QUALITY
# BIODIVERSITY
# LANDSLIDES AND WEATHERING
panel_2 = Panel("1")
subtraction = Subtraction(A=panel, B=albedo)
opaquemat = HBOpaqueMaterial(
    name="BASALTO",
    thickness=panel_2,
    conductivity="2.38",
    density="2700",
    spec_heat="700",
    therm_absp="0.72",
    sol_absp=subtraction,
    vis_absp=subtraction)  # -> mat; plug-in component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
environmental_cobenefit = Panel("""AIR QUALITY
GHG EMISSIONS""")
social_cobenefit = Panel("""HEALTH IMPACTS
PUBBLIC SPACE ACCESS
AESTHETIC VALUE
COMMUNITY INCLUSION
CULTURAL""")
economic_cobenefit = Panel("""EMPLOYMENT AND INCOME GENERATION
SAVINGS
INNOVATION AND INVESTIMENT
PROPERTY VALUE""")
thermal_emissivity = Panel("0.72")
albedo_2 = Panel("0.15")
color = DefineColor(Color=ColourSwatch(SwatchColor=RGB(78, 84, 82)), Source="object")
opaqueconstr = HBOpaqueConstruction(name="BASALTO", materials=opaquemat)  # -> constr; plug-in component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
social_cobenefit_2 = Text(social_cobenefit)
colour = Colour(color)
environmental_cobenefit_2 = Text(environmental_cobenefit)
economic_cobenefit_2 = Text(economic_cobenefit)
albedo_3 = Number(albedo_2)
thermalemissivity = Number(thermal_emissivity)
social_cobenefit_3 = ClusterOutput(social_cobenefit_2)
environmental_cobenefit_3 = ClusterOutput(environmental_cobenefit_2)
economic_cobenefit_3 = ClusterOutput(economic_cobenefit_2)
albedo_4 = ClusterOutput(albedo_3)
thermalemissivity_2 = ClusterOutput(thermalemissivity)
colour_2 = ClusterOutput(colour)
construction = Data(opaqueconstr)
name = Data("BASALTO")
construction_2 = ClusterOutput(construction)
name_2 = ClusterOutput(name)

# ==== cluster CONCRETE_PAVEMENT_DARK
# SOCIAL: HEALTH IMPACTS
# PUBBLIC SPACE ACCESS
# AESTHETIC VALUE
# COMMUUNITY INCLUSION
# CULTURAL
panel = Panel("1")
# ECONOMIC: EMPLOYMENT AND INCOME GENERATION
# SAVINGS
# INNOVATION AND INVESTIMENT
# PROPERTY VALUE
albedo = Panel("0.3")
# ENVIRONMENTAL: AIR QUALITY
# GHG EMISSIONS
# WATER RECOLLECTION AND SECURITY
# WATER QUALITY
# BIODIVERSITY
# LANDSLIDES AND WEATHERING
panel_2 = Panel("1")
subtraction = Subtraction(A=panel, B=albedo)
economic_cobenefit = Panel("""EMPLOYMENT AND INCOME GENERATION
SAVINGS
INNOVATION AND INVESTIMENT
PROPERTY VALUE""")
environmental_cobenefit = Panel("""AIR QUALITY
GHG EMISSIONS
WATER RECOLLECTION AND SECURITY""")
social_cobenefit = Panel("""PUBBLIC SPACE ACCESS
COMMUNITY INCLUSION""")
opaquemat = HBOpaqueMaterial(
    name="CONCRETE_PAVEMENT_DARK",
    thickness=panel_2,
    conductivity="1",
    density="2100",
    spec_heat="653",
    therm_absp="0.80",
    sol_absp=subtraction,
    vis_absp=subtraction)  # -> mat; plug-in component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
thermal_emissivity = Panel("0.80")
albedo_2 = Panel("0.30")
color = DefineColor(Color=ColourSwatch(SwatchColor=RGB(38, 33, 3)), Source="object")
opaqueconstr = HBOpaqueConstruction(name="CONCRETE_PAVEMENT_DARK", materials=opaquemat)  # -> constr; plug-in component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
albedo_3 = Number(albedo_2)
economic_cobenefit_2 = Text(economic_cobenefit)
thermalemissivity = Number(thermal_emissivity)
environmental_cobenefit_2 = Text(environmental_cobenefit)
social_cobenefit_2 = Text(social_cobenefit)
colour = Colour(color)
albedo_4 = ClusterOutput(albedo_3)
economic_cobenefit_3 = ClusterOutput(economic_cobenefit_2)
thermalemissivity_2 = ClusterOutput(thermalemissivity)
environmental_cobenefit_3 = ClusterOutput(environmental_cobenefit_2)
social_cobenefit_3 = ClusterOutput(social_cobenefit_2)
name = Data("CONCRETE_PAVEMENT_DARK")
construction = Data(opaqueconstr)
colour_2 = ClusterOutput(colour)
construction_2 = ClusterOutput(construction)
name_2 = ClusterOutput(name)

# ==== cluster CONCRETE_PAVEMENT_MEDIUM
# SOCIAL: HEALTH IMPACTS
# PUBBLIC SPACE ACCESS
# AESTHETIC VALUE
# COMMUUNITY INCLUSION
# CULTURAL
panel = Panel("1")
# ECONOMIC: EMPLOYMENT AND INCOME GENERATION
# SAVINGS
# INNOVATION AND INVESTIMENT
# PROPERTY VALUE
albedo = Panel("0.50")
# ENVIRONMENTAL: AIR QUALITY
# GHG EMISSIONS
# WATER RECOLLECTION AND SECURITY
# WATER QUALITY
# BIODIVERSITY
# LANDSLIDES AND WEATHERING
panel_2 = Panel("1")
subtraction = Subtraction(A=panel, B=albedo)
economic_cobenefit = Panel("""EMPLOYMENT AND INCOME GENERATION
SAVINGS
INNOVATION AND INVESTIMENT
PROPERTY VALUE""")
environmental_cobenefit = Panel("""AIR QUALITY
GHG EMISSIONS
WATER RECOLLECTION AND SECURITY""")
social_cobenefit = Panel("""HEALTH IMPACTS
PUBBLIC SPACE ACCESS
COMMUNITY INCLUSION""")
thermal_emissivity = Panel("0.85")
albedo_2 = Panel("0.50")
opaquemat = HBOpaqueMaterial(
    name="CONCRETE_PAVEMENT_MEDIUM",
    thickness=panel_2,
    conductivity="1",
    density="2100",
    spec_heat="653",
    therm_absp="0.85",
    sol_absp=subtraction,
    vis_absp=subtraction)  # -> mat; plug-in component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
color = DefineColor(Color=ColourSwatch(SwatchColor=RGB(92, 92, 91)), Source="object")
colour = Colour(color)
social_cobenefit_2 = Text(social_cobenefit)
economic_cobenefit_2 = Text(economic_cobenefit)
albedo_3 = Number(albedo_2)
environmental_cobenefit_2 = Text(environmental_cobenefit)
panel_3 = Panel("CONCRETE PAVEMENT MEDIUM")
thermalemissivity = Number(thermal_emissivity)
opaqueconstr = HBOpaqueConstruction(name=panel_3, materials=opaquemat)  # -> constr; plug-in component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
economic_cobenefit_3 = ClusterOutput(economic_cobenefit_2)
social_cobenefit_3 = ClusterOutput(social_cobenefit_2)
albedo_4 = ClusterOutput(albedo_3)
thermalemissivity_2 = ClusterOutput(thermalemissivity)
environmental_cobenefit_3 = ClusterOutput(environmental_cobenefit_2)
colour_2 = ClusterOutput(colour)
construction = Data(opaqueconstr)
name = Data(panel_3)
construction_2 = ClusterOutput(construction)
name_2 = ClusterOutput(name)

# ==== cluster CONCRETE_PAVEMENT_LIGHT
# SOCIAL: HEALTH IMPACTS
# PUBBLIC SPACE ACCESS
# AESTHETIC VALUE
# COMMUUNITY INCLUSION
# CULTURAL
panel = Panel("1")
# ECONOMIC: EMPLOYMENT AND INCOME GENERATION
# SAVINGS
# INNOVATION AND INVESTIMENT
# PROPERTY VALUE
albedo = Panel("0.60")
# ENVIRONMENTAL: AIR QUALITY
# GHG EMISSIONS
# WATER RECOLLECTION AND SECURITY
# WATER QUALITY
# BIODIVERSITY
# LANDSLIDES AND WEATHERING
panel_2 = Panel("1")
subtraction = Subtraction(A=panel, B=albedo)
albedo_2 = Panel("0.60")
thermal_emissivity = Panel("0.90")
economic_cobenefit = Panel("""EMPLOYMENT AND INCOME GENERATION
SAVINGS
INNOVATION AND INVESTIMENT
PROPERTY VALUE""")
environmental_cobenefit = Panel("""AIR QUALITY
GHG EMISSIONS
WATER RECOLLECTION AND SECURITY""")
social_cobenefit = Panel("""HEALTH IMPACTS
PUBBLIC SPACE ACCESS
COMMUNITY INCLUSION""")
opaquemat = HBOpaqueMaterial(
    name="CONCRETE_PAVEMENT_LIGHT",
    thickness=panel_2,
    conductivity="1",
    density="2100",
    spec_heat="653",
    therm_absp="0.90",
    sol_absp=subtraction,
    vis_absp=subtraction)  # -> mat; plug-in component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
color = DefineColor(Color=ColourSwatch(SwatchColor=RGB(201, 201, 197)), Source="object")
albedo_3 = Number(albedo_2)
economic_cobenefit_2 = Text(economic_cobenefit)
thermalemissivity = Number(thermal_emissivity)
environmental_cobenefit_2 = Text(environmental_cobenefit)
social_cobenefit_2 = Text(social_cobenefit)
panel_3 = Panel("CONCRETE_PAVEMENT_LIGHT")
opaqueconstr = HBOpaqueConstruction(name=panel_3, materials=opaquemat)  # -> constr; plug-in component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
colour = Colour(color)
albedo_4 = ClusterOutput(albedo_3)
thermalemissivity_2 = ClusterOutput(thermalemissivity)
economic_cobenefit_3 = ClusterOutput(economic_cobenefit_2)
social_cobenefit_3 = ClusterOutput(social_cobenefit_2)
environmental_cobenefit_3 = ClusterOutput(environmental_cobenefit_2)
colour_2 = ClusterOutput(colour)
construction = Data(opaqueconstr)
name = Data(panel_3)
construction_2 = ClusterOutput(construction)
name_2 = ClusterOutput(name)

# ==== cluster GRASS
# ENVIRONMENTAL: AIR QUALITY
# GHG EMISSIONS
# WATER RECOLLECTION AND SECURITY
# WATER QUALITY
# BIODIVERSITY
# LANDSLIDES AND WEATHERING
panel = Panel("GRASS")
# SOCIAL: HEALTH IMPACTS
# PUBBLIC SPACE ACCESS
# AESTHETIC VALUE
# COMMUUNITY INCLUSION
# CULTURAL
panel_2 = Panel("0.3")
# ECONOMIC: EMPLOYMENT AND INCOME GENERATION
# SAVINGS
# INNOVATION AND INVESTIMENT
# PROPERTY VALUE
panel_3 = Panel("1200")
economic_cobenefit = Panel("SAVINGS")
vegetationmat = HBVegetationMaterial(
    name=panel,
    plant_height="0.06",
    leaf_area_ind="0.30",
    leaf_reflect="0.22",
    leaf_emiss="0.95",
    soil_reflect="0.4",
    soil_emiss="0.6",
    stomat_resist="180",
    thickness="1",
    conductivity=panel_2,
    density="1100",
    spec_heat=panel_3)  # -> mat; plug-in component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
environmental_cobenefit = Panel("""AIR QUALITY
GHG EMISSIONS
WATER RECOLLECTION AND SECURITY
WATER QUALITY""")
social_cobenefit = Panel("""HEALTH IMPACTS
PUBBLIC SPACE ACCESS
AESTHETIC VALUE
COMMUUNITY INCLUSION""")
thermal_emissivity = Panel("0.93")
albedo = Panel("0.20")
color = DefineColor(Color=ColourSwatch(SwatchColor=RGB(106, 217, 89)), Source="object")
economic_cobenefit_2 = Text(economic_cobenefit)
environmental_cobenefit_2 = Text(environmental_cobenefit)
social_cobenefit_2 = Text(social_cobenefit)
albedo_2 = Number(albedo)
thermalemissivity = Number(thermal_emissivity)
colour = Colour(color)
opaqueconstr = HBOpaqueConstruction(name="GRASS", materials=vegetationmat)  # -> constr; plug-in component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
economic_cobenefit_3 = ClusterOutput(economic_cobenefit_2)
albedo_3 = ClusterOutput(albedo_2)
social_cobenefit_3 = ClusterOutput(social_cobenefit_2)
environmental_cobenefit_3 = ClusterOutput(environmental_cobenefit_2)
thermalemissivity_2 = ClusterOutput(thermalemissivity)
name = Data("GRASS")
colour_2 = ClusterOutput(colour)
name_2 = ClusterOutput(name)
construction = Data(opaqueconstr)
construction_2 = ClusterOutput(construction)

# ==== cluster HIGH_GRASS
# ENVIRONMENTAL: AIR QUALITY
# GHG EMISSIONS
# WATER RECOLLECTION AND SECURITY
# WATER QUALITY
# BIODIVERSITY
# LANDSLIDES AND WEATHERING
panel = Panel("HIGH_GRASS")
# SOCIAL: HEALTH IMPACTS
# PUBBLIC SPACE ACCESS
# AESTHETIC VALUE
# COMMUUNITY INCLUSION
# CULTURAL
panel_2 = Panel("0.3")
# ECONOMIC: EMPLOYMENT AND INCOME GENERATION
# SAVINGS
# INNOVATION AND INVESTIMENT
# PROPERTY VALUE
panel_3 = Panel("1200")
economic_cobenefit = Panel("SAVINGS")
social_cobenefit = Panel("""HEALTH IMPACTS
PUBBLIC SPACE ACCESS
AESTHETIC VALUE
COMMUUNITY INCLUSION""")
environmental_cobenefit = Panel("""AIR QUALITY
GHG EMISSIONS
WATER RECOLLECTION AND SECURITY
WATER QUALITY
BIODIVERSITY""")
vegetationmat = HBVegetationMaterial(
    name=panel,
    plant_height="1",
    leaf_area_ind="0.20",
    leaf_reflect="0.22",
    leaf_emiss="0.95",
    soil_reflect="0.4",
    soil_emiss="0.6",
    stomat_resist="180",
    thickness="1",
    conductivity=panel_2,
    density="1100",
    spec_heat=panel_3)  # -> mat; plug-in component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
albedo = Panel("0.20")
thermal_emissivity = Panel("0.93")
color = DefineColor(Color=ColourSwatch(SwatchColor=RGB(124, 209, 111)), Source="object")
economic_cobenefit_2 = Text(economic_cobenefit)
environmental_cobenefit_2 = Text(environmental_cobenefit)
social_cobenefit_2 = Text(social_cobenefit)
albedo_2 = Number(albedo)
thermalemissivity = Number(thermal_emissivity)
colour = Colour(color)
opaqueconstr = HBOpaqueConstruction(name="HIGH_GRASS", materials=vegetationmat)  # -> constr; plug-in component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
environmental_cobenefit_3 = ClusterOutput(environmental_cobenefit_2)
albedo_3 = ClusterOutput(albedo_2)
social_cobenefit_3 = ClusterOutput(social_cobenefit_2)
thermalemissivity_2 = ClusterOutput(thermalemissivity)
economic_cobenefit_3 = ClusterOutput(economic_cobenefit_2)
name = Data("HIGH_GRASS")
colour_2 = ClusterOutput(colour)
construction = Data(opaqueconstr)
name_2 = ClusterOutput(name)
construction_2 = ClusterOutput(construction)

# ==== cluster AGRICULTURE
# ENVIRONMENTAL: AIR QUALITY
# GHG EMISSIONS
# WATER RECOLLECTION AND SECURITY
# WATER QUALITY
# BIODIVERSITY
# LANDSLIDES AND WEATHERING
panel = Panel("AGRICULTURE")
# SOCIAL: HEALTH IMPACTS
# PUBBLIC SPACE ACCESS
# AESTHETIC VALUE
# COMMUUNITY INCLUSION
# CULTURAL
panel_2 = Panel("0.3")
# ECONOMIC: EMPLOYMENT AND INCOME GENERATION
# SAVINGS
# INNOVATION AND INVESTIMENT
# PROPERTY VALUE
panel_3 = Panel("1200")
economic_cobenefit = Panel("""EMPLOYMENT AND INCOME GENERATION
SAVINGS
INNOVATION AND INVESTIMENT
PROPERTY VALUE""")
vegetationmat = HBVegetationMaterial(
    name=panel,
    plant_height="0.63",
    leaf_area_ind="1.58",
    leaf_reflect="0.22",
    leaf_emiss="0.95",
    soil_reflect="0.4",
    soil_emiss="0.6",
    stomat_resist="180",
    thickness="1",
    conductivity=panel_2,
    density="1100",
    spec_heat=panel_3)  # -> mat; plug-in component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
thermal_emissivity = Panel("0.90")
albedo = Panel("0.20")
environmental_cobenefit = Panel("""AIR QUALITY
GHG EMISSIONS
WATER RECOLLECTION AND SECURITY
WATER QUALITY
BIODIVERSITY""")
social_cobenefit = Panel("""HEALTH IMPACTS
CULTURAL""")
color = DefineColor(Color=ColourSwatch(SwatchColor=RGB(142, 171, 99)), Source="object")
colour = Colour(color)
economic_cobenefit_2 = Text(economic_cobenefit)
albedo_2 = Number(albedo)
thermalemissivity = Number(thermal_emissivity)
environmental_cobenefit_2 = Text(environmental_cobenefit)
social_cobenefit_2 = Text(social_cobenefit)
opaqueconstr = HBOpaqueConstruction(name="AGRICULTURE", materials=vegetationmat)  # -> constr; plug-in component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
colour_2 = ClusterOutput(colour)
economic_cobenefit_3 = ClusterOutput(economic_cobenefit_2)
albedo_3 = ClusterOutput(albedo_2)
thermalemissivity_2 = ClusterOutput(thermalemissivity)
environmental_cobenefit_3 = ClusterOutput(environmental_cobenefit_2)
social_cobenefit_3 = ClusterOutput(social_cobenefit_2)
name = Data("AGRICULTURE")
construction = Data(opaqueconstr)
name_2 = ClusterOutput(name)
construction_2 = ClusterOutput(construction)

# ==== cluster GRASSY_JOINT_FLOORING
# ENVIRONMENTAL: AIR QUALITY
# GHG EMISSIONS
# WATER RECOLLECTION AND SECURITY
# WATER QUALITY
# BIODIVERSITY
# LANDSLIDES AND WEATHERING
albedo = Panel("0.60")
# SOCIAL: HEALTH IMPACTS
# PUBBLIC SPACE ACCESS
# AESTHETIC VALUE
# COMMUUNITY INCLUSION
# CULTURAL
panel = Panel("0.6")
# ECONOMIC: EMPLOYMENT AND INCOME GENERATION
# SAVINGS
# INNOVATION AND INVESTIMENT
# PROPERTY VALUE
panel_2 = Panel("1200")
subtraction = Subtraction(A="1", B=albedo)
vegetationmat = HBVegetationMaterial(
    plant_height="0.03",
    leaf_area_ind="0.1",
    leaf_reflect="0.22",
    leaf_emiss="0.95",
    soil_reflect="0.4",
    soil_emiss="0.6",
    stomat_resist="180",
    thickness="1",
    conductivity=panel,
    density="1100",
    spec_heat=panel_2)  # -> mat; plug-in component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
opaquemat = HBOpaqueMaterial(
    thickness="1",
    conductivity="1",
    density="2100",
    spec_heat="653",
    therm_absp="0.90",
    sol_absp=subtraction,
    vis_absp=subtraction)  # -> mat; plug-in component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
environmental_cobenefit = Panel("""AIR QUALITY
GHG EMISSIONS
WATER RECOLLECTION AND SECURITY
WATER QUALITY
BIODIVERSITY""")
social_cobenefit = Panel("""HEALTH IMPACTS
PUBBLIC SPACE ACCESS
AESTETIC VALUE""")
economic_cobenefit = Panel("""SAVINGS
PROPERTY VALUE""")
merge = Merge(Data1=vegetationmat, Data2=opaquemat)
thermal_emissivity = Panel("0.90")
albedo_2 = Panel("0.40")
color = DefineColor(Color=ColourSwatch(SwatchColor=RGB(155, 196, 165)), Source="object")
opaqueconstr = HBOpaqueConstruction(name="GRASSY_JOINT_FLOORING", materials=merge)  # -> constr; plug-in component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
economic_cobenefit_2 = Text(economic_cobenefit)
colour = Colour(color)
social_cobenefit_2 = Text(social_cobenefit)
environmental_cobenefit_2 = Text(environmental_cobenefit)
albedo_3 = Number(albedo_2)
thermalemissivity = Number(thermal_emissivity)
economic_cobenefit_3 = ClusterOutput(economic_cobenefit_2)
environmental_cobenefit_3 = ClusterOutput(environmental_cobenefit_2)
social_cobenefit_3 = ClusterOutput(social_cobenefit_2)
albedo_4 = ClusterOutput(albedo_3)
thermalemissivity_2 = ClusterOutput(thermalemissivity)
colour_2 = ClusterOutput(colour)
construction = Data(opaqueconstr)
name = Data("GRASSY_JOINT_FLOORING")
construction_2 = ClusterOutput(construction)
name_2 = ClusterOutput(name)

# ==== cluster ASPHALT_2
# SOCIAL: HEALTH IMPACTS
# PUBBLIC SPACE ACCESS
# AESTHETIC VALUE
# COMMUUNITY INCLUSION
# CULTURAL
panel = Panel("1")
# ECONOMIC: EMPLOYMENT AND INCOME GENERATION
# SAVINGS
# INNOVATION AND INVESTIMENT
# PROPERTY VALUE
albedo = Panel("0.15")
# ENVIRONMENTAL: AIR QUALITY
# GHG EMISSIONS
# WATER RECOLLECTION AND SECURITY
# WATER QUALITY
# BIODIVERSITY
# LANDSLIDES AND WEATHERING
panel_2 = Panel("1.16")
subtraction = Subtraction(A=panel, B=albedo)
economical_cobenefit = Panel("""EMPLOYMENT AND INCOME GENERATION
SAVINGS
INNOVATION AND INVESTIMENT
PROPERTY VALUE""")
social_cobenefit = Panel("PUBBLIC SPACE ACCESS")
environmental_cobenefit = Panel("")
thermalemissivity = Panel("0.90")
albedo_2 = Panel("0.15")
opaquemat = HBOpaqueMaterial(
    name="ASPHALT",
    thickness="1",
    conductivity=panel_2,
    density="2300",
    spec_heat="1700",
    therm_absp="0.90",
    sol_absp=subtraction,
    vis_absp=subtraction)  # -> mat; plug-in component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
color = DefineColor(Color=ColourSwatch(SwatchColor=RGB(0, 0, 0)), Source="object")
economic_cobenefit = Text(economical_cobenefit)
social_cobenefit_2 = Text(social_cobenefit)
albedo_3 = Number(albedo_2)
environmental_cobenefit_2 = Text(environmental_cobenefit)
colour = Colour(color)
thermalemissivity_2 = Number(thermalemissivity)
economic_cobenefit_2 = ClusterOutput(economic_cobenefit)
opaqueconstr = HBOpaqueConstruction(name="ASPHALT", materials=opaquemat)  # -> constr; plug-in component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
albedo_4 = ClusterOutput(albedo_3)
thermalemissivity_3 = ClusterOutput(thermalemissivity_2)
environmental_cobenefit_3 = ClusterOutput(environmental_cobenefit_2)
social_cobenefit_3 = ClusterOutput(social_cobenefit_2)
colour_2 = ClusterOutput(colour)
name = Data("ASPHALT")
construction = Data(opaqueconstr)
name_2 = ClusterOutput(name)
construction_2 = ClusterOutput(construction)

# ==== cluster COOL_ASPHALT_2
# SOCIAL: HEALTH IMPACTS
# PUBBLIC SPACE ACCESS
# AESTHETIC VALUE
# COMMUUNITY INCLUSION
# CULTURAL
panel = Panel("1")
# ECONOMIC: EMPLOYMENT AND INCOME GENERATION
# SAVINGS
# INNOVATION AND INVESTIMENT
# PROPERTY VALUE
albedo = Panel("0.6")
# ENVIRONMENTAL: AIR QUALITY
# GHG EMISSIONS
# WATER RECOLLECTION AND SECURITY
# WATER QUALITY
# BIODIVERSITY
# LANDSLIDES AND WEATHERING
panel_2 = Panel("0.70")
subtraction = Subtraction(A=panel, B=albedo)
opaquemat = HBOpaqueMaterial(
    name="COOL_ASPHALT",
    thickness="1",
    conductivity=panel_2,
    density="1460",
    spec_heat="879",
    therm_absp="0.93",
    sol_absp=subtraction,
    vis_absp=subtraction)  # -> mat; plug-in component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
economical_cobenefit = Panel("""EMPLOYMENT AND INCOME GENERATION
SAVINGS
INNOVATION AND INVESTIMENT
PROPERTY VALUE""")
social_cobenefit = Panel("""HEALTH IMPACTS
PUBBLIC SPACE ACCESS""")
environmental_cobenefit = Panel("""AIR QUALITY
GHG EMISSIONS""")
albedo_2 = Panel("0.60")
thermal_emissivity = Panel("0.93")
color = DefineColor(Color=ColourSwatch(SwatchColor=RGB(176, 162, 162)), Source="object")
opaqueconstr = HBOpaqueConstruction(name="COOL_ASPHALT", materials=opaquemat)  # -> constr; plug-in component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
economic_cobenefit = Text(economical_cobenefit)
social_cobenefit_2 = Text(social_cobenefit)
environmental_cobenefit_2 = Text(environmental_cobenefit)
albedo_3 = Number(albedo_2)
colour = Colour(color)
thermalemissivity = Number(thermal_emissivity)
name = Data("COOL_ASPHALT")
economic_cobenefit_2 = ClusterOutput(economic_cobenefit)
social_cobenefit_3 = ClusterOutput(social_cobenefit_2)
environmental_cobenefit_3 = ClusterOutput(environmental_cobenefit_2)
albedo_4 = ClusterOutput(albedo_3)
thermalemissivity_2 = ClusterOutput(thermalemissivity)
colour_2 = ClusterOutput(colour)
name_2 = ClusterOutput(name)
construction = Data(opaqueconstr)
construction_2 = ClusterOutput(construction)

# ==== cluster TERRE_BATTUE_2
# SOCIAL: HEALTH IMPACTS
# PUBBLIC SPACE ACCESS
# AESTHETIC VALUE
# COMMUUNITY INCLUSION
# CULTURAL
# ECONOMIC: EMPLOYMENT AND INCOME GENERATION
# SAVINGS
# INNOVATION AND INVESTIMENT
# PROPERTY VALUE
albedo = Panel("0.40")
# ENVIRONMENTAL: AIR QUALITY
# GHG EMISSIONS
# WATER RECOLLECTION AND SECURITY
# WATER QUALITY
# BIODIVERSITY
# LANDSLIDES AND WEATHERING
panel = Panel("1")
subtraction = Subtraction(A="1", B=albedo)
social_cobenefit = Panel("""HEALTH IMPACTS
PUBBLIC SPACE ACCESS
COMMUUNITY INCLUSION""")
economic_cobenefit = Panel("""SAVINGS
INNOVATION AND INVESTIMENT""")
environmental_cobenefit = Panel("""AIR QUALITY
GHG EMISSIONS
WATER RECOLLECTION AND SECURITY
WATER QUALITY""")
opaquemat = HBOpaqueMaterial(
    name="TERRE_BATTUE",
    thickness=panel,
    conductivity="0.82",
    density="2180",
    spec_heat="720",
    therm_absp="0.9",
    sol_absp=subtraction,
    vis_absp=subtraction)  # -> mat; plug-in component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
albedo_2 = Panel("0.40")
thermal_emissivity = Panel("0.90")
color = DefineColor(Color=ColourSwatch(SwatchColor=RGB(152, 104, 6)), Source="object")
environmental_cobenefit_2 = Text(environmental_cobenefit)
social_cobenefit_2 = Text(social_cobenefit)
economic_cobenefit_2 = Text(economic_cobenefit)
albedo_3 = Number(albedo_2)
thermalemissivity = Number(thermal_emissivity)
colour = Colour(color)
environmental_cobenefit_3 = ClusterOutput(environmental_cobenefit_2)
social_cobenefit_3 = ClusterOutput(social_cobenefit_2)
economic_cobenefit_3 = ClusterOutput(economic_cobenefit_2)
opaqueconstr = HBOpaqueConstruction(name="TERRE_BATTUE", materials=opaquemat)  # -> constr; plug-in component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
albedo_4 = ClusterOutput(albedo_3)
thermalemissivity_2 = ClusterOutput(thermalemissivity)
colour_2 = ClusterOutput(colour)
name = Data("TERRE_BATTUE")
name_2 = ClusterOutput(name)
construction = Data(opaqueconstr)
construction_2 = ClusterOutput(construction)

# ==== cluster BRICK_ROAD_RED_STONES_2
# SOCIAL: HEALTH IMPACTS
# PUBBLIC SPACE ACCESS
# AESTHETIC VALUE
# COMMUUNITY INCLUSION
# CULTURAL
panel = Panel("1")
# ECONOMIC: EMPLOYMENT AND INCOME GENERATION
# SAVINGS
# INNOVATION AND INVESTIMENT
# PROPERTY VALUE
albedo = Panel("0.30")
# ENVIRONMENTAL: AIR QUALITY
# GHG EMISSIONS
# WATER RECOLLECTION AND SECURITY
# WATER QUALITY
# BIODIVERSITY
# LANDSLIDES AND WEATHERING
panel_2 = Panel("1")
subtraction = Subtraction(A=panel, B=albedo)
thermal_emissivity = Panel("0.95")
albedo_2 = Panel("0.30")
economic_cobenefit = Panel("SAVINGS")
social_cobenefit = Panel("PUBBLIC SPACE ACCESS")
environmental_cobenefit = Panel("""AIR QUALITY
GHG EMISSIONS""")
opaquemat = HBOpaqueMaterial(
    name="BRICK_ROAD_RED_STONES",
    thickness=panel_2,
    conductivity="0.90",
    density="2000",
    spec_heat="840",
    therm_absp="0.95",
    sol_absp=subtraction,
    vis_absp=subtraction)  # -> mat; plug-in component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
color = DefineColor(Color=ColourSwatch(SwatchColor=RGB(128, 32, 0)), Source="object")
albedo_3 = Number(albedo_2)
thermalemissivity = Number(thermal_emissivity)
opaqueconstr = HBOpaqueConstruction(name="BRICK_ROAD_RED_STONES", materials=opaquemat)  # -> constr; plug-in component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
colour = Colour(color)
environmental_cobenefit_2 = Text(environmental_cobenefit)
economic_cobenefit_2 = Text(economic_cobenefit)
social_cobenefit_2 = Text(social_cobenefit)
albedo_4 = ClusterOutput(albedo_3)
thermalemissivity_2 = ClusterOutput(thermalemissivity)
colour_2 = ClusterOutput(colour)
economic_cobenefit_3 = ClusterOutput(economic_cobenefit_2)
environmental_cobenefit_3 = ClusterOutput(environmental_cobenefit_2)
name = Data("BRICK_ROAD_RED_STONES")
social_cobenefit_3 = ClusterOutput(social_cobenefit_2)
name_2 = ClusterOutput(name)
construction = Data(opaqueconstr)
construction_2 = ClusterOutput(construction)

# ==== cluster BRICK_ROAD_YELLOW_STONES_2
# SOCIAL: HEALTH IMPACTS
# PUBBLIC SPACE ACCESS
# AESTHETIC VALUE
# COMMUUNITY INCLUSION
# CULTURAL
panel = Panel("1")
# ECONOMIC: EMPLOYMENT AND INCOME GENERATION
# SAVINGS
# INNOVATION AND INVESTIMENT
# PROPERTY VALUE
albedo = Panel("0.40")
# ENVIRONMENTAL: AIR QUALITY
# GHG EMISSIONS
# WATER RECOLLECTION AND SECURITY
# WATER QUALITY
# BIODIVERSITY
# LANDSLIDES AND WEATHERING
panel_2 = Panel("0.90")
subtraction = Subtraction(A=panel, B=albedo)
opaquemat = HBOpaqueMaterial(
    name="BRICK_ROAD_YELLOW_STONES",
    thickness="1",
    conductivity=panel_2,
    density="2000",
    spec_heat="840",
    therm_absp="0.95",
    sol_absp=subtraction,
    vis_absp=subtraction)  # -> mat; plug-in component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
economic_cobenefit = Panel("SAVINGS")
social_cobenefit = Panel("PUBBLIC SPACE ACCESS")
environmental_cobenefit = Panel("""AIR QUALITY
GHG EMISSIONS""")
panel_3 = Panel("BRICK_ROAD_YELLOW_STONES")
thermal_emissivity = Panel("0.95")
albedo_2 = Panel("0.40")
color = DefineColor(Color=ColourSwatch(SwatchColor=RGB(205, 171, 0)), Source="object")
opaqueconstr = HBOpaqueConstruction(name=panel_3, materials=opaquemat)  # -> constr; plug-in component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
environmental_cobenefit_2 = Text(environmental_cobenefit)
social_cobenefit_2 = Text(social_cobenefit)
economic_cobenefit_2 = Text(economic_cobenefit)
colour = Colour(color)
environmental_cobenefit_3 = ClusterOutput(environmental_cobenefit_2)
albedo_3 = Number(albedo_2)
name = Data(panel_3)
economic_cobenefit_3 = ClusterOutput(economic_cobenefit_2)
thermalemissivity = Number(thermal_emissivity)
social_cobenefit_3 = ClusterOutput(social_cobenefit_2)
name_2 = ClusterOutput(name)
construction = Data(opaqueconstr)
albedo_4 = ClusterOutput(albedo_3)
thermalemissivity_2 = ClusterOutput(thermalemissivity)
colour_2 = ClusterOutput(colour)
construction_2 = ClusterOutput(construction)

# ==== cluster FakeWater
# SOCIAL: HEALTH IMPACTS
# PUBBLIC SPACE ACCESS
# AESTHETIC VALUE
# COMMUUNITY INCLUSION
# CULTURAL
panel = Panel("1")
# ECONOMIC: EMPLOYMENT AND INCOME GENERATION
# SAVINGS
# INNOVATION AND INVESTIMENT
# PROPERTY VALUE
albedo = Panel("0.15")
# ENVIRONMENTAL: AIR QUALITY
# GHG EMISSIONS
# WATER RECOLLECTION AND SECURITY
# WATER QUALITY
# BIODIVERSITY
# LANDSLIDES AND WEATHERING
panel_2 = Panel("2")
subtraction = Subtraction(A=panel, B=albedo)
social_cobenefit = Panel("""HEALTH IMPACTS
AESTHETIC VALUE
COMMUNITY INCLUSION
CULTURAL""")
economic_cobenefit = Panel("""SAVINGS
INNOVATION AND INVESTIMENT
PROPERTY VALUE""")
environmental_cobenefit = Panel("""AIR QUALITY
GHG EMISSIONS
WATER RECOLLECTION AND SECURITY
WATER QUALITY
BIODIVERSITY
LANDSLIDES AND WEATHERING""")
opaquemat = HBOpaqueMaterial(
    name="Fake Water",
    thickness="1",
    conductivity=panel_2,
    density="1460",
    spec_heat="879",
    therm_absp="0.9",
    sol_absp=subtraction,
    vis_absp=subtraction)  # -> mat; plug-in component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
thermal_emissivity = Panel("0.90")
albedo_2 = Panel("0.15")
color = DefineColor(Color=ColourSwatch(SwatchColor=RGB(0, 173, 159)), Source="object")
economic_cobenefit_2 = Text(economic_cobenefit)
social_cobenefit_2 = Text(social_cobenefit)
environmental_cobenefit_2 = Text(environmental_cobenefit)
colour = Colour(color)
albedo_3 = Number(albedo_2)
thermalemissivity = Number(thermal_emissivity)
economic_cobenefit_3 = ClusterOutput(economic_cobenefit_2)
environmental_cobenefit_3 = ClusterOutput(environmental_cobenefit_2)
thermalemissivity_2 = ClusterOutput(thermalemissivity)
albedo_4 = ClusterOutput(albedo_3)
social_cobenefit_3 = ClusterOutput(social_cobenefit_2)
opaqueconstr = HBOpaqueConstruction(name="WaterBody", materials=opaquemat)  # -> constr; plug-in component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
colour_2 = ClusterOutput(colour)
name = Data("WaterBody")
construction = Data(opaqueconstr)
construction_2 = ClusterOutput(construction)
name_2 = ClusterOutput(name)

# ==== cluster Cluster_7
m2_pareti = ClusterInput()
m2_pareti_2 = Data(m2_pareti)
pacchetto_calcestruzzo_parete_ventilata = PACCHETTOCALCESTRUZZOPARETEVENTILATA(m2_wall=m2_pareti_2)  # -> name_2, u_fac_si, constr, environmental_cobenefit_3, social_cobenefit_3, economic_cobenefit_2, albedo_3, thermalemissivity_3, gwp_kg_co2_m2_2, gwp_kgco2e_3
pacchetto_calcestruzzo = PACCHETTOCALCESTRUZZO(m2_wall=m2_pareti_2)  # -> name_2, u_fac_si, constr, environmental_cobenefit_3, social_cobenefit_3, economic_cobenefit_2, albedo_3, thermalemissivity_3, gwp_kg_co2_m2_2, gwp_kgco2e_3
muratura_blocco_termico_altamente_isolat = Muratura_blocco_termico_altamente_isolato(m2_wall=m2_pareti_2)  # -> name_2, u_fac_si, constr, environmental_cobenefit_3, social_cobenefit_3, economic_cobenefit_2, albedo_7, thermalemissivity_3, gwp_kg_co2_m2_2, gwp_kgco2e_7; "Muratura_blocco_termico_altamente_isolato"
# Brick Masonry Not-Insulated = 0
# Brick Masonry Insulated = 1
# Brick Masonry Highly Insulated =2
# Thermal Block Masonry Insulated = 3
# Thermal Block Masonry Highly Insulated = 4
# Concrete Masonry Non-Insulated = 5
# Concrete Masonry Medium Insulated External = 6
#  Concrete Masonry Medium Insulated Internal = 7
#  Concrete Masonry Highly Insulated = 8
# Stone Masonry Non-Insulated = 9
#  Stone Masonry Medium Insulated = 10
#  Stone Masonry Highly Insulated = 11
#  Brick Masonry Non-Insulated = 12
#  Brick Masonry Medium Insulated = 13
#  Brick Masonry Highly Insulated = 14
#  CONCRETE PACKAGE = 15
# VENTILATED WALL = 16
# WET WOOD PACKAGE = 17
# DRY WOOD PACKAGE = 18
# Muratura_laterizio_non_isolato              = 0
# Muratura_laterizio_isolato                  = 1
# Muratura_lateerizio_altamente_isolato       = 2
# Muratura_blocco_termico_isolato             = 3
# Muratura_blocco_termico_altamente_isolato   = 4
# Muratura_calcestruzzo_non_isolato           = 5
# Muratura_calcestruzzo_medio_isolato_esterno = 6
# Muratura_calcestruzzo_medio_isolato_interno = 7
# Muratura_calcestruzzo_altamente_isolato     = 8
# Muratura_pietra_non_isolato                 = 9
# Muratura_pietra_medio_isolato               = 10
# Muratura_pietra_altamente_isolato           = 11
# Muratura_mattoni_non_isolato                = 12
# Muratura_mattoni_medio_isolato              = 13
# Muratura_mattoni_altamente_isolato          = 14
# PACCHETTO CALCESTRUZZO                      = 15
# PACCHETTO CALCESTRUZZO PARETE VENTILATA     = 16
# PACCHETTO LEGNO A UMIDO                     = 17
# PACCHETTO LEGNO A SECCO                     = 18
muratura_laterizio_non_isolato = Muratura_laterizio_non_isolato(m2_wall=m2_pareti_2)  # -> name_2, u_fac_si, constr, environmental_cobenefit_3, social_cobenefit_3, economic_cobenefit_2, albedo_6, thermalemissivity_3, gwp_kgco2e_m2_6, gwp_kgco2e_6
muratura_lateerizio_altamente_isolato = Muratura_lateerizio_altamente_isolato(m2_wall=m2_pareti_2)  # -> name_2, u_fac_si, constr, environmental_cobenefit_3, social_cobenefit_3, economic_cobenefit_2, albedo_7, thermalemissivity_3, gwp_kgco2e_m2_7, gwp_kgco2e_7
muratura_laterizio_isolato = Muratura_laterizio_isolato(m2_wall=m2_pareti_2)  # -> name_2, u_fac_si, constr, environmental_cobenefit_3, social_cobenefit_3, economic_cobenefit_2, albedo_7, thermalemissivity_3, gwp_kgco2e_m2_6, gwp_kgco2e_7
muratura_blocco_termico_isolato = Muratura_blocco_termico_isolato(m2_wall=m2_pareti_2)  # -> name_2, u_fac_si, constr, environmental_cobenefit_3, social_cobenefit_3, economic_cobenefit_2, albedo_7, thermalemissivity_3, gwp_kgco2e_m2_7, gwp_kgco2e_7
muratura_calcestruzzo_medio_isolato_este = Muratura_calcestruzzo_medio_isolato_esterno(m2_wall=m2_pareti_2)  # -> name_2, u_fac_si, constr, environmental_cobenefit_3, social_cobenefit_3, economic_cobenefit_2, albedo_8, thermalemissivity_3, gwp_kg_co2_m2_2, gwp_kgco2e_8; "Muratura_calcestruzzo_medio_isolato_esterno"
muratura_calcestruzzo_medio_isolato_inte = Muratura_calcestruzzo_medio_isolato_interno(m2_wall=m2_pareti_2)  # -> name_2, u_fac_si, constr, environmental_cobenefit_3, social_cobenefit_3, economic_cobenefit_2, albedo_8, thermalemissivity_3, gwp_kg_co2_m2_2, gwp_kgco2e_8; "Muratura_calcestruzzo_medio_isolato_interno"
muratura_calcestruzzo_non_isolato = Muratura_calcestruzzo_non_isolato(m2_wall=m2_pareti_2)  # -> name_2, u_fac_si, constr, environmental_cobenefit_3, social_cobenefit_3, economic_cobenefit_2, albedo_7, thermalemissivity_3, gwp_kg_co2_m2_2, gwp_kgco2e_7
muratura_calcestruzzo_altamente_isolato = Muratura_calcestruzzo_altamente_isolato(m2_wall=m2_pareti_2)  # -> name_2, u_fac_si, constr, environmental_cobenefit_3, social_cobenefit_3, economic_cobenefit_2, albedo_8, thermalemissivity_3, gwp_kg_co2_m2_2, gwp_kgco2e_8
pacchetto_legno_a_umido = PACCHETTOLEGNOAUMIDO(m2_wall=m2_pareti_2)  # -> name_2, u_fac_si, constr, environmental_cobenefit_3, social_cobenefit_3, economic_cobenefit_2, albedo_3, thermalemissivity_3, gwp_kg_co2_m2_2, gwp_kgco2e_3
pacchetto_legno_a_secco = PACCHETTOLEGNOASECCO(m2_wall=m2_pareti_2)  # -> name_2, u_fac_si, constr, environmental_cobenefit_3, social_cobenefit_3, economic_cobenefit_2, albedo_3, thermalemissivity_3, gwp_kg_co2_m2_2, gwp_kgco2e_3
muratura_mattoni_altamente_isolato = Muratura_mattoni_altamente_isolato(m2_wall=m2_pareti_2)  # -> name_2, u_fac_si, constr, environmental_cobenefit_3, social_cobenefit_3, economic_cobenefit_2, albedo_7, thermalemissivity_3, gwp_kg_co2_m2_2, gwp_kgco2e_7
muratura_pietra_non_isolato = Muratura_pietra_non_isolato(m2_wall=m2_pareti_2)  # -> name_2, u_fac_si, constr, environmental_cobenefit_3, social_cobenefit_3, economic_cobenefit_2, albedo_6, thermalemissivity_3, gwp_kg_co2_m2_2, gwp_kgco2e_6
muratura_pietra_altamente_isolato = Muratura_pietra_altamente_isolato(m2_wall=m2_pareti_2)  # -> name_2, u_fac_si, constr, environmental_cobenefit_3, social_cobenefit_3, economic_cobenefit_2, albedo_7, thermalemissivity_3, gwp_kg_co2_m2_2, gwp_kgco2e_7
muratura_mattoni_medio_isolato = Muratura_mattoni_medio_isolato(m2_wall=m2_pareti_2)  # -> name_2, u_fac_si, constr, environmental_cobenefit_3, social_cobenefit_3, economic_cobenefit_2, albedo_7, thermalemissivity_3, gwp_kg_co2_m2_2, gwp_kgco2e_7
muratura_pietra_medio_isolato = Muratura_pietra_medio_isolato(m2_wall=m2_pareti_2)  # -> name_2, u_fac_si, constr, environmental_cobenefit_3, social_cobenefit_3, economic_cobenefit_2, albedo_7, thermalemissivity_3, gwp_kg_co2_m2_2, gwp_kgco2e_7
muratura_mattoni_non_isolato = Muratura_mattoni_non_isolato(m2_wall=m2_pareti_2)  # -> name_2, u_fac_si, constr, environmental_cobenefit_3, social_cobenefit_3, economic_cobenefit_2, albedo_6, thermalemissivity_3, gwp_kg_co2_m2_2, gwp_kgco2e_6
wall = ClusterInput()
wall_2 = Number(wall)

stream_filter = StreamFilter(
    Gate=wall_2,
    Stream0=muratura_laterizio_non_isolato.gwp_kgco2e_6,
    Stream1=muratura_laterizio_isolato.gwp_kgco2e_7,
    Stream2=muratura_lateerizio_altamente_isolato.gwp_kgco2e_7,
    Stream3=muratura_blocco_termico_isolato.gwp_kgco2e_7,
    Stream4=muratura_blocco_termico_altamente_isolat.gwp_kgco2e_7,
    Stream5=muratura_calcestruzzo_non_isolato.gwp_kgco2e_7,
    Stream6=muratura_calcestruzzo_medio_isolato_este.gwp_kgco2e_8,
    Stream7=muratura_calcestruzzo_medio_isolato_inte.gwp_kgco2e_8,
    Stream8=muratura_calcestruzzo_altamente_isolato.gwp_kgco2e_8,
    Stream9=muratura_pietra_non_isolato.gwp_kgco2e_6,
    Stream10=muratura_pietra_medio_isolato.gwp_kgco2e_7,
    Stream11=muratura_pietra_altamente_isolato.gwp_kgco2e_7,
    Stream12=muratura_mattoni_non_isolato.gwp_kgco2e_6,
    Stream13=muratura_mattoni_medio_isolato.gwp_kgco2e_7,
    Stream14=muratura_mattoni_altamente_isolato.gwp_kgco2e_7,
    Stream15=pacchetto_calcestruzzo.gwp_kgco2e_3,
    Stream16=pacchetto_calcestruzzo_parete_ventilata.gwp_kgco2e_3,
    Stream17=pacchetto_legno_a_umido.gwp_kgco2e_3,
    Stream18=pacchetto_legno_a_secco.gwp_kgco2e_3)
wall_gwp_kgco2e = Data(stream_filter)
wall_gwp_kgco2e_2 = ClusterOutput(wall_gwp_kgco2e)

stream_filter_2 = StreamFilter(
    Gate=wall_2,
    Stream0=muratura_laterizio_non_isolato.gwp_kgco2e_m2_6,
    Stream1=muratura_laterizio_isolato.gwp_kgco2e_m2_6,
    Stream2=muratura_lateerizio_altamente_isolato.gwp_kgco2e_m2_7,
    Stream3=muratura_blocco_termico_isolato.gwp_kgco2e_m2_7,
    Stream4=muratura_blocco_termico_altamente_isolat.gwp_kg_co2_m2_2,
    Stream5=muratura_calcestruzzo_non_isolato.gwp_kg_co2_m2_2,
    Stream6=muratura_calcestruzzo_medio_isolato_este.gwp_kg_co2_m2_2,
    Stream7=muratura_calcestruzzo_medio_isolato_inte.gwp_kg_co2_m2_2,
    Stream8=muratura_calcestruzzo_altamente_isolato.gwp_kg_co2_m2_2,
    Stream9=muratura_pietra_non_isolato.gwp_kg_co2_m2_2,
    Stream10=muratura_pietra_medio_isolato.gwp_kg_co2_m2_2,
    Stream11=muratura_pietra_altamente_isolato.gwp_kg_co2_m2_2,
    Stream12=muratura_mattoni_non_isolato.gwp_kg_co2_m2_2,
    Stream13=muratura_mattoni_medio_isolato.gwp_kg_co2_m2_2,
    Stream14=muratura_mattoni_altamente_isolato.gwp_kg_co2_m2_2,
    Stream15=pacchetto_calcestruzzo.gwp_kg_co2_m2_2,
    Stream16=pacchetto_calcestruzzo_parete_ventilata.gwp_kg_co2_m2_2,
    Stream17=pacchetto_legno_a_umido.gwp_kg_co2_m2_2,
    Stream18=pacchetto_legno_a_secco.gwp_kg_co2_m2_2)
stream_filter_3 = StreamFilter(
    Gate=wall_2,
    Stream0=muratura_laterizio_non_isolato.thermalemissivity_3,
    Stream1=muratura_laterizio_isolato.thermalemissivity_3,
    Stream2=muratura_lateerizio_altamente_isolato.thermalemissivity_3,
    Stream3=muratura_blocco_termico_isolato.thermalemissivity_3,
    Stream4=muratura_blocco_termico_altamente_isolat.thermalemissivity_3,
    Stream5=muratura_calcestruzzo_non_isolato.thermalemissivity_3,
    Stream6=muratura_calcestruzzo_medio_isolato_este.thermalemissivity_3,
    Stream7=muratura_calcestruzzo_medio_isolato_inte.thermalemissivity_3,
    Stream8=muratura_calcestruzzo_altamente_isolato.thermalemissivity_3,
    Stream9=muratura_pietra_non_isolato.thermalemissivity_3,
    Stream10=muratura_pietra_medio_isolato.thermalemissivity_3,
    Stream11=muratura_pietra_altamente_isolato.thermalemissivity_3,
    Stream12=muratura_mattoni_non_isolato.thermalemissivity_3,
    Stream13=muratura_mattoni_medio_isolato.thermalemissivity_3,
    Stream14=muratura_mattoni_altamente_isolato.thermalemissivity_3,
    Stream15=pacchetto_calcestruzzo.thermalemissivity_3,
    Stream16=pacchetto_calcestruzzo_parete_ventilata.thermalemissivity_3,
    Stream17=pacchetto_legno_a_umido.thermalemissivity_3,
    Stream18=pacchetto_legno_a_secco.thermalemissivity_3)
stream_filter_4 = StreamFilter(
    Gate=wall_2,
    Stream0=muratura_laterizio_non_isolato.environmental_cobenefit_3,
    Stream1=muratura_laterizio_isolato.environmental_cobenefit_3,
    Stream2=muratura_lateerizio_altamente_isolato.environmental_cobenefit_3,
    Stream3=muratura_blocco_termico_isolato.environmental_cobenefit_3,
    Stream4=muratura_blocco_termico_altamente_isolat.environmental_cobenefit_3,
    Stream5=muratura_calcestruzzo_non_isolato.environmental_cobenefit_3,
    Stream6=muratura_calcestruzzo_medio_isolato_este.environmental_cobenefit_3,
    Stream7=muratura_calcestruzzo_medio_isolato_inte.environmental_cobenefit_3,
    Stream8=muratura_calcestruzzo_altamente_isolato.environmental_cobenefit_3,
    Stream9=muratura_pietra_non_isolato.environmental_cobenefit_3,
    Stream10=muratura_pietra_medio_isolato.environmental_cobenefit_3,
    Stream11=muratura_pietra_altamente_isolato.environmental_cobenefit_3,
    Stream12=muratura_mattoni_non_isolato.environmental_cobenefit_3,
    Stream13=muratura_mattoni_medio_isolato.environmental_cobenefit_3,
    Stream14=muratura_mattoni_altamente_isolato.environmental_cobenefit_3,
    Stream15=pacchetto_calcestruzzo.environmental_cobenefit_3,
    Stream16=pacchetto_calcestruzzo_parete_ventilata.environmental_cobenefit_3,
    Stream17=pacchetto_legno_a_umido.environmental_cobenefit_3,
    Stream18=pacchetto_legno_a_secco.environmental_cobenefit_3)
stream_filter_5 = StreamFilter(
    Gate=wall_2,
    Stream0=muratura_laterizio_non_isolato.name_2,
    Stream1=muratura_laterizio_isolato.name_2,
    Stream2=muratura_lateerizio_altamente_isolato.name_2,
    Stream3=muratura_blocco_termico_isolato.name_2,
    Stream4=muratura_blocco_termico_altamente_isolat.name_2,
    Stream5=muratura_calcestruzzo_non_isolato.name_2,
    Stream6=muratura_calcestruzzo_medio_isolato_este.name_2,
    Stream7=muratura_calcestruzzo_medio_isolato_inte.name_2,
    Stream8=muratura_calcestruzzo_altamente_isolato.name_2,
    Stream9=muratura_pietra_non_isolato.name_2,
    Stream10=muratura_pietra_medio_isolato.name_2,
    Stream11=muratura_pietra_altamente_isolato.name_2,
    Stream12=muratura_mattoni_non_isolato.name_2,
    Stream13=muratura_mattoni_medio_isolato.name_2,
    Stream14=muratura_mattoni_altamente_isolato.name_2,
    Stream15=pacchetto_calcestruzzo.name_2,
    Stream16=pacchetto_calcestruzzo_parete_ventilata.name_2,
    Stream17=pacchetto_legno_a_umido.name_2,
    Stream18=pacchetto_legno_a_secco.name_2)
stream_filter_6 = StreamFilter(
    Gate=wall_2,
    Stream0=muratura_laterizio_non_isolato.constr,
    Stream1=muratura_laterizio_isolato.constr,
    Stream2=muratura_lateerizio_altamente_isolato.constr,
    Stream3=muratura_blocco_termico_isolato.constr,
    Stream4=muratura_blocco_termico_altamente_isolat.constr,
    Stream5=muratura_calcestruzzo_non_isolato.constr,
    Stream6=muratura_calcestruzzo_medio_isolato_este.constr,
    Stream7=muratura_calcestruzzo_medio_isolato_inte.constr,
    Stream8=muratura_calcestruzzo_altamente_isolato.constr,
    Stream9=muratura_pietra_non_isolato.constr,
    Stream10=muratura_pietra_medio_isolato.constr,
    Stream11=muratura_pietra_altamente_isolato.constr,
    Stream12=muratura_mattoni_non_isolato.constr,
    Stream13=muratura_mattoni_medio_isolato.constr,
    Stream14=muratura_mattoni_altamente_isolato.constr,
    Stream15=pacchetto_calcestruzzo.constr,
    Stream16=pacchetto_calcestruzzo_parete_ventilata.constr,
    Stream17=pacchetto_legno_a_umido.constr,
    Stream18=pacchetto_legno_a_secco.constr)
stream_filter_7 = StreamFilter(
    Gate=wall_2,
    Stream0=muratura_laterizio_non_isolato.albedo_6,
    Stream1=muratura_laterizio_isolato.albedo_7,
    Stream2=muratura_lateerizio_altamente_isolato.albedo_7,
    Stream3=muratura_blocco_termico_isolato.albedo_7,
    Stream4=muratura_blocco_termico_altamente_isolat.albedo_7,
    Stream5=muratura_calcestruzzo_non_isolato.albedo_7,
    Stream6=muratura_calcestruzzo_medio_isolato_este.albedo_8,
    Stream7=muratura_calcestruzzo_medio_isolato_inte.albedo_8,
    Stream8=muratura_calcestruzzo_altamente_isolato.albedo_8,
    Stream9=muratura_pietra_non_isolato.albedo_6,
    Stream10=muratura_pietra_medio_isolato.albedo_7,
    Stream11=muratura_pietra_altamente_isolato.albedo_7,
    Stream12=muratura_mattoni_non_isolato.albedo_6,
    Stream13=muratura_mattoni_medio_isolato.albedo_7,
    Stream14=muratura_mattoni_altamente_isolato.albedo_7,
    Stream15=pacchetto_calcestruzzo.albedo_3,
    Stream16=pacchetto_calcestruzzo_parete_ventilata.albedo_3,
    Stream17=pacchetto_legno_a_umido.albedo_3,
    Stream18=pacchetto_legno_a_secco.albedo_3)
stream_filter_8 = StreamFilter(
    Gate=wall_2,
    Stream0=muratura_laterizio_non_isolato.social_cobenefit_3,
    Stream1=muratura_laterizio_isolato.social_cobenefit_3,
    Stream2=muratura_lateerizio_altamente_isolato.social_cobenefit_3,
    Stream3=muratura_blocco_termico_isolato.social_cobenefit_3,
    Stream4=muratura_blocco_termico_altamente_isolat.social_cobenefit_3,
    Stream5=muratura_calcestruzzo_non_isolato.social_cobenefit_3,
    Stream6=muratura_calcestruzzo_medio_isolato_este.social_cobenefit_3,
    Stream7=muratura_calcestruzzo_medio_isolato_inte.social_cobenefit_3,
    Stream8=muratura_calcestruzzo_altamente_isolato.social_cobenefit_3,
    Stream9=muratura_pietra_non_isolato.social_cobenefit_3,
    Stream10=muratura_pietra_medio_isolato.social_cobenefit_3,
    Stream11=muratura_pietra_altamente_isolato.social_cobenefit_3,
    Stream12=muratura_mattoni_non_isolato.social_cobenefit_3,
    Stream13=muratura_mattoni_medio_isolato.social_cobenefit_3,
    Stream14=muratura_mattoni_altamente_isolato.social_cobenefit_3,
    Stream15=pacchetto_calcestruzzo.social_cobenefit_3,
    Stream16=pacchetto_calcestruzzo_parete_ventilata.social_cobenefit_3,
    Stream17=pacchetto_legno_a_umido.social_cobenefit_3,
    Stream18=pacchetto_legno_a_secco.social_cobenefit_3)
stream_filter_9 = StreamFilter(
    Gate=wall_2,
    Stream0=muratura_laterizio_non_isolato.economic_cobenefit_2,
    Stream1=muratura_laterizio_isolato.economic_cobenefit_2,
    Stream2=muratura_lateerizio_altamente_isolato.economic_cobenefit_2,
    Stream3=muratura_blocco_termico_isolato.economic_cobenefit_2,
    Stream4=muratura_blocco_termico_altamente_isolat.economic_cobenefit_2,
    Stream5=muratura_calcestruzzo_non_isolato.economic_cobenefit_2,
    Stream6=muratura_calcestruzzo_medio_isolato_este.economic_cobenefit_2,
    Stream7=muratura_calcestruzzo_medio_isolato_inte.economic_cobenefit_2,
    Stream8=muratura_calcestruzzo_altamente_isolato.economic_cobenefit_2,
    Stream9=muratura_pietra_non_isolato.economic_cobenefit_2,
    Stream10=muratura_pietra_medio_isolato.economic_cobenefit_2,
    Stream11=muratura_pietra_altamente_isolato.economic_cobenefit_2,
    Stream12=muratura_mattoni_non_isolato.economic_cobenefit_2,
    Stream13=muratura_mattoni_medio_isolato.economic_cobenefit_2,
    Stream14=muratura_mattoni_altamente_isolato.economic_cobenefit_2,
    Stream15=pacchetto_calcestruzzo.economic_cobenefit_2,
    Stream16=pacchetto_calcestruzzo_parete_ventilata.economic_cobenefit_2,
    Stream17=pacchetto_legno_a_umido.economic_cobenefit_2,
    Stream18=pacchetto_legno_a_secco.economic_cobenefit_2)
stream_filter_10 = StreamFilter(
    Gate=wall_2,
    Stream0=muratura_laterizio_non_isolato.u_fac_si,
    Stream1=muratura_laterizio_isolato.u_fac_si,
    Stream2=muratura_lateerizio_altamente_isolato.u_fac_si,
    Stream3=muratura_blocco_termico_isolato.u_fac_si,
    Stream4=muratura_blocco_termico_altamente_isolat.u_fac_si,
    Stream5=muratura_calcestruzzo_non_isolato.u_fac_si,
    Stream6=muratura_calcestruzzo_medio_isolato_este.u_fac_si,
    Stream7=muratura_calcestruzzo_medio_isolato_inte.u_fac_si,
    Stream8=muratura_calcestruzzo_altamente_isolato.u_fac_si,
    Stream9=muratura_pietra_non_isolato.u_fac_si,
    Stream10=muratura_pietra_medio_isolato.u_fac_si,
    Stream11=muratura_pietra_altamente_isolato.u_fac_si,
    Stream12=muratura_mattoni_non_isolato.u_fac_si,
    Stream13=muratura_mattoni_medio_isolato.u_fac_si,
    Stream14=muratura_mattoni_altamente_isolato.u_fac_si,
    Stream15=pacchetto_calcestruzzo.u_fac_si,
    Stream16=pacchetto_calcestruzzo_parete_ventilata.u_fac_si,
    Stream17=pacchetto_legno_a_umido.u_fac_si,
    Stream18=pacchetto_legno_a_secco.u_fac_si)
wall_thermal_emissivity = Data(stream_filter_3)
economic_cobenefit = Data(stream_filter_9)
selected_const = Data(stream_filter_6)
wall_albedo = Data(stream_filter_7)
wall_u_fac = Data(stream_filter_10)
wall_gwp_kg_co2_m2 = Data(stream_filter_2)
wall_stratigrafia = Data(stream_filter_5)
enviromental_cobenefit = Data(stream_filter_4)
social_cobenefit = Data(stream_filter_8)
economic_cobenefit_2 = ClusterOutput(economic_cobenefit)
wall_thermal_emissivity_2 = ClusterOutput(wall_thermal_emissivity)
wall_stratigrafia_2 = ClusterOutput(wall_stratigrafia)
wall_u_fac_2 = ClusterOutput(wall_u_fac)
wall_albedo_2 = ClusterOutput(wall_albedo)
wall_gwp_kg_co2_m2_2 = ClusterOutput(wall_gwp_kg_co2_m2)
selected_const_2 = ClusterOutput(selected_const)
social_cobenefit_2 = ClusterOutput(social_cobenefit)
enviromental_cobenefit_2 = ClusterOutput(enviromental_cobenefit)

# ==== cluster Cluster_8
# Timber floor not insulated = 0
# Poorly insulated timber floor = 1
# Highly insulated timber floor = 2
# Lateral concrete floor not insulated = 3
# Poorly insulated lateral concrete floor = 4
#  Highly insulated lateral concrete floor = 5
# Medium insulated lightweight concrete floor = 6
#  Insulated lightweight concrete floor = 7
#  Highly insulated lightweight concrete floor = 8
#  Concrete roof = 9
#  Steel roof = 10
#  Wooden roof = 11
#  Extensive green roof = 12
roof = ClusterInput()
m2_solaio = ClusterInput()
roof_2 = Number(roof)
m2_solaio_2 = Data(m2_solaio)
copertura_legno = Copertura_legno(m2_solaio=m2_solaio_2)  # -> name_2, u_fac_si, constr, environmental_cobenefit_3, social_cobenefit_3, economic_cobenefit_2, albedo_3, thermalemissivity_3, gwp_kgco2e_m2_8, gwp_kgco2e_8
copertura_calcestruzzo = Copertura_calcestruzzo(m2_solaio=m2_solaio_2)  # -> name_2, u_fac_si, constr, environmental_cobenefit_3, social_cobenefit_3, economic_cobenefit_2, albedo_3, thermalemissivity_3, gwp_kgco2e_m2_8, gwp_kgco2e_8
# Solaio_legno_non_isolato                 = 0
# Solaio_legno_scarso_isolato              = 1
# Solaio_legno_altamente_isolato           = 2
# Solaio_laterocemento_non_isolato         = 3
# Solaio_laterocemento_scarso_isolato      = 4
# Solaio_laterocemento_altamente_isolato   = 5
# Solaio_allegerito_eps_medio_isolato      = 6
# Solaio_allegerito_eps_isolato            = 7
# Solaio_allegerito_eps_altamente_isolato  = 8
# Copertura_calcestruzzo                   =  9
# Copertura_legno                          = 10
# Copertura_Verde_estensivo                = 11
solaio_legno_non_isolato = Solaio_legno_non_isolato(m2_solaio=m2_solaio_2)  # -> name_2, u_fac_si, constr, environmental_cobenefit_3, social_cobenefit_3, economic_cobenefit_2, albedo_3, thermalemissivity_3, gwp_kgco2e_m2_5, gwp_kgco2e_4
solaio_laterocemento_scarso_isolato = Solaio_laterocemento_scarso_isolato(m2_solaio=m2_solaio_2)  # -> name_2, u_fac_si, constr, environmental_cobenefit_3, social_cobenefit_3, economic_cobenefit_2, albedo_3, thermalemissivity_3, gwp_kgco2e_m2_8, gwp_kgco2e_8
solaio_laterocemento_altamente_isolato = Solaio_laterocemento_altamente_isolato(m2_solaio=m2_solaio_2)  # -> name_2, u_fac_si, constr, environmental_cobenefit_3, social_cobenefit_3, economic_cobenefit_2, albedo_3, thermalemissivity_3, gwp_kgco2e_m2_8, gwp_kgco2e_8
solaio_legno_altamente_isolato = Solaio_legno_altamente_isolato(m2_solaio=m2_solaio_2)  # -> name_2, u_fac_si, constr, environmental_cobenefit_3, social_cobenefit_3, economic_cobenefit_2, albedo_3, thermalemissivity_3, gwp_kgco2e_m2_7, gwp_kgco2e_7
solaio_laterocemento_non_isolato = Solaio_laterocemento_non_isolato(m2_solaio=m2_solaio_2)  # -> name_2, u_fac_si, constr, environmental_cobenefit_3, social_cobenefit_3, economic_cobenefit_2, albedo_3, thermalemissivity_3, gwp_kgco2e_m2_7, gwp_kgco2e_7
solaio_legno_scarso_isolato = Solaio_legno_scarso_isolato(m2_solaio=m2_solaio_2)  # -> name_2, u_fac_si, constr, environmental_cobenefit_3, social_cobenefit_3, economic_cobenefit_2, albedo_3, thermalemissivity_3, gwp_kgco2e_m2_7, gwp_kgco2e_7
copertura_verde_estensivo = Copertura_Verde_estensivo(m2_solaio=m2_solaio_2)  # -> name_2, u_fac_si, constr, environmental_cobenefit_3, social_cobenefit_3, economic_cobenefit_2, albedo_3, thermalemissivity_3, gwp_kgco2e_m2_7, gwp_kgco2e_7
solaio_allegerito_eps_isolato = Solaio_allegerito_eps_isolato(m2_solaio=m2_solaio_2)  # -> name_2, u_fac_si, constr, environmental_cobenefit_3, social_cobenefit_3, economic_cobenefit_2, albedo_3, thermalemissivity_3, gwp_kgco2e_m2_8, gwp_kgco2e_8
solaio_allegerito_eps_medio_isolato = Solaio_allegerito_eps_medio_isolato(m2_solaio=m2_solaio_2)  # -> name_2, u_fac_si, constr, environmental_cobenefit_3, social_cobenefit_3, economic_cobenefit_2, albedo_3, thermalemissivity_3, gwp_kgco2e_m2_8, gwp_kgco2e_8
solaio_allegerito_eps_altamente_isolato = Solaio_allegerito_eps_altamente_isolato(m2_solaio=m2_solaio_2)  # -> name_2, u_fac_si, constr, environmental_cobenefit_3, social_cobenefit_3, economic_cobenefit_2, albedo_3, thermalemissivity_3, gwp_kgco2e_m2_9, gwp_kgco2e_7

stream_filter = StreamFilter(
    Gate=roof_2,
    Stream0=solaio_legno_non_isolato.gwp_kgco2e_4,
    Stream1=solaio_legno_scarso_isolato.gwp_kgco2e_7,
    Stream2=solaio_legno_altamente_isolato.gwp_kgco2e_7,
    Stream3=solaio_laterocemento_non_isolato.gwp_kgco2e_7,
    Stream4=solaio_laterocemento_scarso_isolato.gwp_kgco2e_8,
    Stream5=solaio_laterocemento_altamente_isolato.gwp_kgco2e_8,
    Stream6=solaio_allegerito_eps_medio_isolato.gwp_kgco2e_8,
    Stream7=solaio_allegerito_eps_isolato.gwp_kgco2e_8,
    Stream8=solaio_allegerito_eps_altamente_isolato.gwp_kgco2e_7,
    Stream9=copertura_calcestruzzo.gwp_kgco2e_8,
    Stream10=copertura_legno.gwp_kgco2e_8,
    Stream11=copertura_verde_estensivo.gwp_kgco2e_7)
roof_gwp_kgco2 = Data(stream_filter)
roof_gwp_kgco2_2 = ClusterOutput(roof_gwp_kgco2)

stream_filter_2 = StreamFilter(
    Gate=roof_2,
    Stream0=solaio_legno_non_isolato.constr,
    Stream1=solaio_legno_scarso_isolato.constr,
    Stream2=solaio_legno_altamente_isolato.constr,
    Stream3=solaio_laterocemento_non_isolato.constr,
    Stream4=solaio_laterocemento_scarso_isolato.constr,
    Stream5=solaio_laterocemento_altamente_isolato.constr,
    Stream6=solaio_allegerito_eps_medio_isolato.constr,
    Stream7=solaio_allegerito_eps_isolato.constr,
    Stream8=solaio_allegerito_eps_altamente_isolato.constr,
    Stream9=copertura_calcestruzzo.constr,
    Stream10=copertura_legno.constr,
    Stream11=copertura_verde_estensivo.constr)
stream_filter_3 = StreamFilter(
    Gate=roof_2,
    Stream0=solaio_legno_non_isolato.environmental_cobenefit_3,
    Stream1=solaio_legno_scarso_isolato.environmental_cobenefit_3,
    Stream2=solaio_legno_altamente_isolato.environmental_cobenefit_3,
    Stream3=solaio_laterocemento_non_isolato.environmental_cobenefit_3,
    Stream4=solaio_laterocemento_scarso_isolato.environmental_cobenefit_3,
    Stream5=solaio_laterocemento_altamente_isolato.environmental_cobenefit_3,
    Stream6=solaio_allegerito_eps_medio_isolato.environmental_cobenefit_3,
    Stream7=solaio_allegerito_eps_isolato.environmental_cobenefit_3,
    Stream8=solaio_allegerito_eps_altamente_isolato.environmental_cobenefit_3,
    Stream9=copertura_calcestruzzo.environmental_cobenefit_3,
    Stream10=copertura_legno.environmental_cobenefit_3,
    Stream11=copertura_verde_estensivo.environmental_cobenefit_3)
stream_filter_4 = StreamFilter(
    Gate=roof_2,
    Stream0=solaio_legno_non_isolato.u_fac_si,
    Stream1=solaio_legno_scarso_isolato.u_fac_si,
    Stream2=solaio_legno_altamente_isolato.u_fac_si,
    Stream3=solaio_laterocemento_non_isolato.u_fac_si,
    Stream4=solaio_laterocemento_scarso_isolato.u_fac_si,
    Stream5=solaio_laterocemento_altamente_isolato.u_fac_si,
    Stream6=solaio_allegerito_eps_medio_isolato.u_fac_si,
    Stream7=solaio_allegerito_eps_isolato.u_fac_si,
    Stream8=solaio_allegerito_eps_altamente_isolato.u_fac_si,
    Stream9=copertura_calcestruzzo.u_fac_si,
    Stream10=copertura_legno.u_fac_si,
    Stream11=copertura_verde_estensivo.u_fac_si)
stream_filter_5 = StreamFilter(
    Gate=roof_2,
    Stream0=solaio_legno_non_isolato.gwp_kgco2e_m2_5,
    Stream1=solaio_legno_scarso_isolato.gwp_kgco2e_m2_7,
    Stream2=solaio_legno_altamente_isolato.gwp_kgco2e_m2_7,
    Stream3=solaio_laterocemento_non_isolato.gwp_kgco2e_m2_7,
    Stream4=solaio_laterocemento_scarso_isolato.gwp_kgco2e_m2_8,
    Stream5=solaio_laterocemento_altamente_isolato.gwp_kgco2e_m2_8,
    Stream6=solaio_allegerito_eps_medio_isolato.gwp_kgco2e_m2_8,
    Stream7=solaio_allegerito_eps_isolato.gwp_kgco2e_m2_8,
    Stream8=solaio_allegerito_eps_altamente_isolato.gwp_kgco2e_m2_9,
    Stream9=copertura_calcestruzzo.gwp_kgco2e_m2_8,
    Stream10=copertura_legno.gwp_kgco2e_m2_8,
    Stream11=copertura_verde_estensivo.gwp_kgco2e_m2_7)
stream_filter_6 = StreamFilter(
    Gate=roof_2,
    Stream0=solaio_legno_non_isolato.economic_cobenefit_2,
    Stream1=solaio_legno_scarso_isolato.economic_cobenefit_2,
    Stream2=solaio_legno_altamente_isolato.economic_cobenefit_2,
    Stream3=solaio_laterocemento_non_isolato.economic_cobenefit_2,
    Stream4=solaio_laterocemento_scarso_isolato.economic_cobenefit_2,
    Stream5=solaio_laterocemento_altamente_isolato.economic_cobenefit_2,
    Stream6=solaio_allegerito_eps_medio_isolato.economic_cobenefit_2,
    Stream7=solaio_allegerito_eps_isolato.economic_cobenefit_2,
    Stream8=solaio_allegerito_eps_altamente_isolato.economic_cobenefit_2,
    Stream9=copertura_calcestruzzo.economic_cobenefit_2,
    Stream10=copertura_legno.economic_cobenefit_2,
    Stream11=copertura_verde_estensivo.economic_cobenefit_2)
stream_filter_7 = StreamFilter(
    Gate=roof_2,
    Stream0=solaio_legno_non_isolato.albedo_3,
    Stream1=solaio_legno_scarso_isolato.albedo_3,
    Stream2=solaio_legno_altamente_isolato.albedo_3,
    Stream3=solaio_laterocemento_non_isolato.albedo_3,
    Stream4=solaio_laterocemento_scarso_isolato.albedo_3,
    Stream5=solaio_laterocemento_altamente_isolato.albedo_3,
    Stream6=solaio_allegerito_eps_medio_isolato.albedo_3,
    Stream7=solaio_allegerito_eps_isolato.albedo_3,
    Stream8=solaio_allegerito_eps_altamente_isolato.albedo_3,
    Stream9=copertura_calcestruzzo.albedo_3,
    Stream10=copertura_legno.albedo_3,
    Stream11=copertura_verde_estensivo.albedo_3)
stream_filter_8 = StreamFilter(
    Gate=roof_2,
    Stream0=solaio_legno_non_isolato.thermalemissivity_3,
    Stream1=solaio_legno_scarso_isolato.thermalemissivity_3,
    Stream2=solaio_legno_altamente_isolato.thermalemissivity_3,
    Stream3=solaio_laterocemento_non_isolato.thermalemissivity_3,
    Stream4=solaio_laterocemento_scarso_isolato.thermalemissivity_3,
    Stream5=solaio_laterocemento_altamente_isolato.thermalemissivity_3,
    Stream6=solaio_allegerito_eps_medio_isolato.thermalemissivity_3,
    Stream7=solaio_allegerito_eps_isolato.thermalemissivity_3,
    Stream8=solaio_allegerito_eps_altamente_isolato.thermalemissivity_3,
    Stream9=copertura_calcestruzzo.thermalemissivity_3,
    Stream10=copertura_legno.thermalemissivity_3,
    Stream11=copertura_verde_estensivo.thermalemissivity_3)
stream_filter_9 = StreamFilter(
    Gate=roof_2,
    Stream0=solaio_legno_non_isolato.name_2,
    Stream1=solaio_legno_scarso_isolato.name_2,
    Stream2=solaio_legno_altamente_isolato.name_2,
    Stream3=solaio_laterocemento_non_isolato.name_2,
    Stream4=solaio_laterocemento_scarso_isolato.name_2,
    Stream5=solaio_laterocemento_altamente_isolato.name_2,
    Stream6=solaio_allegerito_eps_medio_isolato.name_2,
    Stream7=solaio_allegerito_eps_isolato.name_2,
    Stream8=solaio_allegerito_eps_altamente_isolato.name_2,
    Stream9=copertura_calcestruzzo.name_2,
    Stream10=copertura_legno.name_2,
    Stream11=copertura_verde_estensivo.name_2)
stream_filter_10 = StreamFilter(
    Gate=roof_2,
    Stream0=solaio_legno_non_isolato.social_cobenefit_3,
    Stream1=solaio_legno_scarso_isolato.social_cobenefit_3,
    Stream2=solaio_legno_altamente_isolato.social_cobenefit_3,
    Stream3=solaio_laterocemento_non_isolato.social_cobenefit_3,
    Stream4=solaio_laterocemento_scarso_isolato.social_cobenefit_3,
    Stream5=solaio_laterocemento_altamente_isolato.social_cobenefit_3,
    Stream6=solaio_allegerito_eps_medio_isolato.social_cobenefit_3,
    Stream7=solaio_allegerito_eps_isolato.social_cobenefit_3,
    Stream8=solaio_allegerito_eps_altamente_isolato.social_cobenefit_3,
    Stream9=copertura_calcestruzzo.social_cobenefit_3,
    Stream10=copertura_legno.social_cobenefit_3,
    Stream11=copertura_verde_estensivo.social_cobenefit_3)
social_cobenefit = Data(stream_filter_10)
roof_thermalemissivity = Data(stream_filter_8)
roof_gwp_kg_co2_m2 = Data(stream_filter_5)
environmental_cobenefit = Data(stream_filter_3)
roof_albedo = Data(stream_filter_7)
roof_stratigrafia = Data(stream_filter_9)
economic_cobenefit = Data(stream_filter_6)
roof_u_fac = Data(stream_filter_4)
selected_constr = Data(stream_filter_2)
roof_gwp_kg_co2_m2_2 = ClusterOutput(roof_gwp_kg_co2_m2)
social_cobenefit_2 = ClusterOutput(social_cobenefit)
economic_cobenefit_2 = ClusterOutput(economic_cobenefit)
environmental_cobenefit_2 = ClusterOutput(environmental_cobenefit)
roof_thermalemissivity_2 = ClusterOutput(roof_thermalemissivity)
roof_u_fac_2 = ClusterOutput(roof_u_fac)
roof_albedo_2 = ClusterOutput(roof_albedo)
roof_stratigrafia_2 = ClusterOutput(roof_stratigrafia)
selected_constr_2 = ClusterOutput(selected_constr)

# ==== cluster Cluster_9
# Solaio_calcestruzzo_igloo_non_isolato - Igloo concrete floor not insulated = 0
# Solaio_calcestruzzo_igloo_scarso_isolato - Poorly insulated igloo concrete floor = 1
# Solaio_calcestruzzo_igloo_isolato - Insulated igloo concrete floor = 2
m2_solaio = ClusterInput()
m2_solaio_2 = Data(m2_solaio)
solaio_calcestruzzo_igloo_non_isolato = Solaio_calcestruzzo_igloo_non_isolato(m2_solaio=m2_solaio_2)  # -> name_2, u_fac_si, constr, environmental_cobenefit_3, social_cobenefit_3, economic_cobenefit_2, albedo_3, thermalemissivity_3, gwp_kg_co2_m2_2, gwp_kgco2_3
solaio_calcestruzzo_igloo_scarso_isolato = Solaio_calcestruzzo_igloo_scarso_isolato(m2_solaio=m2_solaio_2)  # -> name_2, u_fac_si, constr, environmental_cobenefit_3, social_cobenefit_3, economic_cobenefit_2, albedo_3, thermalemissivity_3, gwp_kg_co2_m2_2, gwp_kgco2_2
solaio_calcestruzzo_igloo_isolato = Solaio_calcestruzzo_igloo_isolato(m2_solaio=m2_solaio_2)  # -> name_2, u_fac_si, constr, environmental_cobenefit_3, social_cobenefit_3, economic_cobenefit_2, albedo_3, thermalemissivity_3, gwp_kgco2e_m2_8, gwp_kgco2e_8
gfloor = ClusterInput()
gfloor_2 = Number(gfloor)
stream_filter = StreamFilter(
    Gate=gfloor_2,
    Stream0=solaio_calcestruzzo_igloo_non_isolato.social_cobenefit_3,
    Stream1=solaio_calcestruzzo_igloo_scarso_isolato.social_cobenefit_3,
    Stream2=solaio_calcestruzzo_igloo_isolato.social_cobenefit_3)
stream_filter_2 = StreamFilter(
    Gate=gfloor_2,
    Stream0=solaio_calcestruzzo_igloo_non_isolato.environmental_cobenefit_3,
    Stream1=solaio_calcestruzzo_igloo_scarso_isolato.environmental_cobenefit_3,
    Stream2=solaio_calcestruzzo_igloo_isolato.environmental_cobenefit_3)
stream_filter_3 = StreamFilter(
    Gate=gfloor_2,
    Stream0=solaio_calcestruzzo_igloo_non_isolato.constr,
    Stream1=solaio_calcestruzzo_igloo_scarso_isolato.constr,
    Stream2=solaio_calcestruzzo_igloo_isolato.constr)
stream_filter_4 = StreamFilter(
    Gate=gfloor_2,
    Stream0=solaio_calcestruzzo_igloo_non_isolato.name_2,
    Stream1=solaio_calcestruzzo_igloo_scarso_isolato.name_2,
    Stream2=solaio_calcestruzzo_igloo_isolato.name_2)
stream_filter_5 = StreamFilter(
    Gate=gfloor_2,
    Stream0=solaio_calcestruzzo_igloo_non_isolato.economic_cobenefit_2,
    Stream1=solaio_calcestruzzo_igloo_scarso_isolato.economic_cobenefit_2,
    Stream2=solaio_calcestruzzo_igloo_isolato.economic_cobenefit_2)
stream_filter_6 = StreamFilter(
    Gate=gfloor_2,
    Stream0=solaio_calcestruzzo_igloo_non_isolato.u_fac_si,
    Stream1=solaio_calcestruzzo_igloo_scarso_isolato.u_fac_si,
    Stream2=solaio_calcestruzzo_igloo_isolato.u_fac_si)
stream_filter_7 = StreamFilter(
    Gate=gfloor_2,
    Stream0=solaio_calcestruzzo_igloo_non_isolato.thermalemissivity_3,
    Stream1=solaio_calcestruzzo_igloo_scarso_isolato.thermalemissivity_3,
    Stream2=solaio_calcestruzzo_igloo_isolato.thermalemissivity_3)
stream_filter_8 = StreamFilter(
    Gate=gfloor_2,
    Stream0=solaio_calcestruzzo_igloo_non_isolato.albedo_3,
    Stream1=solaio_calcestruzzo_igloo_scarso_isolato.albedo_3,
    Stream2=solaio_calcestruzzo_igloo_isolato.albedo_3)
stream_filter_9 = StreamFilter(
    Gate=gfloor_2,
    Stream0=solaio_calcestruzzo_igloo_non_isolato.gwp_kg_co2_m2_2,
    Stream1=solaio_calcestruzzo_igloo_scarso_isolato.gwp_kg_co2_m2_2,
    Stream2=solaio_calcestruzzo_igloo_isolato.gwp_kgco2e_m2_8)
stream_filter_10 = StreamFilter(
    Gate=gfloor_2,
    Stream0=solaio_calcestruzzo_igloo_non_isolato.gwp_kgco2_3,
    Stream1=solaio_calcestruzzo_igloo_scarso_isolato.gwp_kgco2_2,
    Stream2=solaio_calcestruzzo_igloo_isolato.gwp_kgco2e_8)
social_cobenefit = Data(stream_filter)
floor_thermalemissivity = Data(stream_filter_7)
environmental_cobenefit = Data(stream_filter_2)
floor_stratigrafia = Data(stream_filter_4)
economic_cobenefit = Data(stream_filter_5)
gfloor_gwp_kgco2e = Data(stream_filter_10)
floor_albedo = Data(stream_filter_8)
floor_gwp_kgco2e_m2 = Data(stream_filter_9)
selected_constr = Data(stream_filter_3)
gf_u_fac = Data(stream_filter_6)
social_cobenefit_2 = ClusterOutput(social_cobenefit)
floor_thermalemissivity_2 = ClusterOutput(floor_thermalemissivity)
environmental_cobenefit_2 = ClusterOutput(environmental_cobenefit)
floor_stratigrafia_2 = ClusterOutput(floor_stratigrafia)
economic_cobenefit_2 = ClusterOutput(economic_cobenefit)
floor_albedo_2 = ClusterOutput(floor_albedo)
floor_gwp_kgco2e_m2_2 = ClusterOutput(floor_gwp_kgco2e_m2)
gf_u_fac_2 = ClusterOutput(gf_u_fac)
selected_constr_2 = ClusterOutput(selected_constr)
gfloor_gwp_kgco2e_2 = ClusterOutput(gfloor_gwp_kgco2e)

# ==== cluster CustomProgramNonResidential
period_of_low_occupation = Panel("""Dec 24 to Jan 5
Aug 1 to Aug 31""")
national_holidays = Panel("""Jan 1
Jan 6
Apr 25
May 1
Jun 2
Aug 15
Nov 1
Dec 8
Dec 25
Dec 26""")

change_value = Slider(0, range=0..100)
gene_pool = GenePool(
    Decimals=2,
    Maximum=1,
    Minimum=0,
    Value=[0, 0, 0, 0, 0, 0, 0, 0, 0.6, 0.8, 0.8, 0.8, 0.8, 0.2, 0.65, 0.65, 0.65, 0.6, 0.2, 0, 0, 0, 0, 0])
occupancyschedule = OccupancySchedule(mon_fri=gene_pool, change_value=change_value, national_holiday=national_holidays, change_period=period_of_low_occupation)
m2_per_persona_ufficio = Slider(5, range=5..12)
division = Division(A="1", B=m2_per_persona_ufficio)
panel = Panel(division)

change_value_2 = Slider(0, range=0..100)
gene_pool_2 = GenePool(
    Decimals=2,
    Maximum=1,
    Minimum=0.3,
    Value=[0.3, 0.3, 0.3, 0.3, 0.3, 0.3, 0.3, 0.3, 0.7, 0.85, 0.85, 0.85, 0.85, 0.65, 0.75, 0.75, 0.75, 0.75, 0.45, 0.3, 0.3, 0.3, 0.3, 0.3])
ecquipmentschedule = EcquipmentSchedule(
    mon_fri=gene_pool_2,
    change_value=change_value_2,
    national_holiday=national_holidays,
    change_period=period_of_low_occupation)
equipment = HBEquipment(name="ecquipaggiamneto elettrico", watts_per_area=Slider(7, range=0..10), schedule=ecquipmentschedule)  # -> equip; plug-in component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

gene_pool_3 = GenePool(
    Decimals=2,
    Maximum=1,
    Minimum=0,
    Value=[0, 0, 0, 0, 0, 0, 0, 0, 0.35, 0.25, 0.25, 0.25, 0.25, 0.5, 0.5, 0.25, 0.25, 0.35, 0.15, 0, 0, 0, 0, 0])
hotwaterschedule = HotWaterSchedule(mon_fri=gene_pool_3, national_holiday=national_holidays)
servicehotwater = HBServiceHotWater(name="acqua calda", flow_per_area="0.05", schedule=hotwaterschedule)  # -> hot_water; plug-in component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

period_of_low_occupation_2 = Panel("Aug 1 to Aug 31")

change_value__summer = Slider(0, range=0..100)
gene_pool_4 = GenePool(
    Decimals=2,
    Maximum=1,
    Minimum=0.05,
    Value=[0.05, 0.05, 0.05, 0.05, 0.05, 0.05, 0.05, 0.05, 0.65, 0.85, 0.85, 0.85, 0.85, 0.7625, 0.85, 0.85, 0.85, 0.85, 0.525, 0.05, 0.05, 0.05, 0.05, 0.05])
lightingschedule = LightingSchedule(
    mon_fri=gene_pool_4,
    change_value__summer=change_value__summer,
    national_holiday=national_holidays,
    change_period=period_of_low_occupation_2)
lighting = HBLighting(name="luce", watts_per_area=Slider(5, range=0..10), schedule=lightingschedule)  # -> lighting; plug-in component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

period_of_low_occupation_3 = Panel("Dec 24 to Jan 5")
period_of_low_occupation_4 = Panel("Aug 1 to Aug 31")

gene_pool_5 = GenePool(
    Decimals=0,
    Maximum=22,
    Minimum=17,
    Value=[17, 17, 17, 17, 17, 17, 17, 17, 19, 21, 21, 21, 21, 21, 17, 21, 21, 21, 21, 20, 19, 17, 17, 17])
gene_pool_6 = GenePool(
    Decimals=0,
    Maximum=28,
    Minimum=24,
    Value=[28, 28, 28, 28, 28, 28, 28, 28, 28, 27.33333333, 26, 26, 26, 26, 26, 26, 26, 26, 26, 27.33333333, 28, 28, 28, 28])
coolingschedule = CoolingSchedule(data=gene_pool_6, data_3=national_holidays, data_2=period_of_low_occupation_4)
heatingschedule = HeatingSchedule(data=gene_pool_5, data_2=national_holidays, data_3=period_of_low_occupation_3)
setpoint = HBSetpoint(name="setpoint", heating_sch=heatingschedule, cooling_sch=coolingschedule)  # -> setpoint; plug-in component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

people = HBPeople(name="occupazione persone", ppl_per_area=division, occupancy_sch=occupancyschedule)  # -> people; plug-in component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
hb_building_programs = HBBuildingPrograms({"LargeOffice", "MediumOffice", "SmallOffice", "MidriseApartment", "HighriseApartment", "Retail", "StripMall", "PrimarySchool", "SecondarySchool", "SmallHotel", "LargeHotel", "Hospital", "Outpatient", "Laboratory", "Warehouse", "SuperMarket", "FullServiceRestaurant", "QuickServiceRestaurant", "Courthouse", "LargeDataCenterHighITE", "LargeDataCenterLowITE", "SmallDataCenterHighITE", "SmallDataCenterLowITE"}, selected="MediumOffice")
programtype = HBProgramType(
    name="program_NonResidential",
    base_program=hb_building_programs,
    people=people,
    lighting=lighting,
    electric_equip=equipment,
    hot_water=servicehotwater,
    setpoint=setpoint)  # -> program; plug-in component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
program = ClusterOutput(programtype)

# ==== cluster CustomProgramResidential

# ----
# riferimenti: peole_0,1_D.M. Sanità 5 luglio 1975 Art. 2 "Per ogni abitante deve essere assicurata una superficie abitabile non inferiore a mq 14, per i primi 4 abitanti, ed a mq 10, per ciascuno dei successivi"
# https://www.sorgenia.it/guida-energia/lumen-cosa-sono_ 4 W/m2
# 
# acqua calda_0,125_"si stima che in media il consumo di acqua calda giornaliero a persona oscilla tra i 20 e i 40 litri"_https://www.acea.it/guide/risparmiare-consumi-acqua-calda
consumo_medio_acqua_calda_l_g_per_person = Slider(30, range=0..100)  # "consumo medio acqua calda l/g per persona"
ore = Slider(24, range=0..100)
division = Division(A=Slider(1, range=0..1), B=Slider(10, range=0..10))
division_2 = Division(A=consumo_medio_acqua_calda_l_g_per_person, B=ore)
# RIFERIENTI
occupazione_p_m2 = Panel(division)
multiplication = Multiplication(A=division_2, B=division)
acqua_calda_l_m_m2 = Panel(multiplication)

# ----
# Una casa in condizioni “medie”, oggi, consuma circa 150-200 kWh/mq
# 
# https://www.immobilgreen.it/news/efficienza-energetica/quanto-consuma-la-tua-casa/
# ripartizione dei consumi
# 
# https://luce-gas.it/guida/consumo/elettrodomestici
number_slider = Slider(1000, range=0..1000)
kwh_m2_annui = Slider(150, range=0..1000)
multiplication_2 = Multiplication(A=kwh_m2_annui, B=number_slider)
wh_m2_annui = Panel(multiplication_2)
# SETPOINT: https://www.daikin.ch/it_ch/products/product.html/EKRTR.html_ inverno giorno 21 C notte 17 C, estate giorno 24 C e notte 28 C
number_slider_2 = Slider(6, range=0..10)
division_3 = Division(A=multiplication_2, B=Slider(360, range=0..1000))
division_4 = Division(A=division_3, B=Slider(24, range=0..100))
division_5 = Division(A=division_4, B=Slider(100, range=0..100))
w_m2_tot = Panel(division_4)
multiplication_3 = Multiplication(A=division_5, B=number_slider_2)
subtraction = Subtraction(A=division_4, B=multiplication_3)
luce = Panel(multiplication_3)
ecuipaggiamento_elettrico = Panel(subtraction)

gene_pool = GenePool(
    Decimals=0,
    Maximum=22,
    Minimum=17,
    Value=[17, 17, 17, 17, 17, 17, 17, 17, 20, 21, 21, 21, 21, 21, 21, 21, 21, 21, 21, 20, 20, 17, 17, 17])
gene_pool_2 = GenePool(
    Decimals=0,
    Maximum=28,
    Minimum=24,
    Value=[28, 28, 28, 28, 28, 28, 28, 28, 28, 27.33333333, 26, 26, 26, 26, 26, 26, 26, 26, 26, 27.33333333, 28, 28, 28, 28])
coolingschedule = CoolingSchedule_2(data=gene_pool_2)
heatingschedule = HeatingSchedule_2(data=gene_pool)
setpoint = HBSetpoint(name="setpoint", heating_sch=heatingschedule, cooling_sch=coolingschedule)  # -> setpoint; plug-in component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

gene_pool_3 = GenePool(
    Decimals=1,
    Maximum=1,
    Minimum=0,
    Value=[1, 1, 1, 1, 1, 1, 1, 0.7, 0.2, 0.2, 0.2, 0.2, 0.2, 0.3, 0.5, 0.5, 0.5, 0.5, 0.7, 0.7, 0.7, 1, 1, 1])
occupancyschedule = OccupancySchedule_2(mon_fri=gene_pool_3)

gene_pool_4 = GenePool(
    Decimals=1,
    Maximum=1,
    Minimum=0,
    Value=[0.2, 0, 0, 0, 0, 0, 0.8, 0.8, 0.8, 0.2, 0.2, 0.25, 0.25, 0.5, 0.5, 0.4, 0.4, 0.4, 0.8, 0.8, 0.8, 0.8, 0.8, 0.4])
hotwaterschedule = LightingSchedule_2(mon_fri=gene_pool_4)

gene_pool_5 = GenePool(
    Decimals=1,
    Maximum=1,
    Minimum=0.2,
    Value=[0.3, 0.2, 0.2, 0.2, 0.2, 0.2, 0.5, 0.5, 0.4, 0.4, 0.4, 0.4, 0.4, 0.4, 0.5, 0.6, 0.6, 0.7, 0.7, 0.7, 0.7, 0.7, 0.7, 0.5])
ecquipmentschedule = LightingSchedule_2(mon_fri=gene_pool_5)

gene_pool_6 = GenePool(
    Decimals=2,
    Maximum=1,
    Minimum=0.05,
    Value=[0.05, 0.05, 0.05, 0.05, 0.05, 0.05, 0.8, 0.8, 0.05, 0.05, 0.05, 0.05, 0.05, 0.05, 0.05, 0.05, 0.5, 0.5, 0.7, 0.8, 0.8, 0.8, 0.7, 0.5])
lightingschedule = LightingSchedule_2(mon_fri=gene_pool_6)

# ----
# PROGRAMMA_DESTINAZIONE_D’USO_RESIDENZIALE
occupazione_p_m2_2 = Panel(division)
acqua_calda_l_m_m2_2 = Panel(multiplication)
luce_2 = Panel(multiplication_3)
ecuipaggiamento_elettrico_2 = Panel(subtraction)
hb_building_programs = HBBuildingPrograms({"LargeOffice", "MediumOffice", "SmallOffice", "MidriseApartment", "HighriseApartment", "Retail", "StripMall", "PrimarySchool", "SecondarySchool", "SmallHotel", "LargeHotel", "Hospital", "Outpatient", "Laboratory", "Warehouse", "SuperMarket", "FullServiceRestaurant", "QuickServiceRestaurant", "Courthouse", "LargeDataCenterHighITE", "LargeDataCenterLowITE", "SmallDataCenterHighITE", "SmallDataCenterLowITE"}, selected="MidriseApartment")

servicehotwater = HBServiceHotWater(name="acqua calda", flow_per_area=acqua_calda_l_m_m2_2, schedule=hotwaterschedule)  # -> hot_water; plug-in component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

lighting = HBLighting(name="luce", watts_per_area=luce_2, schedule=lightingschedule)  # -> lighting; plug-in component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

equipment = HBEquipment(name="ecquipaggiamneto elettrico", watts_per_area=ecuipaggiamento_elettrico_2, schedule=ecquipmentschedule)  # -> equip; plug-in component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

people = HBPeople(name="occupazione persone", ppl_per_area=occupazione_p_m2_2, occupancy_sch=occupancyschedule)  # -> people; plug-in component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

programtype = HBProgramType(
    name="program_residential",
    base_program=hb_building_programs,
    people=people,
    lighting=lighting,
    electric_equip=equipment,
    hot_water=servicehotwater,
    setpoint=setpoint)  # -> program; plug-in component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

program = ClusterOutput(programtype)

# ==== cluster CustomProgram_school
national_holidays = Panel("""Jan 1
Jan 6
Apr 1
Apr 2
Apr 25
May 1
Jun 2
Aug 15
Nov 1
Dec 8
Dec 25
Dec 26""")
period_of_low_occupation = Panel("""Dec 24 to Jan 5
Jul 1 to 31 Jul
Aug 1 to Aug 31""")

gene_pool = GenePool(
    Decimals=0,
    Maximum=22,
    Minimum=17,
    Value=[17, 17, 17, 17, 17, 17, 17, 19, 20, 21, 21, 21, 21, 21, 21, 21, 21, 21, 21, 20, 19, 17, 17, 17])
gene_pool_2 = GenePool(
    Decimals=0,
    Maximum=28,
    Minimum=24,
    Value=[28, 28, 28, 28, 28, 28, 28, 28, 28, 27.33333333, 26, 26, 26, 26, 26, 26, 26, 26, 26, 27.33333333, 28, 28, 28, 28])
period_of_low_occupation_2 = Panel("""Jun 1 to Jun 31
Aug 1 to Aug 31""")
period_of_low_occupation_3 = Panel("Dec 24 to Jan 5")
cooling_sch = Heating_sch(mon_sat=gene_pool_2, change_period=period_of_low_occupation_2, national_holiday=national_holidays)
heating_sch = Heating_sch(mon_sat=gene_pool, change_period=period_of_low_occupation_3, national_holiday=national_holidays)
setpoint = HBSetpoint(name="setpoint", heating_sch=heating_sch, cooling_sch=cooling_sch)  # -> setpoint; plug-in component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

change_value = Slider(0, range=0..100)
gene_pool_3 = GenePool(
    Decimals=2,
    Maximum=1,
    Minimum=0,
    Value=[0, 0, 0, 0, 0, 0, 0, 0, 0.35, 0.25, 0.25, 0.25, 0.25, 0.5, 0.5, 0.25, 0.25, 0.35, 0.16, 0, 0, 0, 0, 0])
hotwater_sch = Occupancy_sch(
    mon_sat=gene_pool_3,
    change_value=change_value,
    change_period=period_of_low_occupation,
    national_holiday=national_holidays)
servicehotwater = HBServiceHotWater(name="acqua calda", flow_per_area="0.05", schedule=hotwater_sch)  # -> hot_water; plug-in component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

change_value_2 = Slider(0, range=0..100)
gene_pool_4 = GenePool(
    Decimals=2,
    Maximum=1,
    Minimum=0,
    Value=[0, 0, 0, 0, 0, 0, 0, 0, 0.8, 0.8, 0.8, 0.8, 0.8, 0.8, 0.8, 0.4, 0.4, 0.4, 0.4, 0, 0, 0, 0, 0])
m2_per_persona_ufficio = Slider(1.88, range=0..12)
occupancy_sch = Occupancy_sch(
    mon_sat=gene_pool_4,
    change_value=change_value_2,
    change_period=period_of_low_occupation,
    national_holiday=national_holidays)
division = Division(A="1", B=m2_per_persona_ufficio)
panel = Panel(division)
people = HBPeople(name="occupazione persone", ppl_per_area=division, occupancy_sch=occupancy_sch)  # -> people; plug-in component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

change_value__summer = Slider(0, range=0..100)
gene_pool_5 = GenePool(
    Decimals=2,
    Maximum=1,
    Minimum=0.05,
    Value=[0.17, 0.17, 0.17, 0.17, 0.17, 0.17, 0.17, 0.17, 0.7, 0.7, 0.7, 0.7, 0.7, 0.7, 0.7, 0.7, 0.7, 0.7, 0.525, 0.17, 0.17, 0.17, 0.17, 0.17])
lighting_sch = Occupancy_sch(
    mon_sat=gene_pool_5,
    change_value=change_value__summer,
    change_period=period_of_low_occupation,
    national_holiday=national_holidays)
lighting = HBLighting(name="illuminazione", watts_per_area=Slider(11, range=0..12), schedule=lighting_sch)  # -> lighting; plug-in component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

change_value_3 = Slider(0, range=0..100)
gene_pool_6 = GenePool(
    Decimals=2,
    Maximum=1,
    Minimum=0.28,
    Value=[0.28, 0.28, 0.28, 0.28, 0.28, 0.28, 0.28, 0.28, 0.85, 0.8457142857, 0.8457142857, 0.8457142857, 0.8457142857, 0.85, 0.85, 0.85, 0.85, 0.4, 0.4, 0.28, 0.28, 0.28, 0.28, 0.28])
equiment_sch = Occupancy_sch(
    mon_sat=gene_pool_6,
    change_value=change_value_3,
    change_period=period_of_low_occupation,
    national_holiday=national_holidays)
equipment = HBEquipment(name="equipaggiamento elettrico", watts_per_area=Slider(14, range=0..15), schedule=equiment_sch)  # -> equip; plug-in component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

programtype = HBProgramType(
    name="program_NonResidential-school",
    people=people,
    lighting=lighting,
    electric_equip=equipment,
    hot_water=servicehotwater,
    setpoint=setpoint)  # -> program; plug-in component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
program = ClusterOutput(programtype)

# ==== cluster Muratura_pietra_non_isolato
m2_wall = ClusterInput()
m2_wall_2 = Data(m2_wall)

# ---- group: GWP (intonaco)
spessore_m = Panel("0.02")
densità_kg_m3 = Panel("1500")
multiplication = Multiplication(A=spessore_m, B=m2_wall_2)
volume_m3 = Panel(multiplication)
multiplication_2 = Multiplication(A=volume_m3, B=densità_kg_m3)
ecc_kgco2e_kg = Panel("0.13")
massa_kg = Panel(multiplication_2)
multiplication_3 = Multiplication(A=massa_kg, B=ecc_kgco2e_kg)
gwp_kgco2e = Panel(multiplication_3)
division = Division(A=gwp_kgco2e, B=m2_wall_2)
gwp_kgco2e_m2 = Panel(division)

# ---- group: GWP (stone)
spessore_m_2 = Panel("0.50")
densità_kg_m3_2 = Panel("2500")
multiplication_4 = Multiplication(A=spessore_m_2, B=m2_wall_2)
volume_m3_2 = Panel(multiplication_4)
multiplication_5 = Multiplication(A=volume_m3_2, B=densità_kg_m3_2)
ecc_kgco2e_kg_2 = Panel("0.079")
massa_kg_2 = Panel(multiplication_5)
multiplication_6 = Multiplication(A=massa_kg_2, B=ecc_kgco2e_kg_2)
gwp_kgco2e_2 = Panel(multiplication_6)
division_2 = Division(A=gwp_kgco2e_2, B=m2_wall_2)
gwp_kgco2e_m2_2 = Panel(division_2)

# ---- group: GWP (intonaco)
spessore_m_3 = Panel("0.02")
densità_kg_m3_3 = Panel("1500")
multiplication_7 = Multiplication(A=spessore_m_3, B=m2_wall_2)
volume_m3_3 = Panel(multiplication_7)
multiplication_8 = Multiplication(A=volume_m3_3, B=densità_kg_m3_3)
ecc_kgco2e_kg_3 = Panel("0.13")
massa_kg_3 = Panel(multiplication_8)
multiplication_9 = Multiplication(A=massa_kg_3, B=ecc_kgco2e_kg_3)
gwp_kgco2e_3 = Panel(multiplication_9)
division_3 = Division(A=gwp_kgco2e_3, B=m2_wall_2)
gwp_kgco2e_m2_3 = Panel(division_3)

# ----
albedo = Panel("0.650")
albedo_2 = Panel("0.300")
albedo_3 = Panel("0.650")
subtraction = Subtraction(A="1", B=albedo_2)
subtraction_2 = Subtraction(A="1", B=albedo_3)
subtraction_3 = Subtraction(A="1", B=albedo)
opaquemat = HBOpaqueMaterial(
    name="Pietra",
    thickness="0.5",
    conductivity="2.4",
    density="2500",
    spec_heat="1000",
    therm_absp="0.92",
    sol_absp=subtraction,
    vis_absp=subtraction)  # -> mat; plug-in component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
opaquemat_2 = HBOpaqueMaterial(
    name="Intonaco_interno",
    thickness="0.02",
    conductivity="0.7",
    density="1500",
    spec_heat="1000",
    therm_absp="0.9",
    sol_absp=subtraction_2,
    vis_absp=subtraction_2)  # -> mat; plug-in component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
opaquemat_3 = HBOpaqueMaterial(
    name="Intonaco_esterno",
    thickness="0.02",
    conductivity="0.7",
    density="1500",
    spec_heat="1000",
    therm_absp="0.9",
    sol_absp=subtraction_3,
    vis_absp=subtraction_3)  # -> mat; plug-in component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
panel = Panel("Stone Masonry Not-Insulated")
merge = Merge(Data1=opaquemat_3, Data2=opaquemat, Data3=opaquemat_2)
economical_cobenefit = Panel("EMPLOYMENT AND INCOME GENERATION")
environmental_cobenefit = Panel("AIR QUALITY")
social_cobenefit = Panel("HEALTH IMPACTS")
thermalemissivity = Panel("0.90")
albedo_4 = Panel("0.65")
opaqueconstr = HBOpaqueConstruction(name=panel, materials=merge)  # -> constr; plug-in component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
name = Data(panel)
economic_cobenefit = Text(economical_cobenefit)
social_cobenefit_2 = Text(social_cobenefit)
albedo_5 = Number(albedo_4)
name_2 = ClusterOutput(name)
environmental_cobenefit_2 = Text(environmental_cobenefit)
thermalemissivity_2 = Number(thermalemissivity)
decnstrconstr = HBDeconstructConstruction(constr=opaqueconstr)  # -> materials, layers, r_val_si, r_val_ip, u_fac_si, u_fac_ip, shgc, t_sol, t_vis; plug-in component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
economic_cobenefit_2 = ClusterOutput(economic_cobenefit)
albedo_6 = ClusterOutput(albedo_5)
thermalemissivity_3 = ClusterOutput(thermalemissivity_2)
environmental_cobenefit_3 = ClusterOutput(environmental_cobenefit_2)
social_cobenefit_3 = ClusterOutput(social_cobenefit_2)
constr = ClusterOutput(opaqueconstr)
u_fac_si = ClusterOutput(decnstrconstr.u_fac_si)
panel_2 = Panel(decnstrconstr.u_fac_si)
addition = Addition(A=gwp_kgco2e_m2_3, B=gwp_kgco2e_m2_2, C=gwp_kgco2e_m2)
addition_2 = Addition(A=gwp_kgco2e_3, B=gwp_kgco2e_2, C=gwp_kgco2e)
gwp = Panel(addition)
gwp_kgco2e_4 = Panel(addition_2)
gwp_kg_co2_m2 = Number(gwp)
gwp_kgco2e_5 = Number(gwp_kgco2e_4)
gwp_kg_co2_m2_2 = ClusterOutput(gwp_kg_co2_m2)
gwp_kgco2e_6 = ClusterOutput(gwp_kgco2e_5)

# ==== cluster Muratura_pietra_medio_isolato
m2_wall = ClusterInput()
m2_wall_2 = Data(m2_wall)

# ---- group: GWP (stone)
spessore_m = Panel("0.50")
densità_kg_m3 = Panel("2500")
multiplication = Multiplication(A=spessore_m, B=m2_wall_2)
volume_m3 = Panel(multiplication)
multiplication_2 = Multiplication(A=volume_m3, B=densità_kg_m3)
ecc_kgco2e_kg = Panel("0.079")
massa_kg = Panel(multiplication_2)
multiplication_3 = Multiplication(A=massa_kg, B=ecc_kgco2e_kg)
gwp_kgco2e = Panel(multiplication_3)
division = Division(A=gwp_kgco2e, B=m2_wall_2)
gwp_kgco2e_m2 = Panel(division)

# ---- group: GWP (intonaco)
spessore_m_2 = Panel("0.02")
densità_kg_m3_2 = Panel("1500")
multiplication_4 = Multiplication(A=spessore_m_2, B=m2_wall_2)
volume_m3_2 = Panel(multiplication_4)
multiplication_5 = Multiplication(A=volume_m3_2, B=densità_kg_m3_2)
ecc_kgco2e_kg_2 = Panel("0.13")
massa_kg_2 = Panel(multiplication_5)
multiplication_6 = Multiplication(A=massa_kg_2, B=ecc_kgco2e_kg_2)
gwp_kgco2e_2 = Panel(multiplication_6)
division_2 = Division(A=gwp_kgco2e_2, B=m2_wall_2)
gwp_kgco2e_m2_2 = Panel(division_2)

# ---- group: GWP (isolante)
spessore_m_3 = Panel("0.05")
densità_kg_m3_3 = Panel("100")
multiplication_7 = Multiplication(A=spessore_m_3, B=m2_wall_2)
volume_m3_3 = Panel(multiplication_7)
multiplication_8 = Multiplication(A=volume_m3_3, B=densità_kg_m3_3)
ecc_kgco2e_kg_3 = Panel("1.12")
massa_kg_3 = Panel(multiplication_8)
multiplication_9 = Multiplication(A=massa_kg_3, B=ecc_kgco2e_kg_3)
gwp_kgco2e_3 = Panel(multiplication_9)
division_3 = Division(A=gwp_kgco2e_3, B=m2_wall_2)
gwp_kgco2e_m2_3 = Panel(division_3)

# ---- group: GWP (intonaco)
spessore_m_4 = Panel("0.02")
densità_kg_m3_4 = Panel("1500")
multiplication_10 = Multiplication(A=spessore_m_4, B=m2_wall_2)
volume_m3_4 = Panel(multiplication_10)
multiplication_11 = Multiplication(A=volume_m3_4, B=densità_kg_m3_4)
ecc_kgco2e_kg_4 = Panel("0.13")
massa_kg_4 = Panel(multiplication_11)
multiplication_12 = Multiplication(A=massa_kg_4, B=ecc_kgco2e_kg_4)
gwp_kgco2e_4 = Panel(multiplication_12)
division_4 = Division(A=gwp_kgco2e_4, B=m2_wall_2)
gwp_kgco2e_m2_4 = Panel(division_4)

# ----
albedo = Panel("0.700")
albedo_2 = Panel("0.300")
albedo_3 = Panel("0.650")
albedo_4 = Panel("0.650")
subtraction = Subtraction(A="1", B=albedo)
subtraction_2 = Subtraction(A="1", B=albedo_2)
subtraction_3 = Subtraction(A="1", B=albedo_3)
subtraction_4 = Subtraction(A="1", B=albedo_4)
opaquemat = HBOpaqueMaterial(
    name="Intonaco_esterno",
    thickness="0.02",
    conductivity="0.7",
    density="1500",
    spec_heat="1000",
    therm_absp="0.9",
    sol_absp=subtraction_3,
    vis_absp=subtraction_3)  # -> mat; plug-in component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
opaquemat_2 = HBOpaqueMaterial(
    name="Isolante",
    thickness="0.05",
    conductivity="0.045",
    density="100",
    spec_heat="840",
    therm_absp="0.1",
    sol_absp=subtraction,
    vis_absp=subtraction)  # -> mat; plug-in component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
opaquemat_3 = HBOpaqueMaterial(
    name="Pietra",
    thickness="0.5",
    conductivity="2.4",
    density="2500",
    spec_heat="1000",
    therm_absp="0.92",
    sol_absp=subtraction_2,
    vis_absp=subtraction_2)  # -> mat; plug-in component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
opaquemat_4 = HBOpaqueMaterial(
    name="Intonaco_interno",
    thickness="0.02",
    conductivity="0.7",
    density="1500",
    spec_heat="1000",
    therm_absp="0.9",
    sol_absp=subtraction_4,
    vis_absp=subtraction_4)  # -> mat; plug-in component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
panel = Panel("Stone Masonry Medium Insulated")
economical_cobenefit = Panel("EMPLOYMENT AND INCOME GENERATION")
social_cobenefit = Panel("HEALTH IMPACTS")
environmental_cobenefit = Panel("AIR QUALITY")
merge = Merge(Data1=opaquemat, Data2=opaquemat_2, Data3=opaquemat_3, Data4=opaquemat_4)
thermalemissivity = Panel("0.90")
albedo_5 = Panel("0.65")
name = Data(panel)
name_2 = ClusterOutput(name)
opaqueconstr = HBOpaqueConstruction(name=panel, materials=merge)  # -> constr; plug-in component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
economic_cobenefit = Text(economical_cobenefit)
social_cobenefit_2 = Text(social_cobenefit)
albedo_6 = Number(albedo_5)
environmental_cobenefit_2 = Text(environmental_cobenefit)
thermalemissivity_2 = Number(thermalemissivity)
decnstrconstr = HBDeconstructConstruction(constr=opaqueconstr)  # -> materials, layers, r_val_si, r_val_ip, u_fac_si, u_fac_ip, shgc, t_sol, t_vis; plug-in component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
economic_cobenefit_2 = ClusterOutput(economic_cobenefit)
albedo_7 = ClusterOutput(albedo_6)
thermalemissivity_3 = ClusterOutput(thermalemissivity_2)
constr = ClusterOutput(opaqueconstr)
environmental_cobenefit_3 = ClusterOutput(environmental_cobenefit_2)
social_cobenefit_3 = ClusterOutput(social_cobenefit_2)
u_fac_si = ClusterOutput(decnstrconstr.u_fac_si)
addition = Addition(A=gwp_kgco2e_4, B=gwp_kgco2e_3, C=gwp_kgco2e, D=gwp_kgco2e_2)
addition_2 = Addition(A=gwp_kgco2e_m2_4, B=gwp_kgco2e_m2_3, C=gwp_kgco2e_m2, D=gwp_kgco2e_m2_2)
gwp = Panel(addition_2)
gwp_kgco2e_5 = Panel(addition)
gwp_kg_co2_m2 = Number(gwp)
gwp_kgco2e_6 = Number(gwp_kgco2e_5)
gwp_kgco2e_7 = ClusterOutput(gwp_kgco2e_6)
gwp_kg_co2_m2_2 = ClusterOutput(gwp_kg_co2_m2)

# ==== cluster Muratura_pietra_altamente_isolato
m2_wall = ClusterInput()
m2_wall_2 = Data(m2_wall)

# ---- group: GWP (stone)
spessore_m = Panel("0.50")
densità_kg_m3 = Panel("2500")
multiplication = Multiplication(A=spessore_m, B=m2_wall_2)
volume_m3 = Panel(multiplication)
multiplication_2 = Multiplication(A=volume_m3, B=densità_kg_m3)
ecc_kgco2e_kg = Panel("0.079")
massa_kg = Panel(multiplication_2)
multiplication_3 = Multiplication(A=massa_kg, B=ecc_kgco2e_kg)
gwp_kgco2e = Panel(multiplication_3)
division = Division(A=gwp_kgco2e, B=m2_wall_2)
gwp_kgco2e_m2 = Panel(division)

# ---- group: GWP (intonaco)
spessore_m_2 = Panel("0.02")
densità_kg_m3_2 = Panel("1500")
multiplication_4 = Multiplication(A=spessore_m_2, B=m2_wall_2)
volume_m3_2 = Panel(multiplication_4)
multiplication_5 = Multiplication(A=volume_m3_2, B=densità_kg_m3_2)
ecc_kgco2e_kg_2 = Panel("0.13")
massa_kg_2 = Panel(multiplication_5)
multiplication_6 = Multiplication(A=massa_kg_2, B=ecc_kgco2e_kg_2)
gwp_kgco2e_2 = Panel(multiplication_6)
division_2 = Division(A=gwp_kgco2e_2, B=m2_wall_2)
gwp_kgco2e_m2_2 = Panel(division_2)

# ---- group: GWP (isolante)
spessore_m_3 = Panel("0.05")
densità_kg_m3_3 = Panel("30")
multiplication_7 = Multiplication(A=spessore_m_3, B=m2_wall_2)
volume_m3_3 = Panel(multiplication_7)
multiplication_8 = Multiplication(A=volume_m3_3, B=densità_kg_m3_3)
ecc_kgco2e_kg_3 = Panel("4.78")
massa_kg_3 = Panel(multiplication_8)
multiplication_9 = Multiplication(A=massa_kg_3, B=ecc_kgco2e_kg_3)
gwp_kgco2e_3 = Panel(multiplication_9)
division_3 = Division(A=gwp_kgco2e_3, B=m2_wall_2)
gwp_kgco2e_m2_3 = Panel(division_3)

# ---- group: GWP (intonaco)
spessore_m_4 = Panel("0.02")
densità_kg_m3_4 = Panel("1500")
multiplication_10 = Multiplication(A=spessore_m_4, B=m2_wall_2)
volume_m3_4 = Panel(multiplication_10)
multiplication_11 = Multiplication(A=volume_m3_4, B=densità_kg_m3_4)
ecc_kgco2e_kg_4 = Panel("0.13")
massa_kg_4 = Panel(multiplication_11)
multiplication_12 = Multiplication(A=massa_kg_4, B=ecc_kgco2e_kg_4)
gwp_kgco2e_4 = Panel(multiplication_12)
division_4 = Division(A=gwp_kgco2e_4, B=m2_wall_2)
gwp_kgco2e_m2_4 = Panel(division_4)

# ----
albedo = Panel("0.300")
albedo_2 = Panel("0.700")
albedo_3 = Panel("0.650")
albedo_4 = Panel("0.650")
subtraction = Subtraction(A="1", B=albedo_2)
subtraction_2 = Subtraction(A="1", B=albedo)
subtraction_3 = Subtraction(A="1", B=albedo_3)
subtraction_4 = Subtraction(A="1", B=albedo_4)
opaquemat = HBOpaqueMaterial(
    name="Intonaco_esterno",
    thickness="0.02",
    conductivity="0.7",
    density="1500",
    spec_heat="1000",
    therm_absp="0.9",
    sol_absp=subtraction_3,
    vis_absp=subtraction_3)  # -> mat; plug-in component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
opaquemat_2 = HBOpaqueMaterial(
    name="Isolante",
    thickness="0.1",
    conductivity="0.032",
    density="30",
    spec_heat="1250",
    therm_absp="0.1",
    sol_absp=subtraction,
    vis_absp=subtraction)  # -> mat; plug-in component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
opaquemat_3 = HBOpaqueMaterial(
    name="Pietra",
    thickness="0.5",
    conductivity="2.4",
    density="2500",
    spec_heat="1000",
    therm_absp="0.92",
    sol_absp=subtraction_2,
    vis_absp=subtraction_2)  # -> mat; plug-in component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
opaquemat_4 = HBOpaqueMaterial(
    name="Intonaco_interno",
    thickness="0.02",
    conductivity="0.7",
    density="1500",
    spec_heat="1000",
    therm_absp="0.9",
    sol_absp=subtraction_4,
    vis_absp=subtraction_4)  # -> mat; plug-in component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
merge = Merge(Data1=opaquemat, Data2=opaquemat_2, Data3=opaquemat_3, Data4=opaquemat_4)
panel = Panel("Stone Masonry Highly Insulated")
economical_cobenefit = Panel("EMPLOYMENT AND INCOME GENERATION")
environmental_cobenefit = Panel("AIR QUALITY")
social_cobenefit = Panel("HEALTH IMPACTS")
thermalemissivity = Panel("0.90")
albedo_5 = Panel("0.65")
name = Data(panel)
name_2 = ClusterOutput(name)
opaqueconstr = HBOpaqueConstruction(name=panel, materials=merge)  # -> constr; plug-in component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
decnstrconstr = HBDeconstructConstruction(constr=opaqueconstr)  # -> materials, layers, r_val_si, r_val_ip, u_fac_si, u_fac_ip, shgc, t_sol, t_vis; plug-in component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
economic_cobenefit = Text(economical_cobenefit)
social_cobenefit_2 = Text(social_cobenefit)
albedo_6 = Number(albedo_5)
environmental_cobenefit_2 = Text(environmental_cobenefit)
thermalemissivity_2 = Number(thermalemissivity)
constr = ClusterOutput(opaqueconstr)
economic_cobenefit_2 = ClusterOutput(economic_cobenefit)
albedo_7 = ClusterOutput(albedo_6)
thermalemissivity_3 = ClusterOutput(thermalemissivity_2)
environmental_cobenefit_3 = ClusterOutput(environmental_cobenefit_2)
social_cobenefit_3 = ClusterOutput(social_cobenefit_2)
u_fac_si = ClusterOutput(decnstrconstr.u_fac_si)
panel_2 = Panel(decnstrconstr.u_fac_si)
addition = Addition(A=gwp_kgco2e_m2_4, B=gwp_kgco2e_m2_3, C=gwp_kgco2e_m2, D=gwp_kgco2e_m2_2)
addition_2 = Addition(A=gwp_kgco2e_4, B=gwp_kgco2e_3, C=gwp_kgco2e, D=gwp_kgco2e_2)
gwp_kgco2e_5 = Panel(addition_2)
gwp = Panel(addition)
gwp_kgco2e_6 = Number(gwp_kgco2e_5)
gwp_kg_co2_m2 = Number(gwp)
gwp_kgco2e_7 = ClusterOutput(gwp_kgco2e_6)
gwp_kg_co2_m2_2 = ClusterOutput(gwp_kg_co2_m2)

# ==== cluster Muratura_mattoni_non_isolato
m2_wall = ClusterInput()
m2_wall_2 = Data(m2_wall)

# ---- group: GWP (intonaco)
spessore_m = Panel("0.02")
densità_kg_m3 = Panel("1500")
multiplication = Multiplication(A=spessore_m, B=m2_wall_2)
volume_m3 = Panel(multiplication)
multiplication_2 = Multiplication(A=volume_m3, B=densità_kg_m3)
ecc_kgco2e_kg = Panel("0.13")
massa_kg = Panel(multiplication_2)
multiplication_3 = Multiplication(A=massa_kg, B=ecc_kgco2e_kg)
gwp_kgco2e = Panel(multiplication_3)
division = Division(A=gwp_kgco2e, B=m2_wall_2)
gwp_kgco2e_m2 = Panel(division)

# ---- group: GWP (mattone)
spessore_m_2 = Panel("0.30")
densità_kg_m3_2 = Panel("1800")
multiplication_4 = Multiplication(A=spessore_m_2, B=m2_wall_2)
volume_m3_2 = Panel(multiplication_4)
multiplication_5 = Multiplication(A=volume_m3_2, B=densità_kg_m3_2)
ecc_kgco2e_kg_2 = Panel("0.213")
massa_kg_2 = Panel(multiplication_5)
multiplication_6 = Multiplication(A=massa_kg_2, B=ecc_kgco2e_kg_2)
gwp_kgco2e_2 = Panel(multiplication_6)
division_2 = Division(A=gwp_kgco2e_2, B=m2_wall_2)
gwp_kgco2e_m2_2 = Panel(division_2)

# ----
albedo = Panel("0.650")
albedo_2 = Panel("0.650")
albedo_3 = Panel("0.400")

# ---- group: GWP (intonaco)
spessore_m_3 = Panel("0.02")
densità_kg_m3_3 = Panel("1500")
multiplication_7 = Multiplication(A=spessore_m_3, B=m2_wall_2)
volume_m3_3 = Panel(multiplication_7)
multiplication_8 = Multiplication(A=volume_m3_3, B=densità_kg_m3_3)
ecc_kgco2e_kg_3 = Panel("0.13")
massa_kg_3 = Panel(multiplication_8)
multiplication_9 = Multiplication(A=massa_kg_3, B=ecc_kgco2e_kg_3)
gwp_kgco2e_3 = Panel(multiplication_9)
division_3 = Division(A=gwp_kgco2e_3, B=m2_wall_2)
gwp_kgco2e_m2_3 = Panel(division_3)

# ----
subtraction = Subtraction(A="1", B=albedo_3)
subtraction_2 = Subtraction(A="1", B=albedo_2)
subtraction_3 = Subtraction(A="1", B=albedo)
opaquemat = HBOpaqueMaterial(
    name="Mattoni_pieni",
    thickness="0.4",
    conductivity="0.78",
    density="1800",
    spec_heat="840",
    therm_absp="0.95",
    sol_absp=subtraction,
    vis_absp=subtraction)  # -> mat; plug-in component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
opaquemat_2 = HBOpaqueMaterial(
    name="Intonaco_interno",
    thickness="0.02",
    conductivity="0.7",
    density="1500",
    spec_heat="1000",
    therm_absp="0.9",
    sol_absp=subtraction_2,
    vis_absp=subtraction_2)  # -> mat; plug-in component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
opaquemat_3 = HBOpaqueMaterial(
    name="Intonaco_esterno",
    thickness="0.02",
    conductivity="0.7",
    density="1500",
    spec_heat="1000",
    therm_absp="0.9",
    sol_absp=subtraction_3,
    vis_absp=subtraction_3)  # -> mat; plug-in component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
panel = Panel("Brick Masonry Not-Insulated")
merge = Merge(Data1=opaquemat_3, Data2=opaquemat, Data3=opaquemat_2)
economical_cobenefit = Panel("EMPLOYMENT AND INCOME GENERATION")
social_cobenefit = Panel("HEALTH IMPACTS")
environmental_cobenefit = Panel("AIR QUALITY")
name = Data(panel)
albedo_4 = Panel("0.65")
thermalemissivity = Panel("0.90")
name_2 = ClusterOutput(name)
opaqueconstr = HBOpaqueConstruction(name=panel, materials=merge)  # -> constr; plug-in component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
economic_cobenefit = Text(economical_cobenefit)
social_cobenefit_2 = Text(social_cobenefit)
albedo_5 = Number(albedo_4)
decnstrconstr = HBDeconstructConstruction(constr=opaqueconstr)  # -> materials, layers, r_val_si, r_val_ip, u_fac_si, u_fac_ip, shgc, t_sol, t_vis; plug-in component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
environmental_cobenefit_2 = Text(environmental_cobenefit)
constr = ClusterOutput(opaqueconstr)
thermalemissivity_2 = Number(thermalemissivity)
economic_cobenefit_2 = ClusterOutput(economic_cobenefit)
albedo_6 = ClusterOutput(albedo_5)
thermalemissivity_3 = ClusterOutput(thermalemissivity_2)
environmental_cobenefit_3 = ClusterOutput(environmental_cobenefit_2)
social_cobenefit_3 = ClusterOutput(social_cobenefit_2)
u_fac_si = ClusterOutput(decnstrconstr.u_fac_si)
panel_2 = Panel(decnstrconstr.u_fac_si)
addition = Addition(A=gwp_kgco2e_m2_3, B=gwp_kgco2e_m2_2, C=gwp_kgco2e_m2)
addition_2 = Addition(A=gwp_kgco2e_3, B=gwp_kgco2e_2, C=gwp_kgco2e)
gwp = Panel(addition)
gwp_kgco2e_4 = Panel(addition_2)
gwp_kg_co2_m2 = Number(gwp)
gwp_kgco2e_5 = Number(gwp_kgco2e_4)
gwp_kg_co2_m2_2 = ClusterOutput(gwp_kg_co2_m2)
gwp_kgco2e_6 = ClusterOutput(gwp_kgco2e_5)

# ==== cluster Muratura_mattoni_medio_isolato
m2_wall = ClusterInput()
m2_wall_2 = Data(m2_wall)

# ---- group: GWP (intonaco)
spessore_m = Panel("0.02")
densità_kg_m3 = Panel("1500")
multiplication = Multiplication(A=spessore_m, B=m2_wall_2)
volume_m3 = Panel(multiplication)
multiplication_2 = Multiplication(A=volume_m3, B=densità_kg_m3)
ecc_kgco2e_kg = Panel("0.13")
massa_kg = Panel(multiplication_2)
multiplication_3 = Multiplication(A=massa_kg, B=ecc_kgco2e_kg)
gwp_kgco2e = Panel(multiplication_3)
division = Division(A=gwp_kgco2e, B=m2_wall_2)
gwp_kgco2e_m2 = Panel(division)

# ---- group: GWP (mattone)
spessore_m_2 = Panel("0.30")
densità_kg_m3_2 = Panel("1800")
multiplication_4 = Multiplication(A=spessore_m_2, B=m2_wall_2)
volume_m3_2 = Panel(multiplication_4)
multiplication_5 = Multiplication(A=volume_m3_2, B=densità_kg_m3_2)
ecc_kgco2e_kg_2 = Panel("0.213")
massa_kg_2 = Panel(multiplication_5)
multiplication_6 = Multiplication(A=massa_kg_2, B=ecc_kgco2e_kg_2)
gwp_kgco2e_2 = Panel(multiplication_6)
division_2 = Division(A=gwp_kgco2e_2, B=m2_wall_2)
gwp_kgco2e_m2_2 = Panel(division_2)

# ---- group: GWP (isolant)
spessore_m_3 = Panel("0.1")
densità_kg_m3_3 = Panel("100")
multiplication_7 = Multiplication(A=spessore_m_3, B=m2_wall_2)
volume_m3_3 = Panel(multiplication_7)
multiplication_8 = Multiplication(A=volume_m3_3, B=densità_kg_m3_3)
ecc_kgco2e_kg_3 = Panel("1.12")
massa_kg_3 = Panel(multiplication_8)
multiplication_9 = Multiplication(A=massa_kg_3, B=ecc_kgco2e_kg_3)
gwp_kgco2e_3 = Panel(multiplication_9)
division_3 = Division(A=gwp_kgco2e_3, B=m2_wall_2)
gwp_kgco2e_m2_3 = Panel(division_3)

# ---- group: GWP (intonaco)
spessore_m_4 = Panel("0.02")
densità_kg_m3_4 = Panel("1500")
multiplication_10 = Multiplication(A=spessore_m_4, B=m2_wall_2)
volume_m3_4 = Panel(multiplication_10)
multiplication_11 = Multiplication(A=volume_m3_4, B=densità_kg_m3_4)
ecc_kgco2e_kg_4 = Panel("0.13")
massa_kg_4 = Panel(multiplication_11)
multiplication_12 = Multiplication(A=massa_kg_4, B=ecc_kgco2e_kg_4)
gwp_kgco2e_4 = Panel(multiplication_12)
division_4 = Division(A=gwp_kgco2e_4, B=m2_wall_2)
gwp_kgco2e_m2_4 = Panel(division_4)

# ----
panel = Panel("0.1")
albedo = Panel("0.400")
albedo_2 = Panel("0.650")
albedo_3 = Panel("0.700")
albedo_4 = Panel("0.650")
subtraction = Subtraction(A="1", B=albedo_3)
subtraction_2 = Subtraction(A="1", B=albedo)
subtraction_3 = Subtraction(A="1", B=albedo_2)
subtraction_4 = Subtraction(A="1", B=albedo_4)
opaquemat = HBOpaqueMaterial(
    name="Intonaco_esterno",
    thickness="0.02",
    conductivity="0.7",
    density="1500",
    spec_heat="1000",
    therm_absp="0.9",
    sol_absp=subtraction_3,
    vis_absp=subtraction_3)  # -> mat; plug-in component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
opaquemat_2 = HBOpaqueMaterial(
    name="Isolante",
    thickness="0.05",
    conductivity="0.045",
    density="100",
    spec_heat="840",
    therm_absp=albedo_3,
    sol_absp=subtraction,
    vis_absp=subtraction)  # -> mat; plug-in component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
opaquemat_3 = HBOpaqueMaterial(
    name="Mattoni_pieni",
    thickness="0.4",
    conductivity="0.78",
    density="1800",
    spec_heat="840",
    therm_absp="0.9",
    sol_absp=subtraction_2,
    vis_absp=subtraction_2)  # -> mat; plug-in component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
opaquemat_4 = HBOpaqueMaterial(
    name="Intonaco_interno",
    thickness="0.02",
    conductivity="0.7",
    density="1500",
    spec_heat="1000",
    therm_absp="0.9",
    sol_absp=subtraction_4,
    vis_absp=subtraction_4)  # -> mat; plug-in component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
panel_2 = Panel("Brick Masonry Medium Insulated")
economical_cobenefit = Panel("EMPLOYMENT AND INCOME GENERATION")
environmental_cobenefit = Panel("AIR QUALITY")
social_cobenefit = Panel("HEALTH IMPACTS")
merge = Merge(Data1=opaquemat, Data2=opaquemat_2, Data3=opaquemat_3, Data4=opaquemat_4)
name = Data(panel_2)
thermalemissivity = Panel("0.90")
albedo_5 = Panel("0.65")
name_2 = ClusterOutput(name)
opaqueconstr = HBOpaqueConstruction(name=panel_2, materials=merge)  # -> constr; plug-in component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
decnstrconstr = HBDeconstructConstruction(constr=opaqueconstr)  # -> materials, layers, r_val_si, r_val_ip, u_fac_si, u_fac_ip, shgc, t_sol, t_vis; plug-in component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
economic_cobenefit = Text(economical_cobenefit)
social_cobenefit_2 = Text(social_cobenefit)
albedo_6 = Number(albedo_5)
environmental_cobenefit_2 = Text(environmental_cobenefit)
thermalemissivity_2 = Number(thermalemissivity)
constr = ClusterOutput(opaqueconstr)
economic_cobenefit_2 = ClusterOutput(economic_cobenefit)
albedo_7 = ClusterOutput(albedo_6)
thermalemissivity_3 = ClusterOutput(thermalemissivity_2)
environmental_cobenefit_3 = ClusterOutput(environmental_cobenefit_2)
social_cobenefit_3 = ClusterOutput(social_cobenefit_2)
panel_3 = Panel(decnstrconstr.u_fac_si)
u_fac_si = ClusterOutput(decnstrconstr.u_fac_si)
addition = Addition(A=gwp_kgco2e_m2, B=gwp_kgco2e_m2_3, C=gwp_kgco2e_m2_2, D=gwp_kgco2e_m2_4)
addition_2 = Addition(A=gwp_kgco2e, B=gwp_kgco2e_3, C=gwp_kgco2e_2, D=gwp_kgco2e_4)
gwp = Panel(addition)
gwp_kgco2e_5 = Panel(addition_2)
gwp_kg_co2_m2 = Number(gwp)
gwp_kgco2e_6 = Number(gwp_kgco2e_5)
gwp_kg_co2_m2_2 = ClusterOutput(gwp_kg_co2_m2)
gwp_kgco2e_7 = ClusterOutput(gwp_kgco2e_6)

# ==== cluster Muratura_mattoni_altamente_isolato
m2_wall = ClusterInput()
m2_wall_2 = Data(m2_wall)

# ---- group: GWP (intonaco)
spessore_m = Panel("0.02")
densità_kg_m3 = Panel("1500")
multiplication = Multiplication(A=spessore_m, B=m2_wall_2)
volume_m3 = Panel(multiplication)
multiplication_2 = Multiplication(A=volume_m3, B=densità_kg_m3)
ecc_kgco2e_kg = Panel("0.13")
massa_kg = Panel(multiplication_2)
multiplication_3 = Multiplication(A=massa_kg, B=ecc_kgco2e_kg)
gwp_kgco2e = Panel(multiplication_3)
division = Division(A=gwp_kgco2e, B=m2_wall_2)
gwp_kgco2e_m2 = Panel(division)

# ---- group: GWP (isolant)
spessore_m_2 = Panel("0.1")
densità_kg_m3_2 = Panel("30")
multiplication_4 = Multiplication(A=spessore_m_2, B=m2_wall_2)
volume_m3_2 = Panel(multiplication_4)
multiplication_5 = Multiplication(A=volume_m3_2, B=densità_kg_m3_2)
ecc_kgco2e_kg_2 = Panel("4.78")
massa_kg_2 = Panel(multiplication_5)
multiplication_6 = Multiplication(A=massa_kg_2, B=ecc_kgco2e_kg_2)
gwp_kgco2e_2 = Panel(multiplication_6)
division_2 = Division(A=gwp_kgco2e_2, B=m2_wall_2)
gwp_kgco2e_m2_2 = Panel(division_2)

# ---- group: GWP (mattoni)
spessore_m_3 = Panel("0.30")
densità_kg_m3_3 = Panel("1800")
multiplication_7 = Multiplication(A=spessore_m_3, B=m2_wall_2)
volume_m3_3 = Panel(multiplication_7)
multiplication_8 = Multiplication(A=volume_m3_3, B=densità_kg_m3_3)
ecc_kgco2e_kg_3 = Panel("0.213")
massa_kg_3 = Panel(multiplication_8)
multiplication_9 = Multiplication(A=massa_kg_3, B=ecc_kgco2e_kg_3)
gwp_kgco2e_3 = Panel(multiplication_9)
division_3 = Division(A=gwp_kgco2e_3, B=m2_wall_2)
gwp_kgco2e_m2_3 = Panel(division_3)

# ---- group: GWP (intonaco)
spessore_m_4 = Panel("0.02")
densità_kg_m3_4 = Panel("1500")
multiplication_10 = Multiplication(A=spessore_m_4, B=m2_wall_2)
volume_m3_4 = Panel(multiplication_10)
multiplication_11 = Multiplication(A=volume_m3_4, B=densità_kg_m3_4)
ecc_kgco2e_kg_4 = Panel("0.13")
massa_kg_4 = Panel(multiplication_11)
multiplication_12 = Multiplication(A=massa_kg_4, B=ecc_kgco2e_kg_4)
gwp_kgco2e_4 = Panel(multiplication_12)
division_4 = Division(A=gwp_kgco2e_4, B=m2_wall_2)
gwp_kgco2e_m2_4 = Panel(division_4)

# ----
albedo = Panel("0.400")
albedo_2 = Panel("0.700")
albedo_3 = Panel("0.650")
albedo_4 = Panel("0.650")
subtraction = Subtraction(A="1", B=albedo_2)
subtraction_2 = Subtraction(A="1", B=albedo)
subtraction_3 = Subtraction(A="1", B=albedo_4)
subtraction_4 = Subtraction(A="1", B=albedo_3)
opaquemat = HBOpaqueMaterial(
    name="Intonaco_esterno",
    thickness="0.02",
    conductivity="0.7",
    density="1500",
    spec_heat="1000",
    therm_absp="0.9",
    sol_absp=subtraction_3,
    vis_absp=subtraction_3)  # -> mat; plug-in component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
opaquemat_2 = HBOpaqueMaterial(
    name="Isolante",
    thickness="0.1",
    conductivity="0.032",
    density="30",
    spec_heat="1250",
    therm_absp="0.1",
    sol_absp=subtraction,
    vis_absp=subtraction)  # -> mat; plug-in component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
opaquemat_3 = HBOpaqueMaterial(
    name="Mattoni_pieni",
    thickness="0.4",
    conductivity="0.78",
    density="1800",
    spec_heat="840",
    therm_absp="0.95",
    sol_absp=subtraction_2,
    vis_absp=subtraction_2)  # -> mat; plug-in component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
opaquemat_4 = HBOpaqueMaterial(
    name="Intonaco_interno",
    thickness="0.02",
    conductivity="0.7",
    density="1500",
    spec_heat="1000",
    therm_absp="0.9",
    sol_absp=subtraction_4,
    vis_absp=subtraction_4)  # -> mat; plug-in component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
panel = Panel("Brick Masonry Highly Insulated")
merge = Merge(Data1=opaquemat, Data2=opaquemat_2, Data3=opaquemat_3, Data4=opaquemat_4)
name = Data(panel)
name_2 = ClusterOutput(name)
economical_cobenefit = Panel("EMPLOYMENT AND INCOME GENERATION")
social_cobenefit = Panel("HEALTH IMPACTS")
environmental_cobenefit = Panel("AIR QUALITY")
opaqueconstr = HBOpaqueConstruction(name=panel, materials=merge)  # -> constr; plug-in component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
thermalemissivity = Panel("0.90")
albedo_5 = Panel("0.65")
decnstrconstr = HBDeconstructConstruction(constr=opaqueconstr)  # -> materials, layers, r_val_si, r_val_ip, u_fac_si, u_fac_ip, shgc, t_sol, t_vis; plug-in component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
constr = ClusterOutput(opaqueconstr)
economic_cobenefit = Text(economical_cobenefit)
social_cobenefit_2 = Text(social_cobenefit)
albedo_6 = Number(albedo_5)
environmental_cobenefit_2 = Text(environmental_cobenefit)
thermalemissivity_2 = Number(thermalemissivity)
u_fac_si = ClusterOutput(decnstrconstr.u_fac_si)
economic_cobenefit_2 = ClusterOutput(economic_cobenefit)
panel_2 = Panel(decnstrconstr.u_fac_si)
albedo_7 = ClusterOutput(albedo_6)
thermalemissivity_3 = ClusterOutput(thermalemissivity_2)
environmental_cobenefit_3 = ClusterOutput(environmental_cobenefit_2)
social_cobenefit_3 = ClusterOutput(social_cobenefit_2)
addition = Addition(A=gwp_kgco2e_m2, B=gwp_kgco2e_m2_2, C=gwp_kgco2e_m2_3, D=gwp_kgco2e_m2_4)
addition_2 = Addition(A=gwp_kgco2e, B=gwp_kgco2e_2, C=gwp_kgco2e_3, D=gwp_kgco2e_4)
gwp_kgco2e_5 = Panel(addition_2)
gwp = Panel(addition)
gwp_kgco2e_6 = Number(gwp_kgco2e_5)
gwp_kg_co2_m2 = Number(gwp)
gwp_kgco2e_7 = ClusterOutput(gwp_kgco2e_6)
gwp_kg_co2_m2_2 = ClusterOutput(gwp_kg_co2_m2)

# ==== cluster Muratura_laterizio_non_isolato
m2_wall = ClusterInput()
m2_wall_2 = Data(m2_wall)

# ---- group: GWP (intonaco)
spessore_m = Panel("0.02")
densità_kg_m3 = Panel("1500")
multiplication = Multiplication(A=spessore_m, B=m2_wall_2)
volume_m3 = Panel(multiplication)
multiplication_2 = Multiplication(A=volume_m3, B=densità_kg_m3)
ecc_kgco2e_kg = Panel("0.13")
massa_kg = Panel(multiplication_2)
multiplication_3 = Multiplication(A=massa_kg, B=ecc_kgco2e_kg)
gwp_kgco2e = Panel(multiplication_3)
division = Division(A=gwp_kgco2e, B=m2_wall_2)
gwp_kgco2e_m2 = Panel(division)

# ---- group: GWP (laterizio)
spessore_m_2 = Panel("0.30")
densità_kg_m3_2 = Panel("755")
multiplication_4 = Multiplication(A=spessore_m_2, B=m2_wall_2)
volume_m3_2 = Panel(multiplication_4)
multiplication_5 = Multiplication(A=volume_m3_2, B=densità_kg_m3_2)
ecc_kgco2e_kg_2 = Panel("0.224")
massa_kg_2 = Panel(multiplication_5)
multiplication_6 = Multiplication(A=massa_kg_2, B=ecc_kgco2e_kg_2)
gwp_kgco2e_2 = Panel(multiplication_6)
division_2 = Division(A=gwp_kgco2e_2, B=m2_wall_2)
gwp_kgco2e_m2_2 = Panel(division_2)

# ----
albedo = Panel("0.650")
albedo_2 = Panel("0.650")

# ---- group: GWP (intonaco)
spessore_m_3 = Panel("0.02")
densità_kg_m3_3 = Panel("1500")
multiplication_7 = Multiplication(A=spessore_m_3, B=m2_wall_2)
volume_m3_3 = Panel(multiplication_7)
multiplication_8 = Multiplication(A=volume_m3_3, B=densità_kg_m3_3)
ecc_kgco2e_kg_3 = Panel("0.13")
massa_kg_3 = Panel(multiplication_8)
multiplication_9 = Multiplication(A=massa_kg_3, B=ecc_kgco2e_kg_3)
gwp_kgco2e_3 = Panel(multiplication_9)
division_3 = Division(A=gwp_kgco2e_3, B=m2_wall_2)
gwp_kgco2e_m2_3 = Panel(division_3)

# ----
albedo_3 = Panel("0.400")
subtraction = Subtraction(A="1", B=albedo)
subtraction_2 = Subtraction(A="1", B=albedo_2)
subtraction_3 = Subtraction(A="1", B=albedo_3)
opaquemat = HBOpaqueMaterial(
    name="Intonaco_interno",
    thickness="0.02",
    conductivity="0.7",
    density="1500",
    spec_heat="1000",
    therm_absp="0.9",
    sol_absp=subtraction,
    vis_absp=subtraction)  # -> mat; plug-in component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
opaquemat_2 = HBOpaqueMaterial(
    name="Intonaco_esterno",
    thickness="0.02",
    conductivity="0.7",
    density="1500",
    spec_heat="1000",
    therm_absp="0.9",
    sol_absp=subtraction_2,
    vis_absp=subtraction_2)  # -> mat; plug-in component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
opaquemat_3 = HBOpaqueMaterial(
    name="Laterizio_forato",
    thickness="0.3",
    conductivity="0.305",
    density="755",
    spec_heat="840",
    therm_absp="0.95",
    sol_absp=subtraction_3,
    vis_absp=subtraction_3)  # -> mat; plug-in component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
merge = Merge(Data1=opaquemat_2, Data2=opaquemat_3, Data3=opaquemat)
panel = Panel("Brick Masonry Not-Insulated")
opaqueconstr = HBOpaqueConstruction(name=panel, materials=merge)  # -> constr; plug-in component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
economical_cobenefit = Panel("EMPLOYMENT AND INCOME GENERATION")
environmental_cobenefit = Panel("AIR QUALITY")
social_cobenefit = Panel("HEALTH IMPACTS")
albedo_4 = Panel("0.65")
thermalemissivity = Panel("0.90")
name = Data(panel)
constr = ClusterOutput(opaqueconstr)
name_2 = ClusterOutput(name)
economic_cobenefit = Text(economical_cobenefit)
social_cobenefit_2 = Text(social_cobenefit)
albedo_5 = Number(albedo_4)
environmental_cobenefit_2 = Text(environmental_cobenefit)
thermalemissivity_2 = Number(thermalemissivity)
decnstrconstr = HBDeconstructConstruction(constr=opaqueconstr)  # -> materials, layers, r_val_si, r_val_ip, u_fac_si, u_fac_ip, shgc, t_sol, t_vis; plug-in component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
economic_cobenefit_2 = ClusterOutput(economic_cobenefit)
albedo_6 = ClusterOutput(albedo_5)
thermalemissivity_3 = ClusterOutput(thermalemissivity_2)
environmental_cobenefit_3 = ClusterOutput(environmental_cobenefit_2)
social_cobenefit_3 = ClusterOutput(social_cobenefit_2)
panel_2 = Panel(decnstrconstr.u_fac_si)
u_fac_si = ClusterOutput(decnstrconstr.u_fac_si)
addition = Addition(A=gwp_kgco2e_m2_3, B=gwp_kgco2e_m2_2, C=gwp_kgco2e_m2)
addition_2 = Addition(A=gwp_kgco2e_3, B=gwp_kgco2e_2, C=gwp_kgco2e)
gwp_kgco2e_m2_4 = Panel(addition)
gwp_kgco2e_4 = Panel(addition_2)
gwp_kgco2e_m2_5 = Number(gwp_kgco2e_m2_4)
gwp_kgco2e_5 = Number(gwp_kgco2e_4)
gwp_kgco2e_m2_6 = ClusterOutput(gwp_kgco2e_m2_5)
gwp_kgco2e_6 = ClusterOutput(gwp_kgco2e_5)

# ==== cluster Muratura_laterizio_isolato
m2_wall = ClusterInput()
m2_wall_2 = Data(m2_wall)

# ---- group: GWP (intonaco)
spessore_m = Panel("0.02")
densità_kg_m3 = Panel("1500")
multiplication = Multiplication(A=spessore_m, B=m2_wall_2)
volume_m3 = Panel(multiplication)
multiplication_2 = Multiplication(A=volume_m3, B=densità_kg_m3)
ecc_kgco2e_kg = Panel("0.13")
massa_kg = Panel(multiplication_2)
multiplication_3 = Multiplication(A=massa_kg, B=ecc_kgco2e_kg)
gwp_kgco2e = Panel(multiplication_3)
division = Division(A=gwp_kgco2e, B=m2_wall_2)
gwp_kgco2e_m2 = Panel(division)

# ---- group: GWP (isolant)
spessore_m_2 = Panel("0.1")
densità_kg_m3_2 = Panel("30")
multiplication_4 = Multiplication(A=spessore_m_2, B=m2_wall_2)
volume_m3_2 = Panel(multiplication_4)
multiplication_5 = Multiplication(A=volume_m3_2, B=densità_kg_m3_2)
ecc_kgco2e_kg_2 = Panel("1.12")
massa_kg_2 = Panel(multiplication_5)
multiplication_6 = Multiplication(A=massa_kg_2, B=ecc_kgco2e_kg_2)
gwp_kgco2e_2 = Panel(multiplication_6)
division_2 = Division(A=gwp_kgco2e_2, B=m2_wall_2)
gwp_kgco2e_m2_2 = Panel(division_2)

# ---- group: GWP (laterizio)
spessore_m_3 = Panel("0.30")
densità_kg_m3_3 = Panel("755")
multiplication_7 = Multiplication(A=spessore_m_3, B=m2_wall_2)
volume_m3_3 = Panel(multiplication_7)
multiplication_8 = Multiplication(A=volume_m3_3, B=densità_kg_m3_3)
ecc_kgco2e_kg_3 = Panel("0.224")
massa_kg_3 = Panel(multiplication_8)
multiplication_9 = Multiplication(A=massa_kg_3, B=ecc_kgco2e_kg_3)
gwp_kgco2e_3 = Panel(multiplication_9)
division_3 = Division(A=gwp_kgco2e_3, B=m2_wall_2)
gwp_kgco2e_m2_3 = Panel(division_3)

# ---- group: GWP (intonaco)
spessore_m_4 = Panel("0.02")
densità_kg_m3_4 = Panel("1500")
multiplication_10 = Multiplication(A=spessore_m_4, B=m2_wall_2)
volume_m3_4 = Panel(multiplication_10)
multiplication_11 = Multiplication(A=volume_m3_4, B=densità_kg_m3_4)
ecc_kgco2e_kg_4 = Panel("0.13")
massa_kg_4 = Panel(multiplication_11)
multiplication_12 = Multiplication(A=massa_kg_4, B=ecc_kgco2e_kg_4)
gwp_kgco2e_4 = Panel(multiplication_12)
division_4 = Division(A=gwp_kgco2e_4, B=m2_wall_2)
gwp_kgco2e_m2_4 = Panel(division_4)

# ----
albedo = Panel("0.7")
albedo_2 = Panel("0.650")
albedo_3 = Panel("0.400")
albedo_4 = Panel("0.650")
subtraction = Subtraction(A="1", B=albedo)
subtraction_2 = Subtraction(A="1", B=albedo_2)
subtraction_3 = Subtraction(A="1", B=albedo_3)
subtraction_4 = Subtraction(A="1", B=albedo_4)
opaquemat = HBOpaqueMaterial(
    name="Isolante",
    thickness="0.1",
    conductivity="0.032",
    density="30",
    spec_heat="1250",
    therm_absp="0.1",
    sol_absp=subtraction,
    vis_absp=subtraction)  # -> mat; plug-in component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
opaquemat_2 = HBOpaqueMaterial(
    name="Intonaco_esterno",
    thickness="0.02",
    conductivity="0.7",
    density="1500",
    spec_heat="1000",
    therm_absp="0.9",
    sol_absp=subtraction_2,
    vis_absp=subtraction_2)  # -> mat; plug-in component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
opaquemat_3 = HBOpaqueMaterial(
    name="Laterizio_forato",
    thickness="0.3",
    conductivity="0.305",
    density="755",
    spec_heat="840",
    therm_absp="0.95",
    sol_absp=subtraction_3,
    vis_absp=subtraction_3)  # -> mat; plug-in component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
opaquemat_4 = HBOpaqueMaterial(
    name="Intonaco_interno",
    thickness="0.02",
    conductivity="0.7",
    density="1500",
    spec_heat="1000",
    therm_absp="0.9",
    sol_absp=subtraction_4,
    vis_absp=subtraction_4)  # -> mat; plug-in component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
panel = Panel("Brick Masonry Insulated")
merge = Merge(Data1=opaquemat_2, Data2=opaquemat, Data3=opaquemat_3, Data4=opaquemat_4)
economical_cobenefit = Panel("EMPLOYMENT AND INCOME GENERATION")
social_cobenefit = Panel("HEALTH IMPACTS")
environmental_cobenefit = Panel("AIR QUALITY")
thermalemissivity = Panel("0.90")
albedo_5 = Panel("0.65")
opaqueconstr = HBOpaqueConstruction(name=panel, materials=merge)  # -> constr; plug-in component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
name = Data(panel)
decnstrconstr = HBDeconstructConstruction(constr=opaqueconstr)  # -> materials, layers, r_val_si, r_val_ip, u_fac_si, u_fac_ip, shgc, t_sol, t_vis; plug-in component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
economic_cobenefit = Text(economical_cobenefit)
constr = ClusterOutput(opaqueconstr)
social_cobenefit_2 = Text(social_cobenefit)
albedo_6 = Number(albedo_5)
environmental_cobenefit_2 = Text(environmental_cobenefit)
thermalemissivity_2 = Number(thermalemissivity)
economic_cobenefit_2 = ClusterOutput(economic_cobenefit)
albedo_7 = ClusterOutput(albedo_6)
thermalemissivity_3 = ClusterOutput(thermalemissivity_2)
environmental_cobenefit_3 = ClusterOutput(environmental_cobenefit_2)
social_cobenefit_3 = ClusterOutput(social_cobenefit_2)
u_fac_si = ClusterOutput(decnstrconstr.u_fac_si)
name_2 = ClusterOutput(name)
panel_2 = Panel(decnstrconstr.u_fac_si)
addition = Addition(A=gwp_kgco2e_m2, B=gwp_kgco2e_m2_2, C=gwp_kgco2e_m2_3, D=gwp_kgco2e_m2_4)
addition_2 = Addition(A=gwp_kgco2e, B=gwp_kgco2e_2, C=gwp_kgco2e_3, D=gwp_kgco2e_4)
gwp = Panel(addition)
gwp_kgco2e_5 = Panel(addition_2)
gwp_kgco2e_m2_5 = Number(gwp)
gwp_kgco2e_6 = Number(gwp_kgco2e_5)
gwp_kgco2e_m2_6 = ClusterOutput(gwp_kgco2e_m2_5)
gwp_kgco2e_7 = ClusterOutput(gwp_kgco2e_6)

# ==== cluster Muratura_lateerizio_altamente_isolato
m2_wall = ClusterInput()
m2_wall_2 = Data(m2_wall)

# ---- group: GWP (intonaco)
spessore_m = Panel("0.02")
densità_kg_m3 = Panel("1500")
multiplication = Multiplication(A=spessore_m, B=m2_wall_2)
volume_m3 = Panel(multiplication)
multiplication_2 = Multiplication(A=volume_m3, B=densità_kg_m3)
ecc_kgco2e_kg = Panel("0.13")
massa_kg = Panel(multiplication_2)
multiplication_3 = Multiplication(A=massa_kg, B=ecc_kgco2e_kg)
gwp_kgco2e = Panel(multiplication_3)
division = Division(A=gwp_kgco2e, B=m2_wall_2)
gwp_kgco2e_m2 = Panel(division)

# ---- group: GWP (isolant)
spessore_m_2 = Panel("0.14")
densità_kg_m3_2 = Panel("30")
multiplication_4 = Multiplication(A=spessore_m_2, B=m2_wall_2)
volume_m3_2 = Panel(multiplication_4)
multiplication_5 = Multiplication(A=volume_m3_2, B=densità_kg_m3_2)
ecc_kgco2e_kg_2 = Panel("4.78")
massa_kg_2 = Panel(multiplication_5)
multiplication_6 = Multiplication(A=massa_kg_2, B=ecc_kgco2e_kg_2)
gwp_kgco2e_2 = Panel(multiplication_6)
division_2 = Division(A=gwp_kgco2e_2, B=m2_wall_2)
gwp_kgco2e_m2_2 = Panel(division_2)

# ---- group: GWP (laterizio)
spessore_m_3 = Panel("0.30")
densità_kg_m3_3 = Panel("755")
multiplication_7 = Multiplication(A=spessore_m_3, B=m2_wall_2)
volume_m3_3 = Panel(multiplication_7)
multiplication_8 = Multiplication(A=volume_m3_3, B=densità_kg_m3_3)
ecc_kgco2e_kg_3 = Panel("0.224")
massa_kg_3 = Panel(multiplication_8)
multiplication_9 = Multiplication(A=massa_kg_3, B=ecc_kgco2e_kg_3)
gwp_kgco2e_3 = Panel(multiplication_9)
division_3 = Division(A=gwp_kgco2e_3, B=m2_wall_2)
gwp_kgco2e_m2_3 = Panel(division_3)

# ---- group: GWP (intonaco)
spessore_m_4 = Panel("0.02")
densità_kg_m3_4 = Panel("1500")
multiplication_10 = Multiplication(A=spessore_m_4, B=m2_wall_2)
volume_m3_4 = Panel(multiplication_10)
multiplication_11 = Multiplication(A=volume_m3_4, B=densità_kg_m3_4)
ecc_kgco2e_kg_4 = Panel("0.13")
massa_kg_4 = Panel(multiplication_11)
multiplication_12 = Multiplication(A=massa_kg_4, B=ecc_kgco2e_kg_4)
gwp_kgco2e_4 = Panel(multiplication_12)
division_4 = Division(A=gwp_kgco2e_4, B=m2_wall_2)
gwp_kgco2e_m2_4 = Panel(division_4)

# ----
albedo = Panel("0.650")
albedo_2 = Panel("0.7")
albedo_3 = Panel("0.650")
albedo_4 = Panel("0.400")
subtraction = Subtraction(A="1", B=albedo_2)
subtraction_2 = Subtraction(A="1", B=albedo)
subtraction_3 = Subtraction(A="1", B=albedo_4)
subtraction_4 = Subtraction(A="1", B=albedo_3)
opaquemat = HBOpaqueMaterial(
    name="Isolante",
    thickness="0.14",
    conductivity="0.032",
    density="30",
    spec_heat="1250",
    therm_absp="0.1",
    sol_absp=subtraction,
    vis_absp=subtraction)  # -> mat; plug-in component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
opaquemat_2 = HBOpaqueMaterial(
    name="Intonaco_esterno",
    thickness="0.02",
    conductivity="0.7",
    density="1500",
    spec_heat="1000",
    therm_absp="0.9",
    sol_absp=subtraction_2,
    vis_absp=subtraction_2)  # -> mat; plug-in component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
opaquemat_3 = HBOpaqueMaterial(
    name="Laterizio_forato",
    thickness="0.3",
    conductivity="0.305",
    density="755",
    spec_heat="840",
    therm_absp="0.95",
    sol_absp=subtraction_3,
    vis_absp=subtraction_3)  # -> mat; plug-in component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
opaquemat_4 = HBOpaqueMaterial(
    name="Intonaco_interno",
    thickness="0.02",
    conductivity="0.7",
    density="1500",
    spec_heat="1000",
    therm_absp="0.9",
    sol_absp=subtraction_4,
    vis_absp=subtraction_4)  # -> mat; plug-in component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
panel = Panel("Brick Masonry Highly Insulated")
merge = Merge(Data1=opaquemat_2, Data2=opaquemat, Data3=opaquemat_3, Data4=opaquemat_4)
economical_cobenefit = Panel("EMPLOYMENT AND INCOME GENERATION")
social_cobenefit = Panel("HEALTH IMPACTS")
environmental_cobenefit = Panel("AIR QUALITY")
thermalemissivity = Panel("0.90")
albedo_5 = Panel("0.65")
opaqueconstr = HBOpaqueConstruction(name=panel, materials=merge)  # -> constr; plug-in component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
name = Data(panel)
economic_cobenefit = Text(economical_cobenefit)
social_cobenefit_2 = Text(social_cobenefit)
albedo_6 = Number(albedo_5)
environmental_cobenefit_2 = Text(environmental_cobenefit)
thermalemissivity_2 = Number(thermalemissivity)
decnstrconstr = HBDeconstructConstruction(constr=opaqueconstr)  # -> materials, layers, r_val_si, r_val_ip, u_fac_si, u_fac_ip, shgc, t_sol, t_vis; plug-in component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
constr = ClusterOutput(opaqueconstr)
name_2 = ClusterOutput(name)
economic_cobenefit_2 = ClusterOutput(economic_cobenefit)
albedo_7 = ClusterOutput(albedo_6)
thermalemissivity_3 = ClusterOutput(thermalemissivity_2)
environmental_cobenefit_3 = ClusterOutput(environmental_cobenefit_2)
social_cobenefit_3 = ClusterOutput(social_cobenefit_2)
panel_2 = Panel(decnstrconstr.u_fac_si)
u_fac_si = ClusterOutput(decnstrconstr.u_fac_si)
addition = Addition(A=gwp_kgco2e_m2, B=gwp_kgco2e_m2_2, C=gwp_kgco2e_m2_3, D=gwp_kgco2e_m2_4)
addition_2 = Addition(A=gwp_kgco2e, B=gwp_kgco2e_2, C=gwp_kgco2e_3, D=gwp_kgco2e_4)
gwp_kgco2e_5 = Panel(addition_2)
gwp_kgco2e_m2_5 = Panel(addition)
gwp_kgco2e_6 = Number(gwp_kgco2e_5)
gwp_kgco2e_m2_6 = Number(gwp_kgco2e_m2_5)
gwp_kgco2e_7 = ClusterOutput(gwp_kgco2e_6)
gwp_kgco2e_m2_7 = ClusterOutput(gwp_kgco2e_m2_6)

# ==== cluster Muratura_blocco_termico_isolato
m2_wall = ClusterInput()
m2_wall_2 = Data(m2_wall)
albedo = Panel("0.650")
albedo_2 = Panel("0.400")
albedo_3 = Panel("0.7")
albedo_4 = Panel("0.650")

# ---- group: GWP (intonaco)
spessore_m = Panel("0.02")
densità_kg_m3 = Panel("1500")
multiplication = Multiplication(A=spessore_m, B=m2_wall_2)
volume_m3 = Panel(multiplication)
multiplication_2 = Multiplication(A=volume_m3, B=densità_kg_m3)
ecc_kgco2e_kg = Panel("0.13")
massa_kg = Panel(multiplication_2)
multiplication_3 = Multiplication(A=massa_kg, B=ecc_kgco2e_kg)
gwp_kgco2e = Panel(multiplication_3)
division = Division(A=gwp_kgco2e, B=m2_wall_2)
gwp_kgco2e_m2 = Panel(division)

# ---- group: GWP (isolant)
spessore_m_2 = Panel("0.1")
densità_kg_m3_2 = Panel("30")
multiplication_4 = Multiplication(A=spessore_m_2, B=m2_wall_2)
volume_m3_2 = Panel(multiplication_4)
multiplication_5 = Multiplication(A=volume_m3_2, B=densità_kg_m3_2)
ecc_kgco2e_kg_2 = Panel("4.78")
massa_kg_2 = Panel(multiplication_5)
multiplication_6 = Multiplication(A=massa_kg_2, B=ecc_kgco2e_kg_2)
gwp_kgco2e_2 = Panel(multiplication_6)
division_2 = Division(A=gwp_kgco2e_2, B=m2_wall_2)
gwp_kgco2e_m2_2 = Panel(division_2)

# ---- group: GWP (blocco termico)
spessore_m_3 = Panel("0.30")
densità_kg_m3_3 = Panel("")
multiplication_7 = Multiplication(A=spessore_m_3, B=m2_wall_2)
volume_m3_3 = Panel(multiplication_7)
multiplication_8 = Multiplication(A=volume_m3_3, B=densità_kg_m3_3)
ecc_kgco2e_kg_3 = Panel("0.213")
massa_kg_3 = Panel(multiplication_8)
multiplication_9 = Multiplication(A=massa_kg_3, B=ecc_kgco2e_kg_3)
gwp_kgco2e_3 = Panel(multiplication_9)
division_3 = Division(A=gwp_kgco2e_3, B=m2_wall_2)
gwp_kgco2e_m2_3 = Panel(division_3)

# ---- group: GWP (intonaco)
spessore_m_4 = Panel("0.02")
densità_kg_m3_4 = Panel("1500")
multiplication_10 = Multiplication(A=spessore_m_4, B=m2_wall_2)
volume_m3_4 = Panel(multiplication_10)
multiplication_11 = Multiplication(A=volume_m3_4, B=densità_kg_m3_4)
ecc_kgco2e_kg_4 = Panel("0.13")
massa_kg_4 = Panel(multiplication_11)
multiplication_12 = Multiplication(A=massa_kg_4, B=ecc_kgco2e_kg_4)
gwp_kgco2e_4 = Panel(multiplication_12)
division_4 = Division(A=gwp_kgco2e_4, B=m2_wall_2)
gwp_kgco2e_m2_4 = Panel(division_4)

# ----
subtraction = Subtraction(A="1", B=albedo_3)
subtraction_2 = Subtraction(A="1", B=albedo)
subtraction_3 = Subtraction(A="1", B=albedo_2)
subtraction_4 = Subtraction(A="1", B=albedo_4)
opaquemat = HBOpaqueMaterial(
    name="Isolante",
    thickness="0.1",
    conductivity="0.032",
    density="30",
    spec_heat="1250",
    therm_absp="0.1",
    sol_absp=subtraction,
    vis_absp=subtraction)  # -> mat; plug-in component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
opaquemat_2 = HBOpaqueMaterial(
    name="Intonaco_esterno",
    thickness="0.02",
    conductivity="0.7",
    density="1500",
    spec_heat="1000",
    therm_absp="0.9",
    sol_absp=subtraction_2,
    vis_absp=subtraction_2)  # -> mat; plug-in component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
opaquemat_3 = HBOpaqueMaterial(
    name="Blocco_termico",
    thickness="0.3",
    conductivity="0.223",
    density="550",
    spec_heat="1000",
    therm_absp="0.95",
    sol_absp=subtraction_3,
    vis_absp=subtraction_3)  # -> mat; plug-in component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
opaquemat_4 = HBOpaqueMaterial(
    name="Intonaco_interno",
    thickness="0.02",
    conductivity="0.7",
    density="1500",
    spec_heat="1000",
    therm_absp="0.9",
    sol_absp=subtraction_4,
    vis_absp=subtraction_4)  # -> mat; plug-in component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
economical_cobenefit = Panel("EMPLOYMENT AND INCOME GENERATION")
panel = Panel("Thermal Block Masonry Insulated")
environmental_cobenefit = Panel("AIR QUALITY")
social_cobenefit = Panel("HEALTH IMPACTS")
merge = Merge(Data1=opaquemat_2, Data2=opaquemat, Data3=opaquemat_3, Data4=opaquemat_4)
albedo_5 = Panel("0.65")
thermalemissivity = Panel("0.90")
name = Data(panel)
opaqueconstr = HBOpaqueConstruction(name=panel, materials=merge)  # -> constr; plug-in component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
economic_cobenefit = Text(economical_cobenefit)
social_cobenefit_2 = Text(social_cobenefit)
albedo_6 = Number(albedo_5)
environmental_cobenefit_2 = Text(environmental_cobenefit)
thermalemissivity_2 = Number(thermalemissivity)
name_2 = ClusterOutput(name)
decnstrconstr = HBDeconstructConstruction(constr=opaqueconstr)  # -> materials, layers, r_val_si, r_val_ip, u_fac_si, u_fac_ip, shgc, t_sol, t_vis; plug-in component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
economic_cobenefit_2 = ClusterOutput(economic_cobenefit)
albedo_7 = ClusterOutput(albedo_6)
thermalemissivity_3 = ClusterOutput(thermalemissivity_2)
constr = ClusterOutput(opaqueconstr)
environmental_cobenefit_3 = ClusterOutput(environmental_cobenefit_2)
social_cobenefit_3 = ClusterOutput(social_cobenefit_2)
u_fac_si = ClusterOutput(decnstrconstr.u_fac_si)
panel_2 = Panel(decnstrconstr.u_fac_si)
addition = Addition(A=gwp_kgco2e_m2, B=gwp_kgco2e_m2_2, C=gwp_kgco2e_m2_3, D=gwp_kgco2e_m2_4)
addition_2 = Addition(A=gwp_kgco2e, B=gwp_kgco2e_2, C=gwp_kgco2e_3, D=gwp_kgco2e_4)
gwp_kgco2e_5 = Panel(addition_2)
gwp_kgco2e_m2_5 = Panel(addition)
gwp_kgco2e_6 = Number(gwp_kgco2e_5)
gwp_kgco2e_m2_6 = Number(gwp_kgco2e_m2_5)
gwp_kgco2e_7 = ClusterOutput(gwp_kgco2e_6)
gwp_kgco2e_m2_7 = ClusterOutput(gwp_kgco2e_m2_6)

# ==== cluster Muratura_blocco_termico_altamente_isolato
m2_wall = ClusterInput()
m2_wall_2 = Data(m2_wall)
panel = Panel("0.95")
albedo = Panel("0.650")
albedo_2 = Panel("0.650")
albedo_3 = Panel("0.400")
albedo_4 = Panel("0.7")

# ---- group: GWP (intonaco)
spessore_m = Panel("0.02")
densità_kg_m3 = Panel("1500")
multiplication = Multiplication(A=spessore_m, B=m2_wall_2)
volume_m3 = Panel(multiplication)
multiplication_2 = Multiplication(A=volume_m3, B=densità_kg_m3)
ecc_kgco2e_kg = Panel("0.13")
massa_kg = Panel(multiplication_2)
multiplication_3 = Multiplication(A=massa_kg, B=ecc_kgco2e_kg)
gwp_kgco2e = Panel(multiplication_3)
division = Division(A=gwp_kgco2e, B=m2_wall_2)
gwp_kgco2e_m2 = Panel(division)

# ---- group: GWP (isolant)
spessore_m_2 = Panel("0.14")
densità_kg_m3_2 = Panel("30")
multiplication_4 = Multiplication(A=spessore_m_2, B=m2_wall_2)
volume_m3_2 = Panel(multiplication_4)
multiplication_5 = Multiplication(A=volume_m3_2, B=densità_kg_m3_2)
ecc_kgco2e_kg_2 = Panel("4.78")
massa_kg_2 = Panel(multiplication_5)
multiplication_6 = Multiplication(A=massa_kg_2, B=ecc_kgco2e_kg_2)
gwp_kgco2e_2 = Panel(multiplication_6)
division_2 = Division(A=gwp_kgco2e_2, B=m2_wall_2)
gwp_kgco2e_m2_2 = Panel(division_2)

# ---- group: GWP (blocco termico)
spessore_m_3 = Panel("0.30")
densità_kg_m3_3 = Panel("")
multiplication_7 = Multiplication(A=spessore_m_3, B=m2_wall_2)
volume_m3_3 = Panel(multiplication_7)
multiplication_8 = Multiplication(A=volume_m3_3, B=densità_kg_m3_3)
ecc_kgco2e_kg_3 = Panel("0.213")
massa_kg_3 = Panel(multiplication_8)
multiplication_9 = Multiplication(A=massa_kg_3, B=ecc_kgco2e_kg_3)
gwp_kgco2e_3 = Panel(multiplication_9)
division_3 = Division(A=gwp_kgco2e_3, B=m2_wall_2)
gwp_kgco2e_m2_3 = Panel(division_3)

# ---- group: GWP (intonaco)
spessore_m_4 = Panel("0.02")
densità_kg_m3_4 = Panel("1500")
multiplication_10 = Multiplication(A=spessore_m_4, B=m2_wall_2)
volume_m3_4 = Panel(multiplication_10)
multiplication_11 = Multiplication(A=volume_m3_4, B=densità_kg_m3_4)
ecc_kgco2e_kg_4 = Panel("0.13")
massa_kg_4 = Panel(multiplication_11)
multiplication_12 = Multiplication(A=massa_kg_4, B=ecc_kgco2e_kg_4)
gwp_kgco2e_4 = Panel(multiplication_12)
division_4 = Division(A=gwp_kgco2e_4, B=m2_wall_2)
gwp_kgco2e_m2_4 = Panel(division_4)

# ----
subtraction = Subtraction(A="1", B=albedo_4)
subtraction_2 = Subtraction(A="1", B=albedo_2)
subtraction_3 = Subtraction(A="1", B=albedo_3)
subtraction_4 = Subtraction(A="1", B=albedo)
opaquemat = HBOpaqueMaterial(
    name="Isolante",
    thickness="0.14",
    conductivity="0.032",
    density="30",
    spec_heat="1250",
    therm_absp="0.1",
    sol_absp=subtraction,
    vis_absp=subtraction)  # -> mat; plug-in component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
opaquemat_2 = HBOpaqueMaterial(
    name="Intonaco_esterno",
    thickness="0.02",
    conductivity="0.7",
    density="1500",
    spec_heat="1000",
    therm_absp="0.9",
    sol_absp=subtraction_2,
    vis_absp=subtraction_2)  # -> mat; plug-in component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
opaquemat_3 = HBOpaqueMaterial(
    name="Blocco_termico_EPS",
    thickness="0.3",
    conductivity="0.065",
    density="550",
    spec_heat="1000",
    therm_absp=albedo_3,
    sol_absp=subtraction_3,
    vis_absp=subtraction_3)  # -> mat; plug-in component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
opaquemat_4 = HBOpaqueMaterial(
    name="Intonaco_interno",
    thickness="0.02",
    conductivity="0.7",
    density="1500",
    spec_heat="1000",
    therm_absp="0.9",
    sol_absp=subtraction_4,
    vis_absp=subtraction_4)  # -> mat; plug-in component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
panel_2 = Panel("Thermal Block Masonry Highly Insulated")
merge = Merge(Data1=opaquemat_2, Data2=opaquemat, Data3=opaquemat_3, Data4=opaquemat_4)
economical_cobenefit = Panel("EMPLOYMENT AND INCOME GENERATION")
social_cobenefit = Panel("HEALTH IMPACTS")
environmental_cobenefit = Panel("AIR QUALITY")
thermalemissivity = Panel("0.90")
albedo_5 = Panel("0.65")
name = Data(panel_2)
name_2 = ClusterOutput(name)
opaqueconstr = HBOpaqueConstruction(name=panel_2, materials=merge)  # -> constr; plug-in component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
economic_cobenefit = Text(economical_cobenefit)
social_cobenefit_2 = Text(social_cobenefit)
albedo_6 = Number(albedo_5)
environmental_cobenefit_2 = Text(environmental_cobenefit)
thermalemissivity_2 = Number(thermalemissivity)
decnstrconstr = HBDeconstructConstruction(constr=opaqueconstr)  # -> materials, layers, r_val_si, r_val_ip, u_fac_si, u_fac_ip, shgc, t_sol, t_vis; plug-in component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
constr = ClusterOutput(opaqueconstr)
economic_cobenefit_2 = ClusterOutput(economic_cobenefit)
albedo_7 = ClusterOutput(albedo_6)
thermalemissivity_3 = ClusterOutput(thermalemissivity_2)
environmental_cobenefit_3 = ClusterOutput(environmental_cobenefit_2)
social_cobenefit_3 = ClusterOutput(social_cobenefit_2)
panel_3 = Panel(decnstrconstr.u_fac_si)
u_fac_si = ClusterOutput(decnstrconstr.u_fac_si)
addition = Addition(A=gwp_kgco2e, B=gwp_kgco2e_2, C=gwp_kgco2e_3, D=gwp_kgco2e_4)
addition_2 = Addition(A=gwp_kgco2e_m2, B=gwp_kgco2e_m2_2, C=gwp_kgco2e_m2_3, D=gwp_kgco2e_m2_4)
gwp_kgco2e_m2_5 = Panel(addition_2)
gwp_kgco2e_5 = Panel(addition)
gwp_kg_co2_m2 = Number(gwp_kgco2e_m2_5)
gwp_kgco2e_6 = Number(gwp_kgco2e_5)
gwp_kg_co2_m2_2 = ClusterOutput(gwp_kg_co2_m2)
gwp_kgco2e_7 = ClusterOutput(gwp_kgco2e_6)

# ==== cluster Muratura_calcestruzzo_non_isolato
m2_wall = ClusterInput()
m2_wall_2 = Data(m2_wall)
albedo = Panel("0.25")
albedo_2 = Panel("0.25")
albedo_3 = Panel("0.650")
albedo_4 = Panel("0.650")
subtraction = Subtraction(A="1", B=albedo_2)
subtraction_2 = Subtraction(A="1", B=albedo)
subtraction_3 = Subtraction(A="1", B=albedo_3)
subtraction_4 = Subtraction(A="1", B=albedo_4)
opaquemat = HBOpaqueMaterial(
    name="custom_air_gap",
    thickness="0.05",
    conductivity="0.278",
    density="1.28",
    spec_heat="1000",
    roughness="Smooth",
    therm_absp="0.9",
    sol_absp="0.7",
    vis_absp="0.7")  # -> mat; plug-in component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
opaquemat_2 = HBOpaqueMaterial(
    name="Calcestruzzo",
    thickness="0.2",
    conductivity="1.7",
    density="2400",
    spec_heat="1000",
    therm_absp="0.9",
    sol_absp=subtraction,
    vis_absp=subtraction)  # -> mat; plug-in component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
opaquemat_3 = HBOpaqueMaterial(
    name="Calcestruzzo",
    thickness="0.2",
    conductivity="1.7",
    density="2400",
    spec_heat="1000",
    therm_absp="0.9",
    sol_absp=subtraction_2,
    vis_absp=subtraction_2)  # -> mat; plug-in component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
opaquemat_4 = HBOpaqueMaterial(
    name="Intonaco_esterno",
    thickness="0.02",
    conductivity="0.7",
    density="1500",
    spec_heat="1000",
    therm_absp="0.9",
    sol_absp=subtraction_3,
    vis_absp=subtraction_3)  # -> mat; plug-in component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
opaquemat_5 = HBOpaqueMaterial(
    name="Intonaco_interno",
    thickness="0.02",
    conductivity="0.7",
    density="1500",
    spec_heat="1000",
    therm_absp="0.9",
    sol_absp=subtraction_4,
    vis_absp=subtraction_4)  # -> mat; plug-in component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

# ---- group: GWP (intonaco)
spessore_m = Panel("0.02")
densità_kg_m3 = Panel("1500")
multiplication = Multiplication(A=spessore_m, B=m2_wall_2)
volume_m3 = Panel(multiplication)
multiplication_2 = Multiplication(A=volume_m3, B=densità_kg_m3)
ecc_kgco2e_kg = Panel("0.13")
massa_kg = Panel(multiplication_2)
multiplication_3 = Multiplication(A=massa_kg, B=ecc_kgco2e_kg)
gwp_kgco2e = Panel(multiplication_3)
division = Division(A=gwp_kgco2e, B=m2_wall_2)
gwp_kgco2e_m2 = Panel(division)

# ---- group: GWP (cls)
spessore_m_2 = Panel("0.2")
densità_kg_m3_2 = Panel("2400")
multiplication_4 = Multiplication(A=spessore_m_2, B=m2_wall_2)
volume_m3_2 = Panel(multiplication_4)
multiplication_5 = Multiplication(A=volume_m3_2, B=densità_kg_m3_2)
ecc_kgco2e_kg_2 = Panel("0.1")
massa_kg_2 = Panel(multiplication_5)
multiplication_6 = Multiplication(A=massa_kg_2, B=ecc_kgco2e_kg_2)
gwp_kgco2e_2 = Panel(multiplication_6)
division_2 = Division(A=gwp_kgco2e_2, B=m2_wall_2)
gwp_kgco2e_m2_2 = Panel(division_2)

spessore_m_3 = Panel("0.2")
densità_kg_m3_3 = Panel("2400")
multiplication_7 = Multiplication(A=spessore_m_3, B=m2_wall_2)
volume_m3_3 = Panel(multiplication_7)
multiplication_8 = Multiplication(A=volume_m3_3, B=densità_kg_m3_3)
ecc_kgco2e_kg_3 = Panel("0.1")
massa_kg_3 = Panel(multiplication_8)
multiplication_9 = Multiplication(A=massa_kg_3, B=ecc_kgco2e_kg_3)
gwp_kgco2e_3 = Panel(multiplication_9)
division_3 = Division(A=gwp_kgco2e_3, B=m2_wall_2)
gwp_kgco2e_m2_3 = Panel(division_3)

# ---- group: GWP (intonaco)
spessore_m_4 = Panel("0.02")
densità_kg_m3_4 = Panel("1500")
multiplication_10 = Multiplication(A=spessore_m_4, B=m2_wall_2)
volume_m3_4 = Panel(multiplication_10)
multiplication_11 = Multiplication(A=volume_m3_4, B=densità_kg_m3_4)
ecc_kgco2e_kg_4 = Panel("0.13")
massa_kg_4 = Panel(multiplication_11)
multiplication_12 = Multiplication(A=massa_kg_4, B=ecc_kgco2e_kg_4)
gwp_kgco2e_4 = Panel(multiplication_12)
division_4 = Division(A=gwp_kgco2e_4, B=m2_wall_2)
gwp_kgco2e_m2_4 = Panel(division_4)

# ----
addition = Addition(A=gwp_kgco2e_m2, B=gwp_kgco2e_m2_2, C=gwp_kgco2e_m2_3, D=gwp_kgco2e_m2_4)
addition_2 = Addition(A=gwp_kgco2e, B=gwp_kgco2e_2, C=gwp_kgco2e_3, D=gwp_kgco2e_4)
gwp_kgco2e_5 = Panel(addition_2)
gwp_kgco2e_m2_5 = Panel(addition)
panel = Panel("Concrete Masonry Not-Insulated")
merge = Merge(Data1=opaquemat_4, Data2=opaquemat_3, Data3=opaquemat, Data4=opaquemat_2, Data5=opaquemat_5)
gwp_kgco2e_6 = Number(gwp_kgco2e_5)
economical_cobenefit = Panel("EMPLOYMENT AND INCOME GENERATION")
social_cobenefit = Panel("HEALTH IMPACTS")
environmental_cobenefit = Panel("AIR QUALITY")
gwp_kgco2e_7 = ClusterOutput(gwp_kgco2e_6)
gwp_kg_co2_m2 = Number(gwp_kgco2e_m2_5)
thermalemissivity = Panel("0.90")
albedo_5 = Panel("0.65")
name = Data(panel)
opaqueconstr = HBOpaqueConstruction(name=panel, materials=merge)  # -> constr; plug-in component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
gwp_kg_co2_m2_2 = ClusterOutput(gwp_kg_co2_m2)
name_2 = ClusterOutput(name)
decnstrconstr = HBDeconstructConstruction(constr=opaqueconstr)  # -> materials, layers, r_val_si, r_val_ip, u_fac_si, u_fac_ip, shgc, t_sol, t_vis; plug-in component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
constr = ClusterOutput(opaqueconstr)
economic_cobenefit = Text(economical_cobenefit)
social_cobenefit_2 = Text(social_cobenefit)
albedo_6 = Number(albedo_5)
environmental_cobenefit_2 = Text(environmental_cobenefit)
thermalemissivity_2 = Number(thermalemissivity)
economic_cobenefit_2 = ClusterOutput(economic_cobenefit)
albedo_7 = ClusterOutput(albedo_6)
thermalemissivity_3 = ClusterOutput(thermalemissivity_2)
environmental_cobenefit_3 = ClusterOutput(environmental_cobenefit_2)
social_cobenefit_3 = ClusterOutput(social_cobenefit_2)
u_fac_si = ClusterOutput(decnstrconstr.u_fac_si)
panel_2 = Panel(decnstrconstr.u_fac_si)

# ==== cluster Muratura_calcestruzzo_medio_isolato_esterno
m2_wall = ClusterInput()
m2_wall_2 = Data(m2_wall)

# ---- group: GWP (intonaco)
spessore_m = Panel("0.02")
densità_kg_m3 = Panel("1500")
multiplication = Multiplication(A=spessore_m, B=m2_wall_2)
volume_m3 = Panel(multiplication)
multiplication_2 = Multiplication(A=volume_m3, B=densità_kg_m3)
ecc_kgco2e_kg = Panel("0.13")
massa_kg = Panel(multiplication_2)
multiplication_3 = Multiplication(A=massa_kg, B=ecc_kgco2e_kg)
gwp_kgco2e = Panel(multiplication_3)
division = Division(A=gwp_kgco2e, B=m2_wall_2)
gwp_kgco2e_m2 = Panel(division)

# ---- group: GWP (isolante)
spessore_m_2 = Panel("0.2")
densità_kg_m3_2 = Panel("100")
multiplication_4 = Multiplication(A=spessore_m_2, B=m2_wall_2)
volume_m3_2 = Panel(multiplication_4)
multiplication_5 = Multiplication(A=volume_m3_2, B=densità_kg_m3_2)
ecc_kgco2e_kg_2 = Panel("1.12")
massa_kg_2 = Panel(multiplication_5)
multiplication_6 = Multiplication(A=massa_kg_2, B=ecc_kgco2e_kg_2)
gwp_kgco2e_2 = Panel(multiplication_6)
division_2 = Division(A=gwp_kgco2e_2, B=m2_wall_2)
gwp_kgco2e_m2_2 = Panel(division_2)

# ---- group: GWP (cls)
spessore_m_3 = Panel("0.05")
densità_kg_m3_3 = Panel("2400")
multiplication_7 = Multiplication(A=spessore_m_3, B=m2_wall_2)
volume_m3_3 = Panel(multiplication_7)
multiplication_8 = Multiplication(A=volume_m3_3, B=densità_kg_m3_3)
ecc_kgco2e_kg_3 = Panel("0.1")
massa_kg_3 = Panel(multiplication_8)
multiplication_9 = Multiplication(A=massa_kg_3, B=ecc_kgco2e_kg_3)
gwp_kgco2e_3 = Panel(multiplication_9)
division_3 = Division(A=gwp_kgco2e_3, B=m2_wall_2)
gwp_kgco2e_m2_3 = Panel(division_3)

spessore_m_4 = Panel("0.2")
densità_kg_m3_4 = Panel("2400")
multiplication_10 = Multiplication(A=spessore_m_4, B=m2_wall_2)
volume_m3_4 = Panel(multiplication_10)
multiplication_11 = Multiplication(A=volume_m3_4, B=densità_kg_m3_4)
ecc_kgco2e_kg_4 = Panel("0.1")
massa_kg_4 = Panel(multiplication_11)
multiplication_12 = Multiplication(A=massa_kg_4, B=ecc_kgco2e_kg_4)
gwp_kgco2e_4 = Panel(multiplication_12)
division_4 = Division(A=gwp_kgco2e_4, B=m2_wall_2)
gwp_kgco2e_m2_4 = Panel(division_4)

# ---- group: GWP (intonaco)
spessore_m_5 = Panel("0.02")
densità_kg_m3_5 = Panel("1500")
multiplication_13 = Multiplication(A=spessore_m_5, B=m2_wall_2)
volume_m3_5 = Panel(multiplication_13)
multiplication_14 = Multiplication(A=volume_m3_5, B=densità_kg_m3_5)
ecc_kgco2e_kg_5 = Panel("0.13")
massa_kg_5 = Panel(multiplication_14)
multiplication_15 = Multiplication(A=massa_kg_5, B=ecc_kgco2e_kg_5)
gwp_kgco2e_5 = Panel(multiplication_15)
division_5 = Division(A=gwp_kgco2e_5, B=m2_wall_2)
gwp_kgco2e_m2_5 = Panel(division_5)

# ----
albedo = Panel("0.650")
albedo_2 = Panel("0.7")
albedo_3 = Panel("0.25")
albedo_4 = Panel("0.25")
albedo_5 = Panel("0.650")
subtraction = Subtraction(A="1", B=albedo_2)
subtraction_2 = Subtraction(A="1", B=albedo)
subtraction_3 = Subtraction(A="1", B=albedo_3)
subtraction_4 = Subtraction(A="1", B=albedo_4)
subtraction_5 = Subtraction(A="1", B=albedo_5)
opaquemat = HBOpaqueMaterial(
    name="Isolante",
    thickness="0.05",
    conductivity="0.045",
    density="100",
    spec_heat="840",
    therm_absp="0.1",
    sol_absp=subtraction,
    vis_absp=subtraction)  # -> mat; plug-in component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
opaquemat_2 = HBOpaqueMaterial(
    name="Intonaco_esterno",
    thickness="0.02",
    conductivity="0.7",
    density="1500",
    spec_heat="1000",
    therm_absp="0.9",
    sol_absp=subtraction_2,
    vis_absp=subtraction_2)  # -> mat; plug-in component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
opaquemat_3 = HBOpaqueMaterial(
    name="custom_air_gap",
    thickness="0.05",
    conductivity="0.278",
    density="1.28",
    spec_heat="1000",
    roughness="Smooth",
    therm_absp="0.9",
    sol_absp="0.7",
    vis_absp="0.7")  # -> mat; plug-in component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
opaquemat_4 = HBOpaqueMaterial(
    name="Calcestruzzo",
    thickness="0.2",
    conductivity="1.7",
    density="2400",
    spec_heat="1000",
    therm_absp="0.9",
    sol_absp=subtraction_3,
    vis_absp=subtraction_3)  # -> mat; plug-in component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
opaquemat_5 = HBOpaqueMaterial(
    name="Calcestruzzo",
    thickness="0.2",
    conductivity="1.7",
    density="2400",
    spec_heat="1000",
    therm_absp="0.9",
    sol_absp=subtraction_4,
    vis_absp=subtraction_4)  # -> mat; plug-in component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
opaquemat_6 = HBOpaqueMaterial(
    name="Intonaco_interno",
    thickness="0.02",
    conductivity="0.7",
    density="1500",
    spec_heat="1000",
    therm_absp="0.9",
    sol_absp=subtraction_5,
    vis_absp=subtraction_5)  # -> mat; plug-in component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
panel = Panel("Concrete Masonry Medium Insulated External")
economical_cobenefit = Panel("EMPLOYMENT AND INCOME GENERATION")
environmental_cobenefit = Panel("AIR QUALITY")
social_cobenefit = Panel("HEALTH IMPACTS")
merge = Merge(Data1=opaquemat_2, Data2=opaquemat, Data3=opaquemat_5, Data4=opaquemat_3, Data5=opaquemat_4, Data6=opaquemat_6)
thermalemissivity = Panel("0.90")
albedo_6 = Panel("0.65")
opaqueconstr = HBOpaqueConstruction(name=panel, materials=merge)  # -> constr; plug-in component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
name = Data(panel)
name_2 = ClusterOutput(name)
economic_cobenefit = Text(economical_cobenefit)
social_cobenefit_2 = Text(social_cobenefit)
albedo_7 = Number(albedo_6)
decnstrconstr = HBDeconstructConstruction(constr=opaqueconstr)  # -> materials, layers, r_val_si, r_val_ip, u_fac_si, u_fac_ip, shgc, t_sol, t_vis; plug-in component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
environmental_cobenefit_2 = Text(environmental_cobenefit)
thermalemissivity_2 = Number(thermalemissivity)
constr = ClusterOutput(opaqueconstr)
economic_cobenefit_2 = ClusterOutput(economic_cobenefit)
albedo_8 = ClusterOutput(albedo_7)
thermalemissivity_3 = ClusterOutput(thermalemissivity_2)
environmental_cobenefit_3 = ClusterOutput(environmental_cobenefit_2)
social_cobenefit_3 = ClusterOutput(social_cobenefit_2)
u_fac_si = ClusterOutput(decnstrconstr.u_fac_si)
panel_2 = Panel(decnstrconstr.u_fac_si)
addition = Addition(A=gwp_kgco2e_m2, B=gwp_kgco2e_m2_3, C=gwp_kgco2e_m2_2, D=gwp_kgco2e_m2_4, E=gwp_kgco2e_m2_5)
addition_2 = Addition(A=gwp_kgco2e, B=gwp_kgco2e_3, C=gwp_kgco2e_2, D=gwp_kgco2e_4, E=gwp_kgco2e_5)
gwp_kgco2e_6 = Panel(addition_2)
gwp_kgco2e_m2_6 = Panel(addition)
gwp_kgco2e_7 = Number(gwp_kgco2e_6)
gwp_kg_co2_m2 = Number(gwp_kgco2e_m2_6)
gwp_kgco2e_8 = ClusterOutput(gwp_kgco2e_7)
gwp_kg_co2_m2_2 = ClusterOutput(gwp_kg_co2_m2)

# ==== cluster Muratura_calcestruzzo_medio_isolato_interno
m2_wall = ClusterInput()
m2_wall_2 = Data(m2_wall)
albedo = Panel("0.650")
albedo_2 = Panel("0.25")
albedo_3 = Panel("0.7")
albedo_4 = Panel("0.25")
albedo_5 = Panel("0.650")
subtraction = Subtraction(A="1", B=albedo_2)
subtraction_2 = Subtraction(A="1", B=albedo)
subtraction_3 = Subtraction(A="1", B=albedo_3)
subtraction_4 = Subtraction(A="1", B=albedo_4)
subtraction_5 = Subtraction(A="1", B=albedo_5)
opaquemat = HBOpaqueMaterial(
    name="Calcestruzzo",
    thickness="0.2",
    conductivity="1.7",
    density="2400",
    spec_heat="1000",
    therm_absp="0.9",
    sol_absp=subtraction,
    vis_absp=subtraction)  # -> mat; plug-in component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
opaquemat_2 = HBOpaqueMaterial(
    name="Intonaco_esterno",
    thickness="0.02",
    conductivity="0.7",
    density="1500",
    spec_heat="1000",
    therm_absp="0.9",
    sol_absp=subtraction_2,
    vis_absp=subtraction_2)  # -> mat; plug-in component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
opaquemat_3 = HBOpaqueMaterial(
    name="Isolante",
    thickness="0.05",
    conductivity="0.045",
    density="100",
    spec_heat="840",
    therm_absp="0.1",
    sol_absp=subtraction_3,
    vis_absp=subtraction_3)  # -> mat; plug-in component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
opaquemat_4 = HBOpaqueMaterial(
    name="Calcestruzzo",
    thickness="0.2",
    conductivity="1.7",
    density="2400",
    spec_heat="1000",
    therm_absp="0.9",
    sol_absp=subtraction_4,
    vis_absp=subtraction_4)  # -> mat; plug-in component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

# ---- group: GWP (intonaco)
spessore_m = Panel("0.02")
densità_kg_m3 = Panel("1500")
multiplication = Multiplication(A=spessore_m, B=m2_wall_2)
volume_m3 = Panel(multiplication)
multiplication_2 = Multiplication(A=volume_m3, B=densità_kg_m3)
ecc_kgco2e_kg = Panel("0.13")
massa_kg = Panel(multiplication_2)
multiplication_3 = Multiplication(A=massa_kg, B=ecc_kgco2e_kg)
gwp_kgco2e = Panel(multiplication_3)
division = Division(A=gwp_kgco2e, B=m2_wall_2)
gwp_kgco2e_m2 = Panel(division)

# ----
opaquemat_5 = HBOpaqueMaterial(
    name="Intonaco_interno",
    thickness="0.02",
    conductivity="0.7",
    density="1500",
    spec_heat="1000",
    therm_absp="0.9",
    sol_absp=subtraction_5,
    vis_absp=subtraction_5)  # -> mat; plug-in component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

# ---- group: GWP (isolante)
spessore_m_2 = Panel("0.2")
densità_kg_m3_2 = Panel("100")
multiplication_4 = Multiplication(A=spessore_m_2, B=m2_wall_2)
volume_m3_2 = Panel(multiplication_4)
multiplication_5 = Multiplication(A=volume_m3_2, B=densità_kg_m3_2)
ecc_kgco2e_kg_2 = Panel("1.12")
massa_kg_2 = Panel(multiplication_5)
multiplication_6 = Multiplication(A=massa_kg_2, B=ecc_kgco2e_kg_2)
gwp_kgco2e_2 = Panel(multiplication_6)
division_2 = Division(A=gwp_kgco2e_2, B=m2_wall_2)
gwp_kgco2e_m2_2 = Panel(division_2)

# ---- group: GWP (cls)
spessore_m_3 = Panel("0.05")
densità_kg_m3_3 = Panel("2400")
multiplication_7 = Multiplication(A=spessore_m_3, B=m2_wall_2)
volume_m3_3 = Panel(multiplication_7)
multiplication_8 = Multiplication(A=volume_m3_3, B=densità_kg_m3_3)
ecc_kgco2e_kg_3 = Panel("0.1")
massa_kg_3 = Panel(multiplication_8)
multiplication_9 = Multiplication(A=massa_kg_3, B=ecc_kgco2e_kg_3)
gwp_kgco2e_3 = Panel(multiplication_9)
division_3 = Division(A=gwp_kgco2e_3, B=m2_wall_2)
gwp_kgco2e_m2_3 = Panel(division_3)

spessore_m_4 = Panel("0.2")
densità_kg_m3_4 = Panel("2400")
multiplication_10 = Multiplication(A=spessore_m_4, B=m2_wall_2)
volume_m3_4 = Panel(multiplication_10)
multiplication_11 = Multiplication(A=volume_m3_4, B=densità_kg_m3_4)
ecc_kgco2e_kg_4 = Panel("0.1")
massa_kg_4 = Panel(multiplication_11)
multiplication_12 = Multiplication(A=massa_kg_4, B=ecc_kgco2e_kg_4)
gwp_kgco2e_4 = Panel(multiplication_12)
division_4 = Division(A=gwp_kgco2e_4, B=m2_wall_2)
gwp_kgco2e_m2_4 = Panel(division_4)

# ---- group: GWP (intonaco)
spessore_m_5 = Panel("0.02")
densità_kg_m3_5 = Panel("1500")
multiplication_13 = Multiplication(A=spessore_m_5, B=m2_wall_2)
volume_m3_5 = Panel(multiplication_13)
multiplication_14 = Multiplication(A=volume_m3_5, B=densità_kg_m3_5)
ecc_kgco2e_kg_5 = Panel("0.13")
massa_kg_5 = Panel(multiplication_14)
multiplication_15 = Multiplication(A=massa_kg_5, B=ecc_kgco2e_kg_5)
gwp_kgco2e_5 = Panel(multiplication_15)
division_5 = Division(A=gwp_kgco2e_5, B=m2_wall_2)
gwp_kgco2e_m2_5 = Panel(division_5)

# ----
economical_cobenefit = Panel("EMPLOYMENT AND INCOME GENERATION")
panel = Panel("Concrete Masonry Medium Insulated Internal")
social_cobenefit = Panel("HEALTH IMPACTS")
environmental_cobenefit = Panel("AIR QUALITY")
merge = Merge(Data1=opaquemat_2, Data2=opaquemat, Data3=opaquemat_3, Data4=opaquemat_4, Data5=opaquemat_5)
thermalemissivity = Panel("0.90")
albedo_6 = Panel("0.65")
name = Data(panel)
opaqueconstr = HBOpaqueConstruction(name=panel, materials=merge)  # -> constr; plug-in component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
name_2 = ClusterOutput(name)
economic_cobenefit = Text(economical_cobenefit)
social_cobenefit_2 = Text(social_cobenefit)
albedo_7 = Number(albedo_6)
environmental_cobenefit_2 = Text(environmental_cobenefit)
thermalemissivity_2 = Number(thermalemissivity)
decnstrconstr = HBDeconstructConstruction(constr=opaqueconstr)  # -> materials, layers, r_val_si, r_val_ip, u_fac_si, u_fac_ip, shgc, t_sol, t_vis; plug-in component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
economic_cobenefit_2 = ClusterOutput(economic_cobenefit)
albedo_8 = ClusterOutput(albedo_7)
constr = ClusterOutput(opaqueconstr)
thermalemissivity_3 = ClusterOutput(thermalemissivity_2)
environmental_cobenefit_3 = ClusterOutput(environmental_cobenefit_2)
social_cobenefit_3 = ClusterOutput(social_cobenefit_2)
panel_2 = Panel(decnstrconstr.u_fac_si)
u_fac_si = ClusterOutput(decnstrconstr.u_fac_si)
addition = Addition(A=gwp_kgco2e_m2, B=gwp_kgco2e_m2_3, C=gwp_kgco2e_m2_2, D=gwp_kgco2e_m2_4, E=gwp_kgco2e_m2_5)
addition_2 = Addition(A=gwp_kgco2e, B=gwp_kgco2e_3, C=gwp_kgco2e_2, D=gwp_kgco2e_4, E=gwp_kgco2e_5)
gwp_kgco2e_m2_6 = Panel(addition)
gwp_kgco2e_6 = Panel(addition_2)
gwp_kg_co2_m2 = Number(gwp_kgco2e_m2_6)
gwp_kgco2e_7 = Number(gwp_kgco2e_6)
gwp_kg_co2_m2_2 = ClusterOutput(gwp_kg_co2_m2)
gwp_kgco2e_8 = ClusterOutput(gwp_kgco2e_7)

# ==== cluster Muratura_calcestruzzo_altamente_isolato
m2_wall = ClusterInput()
m2_wall_2 = Data(m2_wall)
albedo = Panel("0.7")
albedo_2 = Panel("0.25")
albedo_3 = Panel("0.650")
albedo_4 = Panel("0.650")
albedo_5 = Panel("0.25")
subtraction = Subtraction(A="1", B=albedo_2)
subtraction_2 = Subtraction(A="1", B=albedo)
subtraction_3 = Subtraction(A="1", B=albedo_3)
subtraction_4 = Subtraction(A="1", B=albedo_5)
subtraction_5 = Subtraction(A="1", B=albedo_4)
opaquemat = HBOpaqueMaterial(
    name="custom_air_gap",
    thickness="0.05",
    conductivity="0.278",
    density="1.28",
    spec_heat="1000",
    roughness="Smooth",
    therm_absp="0.9",
    sol_absp="0.7",
    vis_absp="0.7")  # -> mat; plug-in component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
opaquemat_2 = HBOpaqueMaterial(
    name="Calcestruzzo",
    thickness="0.2",
    conductivity="1.7",
    density="2400",
    spec_heat="1000",
    therm_absp="0.9",
    sol_absp=subtraction,
    vis_absp=subtraction)  # -> mat; plug-in component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
opaquemat_3 = HBOpaqueMaterial(
    name="Isolante",
    thickness="0.1",
    conductivity="0.032",
    density="30",
    spec_heat="1250",
    therm_absp="0.1",
    sol_absp=subtraction_2,
    vis_absp=subtraction_2)  # -> mat; plug-in component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
opaquemat_4 = HBOpaqueMaterial(
    name="Calcestruzzo",
    thickness="0.2",
    conductivity="1.7",
    density="2400",
    spec_heat="1000",
    therm_absp="0.9",
    sol_absp=subtraction_4,
    vis_absp=subtraction_4)  # -> mat; plug-in component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
opaquemat_5 = HBOpaqueMaterial(
    name="Intonaco_esterno",
    thickness="0.02",
    conductivity="0.7",
    density="1500",
    spec_heat="1000",
    therm_absp="0.9",
    sol_absp=subtraction_3,
    vis_absp=subtraction_3)  # -> mat; plug-in component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
opaquemat_6 = HBOpaqueMaterial(
    name="Intonaco_interno",
    thickness="0.02",
    conductivity="0.7",
    density="1500",
    spec_heat="1000",
    therm_absp="0.9",
    sol_absp=subtraction_5,
    vis_absp=subtraction_5)  # -> mat; plug-in component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

# ---- group: GWP (intonaco)
spessore_m = Panel("0.02")
densità_kg_m3 = Panel("1500")
multiplication = Multiplication(A=spessore_m, B=m2_wall_2)
volume_m3 = Panel(multiplication)
multiplication_2 = Multiplication(A=volume_m3, B=densità_kg_m3)
ecc_kgco2e_kg = Panel("0.13")
massa_kg = Panel(multiplication_2)
multiplication_3 = Multiplication(A=massa_kg, B=ecc_kgco2e_kg)
gwp_kgco2e = Panel(multiplication_3)
division = Division(A=gwp_kgco2e, B=m2_wall_2)
gwp_kgco2e_m2 = Panel(division)

# ---- group: GWP (isolante)
spessore_m_2 = Panel("0.1")
densità_kg_m3_2 = Panel("30")
multiplication_4 = Multiplication(A=spessore_m_2, B=m2_wall_2)
volume_m3_2 = Panel(multiplication_4)
multiplication_5 = Multiplication(A=volume_m3_2, B=densità_kg_m3_2)
ecc_kgco2e_kg_2 = Panel("4.78")
massa_kg_2 = Panel(multiplication_5)
multiplication_6 = Multiplication(A=massa_kg_2, B=ecc_kgco2e_kg_2)
gwp_kgco2e_2 = Panel(multiplication_6)
division_2 = Division(A=gwp_kgco2e_2, B=m2_wall_2)
gwp_kgco2e_m2_2 = Panel(division_2)

# ---- group: GWP (cls)
spessore_m_3 = Panel("0.05")
densità_kg_m3_3 = Panel("2400")
multiplication_7 = Multiplication(A=spessore_m_3, B=m2_wall_2)
volume_m3_3 = Panel(multiplication_7)
multiplication_8 = Multiplication(A=volume_m3_3, B=densità_kg_m3_3)
ecc_kgco2e_kg_3 = Panel("0.1")
massa_kg_3 = Panel(multiplication_8)
multiplication_9 = Multiplication(A=massa_kg_3, B=ecc_kgco2e_kg_3)
gwp_kgco2e_3 = Panel(multiplication_9)
division_3 = Division(A=gwp_kgco2e_3, B=m2_wall_2)
gwp_kgco2e_m2_3 = Panel(division_3)

spessore_m_4 = Panel("0.2")
densità_kg_m3_4 = Panel("2400")
multiplication_10 = Multiplication(A=spessore_m_4, B=m2_wall_2)
volume_m3_4 = Panel(multiplication_10)
multiplication_11 = Multiplication(A=volume_m3_4, B=densità_kg_m3_4)
ecc_kgco2e_kg_4 = Panel("0.1")
massa_kg_4 = Panel(multiplication_11)
multiplication_12 = Multiplication(A=massa_kg_4, B=ecc_kgco2e_kg_4)
gwp_kgco2e_4 = Panel(multiplication_12)
division_4 = Division(A=gwp_kgco2e_4, B=m2_wall_2)
gwp_kgco2e_m2_4 = Panel(division_4)

# ---- group: GWP (intonaco)
spessore_m_5 = Panel("0.02")
densità_kg_m3_5 = Panel("1500")
multiplication_13 = Multiplication(A=spessore_m_5, B=m2_wall_2)
volume_m3_5 = Panel(multiplication_13)
multiplication_14 = Multiplication(A=volume_m3_5, B=densità_kg_m3_5)
ecc_kgco2e_kg_5 = Panel("0.13")
massa_kg_5 = Panel(multiplication_14)
multiplication_15 = Multiplication(A=massa_kg_5, B=ecc_kgco2e_kg_5)
gwp_kgco2e_5 = Panel(multiplication_15)
division_5 = Division(A=gwp_kgco2e_5, B=m2_wall_2)
gwp_kgco2e_m2_5 = Panel(division_5)

# ----
economical_cobenefit = Panel("EMPLOYMENT AND INCOME GENERATION")
social_cobenefit = Panel("HEALTH IMPACTS")
environmental_cobenefit = Panel("AIR QUALITY")
panel = Panel("Concrete Masonry Highly Insulated")
thermalemissivity = Panel("0.90")
albedo_6 = Panel("0.65")
merge = Merge(Data1=opaquemat_5, Data2=opaquemat_3, Data3=opaquemat_4, Data4=opaquemat, Data5=opaquemat_2, Data6=opaquemat_6)
name = Data(panel)
name_2 = ClusterOutput(name)
opaqueconstr = HBOpaqueConstruction(name=panel, materials=merge)  # -> constr; plug-in component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
economic_cobenefit = Text(economical_cobenefit)
social_cobenefit_2 = Text(social_cobenefit)
albedo_7 = Number(albedo_6)
environmental_cobenefit_2 = Text(environmental_cobenefit)
thermalemissivity_2 = Number(thermalemissivity)
economic_cobenefit_2 = ClusterOutput(economic_cobenefit)
albedo_8 = ClusterOutput(albedo_7)
thermalemissivity_3 = ClusterOutput(thermalemissivity_2)
environmental_cobenefit_3 = ClusterOutput(environmental_cobenefit_2)
social_cobenefit_3 = ClusterOutput(social_cobenefit_2)
constr = ClusterOutput(opaqueconstr)
decnstrconstr = HBDeconstructConstruction(constr=opaqueconstr)  # -> materials, layers, r_val_si, r_val_ip, u_fac_si, u_fac_ip, shgc, t_sol, t_vis; plug-in component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
u_fac_si = ClusterOutput(decnstrconstr.u_fac_si)
panel_2 = Panel(decnstrconstr.u_fac_si)
addition = Addition(A=gwp_kgco2e, B=gwp_kgco2e_3, C=gwp_kgco2e_2, D=gwp_kgco2e_4, E=gwp_kgco2e_5)
addition_2 = Addition(A=gwp_kgco2e_m2, B=gwp_kgco2e_m2_3, C=gwp_kgco2e_m2_2, D=gwp_kgco2e_m2_4, E=gwp_kgco2e_m2_5)
gwp_kgco2e_6 = Panel(addition)
gwp_kgco2e_m2_6 = Panel(addition_2)
gwp_kgco2e_7 = Number(gwp_kgco2e_6)
gwp_kgco2e_8 = ClusterOutput(gwp_kgco2e_7)
gwp_kg_co2_m2 = Number(gwp_kgco2e_m2_6)
gwp_kg_co2_m2_2 = ClusterOutput(gwp_kg_co2_m2)

# ==== cluster PACCHETTOLEGNOASECCO
m2_wall = ClusterInput()
m2_wall_2 = Data(m2_wall)

# ---- group: GWP(fibradilegno)
spessore_m = Panel("0.06")
densità_kg_m3 = Panel("230")
multiplication = Multiplication(A=spessore_m, B=m2_wall_2)
volume_m3 = Panel(multiplication)
ecc = Panel("-1.401")
ecc_2 = Panel("0.845")
multiplication_2 = Multiplication(A=volume_m3, B=densità_kg_m3)
addition = Addition(A=ecc_2, B=ecc)
ecc_kgco2e_kg = Panel(addition)
massa_kg = Panel(multiplication_2)
multiplication_3 = Multiplication(A=massa_kg, B=ecc_kgco2e_kg)
kgco2e = Panel(multiplication_3)
division = Division(A=kgco2e, B=m2_wall_2)
gwp_kgco2e_m2 = Panel(division)

# ---- group: GWP(XLAM)
spessore_m_2 = Panel("0.12")
densità_kg_m3_2 = Panel("470")
multiplication_4 = Multiplication(A=spessore_m_2, B=m2_wall_2)
volume_m3_2 = Panel(multiplication_4)
ecc_3 = Panel("0.512")
ecc_4 = Panel("-1.408")
multiplication_5 = Multiplication(A=volume_m3_2, B=densità_kg_m3_2)
addition_2 = Addition(A=ecc_3, B=ecc_4)
ecc_kgco2e_kg_2 = Panel(addition_2)
massa_kg_2 = Panel(multiplication_5)
multiplication_6 = Multiplication(A=massa_kg_2, B=ecc_kgco2e_kg_2)
kgco2e_2 = Panel(multiplication_6)
division_2 = Division(A=kgco2e_2, B=m2_wall_2)
gwp_kgco2e_m2_2 = Panel(division_2)

# ---- group: GWP(fibradilegno)
spessore_m_3 = Panel("0.06")
densità_kg_m3_3 = Panel("230")
multiplication_7 = Multiplication(A=spessore_m_3, B=m2_wall_2)
ecc_5 = Panel("-1.408")
volume_m3_3 = Panel(multiplication_7)
ecc_6 = Panel("0.845")
multiplication_8 = Multiplication(A=volume_m3_3, B=densità_kg_m3_3)
addition_3 = Addition(A=ecc_6, B=ecc_5)
ecc_kgco2e_kg_3 = Panel(addition_3)
massa_kg_3 = Panel(multiplication_8)
multiplication_9 = Multiplication(A=massa_kg_3, B=ecc_kgco2e_kg_3)
kgco2e_3 = Panel(multiplication_9)
division_3 = Division(A=kgco2e_3, B=m2_wall_2)
gwp_kgco2e_m2_3 = Panel(division_3)

# ---- group: GWP(tavolatogrezzo)
spessore_m_4 = Panel("0.024")
densità_kg_m3_4 = Panel("1350")
multiplication_10 = Multiplication(A=spessore_m_4, B=m2_wall_2)
volume_m3_4 = Panel(multiplication_10)
ecc_7 = Panel("-1.639")
ecc_8 = Panel("0.815")
multiplication_11 = Multiplication(A=volume_m3_4, B=densità_kg_m3_4)
addition_4 = Addition(A=ecc_8, B=ecc_7)
massa_kg_4 = Panel(multiplication_11)
ecc_kgco2e_kg_4 = Panel(addition_4)
multiplication_12 = Multiplication(A=massa_kg_4, B=ecc_kgco2e_kg_4)
kgco2e_4 = Panel(multiplication_12)
division_4 = Division(A=kgco2e_4, B=m2_wall_2)
gwp_kgco2e_m2_4 = Panel(division_4)

# ---- group: GWP(gessofibra)
spessore_m_5 = Panel("0.0125")
densità_kg_m3_5 = Panel("1180")
multiplication_13 = Multiplication(A=spessore_m_5, B=m2_wall_2)
volume_m3_5 = Panel(multiplication_13)
multiplication_14 = Multiplication(A=volume_m3_5, B=densità_kg_m3_5)
ecc_kgco2e_kg_5 = Panel("0.217")
massa_kg_5 = Panel(multiplication_14)
multiplication_15 = Multiplication(A=massa_kg_5, B=ecc_kgco2e_kg_5)
kgco2e_5 = Panel(multiplication_15)
division_5 = Division(A=kgco2e_5, B=m2_wall_2)
gwp_kgco2e_m2_5 = Panel(division_5)

# ----
subtraction = Subtraction(A="1", B="0.7")
opaquemat = HBOpaqueMaterial(name="Lastra in gessofibra", thickness="0.0125", conductivity="0.32", density="1180", spec_heat="1100")  # -> mat; plug-in component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
opaquemat_2 = HBOpaqueMaterial(
    name="Tavolato legno grezzo",
    thickness="0.024",
    conductivity="0.26",
    density="1350",
    spec_heat="1880",
    sol_absp=subtraction,
    vis_absp=subtraction)  # -> mat; plug-in component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
opaquemat_3 = HBOpaqueMaterial(name="Fibra di legno Fibertherm® Protect 230", thickness="0.06", conductivity="0.046", density="230", spec_heat="2100")  # -> mat; plug-in component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
opaquemat_4 = HBOpaqueMaterial(name="Fibra di legno Fibertherm® Protect 230", thickness="0.06", conductivity="0.046", density="230", spec_heat="2100")  # -> mat; plug-in component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
opaquemat_5 = HBOpaqueMaterial(name="XLAM", thickness="0.12", conductivity="0.12", density="470", spec_heat="1600")  # -> mat; plug-in component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
economical_cobenefit = Panel("EMPLOYMENT AND INCOME GENERATION")
environmental_cobenefit = Panel("AIR QUALITY")
social_cobenefit = Panel("HEALTH IMPACTS")
merge = Merge(Data1=opaquemat_2, Data2=opaquemat_3, Data3=opaquemat_5, Data4=opaquemat_4, Data5=opaquemat)
albedo = Panel("0.65")
thermalemissivity = Panel("0.90")
opaqueconstr = HBOpaqueConstruction(name="DRY WOOD PACKAGE", materials=merge)  # -> constr; plug-in component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
constr = ClusterOutput(opaqueconstr)
name = Text("DRY WOOD PACKAGE")
economic_cobenefit = Text(economical_cobenefit)
social_cobenefit_2 = Text(social_cobenefit)
albedo_2 = Number(albedo)
environmental_cobenefit_2 = Text(environmental_cobenefit)
thermalemissivity_2 = Number(thermalemissivity)
decnstrconstr = HBDeconstructConstruction(constr=opaqueconstr)  # -> materials, layers, r_val_si, r_val_ip, u_fac_si, u_fac_ip, shgc, t_sol, t_vis; plug-in component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
economic_cobenefit_2 = ClusterOutput(economic_cobenefit)
albedo_3 = ClusterOutput(albedo_2)
name_2 = ClusterOutput(name)
thermalemissivity_3 = ClusterOutput(thermalemissivity_2)
environmental_cobenefit_3 = ClusterOutput(environmental_cobenefit_2)
social_cobenefit_3 = ClusterOutput(social_cobenefit_2)
panel = Panel(decnstrconstr.u_fac_si)
u_fac_si = ClusterOutput(decnstrconstr.u_fac_si)
addition_5 = Addition(A=kgco2e_4, B=kgco2e, C=kgco2e_2, D=kgco2e_3, E=kgco2e_5)
addition_6 = Addition(A=gwp_kgco2e_m2_4, B=gwp_kgco2e_m2, C=gwp_kgco2e_m2_2, D=gwp_kgco2e_m2_3, E=gwp_kgco2e_m2_5)
gwp = Panel(addition_6)
gwp_kgco2e = Panel(addition_5)
gwp_kg_co2_m2 = Number(gwp)
gwp_kgco2e_2 = Number(gwp_kgco2e)
gwp_kg_co2_m2_2 = ClusterOutput(gwp_kg_co2_m2)
gwp_kgco2e_3 = ClusterOutput(gwp_kgco2e_2)

# ==== cluster PACCHETTOLEGNOAUMIDO
m2_wall = ClusterInput()
m2_wall_2 = Data(m2_wall)

# ---- group: GWP(rivestimento)
spessore_m = Panel("0.02")
densità_kg_m3 = Panel("1650")
multiplication = Multiplication(A=spessore_m, B=m2_wall_2)
volume_m3 = Panel(multiplication)
multiplication_2 = Multiplication(A=volume_m3, B=densità_kg_m3)
ecc_kgco2e_kg = Panel("4.19")
massa_kg = Panel(multiplication_2)
multiplication_3 = Multiplication(A=massa_kg, B=ecc_kgco2e_kg)
kgco2e = Panel(multiplication_3)
division = Division(A=kgco2e, B=m2_wall_2)
gwp_kgco2e_m2 = Panel(division)

# ---- group: GWP(maltacementizia)
spessore_m_2 = Panel("0.01")
densità_kg_m3_2 = Panel("1400")
multiplication_4 = Multiplication(A=spessore_m_2, B=m2_wall_2)
volume_m3_2 = Panel(multiplication_4)
multiplication_5 = Multiplication(A=volume_m3_2, B=densità_kg_m3_2)
ecc_kgco2e_kg_2 = Panel("0.157")
massa_kg_2 = Panel(multiplication_5)
multiplication_6 = Multiplication(A=massa_kg_2, B=ecc_kgco2e_kg_2)
kgco2e_2 = Panel(multiplication_6)
division_2 = Division(A=kgco2e_2, B=m2_wall_2)
gwp_kgco2e_m2_2 = Panel(division_2)

spessore_m_3 = Panel("0.01")
densità_kg_m3_3 = Panel("1400")
multiplication_7 = Multiplication(A=spessore_m_3, B=m2_wall_2)
volume_m3_3 = Panel(multiplication_7)
multiplication_8 = Multiplication(A=volume_m3_3, B=densità_kg_m3_3)
ecc_kgco2e_kg_3 = Panel("0.157")
massa_kg_3 = Panel(multiplication_8)
multiplication_9 = Multiplication(A=massa_kg_3, B=ecc_kgco2e_kg_3)
kgco2e_3 = Panel(multiplication_9)
division_3 = Division(A=kgco2e_3, B=m2_wall_2)
gwp_kgco2e_m2_3 = Panel(division_3)

# ---- group: GWP(XLAM)
spessore_m_4 = Panel("0.15")
densità_kg_m3_4 = Panel("470")
multiplication_10 = Multiplication(A=spessore_m_4, B=m2_wall_2)
volume_m3_4 = Panel(multiplication_10)
ecc = Panel("0.512")
ecc_2 = Panel("-1.408")
multiplication_11 = Multiplication(A=volume_m3_4, B=densità_kg_m3_4)
addition = Addition(A=ecc, B=ecc_2)
ecc_kgco2e_kg_4 = Panel(addition)
massa_kg_4 = Panel(multiplication_11)
multiplication_12 = Multiplication(A=massa_kg_4, B=ecc_kgco2e_kg_4)
kgco2e_4 = Panel(multiplication_12)
division_4 = Division(A=kgco2e_4, B=m2_wall_2)
gwp_kgco2e_m2_4 = Panel(division_4)

# ---- group: GWP(fibradilegno)
spessore_m_5 = Panel("0.12")
densità_kg_m3_5 = Panel("230")
multiplication_13 = Multiplication(A=spessore_m_5, B=m2_wall_2)
volume_m3_5 = Panel(multiplication_13)
ecc_3 = Panel("-1.401")
multiplication_14 = Multiplication(A=volume_m3_5, B=densità_kg_m3_5)
ecc_4 = Panel("0.845")
addition_2 = Addition(A=ecc_4, B=ecc_3)
ecc_kgco2e_kg_5 = Panel(addition_2)
massa_kg_5 = Panel(multiplication_14)
multiplication_15 = Multiplication(A=massa_kg_5, B=ecc_kgco2e_kg_5)
kgco2e_5 = Panel(multiplication_15)
division_5 = Division(A=kgco2e_5, B=m2_wall_2)
gwp_kgco2e_m2_5 = Panel(division_5)

# ----
subtraction = Subtraction(A="1", B="0.7")

# ---- group: LEGNO
opaquemat = HBOpaqueMaterial(name="XLAM", thickness="0.15", conductivity="0.12", density="470", spec_heat="1600")  # -> mat; plug-in component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
opaquemat_2 = HBOpaqueMaterial(name="Mapetherm ar1gg", thickness="0.01", conductivity="0.32", density="1400", spec_heat="700")  # -> mat; plug-in component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
opaquemat_3 = HBOpaqueMaterial(name="Fibra di legno Fibertherm® Protect 230", thickness="0.12", conductivity="0.046", density="230", spec_heat="2100")  # -> mat; plug-in component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
opaquemat_4 = HBOpaqueMaterial(name="Mapetherm ar1gg", thickness="0.01", conductivity="0.32", density="1400", spec_heat="700")  # -> mat; plug-in component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
opaquemat_5 = HBOpaqueMaterial(
    name="Quarzolite Tonachino",
    thickness="0.02",
    conductivity="0.89",
    density="1650",
    spec_heat="1000",
    sol_absp=subtraction,
    vis_absp=subtraction)  # -> mat; plug-in component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

# ----
economical_cobenefit = Panel("EMPLOYMENT AND INCOME GENERATION")
social_cobenefit = Panel("HEALTH IMPACTS")
environmental_cobenefit = Panel("AIR QUALITY")
merge = Merge(Data1=opaquemat_5, Data2=opaquemat_4, Data3=opaquemat_3, Data4=opaquemat_2, Data5=opaquemat)
albedo = Panel("0.70")
thermalemissivity = Panel("0.90")
opaqueconstr = HBOpaqueConstruction(name="WET WOOD PACKAGE", materials=merge)  # -> constr; plug-in component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
name = Text("WET WOOD PACKAGE")
name_2 = ClusterOutput(name)
economic_cobenefit = Text(economical_cobenefit)
social_cobenefit_2 = Text(social_cobenefit)
albedo_2 = Number(albedo)
constr = ClusterOutput(opaqueconstr)
environmental_cobenefit_2 = Text(environmental_cobenefit)
decnstrconstr = HBDeconstructConstruction(constr=opaqueconstr)  # -> materials, layers, r_val_si, r_val_ip, u_fac_si, u_fac_ip, shgc, t_sol, t_vis; plug-in component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
thermalemissivity_2 = Number(thermalemissivity)
economic_cobenefit_2 = ClusterOutput(economic_cobenefit)
albedo_3 = ClusterOutput(albedo_2)
thermalemissivity_3 = ClusterOutput(thermalemissivity_2)
environmental_cobenefit_3 = ClusterOutput(environmental_cobenefit_2)
social_cobenefit_3 = ClusterOutput(social_cobenefit_2)
panel = Panel(decnstrconstr.u_fac_si)
u_fac_si = ClusterOutput(decnstrconstr.u_fac_si)
addition_3 = Addition(A=gwp_kgco2e_m2_4, B=gwp_kgco2e_m2_2, C=gwp_kgco2e_m2_5, D=gwp_kgco2e_m2_3, E=gwp_kgco2e_m2)
addition_4 = Addition(A=kgco2e_4, B=kgco2e_2, C=kgco2e_5, D=kgco2e_3, E=kgco2e)
gwp = Panel(addition_3)
gwp_kgco2e = Panel(addition_4)
gwp_kg_co2_m2 = Number(gwp)
gwp_kgco2e_2 = Number(gwp_kgco2e)
gwp_kgco2e_3 = ClusterOutput(gwp_kgco2e_2)
gwp_kg_co2_m2_2 = ClusterOutput(gwp_kg_co2_m2)

# ==== cluster PACCHETTOCALCESTRUZZOPARETEVENTILATA
m2_wall = ClusterInput()
m2_wall_2 = Data(m2_wall)

# ---- group: GWP (bloccotermico)
spessore_m = Panel("0.3")
densità_kg_m3 = Panel("550")
multiplication = Multiplication(A=spessore_m, B=m2_wall_2)
volume_m3 = Panel(multiplication)
multiplication_2 = Multiplication(A=volume_m3, B=densità_kg_m3)
ecc_kgco2e_kg = Panel("0.157")
massa_kg = Panel(multiplication_2)
multiplication_3 = Multiplication(A=massa_kg, B=ecc_kgco2e_kg)
kgco2e = Panel(multiplication_3)
division = Division(A=kgco2e, B=m2_wall_2)
gwp_kgco2e_m2 = Panel(division)

# ---- group: GWP (rivestimento)
spessore_m_2 = Panel("0.02")
densità_kg_m3_2 = Panel("1650")
multiplication_4 = Multiplication(A=spessore_m_2, B=m2_wall_2)
volume_m3_2 = Panel(multiplication_4)
multiplication_5 = Multiplication(A=volume_m3_2, B=densità_kg_m3_2)
ecc_kgco2e_kg_2 = Panel("4.19")
massa_kg_2 = Panel(multiplication_5)
multiplication_6 = Multiplication(A=massa_kg_2, B=ecc_kgco2e_kg_2)
kgco2e_2 = Panel(multiplication_6)
division_2 = Division(A=kgco2e_2, B=m2_wall_2)
gwp_kgco2e_m2_2 = Panel(division_2)

# ---- group: GWP(intonaco)
spessore_m_3 = Panel("0.02")
densità_kg_m3_3 = Panel("1500")
multiplication_7 = Multiplication(A=spessore_m_3, B=m2_wall_2)
volume_m3_3 = Panel(multiplication_7)
multiplication_8 = Multiplication(A=volume_m3_3, B=densità_kg_m3_3)
ecc_kgco2e_kg_3 = Panel("0.13")
massa_kg_3 = Panel(multiplication_8)
multiplication_9 = Multiplication(A=massa_kg_3, B=ecc_kgco2e_kg_3)
kgco2e_3 = Panel(multiplication_9)
division_3 = Division(A=kgco2e_3, B=m2_wall_2)
gwp_kgco2e_m2_3 = Panel(division_3)

# ---- group: GWP(EPS)
spessore_m_4 = Panel("0.1")
densità_kg_m3_4 = Panel("1000")
multiplication_10 = Multiplication(A=spessore_m_4, B=m2_wall_2)
volume_m3_4 = Panel(multiplication_10)
multiplication_11 = Multiplication(A=volume_m3_4, B=densità_kg_m3_4)
ecc_kgco2e_kg_4 = Panel("3.29")
massa_kg_4 = Panel(multiplication_11)
multiplication_12 = Multiplication(A=massa_kg_4, B=ecc_kgco2e_kg_4)
kgco2e_4 = Panel(multiplication_12)
division_4 = Division(A=kgco2e_4, B=m2_wall_2)
gwp_kgco2e_m2_4 = Panel(division_4)

# ---- group: GWP(rivestimento pareteventilata)
spessore_m_5 = Panel("0.0125")
densità_kg_m3_5 = Panel("1150")
multiplication_13 = Multiplication(A=spessore_m_5, B=m2_wall_2)
volume_m3_5 = Panel(multiplication_13)
multiplication_14 = Multiplication(A=volume_m3_5, B=densità_kg_m3_5)
ecc_kgco2e_kg_5 = Panel("0.13")
massa_kg_5 = Panel(multiplication_14)
multiplication_15 = Multiplication(A=massa_kg_5, B=ecc_kgco2e_kg_5)
kgco2e_5 = Panel(multiplication_15)
division_5 = Division(A=kgco2e_5, B=m2_wall_2)
gwp_kgco2e_m2_5 = Panel(division_5)

# ----
subtraction = Subtraction(A="1", B="0.6")

# ---- group: PACCHETTO CALCESTRUZZO CON PARETE VENTILATA
opaquemat = HBOpaqueMaterial(name="intonaco interno", thickness="0.02", conductivity="0.7", density="1500", spec_heat="1000")  # -> mat; plug-in component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
opaquemat_2 = HBOpaqueMaterial(name="Blocco Termico", thickness="0.3", conductivity="0.223", density="550", spec_heat="1000")  # -> mat; plug-in component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
opaquemat_3 = HBOpaqueMaterial(name="Quarzolite Base Coat", thickness="0.002", conductivity="1", density="1580", spec_heat="1000")  # -> mat; plug-in component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
opaquemat_4 = HBOpaqueMaterial(name="Quarzolite Tonachino", thickness="0.02", conductivity="0.89", density="1650", spec_heat="1000", sol_absp="0.7")  # -> mat; plug-in component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
opaquemat_5 = HBOpaqueMaterial(
    name="Acquapanel outdoor",
    thickness="0.0125",
    conductivity="0.35",
    density="1150",
    spec_heat="1000",
    sol_absp=subtraction,
    vis_absp=subtraction)  # -> mat; plug-in component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
opaquemat_6 = HBOpaqueMaterial(name="Mapetherm EPS 100 CAM", thickness="0.1", conductivity="0.035", density="1000", spec_heat="1260")  # -> mat; plug-in component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
opaquemat_7 = HBOpaqueMaterial(name="Camera d'aria", thickness="0.1", conductivity="0.08", density="1225", spec_heat="1005")  # -> mat; plug-in component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

# ----
economical_cobenefit = Panel("EMPLOYMENT AND INCOME GENERATION")
social_cobenefit = Panel("HEALTH IMPACTS")
environmental_cobenefit = Panel("AIR QUALITY")
merge = Merge(
    Data1=opaquemat_5,
    Data2=opaquemat_7,
    Data3=opaquemat_6,
    Data4=opaquemat_4,
    Data5=opaquemat_3,
    Data6=opaquemat_2,
    Data7=opaquemat)
thermalemissivity = Panel("0.90")
albedo = Panel("0.60")
opaqueconstr = HBOpaqueConstruction(name="VENTILATED WALL", materials=merge)  # -> constr; plug-in component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
name = Text("VENTILATED WALL")
economic_cobenefit = Text(economical_cobenefit)
social_cobenefit_2 = Text(social_cobenefit)
albedo_2 = Number(albedo)
environmental_cobenefit_2 = Text(environmental_cobenefit)
thermalemissivity_2 = Number(thermalemissivity)
constr = ClusterOutput(opaqueconstr)
economic_cobenefit_2 = ClusterOutput(economic_cobenefit)
albedo_3 = ClusterOutput(albedo_2)
thermalemissivity_3 = ClusterOutput(thermalemissivity_2)
name_2 = ClusterOutput(name)
environmental_cobenefit_3 = ClusterOutput(environmental_cobenefit_2)
social_cobenefit_3 = ClusterOutput(social_cobenefit_2)
decnstrconstr = HBDeconstructConstruction(constr=opaqueconstr)  # -> materials, layers, r_val_si, r_val_ip, u_fac_si, u_fac_ip, shgc, t_sol, t_vis; plug-in component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
u_fac_si = ClusterOutput(decnstrconstr.u_fac_si)
panel = Panel(decnstrconstr.materials)
addition = Addition(A=gwp_kgco2e_m2_3, B=gwp_kgco2e_m2, C=gwp_kgco2e_m2_2, D=gwp_kgco2e_m2_4, E=gwp_kgco2e_m2_5)
addition_2 = Addition(A=kgco2e_3, B=kgco2e, C=kgco2e_2, D=kgco2e_4, E=kgco2e_5)
gwp = Panel(addition)
gwp_kgco2e = Panel(addition_2)
gwp_kg_co2_m2 = Number(gwp)
gwp_kgco2e_2 = Number(gwp_kgco2e)
gwp_kgco2e_3 = ClusterOutput(gwp_kgco2e_2)
gwp_kg_co2_m2_2 = ClusterOutput(gwp_kg_co2_m2)

# ==== cluster PACCHETTOCALCESTRUZZO
m2_wall = ClusterInput()
m2_wall_2 = Data(m2_wall)

# ---- group: GWP (rivestimento)
spessore_m = Panel("0.02")
densità_kg_m3 = Panel("1650")
multiplication = Multiplication(A=spessore_m, B=m2_wall_2)
volume_m3 = Panel(multiplication)
multiplication_2 = Multiplication(A=volume_m3, B=densità_kg_m3)
ecc_kgco2e_kg = Panel("4.19")
massa_kg = Panel(multiplication_2)
multiplication_3 = Multiplication(A=massa_kg, B=ecc_kgco2e_kg)
kgco2e = Panel(multiplication_3)
division = Division(A=kgco2e, B=m2_wall_2)
gwp_kgco2e_m2 = Panel(division)

# ---- group: GWP(EPS)
spessore_m_2 = Panel("0.1")
densità_kg_m3_2 = Panel("1000")
multiplication_4 = Multiplication(A=spessore_m_2, B=m2_wall_2)
volume_m3_2 = Panel(multiplication_4)
multiplication_5 = Multiplication(A=volume_m3_2, B=densità_kg_m3_2)
ecc_kgco2e_kg_2 = Panel("3.29")
massa_kg_2 = Panel(multiplication_5)
multiplication_6 = Multiplication(A=massa_kg_2, B=ecc_kgco2e_kg_2)
kgco2e_2 = Panel(multiplication_6)
division_2 = Division(A=kgco2e_2, B=m2_wall_2)
gwp_kgco2e_m2_2 = Panel(division_2)

# ---- group: GWP (bloccotermico)
spessore_m_3 = Panel("0.3")
densità_kg_m3_3 = Panel("550")
multiplication_7 = Multiplication(A=spessore_m_3, B=m2_wall_2)
volume_m3_3 = Panel(multiplication_7)
multiplication_8 = Multiplication(A=volume_m3_3, B=densità_kg_m3_3)
ecc_kgco2e_kg_3 = Panel("0.157")
massa_kg_3 = Panel(multiplication_8)
multiplication_9 = Multiplication(A=massa_kg_3, B=ecc_kgco2e_kg_3)
kgco2e_3 = Panel(multiplication_9)
division_3 = Division(A=kgco2e_3, B=m2_wall_2)
gwp_kgco2e_m2_3 = Panel(division_3)

# ---- group: GWP(maltacementizia)
spessore_m_4 = Panel("0.01")
densità_kg_m3_4 = Panel("1400")
multiplication_10 = Multiplication(A=spessore_m_4, B=m2_wall_2)
volume_m3_4 = Panel(multiplication_10)
multiplication_11 = Multiplication(A=volume_m3_4, B=densità_kg_m3_4)
ecc_kgco2e_kg_4 = Panel("0.157")
massa_kg_4 = Panel(multiplication_11)
multiplication_12 = Multiplication(A=massa_kg_4, B=ecc_kgco2e_kg_4)
kgco2e_4 = Panel(multiplication_12)
division_4 = Division(A=kgco2e_4, B=m2_wall_2)
gwp_kgco2e_m2_4 = Panel(division_4)

spessore_m_5 = Panel("0.01")
densità_kg_m3_5 = Panel("1400")
multiplication_13 = Multiplication(A=spessore_m_5, B=m2_wall_2)
volume_m3_5 = Panel(multiplication_13)
multiplication_14 = Multiplication(A=volume_m3_5, B=densità_kg_m3_5)
ecc_kgco2e_kg_5 = Panel("0.157")
massa_kg_5 = Panel(multiplication_14)
multiplication_15 = Multiplication(A=massa_kg_5, B=ecc_kgco2e_kg_5)
kgco2e_5 = Panel(multiplication_15)
division_5 = Division(A=kgco2e_5, B=m2_wall_2)
gwp_kgco2e_m2_5 = Panel(division_5)

# ---- group: GWP(maltalivellante)
spessore_m_6 = Panel("0.02")
densità_kg_m3_6 = Panel("1830")
multiplication_16 = Multiplication(A=spessore_m_6, B=m2_wall_2)
volume_m3_6 = Panel(multiplication_16)
multiplication_17 = Multiplication(A=volume_m3_6, B=densità_kg_m3_6)
ecc_kgco2e_kg_6 = Panel("0.149")
massa_kg_6 = Panel(multiplication_17)
multiplication_18 = Multiplication(A=massa_kg_6, B=ecc_kgco2e_kg_6)
kgco2e_6 = Panel(multiplication_18)
division_6 = Division(A=kgco2e_6, B=m2_wall_2)
gwp_kgco2e_m2_6 = Panel(division_6)

# ---- group: GWP(intonaco)
spessore_m_7 = Panel("0.02")
densità_kg_m3_7 = Panel("1500")
multiplication_19 = Multiplication(A=spessore_m_7, B=m2_wall_2)
volume_m3_7 = Panel(multiplication_19)
multiplication_20 = Multiplication(A=volume_m3_7, B=densità_kg_m3_7)
ecc_kgco2e_kg_7 = Panel("0.13")
massa_kg_7 = Panel(multiplication_20)
multiplication_21 = Multiplication(A=massa_kg_7, B=ecc_kgco2e_kg_7)
kgco2e_7 = Panel(multiplication_21)
division_7 = Division(A=kgco2e_7, B=m2_wall_2)
gwp_kgco2e_m2_7 = Panel(division_7)

# ----
economical_cobenefit = Panel("EMPLOYMENT AND INCOME GENERATION")
environmental_cobenefit = Panel("AIR QUALITY")
social_cobenefit = Panel("HEALTH IMPACTS")
thermalemissivity = Panel("0.90")
albedo = Panel("0.70")
name = Text("CONCRETE PACKAGE")
economic_cobenefit = Text(economical_cobenefit)
name_2 = ClusterOutput(name)
social_cobenefit_2 = Text(social_cobenefit)
albedo_2 = Number(albedo)
environmental_cobenefit_2 = Text(environmental_cobenefit)
thermalemissivity_2 = Number(thermalemissivity)
economic_cobenefit_2 = ClusterOutput(economic_cobenefit)
albedo_3 = ClusterOutput(albedo_2)
thermalemissivity_3 = ClusterOutput(thermalemissivity_2)
environmental_cobenefit_3 = ClusterOutput(environmental_cobenefit_2)
social_cobenefit_3 = ClusterOutput(social_cobenefit_2)
addition = Addition(
    A=gwp_kgco2e_m2_7,
    B=gwp_kgco2e_m2_3,
    C=gwp_kgco2e_m2_6,
    D=gwp_kgco2e_m2_4,
    E=gwp_kgco2e_m2_2,
    F=gwp_kgco2e_m2_5,
    G=gwp_kgco2e_m2)
addition_2 = Addition(A=kgco2e_7, B=kgco2e_3, C=kgco2e_6, D=kgco2e_4, E=kgco2e_2, F=kgco2e_5, G=kgco2e)
gwp = Panel(addition)
gwp_kgco2e = Panel(addition_2)
gwp_kg_co2_m2 = Number(gwp)
gwp_kgco2e_2 = Number(gwp_kgco2e)
gwp_kg_co2_m2_2 = ClusterOutput(gwp_kg_co2_m2)
gwp_kgco2e_3 = ClusterOutput(gwp_kgco2e_2)

# ---- group: PACCHETTO CALCESTRUZZO
panel = Panel("0.7")
opaquemat = HBOpaqueMaterial(name="Quarzolite Base Coat", thickness="0.002", conductivity="1", density="1580", spec_heat="1000")  # -> mat; plug-in component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
opaquemat_2 = HBOpaqueMaterial(name="Mapetherm ar1gg", thickness="0.01", conductivity="0.32", density="1400", spec_heat="700")  # -> mat; plug-in component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
opaquemat_3 = HBOpaqueMaterial(name="Blocco Termico", thickness="0.3", conductivity="0.223", density="550", spec_heat="1000")  # -> mat; plug-in component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
opaquemat_4 = HBOpaqueMaterial(name="Nivoplan+Planicrete", thickness="0.02", conductivity="0.95", density="1830", spec_heat="700")  # -> mat; plug-in component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
opaquemat_5 = HBOpaqueMaterial(name="Mapetherm ar1gg", thickness="0.01", conductivity="0.32", density="1400", spec_heat="700")  # -> mat; plug-in component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
opaquemat_6 = HBOpaqueMaterial(name="Mapetherm EPS 100 CAM", thickness="0.1", conductivity="0.035", density="1000", spec_heat="1260")  # -> mat; plug-in component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
opaquemat_7 = HBOpaqueMaterial(name="intonaco interno", thickness="0.02", conductivity="0.7", density="1500", spec_heat="1000")  # -> mat; plug-in component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

# ----
subtraction = Subtraction(A="1", B=panel)

# ---- group: PACCHETTO CALCESTRUZZO (continued)
opaquemat_8 = HBOpaqueMaterial(
    name="Quarzolite Tonachino",
    thickness="0.02",
    conductivity="0.89",
    density="1650",
    spec_heat="1000",
    sol_absp=subtraction,
    vis_absp=subtraction)  # -> mat; plug-in component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

# ----
merge = Merge(
    Data1=opaquemat_8,
    Data2=opaquemat,
    Data3=opaquemat_2,
    Data4=opaquemat_6,
    Data5=opaquemat_5,
    Data6=opaquemat_4,
    Data7=opaquemat_3,
    Data8=opaquemat_7)
opaqueconstr = HBOpaqueConstruction(name="CONCRETE PACKAGE", materials=merge)  # -> constr; plug-in component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
constr = ClusterOutput(opaqueconstr)
decnstrconstr = HBDeconstructConstruction(constr=opaqueconstr)  # -> materials, layers, r_val_si, r_val_ip, u_fac_si, u_fac_ip, shgc, t_sol, t_vis; plug-in component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
u_fac_si = ClusterOutput(decnstrconstr.u_fac_si)
panel_2 = Panel(decnstrconstr.u_fac_si)

# ==== cluster Solaio_legno_non_isolato
m2_solaio = ClusterInput()
m2_solaio_2 = Data(m2_solaio)

# ---- group: GWP (tegole)
spessore_m = Panel("0.02")
densità_kg_m3 = Panel("1350")
multiplication = Multiplication(A=spessore_m, B=m2_solaio_2)
volume_m3 = Panel(multiplication)
multiplication_2 = Multiplication(A=volume_m3, B=densità_kg_m3)
ecc_kgco2e_kg = Panel("0.48")
massa_kg = Panel(multiplication_2)
multiplication_3 = Multiplication(A=massa_kg, B=ecc_kgco2e_kg)
gwp_kgco2e = Panel(multiplication_3)
division = Division(A=gwp_kgco2e, B=m2_solaio_2)
gwp_kgco2e_m2 = Panel(division)

# ---- group: GWP (tavolato )
spessore_m_2 = Panel("0.04")
densità_kg_m3_2 = Panel("450")
multiplication_4 = Multiplication(A=spessore_m_2, B=m2_solaio_2)
volume_m3_2 = Panel(multiplication_4)
multiplication_5 = Multiplication(A=volume_m3_2, B=densità_kg_m3_2)
ecc_kgco2e_kg_2 = Panel("0.493")
massa_kg_2 = Panel(multiplication_5)
multiplication_6 = Multiplication(A=massa_kg_2, B=ecc_kgco2e_kg_2)
gwp_kgco2e_2 = Panel(multiplication_6)
division_2 = Division(A=gwp_kgco2e_2, B=m2_solaio_2)
gwp_kgco2e_m2_2 = Panel(division_2)

# ----
subtraction = Subtraction(A="1", B="0.15")
subtraction_2 = Subtraction(A="1", B="0.4")
opaquemat = HBOpaqueMaterial(
    name="custom_air_gap",
    thickness="0.02",
    conductivity="0.125",
    density="1.28",
    spec_heat="1000",
    roughness="Smooth",
    therm_absp="0.9",
    sol_absp="0.7",
    vis_absp="0.7")  # -> mat; plug-in component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
opaquemat_2 = HBOpaqueMaterial(
    name="Tavolato_legno",
    thickness="0.04",
    conductivity="0.120",
    density="450",
    spec_heat="2200",
    therm_absp="0.85",
    sol_absp=subtraction,
    vis_absp=subtraction)  # -> mat; plug-in component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
opaquemat_3 = HBOpaqueMaterial(
    name="Tegole",
    thickness="0.02",
    conductivity="0.575",
    density="1350",
    spec_heat="840",
    therm_absp="0.91",
    sol_absp=subtraction_2,
    vis_absp=subtraction_2)  # -> mat; plug-in component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
panel = Panel("Timber floor not insulated")
merge = Merge(Data1=opaquemat_3, Data2=opaquemat, Data3=opaquemat_2)
economical_cobenefit = Panel("")
social_cobenefit = Panel("")
environmental_cobenefit = Panel("")
thermalemissivity = Panel("0.91")
albedo = Panel("0.4")
opaqueconstr = HBOpaqueConstruction(name=panel, materials=merge)  # -> constr; plug-in component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
name = Text(panel)
decnstrconstr = HBDeconstructConstruction(constr=opaqueconstr)  # -> materials, layers, r_val_si, r_val_ip, u_fac_si, u_fac_ip, shgc, t_sol, t_vis; plug-in component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
economic_cobenefit = Text(economical_cobenefit)
social_cobenefit_2 = Text(social_cobenefit)
albedo_2 = Number(albedo)
environmental_cobenefit_2 = Text(environmental_cobenefit)
thermalemissivity_2 = Number(thermalemissivity)
constr = ClusterOutput(opaqueconstr)
name_2 = ClusterOutput(name)
economic_cobenefit_2 = ClusterOutput(economic_cobenefit)
albedo_3 = ClusterOutput(albedo_2)
thermalemissivity_3 = ClusterOutput(thermalemissivity_2)
environmental_cobenefit_3 = ClusterOutput(environmental_cobenefit_2)
social_cobenefit_3 = ClusterOutput(social_cobenefit_2)
u_fac_si = ClusterOutput(decnstrconstr.u_fac_si)
panel_2 = Panel(decnstrconstr.u_fac_si)
addition = Addition(A=gwp_kgco2e_m2, B=gwp_kgco2e_m2_2)
addition_2 = Addition(A=gwp_kgco2e, B=gwp_kgco2e_2)
gwp_kgco2e_m2_3 = Panel(addition)
gwp_kgco2 = Panel(addition_2)
gwp_kgco2e_m2_4 = Number(gwp_kgco2e_m2_3)
gwp_kgco2e_m2_5 = ClusterOutput(gwp_kgco2e_m2_4)
gwp_kgco2e_3 = Number(gwp_kgco2)
gwp_kgco2e_4 = ClusterOutput(gwp_kgco2e_3)

# ==== cluster Solaio_legno_scarso_isolato
m2_solaio = ClusterInput()
m2_solaio_2 = Data(m2_solaio)
subtraction = Subtraction(A="1", B="0.4")
subtraction_2 = Subtraction(A="1", B="0.15")
subtraction_3 = Subtraction(A="1", B="0.15")
subtraction_4 = Subtraction(A="1", B="0.7")
opaquemat = HBOpaqueMaterial(
    name="Tegole",
    thickness="0.02",
    conductivity="0.575",
    density="1350",
    spec_heat="840",
    therm_absp="0.91",
    sol_absp=subtraction,
    vis_absp=subtraction)  # -> mat; plug-in component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
opaquemat_2 = HBOpaqueMaterial(
    name="custom_air_gap",
    thickness="0.02",
    conductivity="0.125",
    density="1.28",
    spec_heat="1000",
    roughness="Smooth",
    therm_absp="0.9",
    sol_absp="0.7",
    vis_absp="0.7")  # -> mat; plug-in component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
opaquemat_3 = HBOpaqueMaterial(
    name="Tavolato_legno",
    thickness="0.02",
    conductivity="0.120",
    density="450",
    spec_heat="2200",
    therm_absp="0.85",
    sol_absp=subtraction_2,
    vis_absp=subtraction_2)  # -> mat; plug-in component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
opaquemat_4 = HBOpaqueMaterial(
    name="Tavolato_legno",
    thickness="0.02",
    conductivity="0.120",
    density="450",
    spec_heat="2200",
    therm_absp="0.85",
    sol_absp=subtraction_3,
    vis_absp=subtraction_3)  # -> mat; plug-in component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
opaquemat_5 = HBOpaqueMaterial(
    name="Isolante",
    thickness="0.02",
    conductivity="0.045",
    density="100",
    spec_heat="840",
    therm_absp="0.1",
    sol_absp=subtraction_4,
    vis_absp=subtraction_4)  # -> mat; plug-in component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

# ---- group: GWP (tegole)
spessore_m = Panel("0.02")
densità_kg_m3 = Panel("1350")
multiplication = Multiplication(A=spessore_m, B=m2_solaio_2)
volume_m3 = Panel(multiplication)
multiplication_2 = Multiplication(A=volume_m3, B=densità_kg_m3)
ecc_kgco2e_kg = Panel("0.48")
massa_kg = Panel(multiplication_2)
multiplication_3 = Multiplication(A=massa_kg, B=ecc_kgco2e_kg)
gwp_kgco2e = Panel(multiplication_3)
division = Division(A=gwp_kgco2e, B=m2_solaio_2)
gwp_kgco2e_m2 = Panel(division)

# ---- group: GWP (tavolato )
spessore_m_2 = Panel("0.02")
densità_kg_m3_2 = Panel("450")
multiplication_4 = Multiplication(A=spessore_m_2, B=m2_solaio_2)
volume_m3_2 = Panel(multiplication_4)
multiplication_5 = Multiplication(A=volume_m3_2, B=densità_kg_m3_2)
ecc_kgco2e_kg_2 = Panel("0.493")
massa_kg_2 = Panel(multiplication_5)
multiplication_6 = Multiplication(A=massa_kg_2, B=ecc_kgco2e_kg_2)
gwp_kgco2e_2 = Panel(multiplication_6)
division_2 = Division(A=gwp_kgco2e_2, B=m2_solaio_2)
gwp_kgco2e_m2_2 = Panel(division_2)

spessore_m_3 = Panel("0.02")
densità_kg_m3_3 = Panel("450")
multiplication_7 = Multiplication(A=spessore_m_3, B=m2_solaio_2)
volume_m3_3 = Panel(multiplication_7)
multiplication_8 = Multiplication(A=volume_m3_3, B=densità_kg_m3_3)
ecc_kgco2e_kg_3 = Panel("0.493")
massa_kg_3 = Panel(multiplication_8)
multiplication_9 = Multiplication(A=massa_kg_3, B=ecc_kgco2e_kg_3)
gwp_kgco2e_3 = Panel(multiplication_9)
division_3 = Division(A=gwp_kgco2e_3, B=m2_solaio_2)
gwp_kgco2e_m2_3 = Panel(division_3)

# ---- group: GWP (isolante )
spessore_m_4 = Panel("0.02")
densità_kg_m3_4 = Panel("100")
multiplication_10 = Multiplication(A=spessore_m_4, B=m2_solaio_2)
volume_m3_4 = Panel(multiplication_10)
multiplication_11 = Multiplication(A=volume_m3_4, B=densità_kg_m3_4)
ecc_kgco2e_kg_4 = Panel("1.12")
massa_kg_4 = Panel(multiplication_11)
multiplication_12 = Multiplication(A=massa_kg_4, B=ecc_kgco2e_kg_4)
gwp_kgco2e_4 = Panel(multiplication_12)
division_4 = Division(A=gwp_kgco2e_4, B=m2_solaio_2)
gwp_kgco2e_m2_4 = Panel(division_4)

# ----
economical_cobenefit = Panel("")
social_cobenefit = Panel("")
environmental_cobenefit = Panel("")
thermalemissivity = Panel("0.91")
merge = Merge(Data1=opaquemat, Data2=opaquemat_2, Data3=opaquemat_4, Data4=opaquemat_5, Data5=opaquemat_3)
albedo = Panel("0.40")
panel = Panel("Poorly insulated timber floor")
opaqueconstr = HBOpaqueConstruction(name=panel, materials=merge)  # -> constr; plug-in component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
name = Text(panel)
economic_cobenefit = Text(economical_cobenefit)
name_2 = ClusterOutput(name)
social_cobenefit_2 = Text(social_cobenefit)
albedo_2 = Number(albedo)
environmental_cobenefit_2 = Text(environmental_cobenefit)
thermalemissivity_2 = Number(thermalemissivity)
constr = ClusterOutput(opaqueconstr)
decnstrconstr = HBDeconstructConstruction(constr=opaqueconstr)  # -> materials, layers, r_val_si, r_val_ip, u_fac_si, u_fac_ip, shgc, t_sol, t_vis; plug-in component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
economic_cobenefit_2 = ClusterOutput(economic_cobenefit)
albedo_3 = ClusterOutput(albedo_2)
thermalemissivity_3 = ClusterOutput(thermalemissivity_2)
environmental_cobenefit_3 = ClusterOutput(environmental_cobenefit_2)
social_cobenefit_3 = ClusterOutput(social_cobenefit_2)
u_fac_si = ClusterOutput(decnstrconstr.u_fac_si)
panel_2 = Panel(decnstrconstr.u_fac_si)
addition = Addition(A=gwp_kgco2e_m2, B=gwp_kgco2e_m2_3, C=gwp_kgco2e_m2_4, D=gwp_kgco2e_m2_2)
addition_2 = Addition(A=gwp_kgco2e, B=gwp_kgco2e_3, C=gwp_kgco2e_4, D=gwp_kgco2e_2)
gwp_kgco2e_m2_5 = Panel(addition)
gwp_kgco2e_5 = Panel(addition_2)
gwp_kgco2e_m2_6 = Number(gwp_kgco2e_m2_5)
gwp_kgco2e_6 = Data(gwp_kgco2e_5)
gwp_kgco2e_m2_7 = ClusterOutput(gwp_kgco2e_m2_6)
gwp_kgco2e_7 = ClusterOutput(gwp_kgco2e_6)

# ==== cluster Solaio_legno_altamente_isolato
m2_solaio = ClusterInput()
m2_solaio_2 = Data(m2_solaio)

# ---- group: GWP (tavolato )
spessore_m = Panel("0.02")
densità_kg_m3 = Panel("450")
multiplication = Multiplication(A=spessore_m, B=m2_solaio_2)
volume_m3 = Panel(multiplication)
multiplication_2 = Multiplication(A=volume_m3, B=densità_kg_m3)
ecc_kgco2e_kg = Panel("0.493")
massa_kg = Panel(multiplication_2)
multiplication_3 = Multiplication(A=massa_kg, B=ecc_kgco2e_kg)
gwp_kgco2e = Panel(multiplication_3)
division = Division(A=gwp_kgco2e, B=m2_solaio_2)
gwp_kgco2e_m2 = Panel(division)

# ---- group: GWP (tegole)
spessore_m_2 = Panel("0.02")
densità_kg_m3_2 = Panel("1350")
multiplication_4 = Multiplication(A=spessore_m_2, B=m2_solaio_2)
volume_m3_2 = Panel(multiplication_4)
multiplication_5 = Multiplication(A=volume_m3_2, B=densità_kg_m3_2)
ecc_kgco2e_kg_2 = Panel("0.48")
massa_kg_2 = Panel(multiplication_5)
multiplication_6 = Multiplication(A=massa_kg_2, B=ecc_kgco2e_kg_2)
gwp_kgco2e_2 = Panel(multiplication_6)
division_2 = Division(A=gwp_kgco2e_2, B=m2_solaio_2)
gwp_kgco2e_m2_2 = Panel(division_2)

# ---- group: GWP (tavolato )
spessore_m_3 = Panel("0.02")
densità_kg_m3_3 = Panel("450")
multiplication_7 = Multiplication(A=spessore_m_3, B=m2_solaio_2)
volume_m3_3 = Panel(multiplication_7)
multiplication_8 = Multiplication(A=volume_m3_3, B=densità_kg_m3_3)
ecc_kgco2e_kg_3 = Panel("0.493")
massa_kg_3 = Panel(multiplication_8)
multiplication_9 = Multiplication(A=massa_kg_3, B=ecc_kgco2e_kg_3)
gwp_kgco2e_3 = Panel(multiplication_9)
division_3 = Division(A=gwp_kgco2e_3, B=m2_solaio_2)
gwp_kgco2e_m2_3 = Panel(division_3)

# ---- group: GWP (isolante )
spessore_m_4 = Panel("0.18")
densità_kg_m3_4 = Panel("30")
multiplication_10 = Multiplication(A=spessore_m_4, B=m2_solaio_2)
volume_m3_4 = Panel(multiplication_10)
multiplication_11 = Multiplication(A=volume_m3_4, B=densità_kg_m3_4)
ecc_kgco2e_kg_4 = Panel("1.12")
massa_kg_4 = Panel(multiplication_11)
multiplication_12 = Multiplication(A=massa_kg_4, B=ecc_kgco2e_kg_4)
gwp_kgco2e_4 = Panel(multiplication_12)
division_4 = Division(A=gwp_kgco2e_4, B=m2_solaio_2)
gwp_kgco2e_m2_4 = Panel(division_4)

# ----
subtraction = Subtraction(A="1", B="0.4")
subtraction_2 = Subtraction(A="1", B="0.15")
subtraction_3 = Subtraction(A="1", B="0.15")
subtraction_4 = Subtraction(A="1", B="0.7")
opaquemat = HBOpaqueMaterial(
    name="Tegole",
    thickness="0.02",
    conductivity="0.575",
    density="1350",
    spec_heat="840",
    therm_absp="0.91",
    sol_absp=subtraction,
    vis_absp=subtraction)  # -> mat; plug-in component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
opaquemat_2 = HBOpaqueMaterial(
    name="custom_air_gap",
    thickness="0.02",
    conductivity="0.125",
    density="1.28",
    spec_heat="1000",
    roughness="Smooth",
    therm_absp="0.9",
    sol_absp="0.7",
    vis_absp="0.7")  # -> mat; plug-in component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
opaquemat_3 = HBOpaqueMaterial(
    name="Tavolato_legno",
    thickness="0.02",
    conductivity="0.120",
    density="450",
    spec_heat="2200",
    therm_absp="0.85",
    sol_absp=subtraction_2,
    vis_absp=subtraction_2)  # -> mat; plug-in component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
opaquemat_4 = HBOpaqueMaterial(
    name="Tavolato_legno",
    thickness="0.02",
    conductivity="0.120",
    density="450",
    spec_heat="2200",
    therm_absp="0.85",
    sol_absp=subtraction_3,
    vis_absp=subtraction_3)  # -> mat; plug-in component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
opaquemat_5 = HBOpaqueMaterial(
    name="Isolante",
    thickness="0.18",
    conductivity="0.032",
    density="30",
    spec_heat="1250",
    therm_absp="0.1",
    sol_absp=subtraction_4,
    vis_absp=subtraction_4)  # -> mat; plug-in component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
panel = Panel("Highly insulated timber floor")
merge = Merge(Data1=opaquemat, Data2=opaquemat_2, Data3=opaquemat_4, Data4=opaquemat_5, Data5=opaquemat_3)
opaqueconstr = HBOpaqueConstruction(name=panel, materials=merge)  # -> constr; plug-in component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
name = Text(panel)
economical_cobenefit = Panel("")
environmental_cobenefit = Panel("")
social_cobenefit = Panel("")
albedo = Panel("0.4")
thermalemissivity = Panel("0.90")
name_2 = ClusterOutput(name)
decnstrconstr = HBDeconstructConstruction(constr=opaqueconstr)  # -> materials, layers, r_val_si, r_val_ip, u_fac_si, u_fac_ip, shgc, t_sol, t_vis; plug-in component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
constr = ClusterOutput(opaqueconstr)
economic_cobenefit = Text(economical_cobenefit)
social_cobenefit_2 = Text(social_cobenefit)
albedo_2 = Number(albedo)
environmental_cobenefit_2 = Text(environmental_cobenefit)
thermalemissivity_2 = Number(thermalemissivity)
panel_2 = Panel(decnstrconstr.u_fac_si)
economic_cobenefit_2 = ClusterOutput(economic_cobenefit)
u_fac_si = ClusterOutput(decnstrconstr.u_fac_si)
albedo_3 = ClusterOutput(albedo_2)
thermalemissivity_3 = ClusterOutput(thermalemissivity_2)
environmental_cobenefit_3 = ClusterOutput(environmental_cobenefit_2)
social_cobenefit_3 = ClusterOutput(social_cobenefit_2)
addition = Addition(A=gwp_kgco2e_m2_2, B=gwp_kgco2e_m2_3, C=gwp_kgco2e_m2_4, D=gwp_kgco2e_m2)
addition_2 = Addition(A=gwp_kgco2e_2, B=gwp_kgco2e_3, C=gwp_kgco2e_4, D=gwp_kgco2e)
gwp_kgco2e_m2_5 = Panel(addition)
gwp_kgco2e_5 = Panel(addition_2)
gwp_kgco2e_m2_6 = Number(gwp_kgco2e_m2_5)
gwp_kgco2e_6 = Number(gwp_kgco2e_5)
gwp_kgco2e_m2_7 = ClusterOutput(gwp_kgco2e_m2_6)
gwp_kgco2e_7 = ClusterOutput(gwp_kgco2e_6)

# ==== cluster Solaio_laterocemento_non_isolato
m2_solaio = ClusterInput()
m2_solaio_2 = Data(m2_solaio)

# ---- group: GWP (getto cls)
spessore_m = Panel("0.10")
densità_kg_m3 = Panel("2400")
multiplication = Multiplication(A=spessore_m, B=m2_solaio_2)
volume_m3 = Panel(multiplication)
multiplication_2 = Multiplication(A=volume_m3, B=densità_kg_m3)
ecc_kgco2e_kg = Panel("0.094")
massa_kg = Panel(multiplication_2)
multiplication_3 = Multiplication(A=massa_kg, B=ecc_kgco2e_kg)
gwp_kgco2e = Panel(multiplication_3)
division = Division(A=gwp_kgco2e, B=m2_solaio_2)
gwp_kgco2e_m2 = Panel(division)

# ---- group: GWP(tegole)
spessore_m_2 = Panel("0.02")
densità_kg_m3_2 = Panel("1350")
multiplication_4 = Multiplication(A=spessore_m_2, B=m2_solaio_2)
volume_m3_2 = Panel(multiplication_4)
multiplication_5 = Multiplication(A=volume_m3_2, B=densità_kg_m3_2)
ecc_kgco2e_kg_2 = Panel("0.48")
massa_kg_2 = Panel(multiplication_5)
multiplication_6 = Multiplication(A=massa_kg_2, B=ecc_kgco2e_kg_2)
gwp_kgco2e_2 = Panel(multiplication_6)
division_2 = Division(A=gwp_kgco2e_2, B=m2_solaio_2)
gwp_kgco2e_m2_2 = Panel(division_2)

# ---- group: GWP(pignatte)
spessore_m_3 = Panel("0.20")
densità_kg_m3_3 = Panel("480")
multiplication_7 = Multiplication(A=spessore_m_3, B=m2_solaio_2)
volume_m3_3 = Panel(multiplication_7)
multiplication_8 = Multiplication(A=volume_m3_3, B=densità_kg_m3_3)
ecc_kgco2e_kg_3 = Panel("0.224")
massa_kg_3 = Panel(multiplication_8)
multiplication_9 = Multiplication(A=massa_kg_3, B=ecc_kgco2e_kg_3)
gwp_kgco2e_3 = Panel(multiplication_9)
division_3 = Division(A=gwp_kgco2e_3, B=m2_solaio_2)
gwp_kgco2e_m2_3 = Panel(division_3)

# ---- group: GWP(intonaco)
spessore_m_4 = Panel("0.02")
densità_kg_m3_4 = Panel("1500")
multiplication_10 = Multiplication(A=spessore_m_4, B=m2_solaio_2)
volume_m3_4 = Panel(multiplication_10)
multiplication_11 = Multiplication(A=volume_m3_4, B=densità_kg_m3_4)
ecc_kgco2e_kg_4 = Panel("0.13")
massa_kg_4 = Panel(multiplication_11)
multiplication_12 = Multiplication(A=massa_kg_4, B=ecc_kgco2e_kg_4)
gwp_kgco2e_4 = Panel(multiplication_12)
division_4 = Division(A=gwp_kgco2e_4, B=m2_solaio_2)
gwp_kgco2e_m2_4 = Panel(division_4)

# ----
subtraction = Subtraction(A="1", B="0.4")
subtraction_2 = Subtraction(A="1", B="0.250")
subtraction_3 = Subtraction(A="1", B="0.650")
opaquemat = HBOpaqueMaterial(
    name="Tegole",
    thickness="0.02",
    conductivity="0.575",
    density="1350",
    spec_heat="840",
    therm_absp="0.91",
    sol_absp=subtraction,
    vis_absp=subtraction)  # -> mat; plug-in component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
opaquemat_2 = HBOpaqueMaterial(
    name="Solaio_laterocemento",
    thickness="0.3",
    conductivity="0.720",
    density="1800",
    spec_heat="840",
    therm_absp="0.54",
    sol_absp=subtraction_2,
    vis_absp=subtraction_2)  # -> mat; plug-in component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
opaquemat_3 = HBOpaqueMaterial(
    name="custom_air_gap",
    thickness="0.02",
    conductivity="0.125",
    density="1.28",
    spec_heat="1000",
    roughness="Smooth",
    therm_absp="0.9",
    sol_absp="0.7",
    vis_absp="0.7")  # -> mat; plug-in component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
opaquemat_4 = HBOpaqueMaterial(
    name="Intonaco_interno",
    thickness="0.02",
    conductivity="0.700",
    density="1500",
    spec_heat="1000",
    therm_absp="0.9",
    sol_absp=subtraction_3,
    vis_absp=subtraction_3)  # -> mat; plug-in component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
panel = Panel("Lateral concrete floor not insulated")
merge = Merge(Data1=opaquemat, Data2=opaquemat_3, Data3=opaquemat_2, Data4=opaquemat_4)
economical_cobenefit = Panel("")
environmental_cobenefit = Panel("")
social_cobenefit = Panel("")
albedo = Panel("0.65")
thermalemissivity = Panel("0.90")
opaqueconstr = HBOpaqueConstruction(name=panel, materials=merge)  # -> constr; plug-in component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
name = Text(panel)
economic_cobenefit = Text(economical_cobenefit)
social_cobenefit_2 = Text(social_cobenefit)
albedo_2 = Number(albedo)
name_2 = ClusterOutput(name)
environmental_cobenefit_2 = Text(environmental_cobenefit)
constr = ClusterOutput(opaqueconstr)
thermalemissivity_2 = Number(thermalemissivity)
economic_cobenefit_2 = ClusterOutput(economic_cobenefit)
albedo_3 = ClusterOutput(albedo_2)
thermalemissivity_3 = ClusterOutput(thermalemissivity_2)
decnstrconstr = HBDeconstructConstruction(constr=opaqueconstr)  # -> materials, layers, r_val_si, r_val_ip, u_fac_si, u_fac_ip, shgc, t_sol, t_vis; plug-in component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
environmental_cobenefit_3 = ClusterOutput(environmental_cobenefit_2)
social_cobenefit_3 = ClusterOutput(social_cobenefit_2)
panel_2 = Panel(decnstrconstr.u_fac_si)
u_fac_si = ClusterOutput(decnstrconstr.u_fac_si)
addition = Addition(A=gwp_kgco2e_m2_2, B=gwp_kgco2e_m2, C=gwp_kgco2e_m2_3, D=gwp_kgco2e_m2_4)
addition_2 = Addition(A=gwp_kgco2e_2, B=gwp_kgco2e, C=gwp_kgco2e_3, D=gwp_kgco2e_4)
gwp_kgco2e_m2_5 = Panel(addition)
gwp_kgco2e_5 = Panel(addition_2)
gwp_kgco2e_m2_6 = Number(gwp_kgco2e_m2_5)
gwp_kgco2e_6 = Number(gwp_kgco2e_5)
gwp_kgco2e_m2_7 = ClusterOutput(gwp_kgco2e_m2_6)
gwp_kgco2e_7 = ClusterOutput(gwp_kgco2e_6)

# ==== cluster Solaio_laterocemento_scarso_isolato
m2_solaio = ClusterInput()
m2_solaio_2 = Data(m2_solaio)

# ---- group: GWP(isolante)
spessore_m = Panel("0.02")
densità_kg_m3 = Panel("100")
multiplication = Multiplication(A=spessore_m, B=m2_solaio_2)
volume_m3 = Panel(multiplication)
multiplication_2 = Multiplication(A=volume_m3, B=densità_kg_m3)
ecc_kgco2e_kg = Panel("1.12")
massa_kg = Panel(multiplication_2)
multiplication_3 = Multiplication(A=massa_kg, B=ecc_kgco2e_kg)
gwp_kgco2e = Panel(multiplication_3)
division = Division(A=gwp_kgco2e, B=m2_solaio_2)
gwp_kgco2e_m2 = Panel(division)

# ---- group: GWP(tegole)
spessore_m_2 = Panel("0.02")
densità_kg_m3_2 = Panel("1350")
multiplication_4 = Multiplication(A=spessore_m_2, B=m2_solaio_2)
volume_m3_2 = Panel(multiplication_4)
multiplication_5 = Multiplication(A=volume_m3_2, B=densità_kg_m3_2)
ecc_kgco2e_kg_2 = Panel("0.48")
massa_kg_2 = Panel(multiplication_5)
multiplication_6 = Multiplication(A=massa_kg_2, B=ecc_kgco2e_kg_2)
gwp_kgco2e_2 = Panel(multiplication_6)
division_2 = Division(A=gwp_kgco2e_2, B=m2_solaio_2)
gwp_kgco2e_m2_2 = Panel(division_2)

# ---- group: GWP (getto cls)
spessore_m_3 = Panel("0.10")
densità_kg_m3_3 = Panel("2400")
multiplication_7 = Multiplication(A=spessore_m_3, B=m2_solaio_2)
volume_m3_3 = Panel(multiplication_7)
multiplication_8 = Multiplication(A=volume_m3_3, B=densità_kg_m3_3)
ecc_kgco2e_kg_3 = Panel("0.094")
massa_kg_3 = Panel(multiplication_8)
multiplication_9 = Multiplication(A=massa_kg_3, B=ecc_kgco2e_kg_3)
gwp_kgco2e_3 = Panel(multiplication_9)
division_3 = Division(A=gwp_kgco2e_3, B=m2_solaio_2)
gwp_kgco2e_m2_3 = Panel(division_3)

# ---- group: GWP(pignatte)
spessore_m_4 = Panel("0.20")
densità_kg_m3_4 = Panel("480")
multiplication_10 = Multiplication(A=spessore_m_4, B=m2_solaio_2)
volume_m3_4 = Panel(multiplication_10)
multiplication_11 = Multiplication(A=volume_m3_4, B=densità_kg_m3_4)
ecc_kgco2e_kg_4 = Panel("0.224")
massa_kg_4 = Panel(multiplication_11)
multiplication_12 = Multiplication(A=massa_kg_4, B=ecc_kgco2e_kg_4)
gwp_kgco2e_4 = Panel(multiplication_12)
division_4 = Division(A=gwp_kgco2e_4, B=m2_solaio_2)
gwp_kgco2e_m2_4 = Panel(division_4)

# ---- group: GWP(intonaco)
spessore_m_5 = Panel("0.02")
densità_kg_m3_5 = Panel("1500")
multiplication_13 = Multiplication(A=spessore_m_5, B=m2_solaio_2)
volume_m3_5 = Panel(multiplication_13)
multiplication_14 = Multiplication(A=volume_m3_5, B=densità_kg_m3_5)
ecc_co2e = Panel("0.13")
massa_kg_5 = Panel(multiplication_14)
multiplication_15 = Multiplication(A=massa_kg_5, B=ecc_co2e)
gwp_kgco2e_5 = Panel(multiplication_15)
division_5 = Division(A=gwp_kgco2e_5, B=m2_solaio_2)
gwp_kgco2e_m2_5 = Panel(division_5)

# ----
subtraction = Subtraction(A="1", B="0.7")
subtraction_2 = Subtraction(A="1", B="0.4")
subtraction_3 = Subtraction(A="1", B="0.250")
subtraction_4 = Subtraction(A="1", B="0.650")
opaquemat = HBOpaqueMaterial(
    name="Isolante",
    thickness="0.02",
    conductivity="0.045",
    density="100",
    spec_heat="840",
    therm_absp="0.1",
    sol_absp=subtraction,
    vis_absp=subtraction)  # -> mat; plug-in component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
opaquemat_2 = HBOpaqueMaterial(
    name="Tegole",
    thickness="0.02",
    conductivity="0.575",
    density="1350",
    spec_heat="840",
    therm_absp="0.91",
    sol_absp=subtraction_2,
    vis_absp=subtraction_2)  # -> mat; plug-in component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
opaquemat_3 = HBOpaqueMaterial(
    name="custom_air_gap",
    thickness="0.02",
    conductivity="0.125",
    density="1.28",
    spec_heat="1000",
    roughness="Smooth",
    therm_absp="0.9",
    sol_absp="0.7",
    vis_absp="0.7")  # -> mat; plug-in component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
opaquemat_4 = HBOpaqueMaterial(
    name="Solaio_laterocemento",
    thickness="0.3",
    conductivity="0.720",
    density="1800",
    spec_heat="840",
    therm_absp="0.54",
    sol_absp=subtraction_3,
    vis_absp=subtraction_3)  # -> mat; plug-in component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
opaquemat_5 = HBOpaqueMaterial(
    name="Intonaco_interno",
    thickness="0.02",
    conductivity="0.700",
    density="1500",
    spec_heat="1000",
    therm_absp="0.9",
    sol_absp=subtraction_4,
    vis_absp=subtraction_4)  # -> mat; plug-in component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
panel = Panel("Poorly insulated lateral concrete floor")
merge = Merge(Data1=opaquemat_2, Data2=opaquemat_3, Data3=opaquemat, Data4=opaquemat_4, Data5=opaquemat_5)
economical_cobenefit = Panel("")
social_cobenefit = Panel("")
environmental_cobenefit = Panel("")
albedo = Panel("0.65")
thermalemissivity = Panel("0.90")
opaqueconstr = HBOpaqueConstruction(name=panel, materials=merge)  # -> constr; plug-in component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
name = Text(panel)
economic_cobenefit = Text(economical_cobenefit)
social_cobenefit_2 = Text(social_cobenefit)
albedo_2 = Number(albedo)
decnstrconstr = HBDeconstructConstruction(constr=opaqueconstr)  # -> materials, layers, r_val_si, r_val_ip, u_fac_si, u_fac_ip, shgc, t_sol, t_vis; plug-in component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
environmental_cobenefit_2 = Text(environmental_cobenefit)
thermalemissivity_2 = Number(thermalemissivity)
constr = ClusterOutput(opaqueconstr)
economic_cobenefit_2 = ClusterOutput(economic_cobenefit)
albedo_3 = ClusterOutput(albedo_2)
thermalemissivity_3 = ClusterOutput(thermalemissivity_2)
name_2 = ClusterOutput(name)
environmental_cobenefit_3 = ClusterOutput(environmental_cobenefit_2)
social_cobenefit_3 = ClusterOutput(social_cobenefit_2)
panel_2 = Panel(decnstrconstr.u_fac_si)
u_fac_si = ClusterOutput(decnstrconstr.u_fac_si)
addition = Addition(A=gwp_kgco2e_2, B=gwp_kgco2e, C=gwp_kgco2e_3, D=gwp_kgco2e_4, E=gwp_kgco2e_5)
addition_2 = Addition(A=gwp_kgco2e_m2_2, B=gwp_kgco2e_m2, C=gwp_kgco2e_m2_3, D=gwp_kgco2e_m2_4, E=gwp_kgco2e_m2_5)
gwp_kgco2e_6 = Panel(addition)
gwp_kgco2e_m2_6 = Panel(addition_2)
gwp_kgco2e_7 = Number(gwp_kgco2e_6)
gwp_kgco2e_m2_7 = Number(gwp_kgco2e_m2_6)
gwp_kgco2e_8 = ClusterOutput(gwp_kgco2e_7)
gwp_kgco2e_m2_8 = ClusterOutput(gwp_kgco2e_m2_7)

# ==== cluster Solaio_laterocemento_altamente_isolato
m2_solaio = ClusterInput()
m2_solaio_2 = Data(m2_solaio)
subtraction = Subtraction(A="1", B="0.7")
panel = Panel("0.1")
subtraction_2 = Subtraction(A="1", B="0.4")
subtraction_3 = Subtraction(A="1", B="0.250")
subtraction_4 = Subtraction(A="1", B="0.650")

# ---- group: GWP(isolante)
spessore_m = Panel("0.14")
densità_kg_m3 = Panel("30")
multiplication = Multiplication(A=spessore_m, B=m2_solaio_2)
volume_m3 = Panel(multiplication)
multiplication_2 = Multiplication(A=volume_m3, B=densità_kg_m3)
ecc_kgco2e_kg = Panel("1.12")
massa_kg = Panel(multiplication_2)
multiplication_3 = Multiplication(A=massa_kg, B=ecc_kgco2e_kg)
gwp_kgco2e = Panel(multiplication_3)
division = Division(A=gwp_kgco2e, B=m2_solaio_2)
gwp_kgco2e_m2 = Panel(division)

# ---- group: GWP(tegole)
spessore_m_2 = Panel("0.02")
densità_kg_m3_2 = Panel("1350")
multiplication_4 = Multiplication(A=spessore_m_2, B=m2_solaio_2)
volume_m3_2 = Panel(multiplication_4)
multiplication_5 = Multiplication(A=volume_m3_2, B=densità_kg_m3_2)
ecc_kgco2e_kg_2 = Panel("0.48")
massa_kg_2 = Panel(multiplication_5)
multiplication_6 = Multiplication(A=massa_kg_2, B=ecc_kgco2e_kg_2)
gwp_kgco2e_2 = Panel(multiplication_6)
division_2 = Division(A=gwp_kgco2e_2, B=m2_solaio_2)
gwp_kgco2e_m2_2 = Panel(division_2)

# ---- group: GWP (getto cls)
spessore_m_3 = Panel("0.10")
densità_kg_m3_3 = Panel("2400")
multiplication_7 = Multiplication(A=spessore_m_3, B=m2_solaio_2)
volume_m3_3 = Panel(multiplication_7)
multiplication_8 = Multiplication(A=volume_m3_3, B=densità_kg_m3_3)
ecc_kgco2e_kg_3 = Panel("0.094")
massa_kg_3 = Panel(multiplication_8)
multiplication_9 = Multiplication(A=massa_kg_3, B=ecc_kgco2e_kg_3)
gwp_kgco2e_3 = Panel(multiplication_9)
division_3 = Division(A=gwp_kgco2e_3, B=m2_solaio_2)
gwp_kgco2e_m2_3 = Panel(division_3)

# ----
opaquemat = HBOpaqueMaterial(
    name="custom_air_gap",
    thickness="0.02",
    conductivity="0.125",
    density="1.28",
    spec_heat="1000",
    roughness="Smooth",
    therm_absp="0.9",
    sol_absp="0.7",
    vis_absp="0.7")  # -> mat; plug-in component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
opaquemat_2 = HBOpaqueMaterial(
    name="Isolante",
    thickness="0.14",
    conductivity="0.032",
    density="30",
    spec_heat="1250",
    therm_absp="0.7",
    sol_absp=subtraction,
    vis_absp=subtraction)  # -> mat; plug-in component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
opaquemat_3 = HBOpaqueMaterial(
    name="Tegole",
    thickness="0.02",
    conductivity="0.575",
    density="1350",
    spec_heat="840",
    therm_absp="0.91",
    sol_absp=subtraction_2,
    vis_absp=subtraction_2)  # -> mat; plug-in component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

# ---- group: GWP(pignatte)
spessore_m_4 = Panel("0.20")
densità_kg_m3_4 = Panel("480")
multiplication_10 = Multiplication(A=spessore_m_4, B=m2_solaio_2)
volume_m3_4 = Panel(multiplication_10)
multiplication_11 = Multiplication(A=volume_m3_4, B=densità_kg_m3_4)
ecc_kgco2e_kg_4 = Panel("0.224")
massa_kg_4 = Panel(multiplication_11)
multiplication_12 = Multiplication(A=massa_kg_4, B=ecc_kgco2e_kg_4)
gwp_kgco2e_4 = Panel(multiplication_12)
division_4 = Division(A=gwp_kgco2e_4, B=m2_solaio_2)
gwp_kgco2e_m2_4 = Panel(division_4)

# ----
opaquemat_4 = HBOpaqueMaterial(
    name="Solaio_laterocemento",
    thickness="0.3",
    conductivity="0.720",
    density="1800",
    spec_heat="840",
    therm_absp="0.54",
    sol_absp=subtraction_3,
    vis_absp=subtraction_3)  # -> mat; plug-in component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
opaquemat_5 = HBOpaqueMaterial(
    name="Intonaco_interno",
    thickness="0.02",
    conductivity="0.700",
    density="1500",
    spec_heat="1000",
    therm_absp="0.9",
    sol_absp=subtraction_4,
    vis_absp=subtraction_4)  # -> mat; plug-in component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

# ---- group: GWP(intonaco)
spessore_m_5 = Panel("0.02")
densità_kg_m3_5 = Panel("1500")
multiplication_13 = Multiplication(A=spessore_m_5, B=m2_solaio_2)
volume_m3_5 = Panel(multiplication_13)
multiplication_14 = Multiplication(A=volume_m3_5, B=densità_kg_m3_5)
ecc_kgco2e_kg_5 = Panel("0.13")
massa_kg_5 = Panel(multiplication_14)
multiplication_15 = Multiplication(A=massa_kg_5, B=ecc_kgco2e_kg_5)
gwp_kgco2e_5 = Panel(multiplication_15)
division_5 = Division(A=gwp_kgco2e_5, B=m2_solaio_2)
gwp_kgco2e_m2_5 = Panel(division_5)

# ----
panel_2 = Panel("Highly insulated lateral concrete floor")
economical_cobenefit = Panel("")
environmental_cobenefit = Panel("")
social_cobenefit = Panel("")
albedo = Panel("0.65")
thermalemissivity = Panel("0.90")
merge = Merge(Data1=opaquemat_3, Data2=opaquemat, Data3=opaquemat_2, Data4=opaquemat_4, Data5=opaquemat_5)
opaqueconstr = HBOpaqueConstruction(name=panel_2, materials=merge)  # -> constr; plug-in component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
name = Text(panel_2)
economic_cobenefit = Text(economical_cobenefit)
social_cobenefit_2 = Text(social_cobenefit)
albedo_2 = Number(albedo)
decnstrconstr = HBDeconstructConstruction(constr=opaqueconstr)  # -> materials, layers, r_val_si, r_val_ip, u_fac_si, u_fac_ip, shgc, t_sol, t_vis; plug-in component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
environmental_cobenefit_2 = Text(environmental_cobenefit)
thermalemissivity_2 = Number(thermalemissivity)
constr = ClusterOutput(opaqueconstr)
economic_cobenefit_2 = ClusterOutput(economic_cobenefit)
albedo_3 = ClusterOutput(albedo_2)
name_2 = ClusterOutput(name)
thermalemissivity_3 = ClusterOutput(thermalemissivity_2)
environmental_cobenefit_3 = ClusterOutput(environmental_cobenefit_2)
social_cobenefit_3 = ClusterOutput(social_cobenefit_2)
u_fac_si = ClusterOutput(decnstrconstr.u_fac_si)
panel_3 = Panel(decnstrconstr.u_fac_si)
addition = Addition(A=gwp_kgco2e_2, B=gwp_kgco2e, C=gwp_kgco2e_3, D=gwp_kgco2e_4, E=gwp_kgco2e_5)
addition_2 = Addition(A=gwp_kgco2e_m2_2, B=gwp_kgco2e_m2, C=gwp_kgco2e_m2_3, D=gwp_kgco2e_m2_4, E=gwp_kgco2e_m2_5)
gwp_kgco2e_6 = Panel(addition)
gwp_kgco2e_m2_6 = Panel(addition_2)
gwp_kgco2e_7 = Number(gwp_kgco2e_6)
gwp_kgco2e_m2_7 = Number(gwp_kgco2e_m2_6)
gwp_kgco2e_8 = ClusterOutput(gwp_kgco2e_7)
gwp_kgco2e_m2_8 = ClusterOutput(gwp_kgco2e_m2_7)

# ==== cluster Solaio_allegerito_eps_medio_isolato
m2_solaio = ClusterInput()
m2_solaio_2 = Data(m2_solaio)
subtraction = Subtraction(A="1", B="0.4")
subtraction_2 = Subtraction(A="1", B="0.7")
subtraction_3 = Subtraction(A="1", B="0.250")
subtraction_4 = Subtraction(A="1", B="0.650")
opaquemat = HBOpaqueMaterial(
    name="custom_air_gap",
    thickness="0.02",
    conductivity="0.125",
    density="1.28",
    spec_heat="1000",
    roughness="Smooth",
    therm_absp="0.9",
    sol_absp="0.7",
    vis_absp="0.7")  # -> mat; plug-in component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
opaquemat_2 = HBOpaqueMaterial(
    name="Tegole",
    thickness="0.02",
    conductivity="0.575",
    density="1350",
    spec_heat="840",
    therm_absp="0.91",
    sol_absp=subtraction,
    vis_absp=subtraction)  # -> mat; plug-in component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
opaquemat_3 = HBOpaqueMaterial(
    name="Isolante",
    thickness="0.05",
    conductivity="0.045",
    density="100",
    spec_heat="840",
    therm_absp="0.1",
    sol_absp=subtraction_2,
    vis_absp=subtraction_2)  # -> mat; plug-in component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
opaquemat_4 = HBOpaqueMaterial(
    name="Solaio_alleggerito_EPS",
    thickness="0.3",
    conductivity="0.220",
    density="800",
    spec_heat="1000",
    therm_absp="0.54",
    sol_absp=subtraction_3,
    vis_absp=subtraction_3)  # -> mat; plug-in component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
opaquemat_5 = HBOpaqueMaterial(
    name="Intonaco_interno",
    thickness="0.02",
    conductivity="0.700",
    density="1500",
    spec_heat="1000",
    therm_absp="0.9",
    sol_absp=subtraction_4,
    vis_absp=subtraction_4)  # -> mat; plug-in component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

# ---- group: GWP(isolante)
spessore_m = Panel("0.05")
densità_kg_m3 = Panel("30")
multiplication = Multiplication(A=spessore_m, B=m2_solaio_2)
volume_m3 = Panel(multiplication)
multiplication_2 = Multiplication(A=volume_m3, B=densità_kg_m3)
ecc_kgco2e_kg = Panel("1.12")
massa_kg = Panel(multiplication_2)
multiplication_3 = Multiplication(A=massa_kg, B=ecc_kgco2e_kg)
gwp_kgco2e = Panel(multiplication_3)
division = Division(A=gwp_kgco2e, B=m2_solaio_2)
gwp_kgco2e_m2 = Panel(division)

# ---- group: GWP(tegole)
spessore_m_2 = Panel("0.02")
densità_kg_m3_2 = Panel("1350")
multiplication_4 = Multiplication(A=spessore_m_2, B=m2_solaio_2)
volume_m3_2 = Panel(multiplication_4)
multiplication_5 = Multiplication(A=volume_m3_2, B=densità_kg_m3_2)
ecc_kgco2e_kg_2 = Panel("0.48")
massa_kg_2 = Panel(multiplication_5)
multiplication_6 = Multiplication(A=massa_kg_2, B=ecc_kgco2e_kg_2)
gwp_kgco2e_2 = Panel(multiplication_6)
division_2 = Division(A=gwp_kgco2e_2, B=m2_solaio_2)
gwp_kgco2e_m2_2 = Panel(division_2)

# ---- group: GWP (getto cls)
spessore_m_3 = Panel("0.10")
densità_kg_m3_3 = Panel("2400")
multiplication_7 = Multiplication(A=spessore_m_3, B=m2_solaio_2)
volume_m3_3 = Panel(multiplication_7)
multiplication_8 = Multiplication(A=volume_m3_3, B=densità_kg_m3_3)
ecc_kgco2e_kg_3 = Panel("0.094")
massa_kg_3 = Panel(multiplication_8)
multiplication_9 = Multiplication(A=massa_kg_3, B=ecc_kgco2e_kg_3)
gwp_kgco2e_3 = Panel(multiplication_9)
division_3 = Division(A=gwp_kgco2e_3, B=m2_solaio_2)
gwp_kgco2e_m2_3 = Panel(division_3)

# ---- group: GWP(pignatte eps)
spessore_m_4 = Panel("0.20")
densità_kg_m3_4 = Panel("15")
multiplication_10 = Multiplication(A=spessore_m_4, B=m2_solaio_2)
volume_m3_4 = Panel(multiplication_10)
multiplication_11 = Multiplication(A=volume_m3_4, B=densità_kg_m3_4)
ecc_kgco2e_kg_4 = Panel("4.78")
massa_kg_4 = Panel(multiplication_11)
multiplication_12 = Multiplication(A=massa_kg_4, B=ecc_kgco2e_kg_4)
gwp_kgco2e_4 = Panel(multiplication_12)
division_4 = Division(A=gwp_kgco2e_4, B=m2_solaio_2)
gwp_kgco2e_m2_4 = Panel(division_4)

# ---- group: GWP(intonaco)
spessore_m_5 = Panel("0.02")
densità_kg_m3_5 = Panel("1500")
multiplication_13 = Multiplication(A=spessore_m_5, B=m2_solaio_2)
volume_m3_5 = Panel(multiplication_13)
multiplication_14 = Multiplication(A=volume_m3_5, B=densità_kg_m3_5)
ecc_kgco2e_kg_5 = Panel("0.13")
massa_kg_5 = Panel(multiplication_14)
multiplication_15 = Multiplication(A=massa_kg_5, B=ecc_kgco2e_kg_5)
gwp_kgco2e_5 = Panel(multiplication_15)
division_5 = Division(A=gwp_kgco2e_5, B=m2_solaio_2)
gwp_kgco2e_m2_5 = Panel(division_5)

# ----
panel = Panel("Medium insulated lightweight concrete floor")
merge = Merge(Data1=opaquemat_2, Data2=opaquemat, Data3=opaquemat_3, Data4=opaquemat_4, Data5=opaquemat_5)
economical_cobenefit = Panel("")
social_cobenefit = Panel("")
environmental_cobenefit = Panel("")
thermalemissivity = Panel("0.90")
albedo = Panel("0.40")
opaqueconstr = HBOpaqueConstruction(name=panel, materials=merge)  # -> constr; plug-in component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
name = Text(panel)
decnstrconstr = HBDeconstructConstruction(constr=opaqueconstr)  # -> materials, layers, r_val_si, r_val_ip, u_fac_si, u_fac_ip, shgc, t_sol, t_vis; plug-in component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
name_2 = ClusterOutput(name)
constr = ClusterOutput(opaqueconstr)
economic_cobenefit = Text(economical_cobenefit)
social_cobenefit_2 = Text(social_cobenefit)
albedo_2 = Number(albedo)
environmental_cobenefit_2 = Text(environmental_cobenefit)
thermalemissivity_2 = Number(thermalemissivity)
economic_cobenefit_2 = ClusterOutput(economic_cobenefit)
albedo_3 = ClusterOutput(albedo_2)
thermalemissivity_3 = ClusterOutput(thermalemissivity_2)
environmental_cobenefit_3 = ClusterOutput(environmental_cobenefit_2)
social_cobenefit_3 = ClusterOutput(social_cobenefit_2)
u_fac_si = ClusterOutput(decnstrconstr.u_fac_si)
panel_2 = Panel(decnstrconstr.u_fac_si)
addition = Addition(A=gwp_kgco2e_m2_2, B=gwp_kgco2e_m2, C=gwp_kgco2e_m2_3, D=gwp_kgco2e_m2_4, E=gwp_kgco2e_m2_5)
addition_2 = Addition(A=gwp_kgco2e_2, B=gwp_kgco2e, C=gwp_kgco2e_3, D=gwp_kgco2e_4, E=gwp_kgco2e_5)
gwp_kgco2e_m2_6 = Panel(addition)
gwp_kgco2e_6 = Panel(addition_2)
gwp_kgco2e_m2_7 = Number(gwp_kgco2e_m2_6)
gwp_kgco2e_7 = Number(gwp_kgco2e_6)
gwp_kgco2e_m2_8 = ClusterOutput(gwp_kgco2e_m2_7)
gwp_kgco2e_8 = ClusterOutput(gwp_kgco2e_7)

# ==== cluster Copertura_Verde_estensivo
m2_solaio = ClusterInput()
m2_solaio_2 = Data(m2_solaio)

# ---- group: GWP(isolante mapetherm)
spessore_m = Panel("0.10")
densità_kg_m3 = Panel("1000")
multiplication = Multiplication(A=spessore_m, B=m2_solaio_2)
volume_m3 = Panel(multiplication)
multiplication_2 = Multiplication(A=volume_m3, B=densità_kg_m3)
ecc_kgco2e_kg = Panel("3.29")
massa_kg = Panel(multiplication_2)
multiplication_3 = Multiplication(A=massa_kg, B=ecc_kgco2e_kg)
gwp_kgco2e = Panel(multiplication_3)
division = Division(A=gwp_kgco2e, B=m2_solaio_2)
gwp_kgco2e_m2 = Panel(division)

# ---- group: GWP (getto cls)
spessore_m_2 = Panel("0.10")
densità_kg_m3_2 = Panel("2400")
multiplication_4 = Multiplication(A=spessore_m_2, B=m2_solaio_2)
volume_m3_2 = Panel(multiplication_4)
multiplication_5 = Multiplication(A=volume_m3_2, B=densità_kg_m3_2)
ecc_kgco2e_kg_2 = Panel("0.094")
massa_kg_2 = Panel(multiplication_5)
multiplication_6 = Multiplication(A=massa_kg_2, B=ecc_kgco2e_kg_2)
gwp_kgco2e_2 = Panel(multiplication_6)
division_2 = Division(A=gwp_kgco2e_2, B=m2_solaio_2)
gwp_kgco2e_m2_2 = Panel(division_2)

# ----
subtraction = Subtraction(A="1", B="0.15")

# ---- group: GWP(pignatte)
spessore_m_3 = Panel("0.20")
densità_kg_m3_3 = Panel("480")
multiplication_7 = Multiplication(A=spessore_m_3, B=m2_solaio_2)
volume_m3_3 = Panel(multiplication_7)
multiplication_8 = Multiplication(A=volume_m3_3, B=densità_kg_m3_3)
ecc_kgco2e_kg_3 = Panel("0.224")
massa_kg_3 = Panel(multiplication_8)
multiplication_9 = Multiplication(A=massa_kg_3, B=ecc_kgco2e_kg_3)
gwp_kgco2e_3 = Panel(multiplication_9)
division_3 = Division(A=gwp_kgco2e_3, B=m2_solaio_2)
gwp_kgco2e_m2_3 = Panel(division_3)

# ---- group: GWP(intonaco)
spessore_m_4 = Panel("0.02")
densità_kg_m3_4 = Panel("1500")
multiplication_10 = Multiplication(A=spessore_m_4, B=m2_solaio_2)
volume_m3_4 = Panel(multiplication_10)
multiplication_11 = Multiplication(A=volume_m3_4, B=densità_kg_m3_4)
ecc_kgco2e_kg_4 = Panel("0.13")
massa_kg_4 = Panel(multiplication_11)
multiplication_12 = Multiplication(A=massa_kg_4, B=ecc_kgco2e_kg_4)
gwp_kgco2e_4 = Panel(multiplication_12)
division_4 = Division(A=gwp_kgco2e_4, B=m2_solaio_2)
gwp_kgco2e_m2_4 = Panel(division_4)

# ----
vegetationmat = HBVegetationMaterial(
    name="GRASS",
    plant_height="0.06",
    leaf_area_ind="0.30",
    leaf_reflect="0.22",
    leaf_emiss="0.95",
    soil_reflect="0.4",
    soil_emiss="0.6",
    stomat_resist="180",
    thickness="1",
    conductivity="0.3",
    density="1100",
    spec_heat="1200")  # -> mat; plug-in component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
opaquemat = HBOpaqueMaterial(
    name="DAKU ROOF SOIL",
    thickness="0.08",
    conductivity="0.2",
    density="980",
    spec_heat="836.8",
    therm_absp="0.3",
    sol_absp=subtraction,
    vis_absp=subtraction)  # -> mat; plug-in component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
opaquemat_2 = HBOpaqueMaterial(name="DAKU FSD 10", thickness="0.047", conductivity="0.1", density="25", spec_heat="1338")  # -> mat; plug-in component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
opaquemat_3 = HBOpaqueMaterial(name="Mapetherm EPS 100 CAM", thickness="0.1", conductivity="0.035", density="1000", spec_heat="1260")  # -> mat; plug-in component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
opaquemat_4 = HBOpaqueMaterial(name="Intonaco interno", thickness="0.02", conductivity="0.7", density="1500", spec_heat="1000")  # -> mat; plug-in component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
opaquemat_5 = HBOpaqueMaterial(name="Solaio in laterocemento ", thickness="0.3", conductivity="0.72", density="1800", spec_heat="840")  # -> mat; plug-in component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
merge = Merge(Data1=vegetationmat, Data2=opaquemat, Data3=opaquemat_2, Data4=opaquemat_3, Data5=opaquemat_5, Data6=opaquemat_4)
economical_cobenefit = Panel("")
social_cobenefit = Panel("")
environmental_cobenefit = Panel("")
thermalemissivity = Panel("0.95")
albedo = Panel("0.25")
opaqueconstr = HBOpaqueConstruction(name="Extensive green roof", materials=merge)  # -> constr; plug-in component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
name = Text("Extensive green roof")
constr = ClusterOutput(opaqueconstr)
economic_cobenefit = Text(economical_cobenefit)
social_cobenefit_2 = Text(social_cobenefit)
albedo_2 = Number(albedo)
environmental_cobenefit_2 = Text(environmental_cobenefit)
thermalemissivity_2 = Number(thermalemissivity)
name_2 = ClusterOutput(name)
decnstrconstr = HBDeconstructConstruction(constr=opaqueconstr)  # -> materials, layers, r_val_si, r_val_ip, u_fac_si, u_fac_ip, shgc, t_sol, t_vis; plug-in component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
economic_cobenefit_2 = ClusterOutput(economic_cobenefit)
albedo_3 = ClusterOutput(albedo_2)
thermalemissivity_3 = ClusterOutput(thermalemissivity_2)
environmental_cobenefit_3 = ClusterOutput(environmental_cobenefit_2)
social_cobenefit_3 = ClusterOutput(social_cobenefit_2)
panel = Panel(decnstrconstr.u_fac_si)
u_fac_si = ClusterOutput(decnstrconstr.u_fac_si)
addition = Addition(A=gwp_kgco2e_m2, B=gwp_kgco2e_m2_2, C=gwp_kgco2e_m2_3, D=gwp_kgco2e_m2_4)
addition_2 = Addition(A=gwp_kgco2e, B=gwp_kgco2e_2, C=gwp_kgco2e_3, D=gwp_kgco2e_4)
gwp_kgco2e_m2_5 = Panel(addition)
gwp_kgco2e_5 = Panel(addition_2)
gwp_kgco2e_m2_6 = Number(gwp_kgco2e_m2_5)
gwp_kgco2e_6 = Number(gwp_kgco2e_5)
gwp_kgco2e_m2_7 = ClusterOutput(gwp_kgco2e_m2_6)
gwp_kgco2e_7 = ClusterOutput(gwp_kgco2e_6)

# ==== cluster Solaio_allegerito_eps_isolato
m2_solaio = ClusterInput()
m2_solaio_2 = Data(m2_solaio)
subtraction = Subtraction(A="1", B="0.4")
subtraction_2 = Subtraction(A="1", B="0.7")
subtraction_3 = Subtraction(A="1", B="0.250")
subtraction_4 = Subtraction(A="1", B="0.650")
opaquemat = HBOpaqueMaterial(
    name="custom_air_gap",
    thickness="0.02",
    conductivity="0.125",
    density="1.28",
    spec_heat="1000",
    roughness="Smooth",
    therm_absp="0.9",
    sol_absp="0.7",
    vis_absp="0.7")  # -> mat; plug-in component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
opaquemat_2 = HBOpaqueMaterial(
    name="Tegole",
    thickness="0.02",
    conductivity="0.575",
    density="1350",
    spec_heat="840",
    therm_absp="0.91",
    sol_absp=subtraction,
    vis_absp=subtraction)  # -> mat; plug-in component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
opaquemat_3 = HBOpaqueMaterial(
    name="Isolante",
    thickness="0.1",
    conductivity="0.045",
    density="100",
    spec_heat="840",
    therm_absp="0.1",
    sol_absp=subtraction_2,
    vis_absp=subtraction_2)  # -> mat; plug-in component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
opaquemat_4 = HBOpaqueMaterial(
    name="Solaio_alleggerito_EPS",
    thickness="0.3",
    conductivity="0.220",
    density="800",
    spec_heat="1000",
    therm_absp="0.54",
    sol_absp=subtraction_3,
    vis_absp=subtraction_3)  # -> mat; plug-in component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
opaquemat_5 = HBOpaqueMaterial(
    name="Intonaco_interno",
    thickness="0.02",
    conductivity="0.700",
    density="1500",
    spec_heat="1000",
    therm_absp="0.9",
    sol_absp=subtraction_4,
    vis_absp=subtraction_4)  # -> mat; plug-in component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

# ---- group: GWP(isolante)
spessore_m = Panel("0.1")
densità_kg_m3 = Panel("100")
multiplication = Multiplication(A=spessore_m, B=m2_solaio_2)
volume_m3 = Panel(multiplication)
multiplication_2 = Multiplication(A=volume_m3, B=densità_kg_m3)
ecc_kgco2e_kg = Panel("4.78")
massa_kg = Panel(multiplication_2)
multiplication_3 = Multiplication(A=massa_kg, B=ecc_kgco2e_kg)
gwp_kgco2e = Panel(multiplication_3)
division = Division(A=gwp_kgco2e, B=m2_solaio_2)
gwp_kgco2e_m2 = Panel(division)

# ---- group: GWP(tegole)
spessore_m_2 = Panel("0.02")
densità_kg_m3_2 = Panel("1350")
multiplication_4 = Multiplication(A=spessore_m_2, B=m2_solaio_2)
volume_m3_2 = Panel(multiplication_4)
multiplication_5 = Multiplication(A=volume_m3_2, B=densità_kg_m3_2)
ecc_kgco2e_kg_2 = Panel("0.48")
massa_kg_2 = Panel(multiplication_5)
multiplication_6 = Multiplication(A=massa_kg_2, B=ecc_kgco2e_kg_2)
gwp_kgco2e_2 = Panel(multiplication_6)
division_2 = Division(A=gwp_kgco2e_2, B=m2_solaio_2)
gwp_kgco2e_m2_2 = Panel(division_2)

# ---- group: GWP (getto cls)
spessore_m_3 = Panel("0.10")
densità_kg_m3_3 = Panel("2400")
multiplication_7 = Multiplication(A=spessore_m_3, B=m2_solaio_2)
volume_m3_3 = Panel(multiplication_7)
multiplication_8 = Multiplication(A=volume_m3_3, B=densità_kg_m3_3)
ecc_kgco2e_kg_3 = Panel("0.094")
massa_kg_3 = Panel(multiplication_8)
multiplication_9 = Multiplication(A=massa_kg_3, B=ecc_kgco2e_kg_3)
gwp_kgco2e_3 = Panel(multiplication_9)
division_3 = Division(A=gwp_kgco2e_3, B=m2_solaio_2)
gwp_kgco2e_m2_3 = Panel(division_3)

# ---- group: GWP(pignatte eps)
spessore_m_4 = Panel("0.20")
densità_kg_m3_4 = Panel("15")
multiplication_10 = Multiplication(A=spessore_m_4, B=m2_solaio_2)
volume_m3_4 = Panel(multiplication_10)
multiplication_11 = Multiplication(A=volume_m3_4, B=densità_kg_m3_4)
ecc_kgco2e_kg_4 = Panel("4.78")
massa_kg_4 = Panel(multiplication_11)
multiplication_12 = Multiplication(A=massa_kg_4, B=ecc_kgco2e_kg_4)
gwp_kgco2e_4 = Panel(multiplication_12)
division_4 = Division(A=gwp_kgco2e_4, B=m2_solaio_2)
gwp_kgco2e_m2_4 = Panel(division_4)

# ---- group: GWP(intonaco)
spessore_m_5 = Panel("0.02")
densità_kg_m3_5 = Panel("1500")
multiplication_13 = Multiplication(A=spessore_m_5, B=m2_solaio_2)
volume_m3_5 = Panel(multiplication_13)
multiplication_14 = Multiplication(A=volume_m3_5, B=densità_kg_m3_5)
ecc_kgco2e_kg_5 = Panel("0.13")
massa_kg_5 = Panel(multiplication_14)
multiplication_15 = Multiplication(A=massa_kg_5, B=ecc_kgco2e_kg_5)
gwp_kgco2e_5 = Panel(multiplication_15)
division_5 = Division(A=gwp_kgco2e_5, B=m2_solaio_2)
gwp_kgco2e_m2_5 = Panel(division_5)

# ----
panel = Panel("Insulated lightweight concrete floor")
economical_cobenefit = Panel("")
social_cobenefit = Panel("")
environmental_cobenefit = Panel("")
albedo = Panel("0.40")
thermalemissivity = Panel("0.90")
merge = Merge(Data1=opaquemat_2, Data2=opaquemat, Data3=opaquemat_3, Data4=opaquemat_4, Data5=opaquemat_5)
opaqueconstr = HBOpaqueConstruction(name=panel, materials=merge)  # -> constr; plug-in component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
economic_cobenefit = Text(economical_cobenefit)
social_cobenefit_2 = Text(social_cobenefit)
albedo_2 = Number(albedo)
environmental_cobenefit_2 = Text(environmental_cobenefit)
thermalemissivity_2 = Number(thermalemissivity)
name = Text(panel)
constr = ClusterOutput(opaqueconstr)
decnstrconstr = HBDeconstructConstruction(constr=opaqueconstr)  # -> materials, layers, r_val_si, r_val_ip, u_fac_si, u_fac_ip, shgc, t_sol, t_vis; plug-in component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
economic_cobenefit_2 = ClusterOutput(economic_cobenefit)
albedo_3 = ClusterOutput(albedo_2)
thermalemissivity_3 = ClusterOutput(thermalemissivity_2)
environmental_cobenefit_3 = ClusterOutput(environmental_cobenefit_2)
social_cobenefit_3 = ClusterOutput(social_cobenefit_2)
name_2 = ClusterOutput(name)
panel_2 = Panel(decnstrconstr.u_fac_si)
u_fac_si = ClusterOutput(decnstrconstr.u_fac_si)
addition = Addition(A=gwp_kgco2e_2, B=gwp_kgco2e, C=gwp_kgco2e_3, D=gwp_kgco2e_4, E=gwp_kgco2e_5)
addition_2 = Addition(A=gwp_kgco2e_m2_2, B=gwp_kgco2e_m2, C=gwp_kgco2e_m2_3, D=gwp_kgco2e_m2_4, E=gwp_kgco2e_m2_5)
gwp_kgco2e_m2_6 = Panel(addition_2)
gwp_kgco2e_6 = Panel(addition)
gwp_kgco2e_7 = Number(gwp_kgco2e_6)
gwp_kgco2e_m2_7 = Number(gwp_kgco2e_m2_6)
gwp_kgco2e_m2_8 = ClusterOutput(gwp_kgco2e_m2_7)
gwp_kgco2e_8 = ClusterOutput(gwp_kgco2e_7)

# ==== cluster Copertura_legno
m2_solaio = ClusterInput()
m2_solaio_2 = Data(m2_solaio)
subtraction = Subtraction(A="1", B="0.7")

# ---- group: GWP(fibradilegno)
spessore_m = Panel("0.06")
densità_kg_m3 = Panel("230")
multiplication = Multiplication(A=spessore_m, B=m2_solaio_2)
volume_m3 = Panel(multiplication)
ecc = Panel("-1.401")
ecc_2 = Panel("0.845")
multiplication_2 = Multiplication(A=volume_m3, B=densità_kg_m3)
addition = Addition(A=ecc_2, B=ecc)
ecc_kgco2e_kg = Panel(addition)
massa_kg = Panel(multiplication_2)
multiplication_3 = Multiplication(A=massa_kg, B=ecc_kgco2e_kg)
gwp_kgco2e = Panel(multiplication_3)
division = Division(A=gwp_kgco2e, B=m2_solaio_2)
gwp_kgco2e_m2 = Panel(division)

# ---- group: GWP(XLAM)
spessore_m_2 = Panel("0.12")
densità_kg_m3_2 = Panel("470")
multiplication_4 = Multiplication(A=spessore_m_2, B=m2_solaio_2)
volume_m3_2 = Panel(multiplication_4)
ecc_3 = Panel("0.512")
ecc_4 = Panel("-1.408")
multiplication_5 = Multiplication(A=volume_m3_2, B=densità_kg_m3_2)
addition_2 = Addition(A=ecc_3, B=ecc_4)
ecc_kgco2e_kg_2 = Panel(addition_2)
massa_kg_2 = Panel(multiplication_5)
multiplication_6 = Multiplication(A=massa_kg_2, B=ecc_kgco2e_kg_2)
gwp_kgco2e_2 = Panel(multiplication_6)
division_2 = Division(A=gwp_kgco2e_2, B=m2_solaio_2)
gwp_kgco2e_m2_2 = Panel(division_2)

# ---- group: GWP(fibradilegno)
spessore_m_3 = Panel("0.06")
densità_kg_m3_3 = Panel("230")
multiplication_7 = Multiplication(A=spessore_m_3, B=m2_solaio_2)
ecc_5 = Panel("-1.408")
volume_m3_3 = Panel(multiplication_7)
ecc_6 = Panel("0.845")
multiplication_8 = Multiplication(A=volume_m3_3, B=densità_kg_m3_3)
addition_3 = Addition(A=ecc_6, B=ecc_5)
ecc_kgco2e_kg_3 = Panel(addition_3)
massa_kg_3 = Panel(multiplication_8)
multiplication_9 = Multiplication(A=massa_kg_3, B=ecc_kgco2e_kg_3)
gwp_kgco2e_3 = Panel(multiplication_9)
division_3 = Division(A=gwp_kgco2e_3, B=m2_solaio_2)
gwp_kgco2e_m2_3 = Panel(division_3)

# ---- group: GWP(tavolatogrezzo)
spessore_m_4 = Panel("0.024")
densità_kg_m3_4 = Panel("1350")
multiplication_10 = Multiplication(A=spessore_m_4, B=m2_solaio_2)
volume_m3_4 = Panel(multiplication_10)
ecc_7 = Panel("-1.639")
ecc_8 = Panel("0.815")
multiplication_11 = Multiplication(A=volume_m3_4, B=densità_kg_m3_4)
addition_4 = Addition(A=ecc_8, B=ecc_7)
massa_kg_4 = Panel(multiplication_11)
ecc_kgco2e_kg_4 = Panel(addition_4)
multiplication_12 = Multiplication(A=massa_kg_4, B=ecc_kgco2e_kg_4)
gwp_kgco2e_4 = Panel(multiplication_12)
division_4 = Division(A=gwp_kgco2e_4, B=m2_solaio_2)
gwp_kgco2e_m2_4 = Panel(division_4)

# ---- group: GWP(gessofibra)
spessore_m_5 = Panel("0.0125")
densità_kg_m3_5 = Panel("1180")
multiplication_13 = Multiplication(A=spessore_m_5, B=m2_solaio_2)
volume_m3_5 = Panel(multiplication_13)
multiplication_14 = Multiplication(A=volume_m3_5, B=densità_kg_m3_5)
ecc_kgco2e_kg_5 = Panel("0.217")
massa_kg_5 = Panel(multiplication_14)
multiplication_15 = Multiplication(A=massa_kg_5, B=ecc_kgco2e_kg_5)
gwp_kgco2e_5 = Panel(multiplication_15)
division_5 = Division(A=gwp_kgco2e_5, B=m2_solaio_2)
gwp_kgco2e_m2_5 = Panel(division_5)

# ----
opaquemat = HBOpaqueMaterial(
    name="tavolato di legno grezzo",
    thickness="0.024",
    conductivity="0.26",
    density="1350",
    spec_heat="1880",
    therm_absp="0.69",
    sol_absp=subtraction,
    vis_absp=subtraction)  # -> mat; plug-in component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
opaquemat_2 = HBOpaqueMaterial(name="Fibra di legno Fibertherm Protect 230", thickness="0.06", conductivity="0.046", density="230", spec_heat="2100")  # -> mat; plug-in component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
opaquemat_3 = HBOpaqueMaterial(name="X-LAM", thickness="0.12", conductivity="0.12", density="470", spec_heat="1600")  # -> mat; plug-in component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
opaquemat_4 = HBOpaqueMaterial(name="Lastra gessofibra fermacell", thickness="0.0125", conductivity="0.32", density="1180", spec_heat="1100")  # -> mat; plug-in component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
opaquemat_5 = HBOpaqueMaterial(name="Fibra di legno Fibertherm Protect 230", thickness="0.06", conductivity="0.046", density="230", spec_heat="2100")  # -> mat; plug-in component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
merge = Merge(Data1=opaquemat, Data2=opaquemat_2, Data3=opaquemat_3, Data4=opaquemat_5, Data5=opaquemat_4)
economical_cobenefit = Panel("")
environmental_cobenefit = Panel("")
social_cobenefit = Panel("")
albedo = Panel("0.70")
thermalemissivity = Panel("0.69")
opaqueconstr = HBOpaqueConstruction(name="Wooden roof", materials=merge)  # -> constr; plug-in component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
name = Text("Wooden roof")
constr = ClusterOutput(opaqueconstr)
economic_cobenefit = Text(economical_cobenefit)
social_cobenefit_2 = Text(social_cobenefit)
albedo_2 = Number(albedo)
environmental_cobenefit_2 = Text(environmental_cobenefit)
thermalemissivity_2 = Number(thermalemissivity)
name_2 = ClusterOutput(name)
decnstrconstr = HBDeconstructConstruction(constr=opaqueconstr)  # -> materials, layers, r_val_si, r_val_ip, u_fac_si, u_fac_ip, shgc, t_sol, t_vis; plug-in component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
economic_cobenefit_2 = ClusterOutput(economic_cobenefit)
albedo_3 = ClusterOutput(albedo_2)
thermalemissivity_3 = ClusterOutput(thermalemissivity_2)
environmental_cobenefit_3 = ClusterOutput(environmental_cobenefit_2)
social_cobenefit_3 = ClusterOutput(social_cobenefit_2)
panel = Panel(decnstrconstr.u_fac_si)
u_fac_si = ClusterOutput(decnstrconstr.u_fac_si)
addition_5 = Addition(A=gwp_kgco2e_m2_4, B=gwp_kgco2e_m2, C=gwp_kgco2e_m2_2, D=gwp_kgco2e_m2_3, E=gwp_kgco2e_m2_5)
addition_6 = Addition(A=gwp_kgco2e_4, B=gwp_kgco2e, C=gwp_kgco2e_2, D=gwp_kgco2e_3, E=gwp_kgco2e_5)
gwp_kgco2e_m2_6 = Panel(addition_5)
gwp_kgco2e_6 = Panel(addition_6)
gwp_kgco2e_m2_7 = Number(gwp_kgco2e_m2_6)
gwp_kgco2e_m2_8 = ClusterOutput(gwp_kgco2e_m2_7)
gwp_kgco2e_7 = Number(gwp_kgco2e_6)
gwp_kgco2e_8 = ClusterOutput(gwp_kgco2e_7)

# ==== cluster Solaio_allegerito_eps_altamente_isolato
m2_solaio = ClusterInput()
m2_solaio_2 = Data(m2_solaio)

# ---- group: GWP(isolante)
spessore_m = Panel("0.14")
densità_kg_m3 = Panel("30")
multiplication = Multiplication(A=spessore_m, B=m2_solaio_2)
volume_m3 = Panel(multiplication)
multiplication_2 = Multiplication(A=volume_m3, B=densità_kg_m3)
ecc_kgco2e_kg = Panel("4.78")
massa_kg = Panel(multiplication_2)
multiplication_3 = Multiplication(A=massa_kg, B=ecc_kgco2e_kg)
gwp_kgco2e = Panel(multiplication_3)
division = Division(A=gwp_kgco2e, B=m2_solaio_2)
gwp_kgco2e_m2 = Panel(division)

# ---- group: GWP(tegole)
spessore_m_2 = Panel("0.02")
densità_kg_m3_2 = Panel("1350")
multiplication_4 = Multiplication(A=spessore_m_2, B=m2_solaio_2)
volume_m3_2 = Panel(multiplication_4)
multiplication_5 = Multiplication(A=volume_m3_2, B=densità_kg_m3_2)
ecc_kgco2e_kg_2 = Panel("0.48")
massa_kg_2 = Panel(multiplication_5)
multiplication_6 = Multiplication(A=massa_kg_2, B=ecc_kgco2e_kg_2)
gwp_kgco2e_2 = Panel(multiplication_6)
division_2 = Division(A=gwp_kgco2e_2, B=m2_solaio_2)
gwp_kgco2e_m2_2 = Panel(division_2)

# ---- group: GWP (getto cls)
spessore_m_3 = Panel("0.10")
densità_kg_m3_3 = Panel("2400")
multiplication_7 = Multiplication(A=spessore_m_3, B=m2_solaio_2)
volume_m3_3 = Panel(multiplication_7)
multiplication_8 = Multiplication(A=volume_m3_3, B=densità_kg_m3_3)
ecc_kgco2e_kg_3 = Panel("0.094")
massa_kg_3 = Panel(multiplication_8)
multiplication_9 = Multiplication(A=massa_kg_3, B=ecc_kgco2e_kg_3)
gwp_kgco2e_3 = Panel(multiplication_9)
division_3 = Division(A=gwp_kgco2e_3, B=m2_solaio_2)
gwp_kgco2e_m2_3 = Panel(division_3)

# ---- group: GWP(pignatte eps)
spessore_m_4 = Panel("0.20")
densità_kg_m3_4 = Panel("15")
multiplication_10 = Multiplication(A=spessore_m_4, B=m2_solaio_2)
volume_m3_4 = Panel(multiplication_10)
multiplication_11 = Multiplication(A=volume_m3_4, B=densità_kg_m3_4)
ecc_kgco2e_kg_4 = Panel("4.78")
massa_kg_4 = Panel(multiplication_11)
multiplication_12 = Multiplication(A=massa_kg_4, B=ecc_kgco2e_kg_4)
gwp_kgco2e_4 = Panel(multiplication_12)
division_4 = Division(A=gwp_kgco2e_4, B=m2_solaio_2)
gwp_kgco2e_m2_4 = Panel(division_4)

# ---- group: GWP(intonaco)
spessore_m_5 = Panel("0.02")
densità_kg_m3_5 = Panel("1500")
multiplication_13 = Multiplication(A=spessore_m_5, B=m2_solaio_2)
volume_m3_5 = Panel(multiplication_13)
multiplication_14 = Multiplication(A=volume_m3_5, B=densità_kg_m3_5)
ecc_kgco2e_kg_5 = Panel("0.13")
massa_kg_5 = Panel(multiplication_14)
multiplication_15 = Multiplication(A=massa_kg_5, B=ecc_kgco2e_kg_5)
gwp_kgco2e_5 = Panel(multiplication_15)
division_5 = Division(A=gwp_kgco2e_5, B=m2_solaio_2)
gwp_kgco2e_m2_5 = Panel(division_5)

# ----
subtraction = Subtraction(A="1", B="0.4")
subtraction_2 = Subtraction(A="1", B="0.7")
subtraction_3 = Subtraction(A="1", B="0.250")
subtraction_4 = Subtraction(A="1", B="0.650")
opaquemat = HBOpaqueMaterial(
    name="custom_air_gap",
    thickness="0.02",
    conductivity="0.125",
    density="1.28",
    spec_heat="1000",
    roughness="Smooth",
    therm_absp="0.9",
    sol_absp="0.7",
    vis_absp="0.7")  # -> mat; plug-in component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
opaquemat_2 = HBOpaqueMaterial(
    name="Tegole",
    thickness="0.02",
    conductivity="0.575",
    density="1350",
    spec_heat="840",
    therm_absp="0.91",
    sol_absp=subtraction,
    vis_absp=subtraction)  # -> mat; plug-in component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
opaquemat_3 = HBOpaqueMaterial(
    name="Isolante",
    thickness="0.14",
    conductivity="0.032",
    density="30",
    spec_heat="1250",
    therm_absp="0.1",
    sol_absp=subtraction_2,
    vis_absp=subtraction_2)  # -> mat; plug-in component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
opaquemat_4 = HBOpaqueMaterial(
    name="Solaio_alleggerito_EPS",
    thickness="0.3",
    conductivity="0.220",
    density="800",
    spec_heat="1000",
    therm_absp="0.54",
    sol_absp=subtraction_3,
    vis_absp=subtraction_3)  # -> mat; plug-in component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
opaquemat_5 = HBOpaqueMaterial(
    name="Intonaco_interno",
    thickness="0.02",
    conductivity="0.700",
    density="1500",
    spec_heat="1000",
    therm_absp="0.9",
    sol_absp=subtraction_4,
    vis_absp=subtraction_4)  # -> mat; plug-in component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
panel = Panel("Highly insulated lightweight concrete floor")
merge = Merge(Data1=opaquemat_2, Data2=opaquemat, Data3=opaquemat_3, Data4=opaquemat_4, Data5=opaquemat_5)
economical_cobenefit = Panel("")
environmental_cobenefit = Panel("")
social_cobenefit = Panel("")
name = Text(panel)
opaqueconstr = HBOpaqueConstruction(name=panel, materials=merge)  # -> constr; plug-in component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
albedo = Panel("0.40")
thermalemissivity = Panel("0.90")
name_2 = ClusterOutput(name)
decnstrconstr = HBDeconstructConstruction(constr=opaqueconstr)  # -> materials, layers, r_val_si, r_val_ip, u_fac_si, u_fac_ip, shgc, t_sol, t_vis; plug-in component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
constr = ClusterOutput(opaqueconstr)
economic_cobenefit = Text(economical_cobenefit)
social_cobenefit_2 = Text(social_cobenefit)
albedo_2 = Number(albedo)
environmental_cobenefit_2 = Text(environmental_cobenefit)
thermalemissivity_2 = Number(thermalemissivity)
u_fac_si = ClusterOutput(decnstrconstr.u_fac_si)
economic_cobenefit_2 = ClusterOutput(economic_cobenefit)
albedo_3 = ClusterOutput(albedo_2)
panel_2 = Panel(decnstrconstr.u_fac_si)
thermalemissivity_3 = ClusterOutput(thermalemissivity_2)
environmental_cobenefit_3 = ClusterOutput(environmental_cobenefit_2)
social_cobenefit_3 = ClusterOutput(social_cobenefit_2)
addition = Addition(A=gwp_kgco2e_m2_2, B=gwp_kgco2e_m2, C=gwp_kgco2e_m2_3, D=gwp_kgco2e_m2_4, E=gwp_kgco2e_m2_5)
addition_2 = Addition(A=gwp_kgco2e_2, B=gwp_kgco2e, C=gwp_kgco2e_3, D=gwp_kgco2e_4, E=gwp_kgco2e_5)
gwp_kgco2e_m2_6 = Panel(addition)
gwp_kgco2e_m2_7 = Panel(addition_2)
gwp_kgco2e_m2_8 = Number(gwp_kgco2e_m2_6)
gwp_kgco2e_6 = Number(gwp_kgco2e_m2_7)
gwp_kgco2e_m2_9 = ClusterOutput(gwp_kgco2e_m2_8)
gwp_kgco2e_7 = ClusterOutput(gwp_kgco2e_6)

# ==== cluster Copertura_calcestruzzo
m2_solaio = ClusterInput()
m2_solaio_2 = Data(m2_solaio)
subtraction = Subtraction(A="1", B="0.4")

# ---- group: GWP(isolante mapetherm)
spessore_m = Panel("0.10")
densità_kg_m3 = Panel("1000")
multiplication = Multiplication(A=spessore_m, B=m2_solaio_2)
volume_m3 = Panel(multiplication)
multiplication_2 = Multiplication(A=volume_m3, B=densità_kg_m3)
ecc_kgco2e_kg = Panel("3.29")
massa_kg = Panel(multiplication_2)
multiplication_3 = Multiplication(A=massa_kg, B=ecc_kgco2e_kg)
gwp_kgco2e = Panel(multiplication_3)
division = Division(A=gwp_kgco2e, B=m2_solaio_2)
gwp_kgco2e_m2 = Panel(division)

# ---- group: GWP(tegole)
spessore_m_2 = Panel("0.02")
densità_kg_m3_2 = Panel("1350")
multiplication_4 = Multiplication(A=spessore_m_2, B=m2_solaio_2)
volume_m3_2 = Panel(multiplication_4)
multiplication_5 = Multiplication(A=volume_m3_2, B=densità_kg_m3_2)
ecc_kgco2e_kg_2 = Panel("0.48")
massa_kg_2 = Panel(multiplication_5)
multiplication_6 = Multiplication(A=massa_kg_2, B=ecc_kgco2e_kg_2)
gwp_kgco2e_2 = Panel(multiplication_6)
division_2 = Division(A=gwp_kgco2e_2, B=m2_solaio_2)
gwp_kgco2e_m2_2 = Panel(division_2)

# ---- group: GWP (getto cls)
spessore_m_3 = Panel("0.10")
densità_kg_m3_3 = Panel("2400")
multiplication_7 = Multiplication(A=spessore_m_3, B=m2_solaio_2)
volume_m3_3 = Panel(multiplication_7)
multiplication_8 = Multiplication(A=volume_m3_3, B=densità_kg_m3_3)
ecc_kgco2e_kg_3 = Panel("0.094")
massa_kg_3 = Panel(multiplication_8)
multiplication_9 = Multiplication(A=massa_kg_3, B=ecc_kgco2e_kg_3)
gwp_kgco2e_3 = Panel(multiplication_9)
division_3 = Division(A=gwp_kgco2e_3, B=m2_solaio_2)
gwp_kgco2e_m2_3 = Panel(division_3)

# ---- group: GWP(pignatte)
spessore_m_4 = Panel("0.20")
densità_kg_m3_4 = Panel("480")
multiplication_10 = Multiplication(A=spessore_m_4, B=m2_solaio_2)
volume_m3_4 = Panel(multiplication_10)
multiplication_11 = Multiplication(A=volume_m3_4, B=densità_kg_m3_4)
ecc_kgco2e_kg_4 = Panel("0.224")
massa_kg_4 = Panel(multiplication_11)
multiplication_12 = Multiplication(A=massa_kg_4, B=ecc_kgco2e_kg_4)
gwp_kgco2e_4 = Panel(multiplication_12)
division_4 = Division(A=gwp_kgco2e_4, B=m2_solaio_2)
gwp_kgco2e_m2_4 = Panel(division_4)

# ---- group: GWP(intonaco)
spessore_m_5 = Panel("0.02")
densità_kg_m3_5 = Panel("1500")
multiplication_13 = Multiplication(A=spessore_m_5, B=m2_solaio_2)
volume_m3_5 = Panel(multiplication_13)
multiplication_14 = Multiplication(A=volume_m3_5, B=densità_kg_m3_5)
ecc_kgco2e_kg_5 = Panel("0.13")
massa_kg_5 = Panel(multiplication_14)
multiplication_15 = Multiplication(A=massa_kg_5, B=ecc_kgco2e_kg_5)
gwp_kgco2e_5 = Panel(multiplication_15)
division_5 = Division(A=gwp_kgco2e_5, B=m2_solaio_2)
gwp_kgco2e_m2_5 = Panel(division_5)

# ----
opaquemat = HBOpaqueMaterial(name="Mapetherm EPS 100 CAM", thickness="0.1", conductivity="0.035", density="1000", spec_heat="1260")  # -> mat; plug-in component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
opaquemat_2 = HBOpaqueMaterial(name="Solaio in laterocemento", thickness="0.3", conductivity="0.72", density="1800", spec_heat="840")  # -> mat; plug-in component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
opaquemat_3 = HBOpaqueMaterial(name="Intonaco interno", thickness="0.02", conductivity="0.7", density="1500", spec_heat="1000")  # -> mat; plug-in component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
opaquemat_4 = HBOpaqueMaterial(
    name="Tegole",
    thickness="0.02",
    conductivity="0.575",
    density="1350",
    spec_heat="840",
    therm_absp="0.91",
    sol_absp=subtraction,
    vis_absp=subtraction)  # -> mat; plug-in component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
merge = Merge(Data1=opaquemat_4, Data2=opaquemat, Data3=opaquemat_2, Data4=opaquemat_3)
economical_cobenefit = Panel("")
social_cobenefit = Panel("")
environmental_cobenefit = Panel("")
thermalemissivity = Panel("0.90")
albedo = Panel("0.40")
opaqueconstr = HBOpaqueConstruction(name="Concrete roof", materials=merge)  # -> constr; plug-in component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
name = Text("Concrete roof")
constr = ClusterOutput(opaqueconstr)
economic_cobenefit = Text(economical_cobenefit)
decnstrconstr = HBDeconstructConstruction(constr=opaqueconstr)  # -> materials, layers, r_val_si, r_val_ip, u_fac_si, u_fac_ip, shgc, t_sol, t_vis; plug-in component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
social_cobenefit_2 = Text(social_cobenefit)
albedo_2 = Number(albedo)
environmental_cobenefit_2 = Text(environmental_cobenefit)
thermalemissivity_2 = Number(thermalemissivity)
name_2 = ClusterOutput(name)
economic_cobenefit_2 = ClusterOutput(economic_cobenefit)
albedo_3 = ClusterOutput(albedo_2)
thermalemissivity_3 = ClusterOutput(thermalemissivity_2)
environmental_cobenefit_3 = ClusterOutput(environmental_cobenefit_2)
social_cobenefit_3 = ClusterOutput(social_cobenefit_2)
panel = Panel(decnstrconstr.u_fac_si)
u_fac_si = ClusterOutput(decnstrconstr.u_fac_si)
addition = Addition(A=gwp_kgco2e_m2_2, B=gwp_kgco2e_m2, C=gwp_kgco2e_m2_3, D=gwp_kgco2e_m2_4, E=gwp_kgco2e_m2_5)
addition_2 = Addition(A=gwp_kgco2e_2, B=gwp_kgco2e, C=gwp_kgco2e_3, D=gwp_kgco2e_4, E=gwp_kgco2e_5)
gwp_kgco2e_m2_6 = Panel(addition)
gwp_kgco2e_6 = Panel(addition_2)
gwp_kgco2e_m2_7 = Number(gwp_kgco2e_m2_6)
gwp_kgco2e_7 = Number(gwp_kgco2e_6)
gwp_kgco2e_8 = ClusterOutput(gwp_kgco2e_7)
gwp_kgco2e_m2_8 = ClusterOutput(gwp_kgco2e_m2_7)

# ==== cluster Solaio_calcestruzzo_igloo_non_isolato
m2_solaio = ClusterInput()
m2_solaio_2 = Data(m2_solaio)
subtraction = Subtraction(A="1", B="0.2")
subtraction_2 = Subtraction(A="1", B="0.250")
subtraction_3 = Subtraction(A="1", B="0.250")
opaquemat = HBOpaqueMaterial(
    name="pavimentazione",
    thickness="0.01",
    conductivity="1.300",
    density="2300",
    spec_heat="840",
    therm_absp="0.85",
    sol_absp=subtraction,
    vis_absp=subtraction)  # -> mat; plug-in component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
opaquemat_2 = HBOpaqueMaterial(
    name="massetto_calcestruzzo",
    thickness="0.05",
    conductivity="2.02",
    density="2200",
    spec_heat="1000",
    therm_absp="0.9",
    sol_absp=subtraction_2,
    vis_absp=subtraction_2)  # -> mat; plug-in component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
opaquemat_3 = HBOpaqueMaterial(
    name="Calcestruzzo",
    thickness="0.3",
    conductivity="1.7",
    density="2400",
    spec_heat="1000",
    therm_absp="0.9",
    sol_absp=subtraction_3,
    vis_absp=subtraction_3)  # -> mat; plug-in component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

# ---- group: GWP (cls)
spessore_m = Panel("0.3")
densità_kg_m3 = Panel("2400")
multiplication = Multiplication(A=spessore_m, B=m2_solaio_2)
volume_m3 = Panel(multiplication)
multiplication_2 = Multiplication(A=volume_m3, B=densità_kg_m3)
ecc_kgco2e_kg = Panel("0.094")
massa_kg = Panel(multiplication_2)
multiplication_3 = Multiplication(A=massa_kg, B=ecc_kgco2e_kg)
gwp_kgco2e = Panel(multiplication_3)
division = Division(A=gwp_kgco2e, B=m2_solaio_2)
gwp_kgco2e_m2 = Panel(division)

# ---- group: GWP (massetto)
spessore_m_2 = Panel("0.05")
densità_kg_m3_2 = Panel("2200")
multiplication_4 = Multiplication(A=spessore_m_2, B=m2_solaio_2)
volume_m3_2 = Panel(multiplication_4)
multiplication_5 = Multiplication(A=volume_m3_2, B=densità_kg_m3_2)
ecc_kgco2e_kg_2 = Panel("0.089")
massa_kg_2 = Panel(multiplication_5)
multiplication_6 = Multiplication(A=massa_kg_2, B=ecc_kgco2e_kg_2)
gwp_kgco2e_2 = Panel(multiplication_6)
division_2 = Division(A=gwp_kgco2e_2, B=m2_solaio_2)
gwp_kgco2e_m2_2 = Panel(division_2)

# ----
opaquemat_4 = HBOpaqueMaterial(
    name="custom_air_gap",
    thickness="0.22",
    conductivity="1.22",
    density="1.28",
    spec_heat="1000",
    roughness="Smooth",
    therm_absp="0.9",
    sol_absp="0.7",
    vis_absp="0.7")  # -> mat; plug-in component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

# ---- group: GWP(pavimentazione)
spessore_m_3 = Panel("0.01")
densità_kg_m3_3 = Panel("2300")
multiplication_7 = Multiplication(A=spessore_m_3, B=m2_solaio_2)
volume_m3_3 = Panel(multiplication_7)
multiplication_8 = Multiplication(A=volume_m3_3, B=densità_kg_m3_3)
ecc_kgco2e_kg_3 = Panel("0.615")
massa_kg_3 = Panel(multiplication_8)
multiplication_9 = Multiplication(A=massa_kg_3, B=ecc_kgco2e_kg_3)
gwp_kgco2e_3 = Panel(multiplication_9)
division_3 = Division(A=gwp_kgco2e_3, B=m2_solaio_2)
gwp_kgco2e_m2_3 = Panel(division_3)

# ----
panel = Panel("Igloo concrete floor not insulated")
merge = Merge(Data1=opaquemat_4, Data2=opaquemat_3, Data3=opaquemat_2, Data4=opaquemat)
economical_cobenefit = Panel("")
environmental_cobenefit = Panel("")
social_cobenefit = Panel("")
albedo = Panel("0.40")
thermalemissivity = Panel("0.90")
opaqueconstr = HBOpaqueConstruction(name=panel, materials=merge)  # -> constr; plug-in component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
economic_cobenefit = Text(economical_cobenefit)
social_cobenefit_2 = Text(social_cobenefit)
albedo_2 = Number(albedo)
constr = ClusterOutput(opaqueconstr)
environmental_cobenefit_2 = Text(environmental_cobenefit)
decnstrconstr = HBDeconstructConstruction(constr=opaqueconstr)  # -> materials, layers, r_val_si, r_val_ip, u_fac_si, u_fac_ip, shgc, t_sol, t_vis; plug-in component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
thermalemissivity_2 = Number(thermalemissivity)
name = Text(panel)
economic_cobenefit_2 = ClusterOutput(economic_cobenefit)
albedo_3 = ClusterOutput(albedo_2)
thermalemissivity_3 = ClusterOutput(thermalemissivity_2)
environmental_cobenefit_3 = ClusterOutput(environmental_cobenefit_2)
social_cobenefit_3 = ClusterOutput(social_cobenefit_2)
name_2 = ClusterOutput(name)
u_fac_si = ClusterOutput(decnstrconstr.u_fac_si)
panel_2 = Panel(decnstrconstr.u_fac_si)
addition = Addition(A=gwp_kgco2e_m2, B=gwp_kgco2e_m2_2, C=gwp_kgco2e_m2_3)
addition_2 = Addition(A=gwp_kgco2e, B=gwp_kgco2e_2, C=gwp_kgco2e_m2_3)
gwp_kgco2_m2 = Panel(addition)
gwp_kgco2 = Panel(addition_2)
gwp_kg_co2_m2 = Number(gwp_kgco2_m2)
gwp_kgco2_2 = Number(gwp_kgco2)
gwp_kg_co2_m2_2 = ClusterOutput(gwp_kg_co2_m2)
gwp_kgco2_3 = ClusterOutput(gwp_kgco2_2)

# ==== cluster Solaio_calcestruzzo_igloo_scarso_isolato
m2_solaio = ClusterInput()
m2_solaio_2 = Data(m2_solaio)
subtraction = Subtraction(A="1", B="0.250")
subtraction_2 = Subtraction(A="1", B="0.250")
subtraction_3 = Subtraction(A="1", B="0.250")
subtraction_4 = Subtraction(A="1", B="0.2")
subtraction_5 = Subtraction(A="1", B="0.7")
panel = Panel("0.1")

# ---- group: GWP(pavimentazione)
spessore_m = Panel("0.01")
densità_kg_m3 = Panel("2300")
multiplication = Multiplication(A=spessore_m, B=m2_solaio_2)
volume_m3 = Panel(multiplication)
multiplication_2 = Multiplication(A=volume_m3, B=densità_kg_m3)
ecc_kgco2e_kg = Panel("0.615")
massa_kg = Panel(multiplication_2)
multiplication_3 = Multiplication(A=massa_kg, B=ecc_kgco2e_kg)
kgco2e = Panel(multiplication_3)
division = Division(A=kgco2e, B=m2_solaio_2)
gwp_kgco2e_m2 = Panel(division)

# ---- group: GWP (isolante)
spessore_m_2 = Panel("0.02")
densità_kg_m3_2 = Panel("100")
multiplication_4 = Multiplication(A=spessore_m_2, B=m2_solaio_2)
volume_m3_2 = Panel(multiplication_4)
multiplication_5 = Multiplication(A=volume_m3_2, B=densità_kg_m3_2)
ecc_kgco2e_kg_2 = Panel("1.12")
massa_kg_2 = Panel(multiplication_5)
multiplication_6 = Multiplication(A=massa_kg_2, B=ecc_kgco2e_kg_2)
gwp_kgco2e = Panel(multiplication_6)
division_2 = Division(A=gwp_kgco2e, B=m2_solaio_2)
gwp_kgco2e_m2_2 = Panel(division_2)

# ---- group: GWP (massetto)
spessore_m_3 = Panel("0.05")
densità_kg_m3_3 = Panel("2200")
multiplication_7 = Multiplication(A=spessore_m_3, B=m2_solaio_2)
volume_m3_3 = Panel(multiplication_7)
multiplication_8 = Multiplication(A=volume_m3_3, B=densità_kg_m3_3)
ecc_kgco2e_kg_3 = Panel("0.089")
massa_kg_3 = Panel(multiplication_8)
multiplication_9 = Multiplication(A=massa_kg_3, B=ecc_kgco2e_kg_3)
gwp_kgco2e_2 = Panel(multiplication_9)
division_3 = Division(A=gwp_kgco2e_2, B=m2_solaio_2)
gwp_kgco2e_m2_3 = Panel(division_3)

# ---- group: GWP (cls)
spessore_m_4 = Panel("0.3")
densità_kg_m3_4 = Panel("2400")
multiplication_10 = Multiplication(A=spessore_m_4, B=m2_solaio_2)
volume_m3_4 = Panel(multiplication_10)
multiplication_11 = Multiplication(A=volume_m3_4, B=densità_kg_m3_4)
ecc_kgco2e_kg_4 = Panel("0.094")
massa_kg_4 = Panel(multiplication_11)
multiplication_12 = Multiplication(A=massa_kg_4, B=ecc_kgco2e_kg_4)
gwp_kgco2e_3 = Panel(multiplication_12)
division_4 = Division(A=gwp_kgco2e_3, B=m2_solaio_2)
gwp_kgco2e_m2_4 = Panel(division_4)

# ---- group: GWP (massetto)
spessore_m_5 = Panel("0.05")
densità_kg_m3_5 = Panel("2200")
multiplication_13 = Multiplication(A=spessore_m_5, B=m2_solaio_2)
volume_m3_5 = Panel(multiplication_13)
multiplication_14 = Multiplication(A=volume_m3_5, B=densità_kg_m3_5)
ecc_kgco2e_kg_5 = Panel("0.089")
massa_kg_5 = Panel(multiplication_14)
multiplication_15 = Multiplication(A=massa_kg_5, B=ecc_kgco2e_kg_5)
gwp_kgco2e_4 = Panel(multiplication_15)
division_5 = Division(A=gwp_kgco2e_4, B=m2_solaio_2)
gwp_kgco2e_m2_5 = Panel(division_5)

# ----
opaquemat = HBOpaqueMaterial(
    name="Calcestruzzo",
    thickness="0.3",
    conductivity="1.7",
    density="2400",
    spec_heat="1000",
    therm_absp="0.9",
    sol_absp=subtraction_2,
    vis_absp=subtraction_2)  # -> mat; plug-in component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
opaquemat_2 = HBOpaqueMaterial(
    name="massetto_calcestruzzo",
    thickness="0.05",
    conductivity="2.02",
    density="2200",
    spec_heat="1000",
    therm_absp="0.9",
    sol_absp=subtraction,
    vis_absp=subtraction)  # -> mat; plug-in component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
opaquemat_3 = HBOpaqueMaterial(
    name="massetto_calcestruzzo",
    thickness="0.05",
    conductivity="2.02",
    density="2200",
    spec_heat="1000",
    therm_absp="0.9",
    sol_absp=subtraction_3,
    vis_absp=subtraction_3)  # -> mat; plug-in component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
opaquemat_4 = HBOpaqueMaterial(
    name="custom_air_gap",
    thickness="0.22",
    conductivity="1.22",
    density="1.28",
    spec_heat="1000",
    roughness="Smooth",
    therm_absp="0.9",
    sol_absp="0.7",
    vis_absp="0.7")  # -> mat; plug-in component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
opaquemat_5 = HBOpaqueMaterial(
    name="pavimentazione",
    thickness="0.01",
    conductivity="1.300",
    density="2300",
    spec_heat="840",
    therm_absp="0.85",
    sol_absp=subtraction_4,
    vis_absp=subtraction_4)  # -> mat; plug-in component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
opaquemat_6 = HBOpaqueMaterial(
    name="isolante",
    thickness="0.02",
    conductivity="0.045",
    density="100",
    spec_heat="840",
    therm_absp="0.7",
    sol_absp=subtraction_5,
    vis_absp=subtraction_5)  # -> mat; plug-in component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
panel_2 = Panel("Poorly insulated igloo concrete floor")
merge = Merge(Data1=opaquemat_4, Data2=opaquemat, Data3=opaquemat_3, Data4=opaquemat_6, Data5=opaquemat_2, Data6=opaquemat_5)
economical_cobenefit = Panel("")
environmental_cobenefit = Panel("")
social_cobenefit = Panel("")
albedo = Panel("0.40")
thermalemissivity = Panel("0.90")
opaqueconstr = HBOpaqueConstruction(name=panel_2, materials=merge)  # -> constr; plug-in component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
constr = ClusterOutput(opaqueconstr)
decnstrconstr = HBDeconstructConstruction(constr=opaqueconstr)  # -> materials, layers, r_val_si, r_val_ip, u_fac_si, u_fac_ip, shgc, t_sol, t_vis; plug-in component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
economic_cobenefit = Text(economical_cobenefit)
social_cobenefit_2 = Text(social_cobenefit)
albedo_2 = Number(albedo)
environmental_cobenefit_2 = Text(environmental_cobenefit)
name = Text(panel_2)
thermalemissivity_2 = Number(thermalemissivity)
economic_cobenefit_2 = ClusterOutput(economic_cobenefit)
albedo_3 = ClusterOutput(albedo_2)
thermalemissivity_3 = ClusterOutput(thermalemissivity_2)
environmental_cobenefit_3 = ClusterOutput(environmental_cobenefit_2)
social_cobenefit_3 = ClusterOutput(social_cobenefit_2)
name_2 = ClusterOutput(name)
panel_3 = Panel(decnstrconstr.u_fac_si)
u_fac_si = ClusterOutput(decnstrconstr.u_fac_si)
addition = Addition(A=gwp_kgco2e_m2_4, B=gwp_kgco2e_m2_5, C=gwp_kgco2e_m2_2, D=gwp_kgco2e_m2_3, E=gwp_kgco2e_m2)
addition_2 = Addition(A=gwp_kgco2e_3, B=gwp_kgco2e_4, C=gwp_kgco2e, D=gwp_kgco2e_2, E=kgco2e)
gwp = Panel(addition_2)
gwp_kgco2_m2 = Panel(addition)
gwp_kgco2 = Number(gwp)
gwp_kg_co2_m2 = Number(gwp_kgco2_m2)
gwp_kgco2_2 = ClusterOutput(gwp_kgco2)
gwp_kg_co2_m2_2 = ClusterOutput(gwp_kg_co2_m2)

# ==== cluster Solaio_calcestruzzo_igloo_isolato
m2_solaio = ClusterInput()
m2_solaio_2 = Data(m2_solaio)

# ---- group: GWP(pavimentazione)
spessore_m = Panel("0.01")
densità_kg_m3 = Panel("2300")
multiplication = Multiplication(A=spessore_m, B=m2_solaio_2)
volume_m3 = Panel(multiplication)
multiplication_2 = Multiplication(A=volume_m3, B=densità_kg_m3)
ecc_kgco2e_kg = Panel("0.615")
massa_kg = Panel(multiplication_2)
multiplication_3 = Multiplication(A=massa_kg, B=ecc_kgco2e_kg)
gwp_kgco2e = Panel(multiplication_3)
division = Division(A=gwp_kgco2e, B=m2_solaio_2)
gwp_kgco2e_m2 = Panel(division)

# ---- group: GWP (isolante)
spessore_m_2 = Panel("0.1")
densità_kg_m3_2 = Panel("30")
multiplication_4 = Multiplication(A=spessore_m_2, B=m2_solaio_2)
volume_m3_2 = Panel(multiplication_4)
multiplication_5 = Multiplication(A=volume_m3_2, B=densità_kg_m3_2)
ecc_kgco2e_kg_2 = Panel("4.78")
massa_kg_2 = Panel(multiplication_5)
multiplication_6 = Multiplication(A=massa_kg_2, B=ecc_kgco2e_kg_2)
gwp_kgco2e_2 = Panel(multiplication_6)
division_2 = Division(A=gwp_kgco2e_2, B=m2_solaio_2)
gwp_kgco2e_m2_2 = Panel(division_2)

# ---- group: GWP (massetto)
spessore_m_3 = Panel("0.05")
densità_kg_m3_3 = Panel("2200")
multiplication_7 = Multiplication(A=spessore_m_3, B=m2_solaio_2)
volume_m3_3 = Panel(multiplication_7)
multiplication_8 = Multiplication(A=volume_m3_3, B=densità_kg_m3_3)
ecc_kgco2e_kg_3 = Panel("0.089")
massa_kg_3 = Panel(multiplication_8)
multiplication_9 = Multiplication(A=massa_kg_3, B=ecc_kgco2e_kg_3)
gwp_kgco2e_3 = Panel(multiplication_9)
division_3 = Division(A=gwp_kgco2e_3, B=m2_solaio_2)
gwp_kgco2e_m2_3 = Panel(division_3)

spessore_m_4 = Panel("0.05")
densità_kg_m3_4 = Panel("2200")
multiplication_10 = Multiplication(A=spessore_m_4, B=m2_solaio_2)
volume_m3_4 = Panel(multiplication_10)
multiplication_11 = Multiplication(A=volume_m3_4, B=densità_kg_m3_4)
ecc_kgco2e_kg_4 = Panel("0.089")
massa_kg_4 = Panel(multiplication_11)
multiplication_12 = Multiplication(A=massa_kg_4, B=ecc_kgco2e_kg_4)
gwp_kgco2e_4 = Panel(multiplication_12)
division_4 = Division(A=gwp_kgco2e_4, B=m2_solaio_2)
gwp_kgco2e_m2_4 = Panel(division_4)

# ---- group: GWP (cls)
spessore_m_5 = Panel("0.3")
densità_kg_m3_5 = Panel("2400")
multiplication_13 = Multiplication(A=spessore_m_5, B=m2_solaio_2)
volume_m3_5 = Panel(multiplication_13)
multiplication_14 = Multiplication(A=volume_m3_5, B=densità_kg_m3_5)
ecc_kgco2e_kg_5 = Panel("0.094")
massa_kg_5 = Panel(multiplication_14)
multiplication_15 = Multiplication(A=massa_kg_5, B=ecc_kgco2e_kg_5)
gwp_kgco2e_5 = Panel(multiplication_15)
division_5 = Division(A=gwp_kgco2e_5, B=m2_solaio_2)
gwp_kgco2e_m2_5 = Panel(division_5)

# ----
subtraction = Subtraction(A="1", B="0.250")
subtraction_2 = Subtraction(A="1", B="0.250")
subtraction_3 = Subtraction(A="1", B="0.250")
subtraction_4 = Subtraction(A="1", B="0.2")
subtraction_5 = Subtraction(A="1", B="0.7")
opaquemat = HBOpaqueMaterial(
    name="custom_air_gap",
    thickness="0.22",
    conductivity="1.22",
    density="1.28",
    spec_heat="1000",
    roughness="Smooth",
    therm_absp="0.9",
    sol_absp="0.7",
    vis_absp="0.7")  # -> mat; plug-in component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
opaquemat_2 = HBOpaqueMaterial(
    name="Calcestruzzo",
    thickness="0.3",
    conductivity="1.7",
    density="2400",
    spec_heat="1000",
    therm_absp="0.9",
    sol_absp=subtraction_2,
    vis_absp=subtraction_2)  # -> mat; plug-in component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
opaquemat_3 = HBOpaqueMaterial(
    name="massetto_calcestruzzo",
    thickness="0.05",
    conductivity="2.02",
    density="2200",
    spec_heat="1000",
    therm_absp="0.9",
    sol_absp=subtraction,
    vis_absp=subtraction)  # -> mat; plug-in component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
opaquemat_4 = HBOpaqueMaterial(
    name="massetto_calcestruzzo",
    thickness="0.05",
    conductivity="2.02",
    density="2200",
    spec_heat="1000",
    therm_absp="0.9",
    sol_absp=subtraction_3,
    vis_absp=subtraction_3)  # -> mat; plug-in component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
opaquemat_5 = HBOpaqueMaterial(
    name="pavimentazione",
    thickness="0.01",
    conductivity="1.300",
    density="2300",
    spec_heat="840",
    therm_absp="0.85",
    sol_absp=subtraction_4,
    vis_absp=subtraction_4)  # -> mat; plug-in component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
opaquemat_6 = HBOpaqueMaterial(
    name="isolante",
    thickness="0.1",
    conductivity="0.032",
    density="30",
    spec_heat="1250",
    therm_absp="0.1",
    sol_absp=subtraction_5,
    vis_absp=subtraction_5)  # -> mat; plug-in component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
panel = Panel("Insulated igloo concrete floor")
economical_cobenefit = Panel("")
environmental_cobenefit = Panel("")
social_cobenefit = Panel("")
albedo = Panel("0.40")
thermalemissivity = Panel("0.90")
merge = Merge(Data1=opaquemat, Data2=opaquemat_2, Data3=opaquemat_4, Data4=opaquemat_6, Data5=opaquemat_3, Data6=opaquemat_5)
opaqueconstr = HBOpaqueConstruction(name=panel, materials=merge)  # -> constr; plug-in component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
name = Text(panel)
economic_cobenefit = Text(economical_cobenefit)
social_cobenefit_2 = Text(social_cobenefit)
albedo_2 = Number(albedo)
environmental_cobenefit_2 = Text(environmental_cobenefit)
thermalemissivity_2 = Number(thermalemissivity)
constr = ClusterOutput(opaqueconstr)
decnstrconstr = HBDeconstructConstruction(constr=opaqueconstr)  # -> materials, layers, r_val_si, r_val_ip, u_fac_si, u_fac_ip, shgc, t_sol, t_vis; plug-in component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
economic_cobenefit_2 = ClusterOutput(economic_cobenefit)
albedo_3 = ClusterOutput(albedo_2)
thermalemissivity_3 = ClusterOutput(thermalemissivity_2)
name_2 = ClusterOutput(name)
environmental_cobenefit_3 = ClusterOutput(environmental_cobenefit_2)
social_cobenefit_3 = ClusterOutput(social_cobenefit_2)
panel_2 = Panel(decnstrconstr.u_fac_si)
u_fac_si = ClusterOutput(decnstrconstr.u_fac_si)
addition = Addition(A=gwp_kgco2e_5, B=gwp_kgco2e_4, C=gwp_kgco2e_2, D=gwp_kgco2e_3, E=gwp_kgco2e)
addition_2 = Addition(A=gwp_kgco2e_m2_5, B=gwp_kgco2e_m2_4, C=gwp_kgco2e_m2, D=gwp_kgco2e_m2_2, E=gwp_kgco2e_m2_3)
gwp_kgco2e_6 = Panel(addition)
gwp_kgco2e_m2_6 = Panel(addition_2)
gwp_kgco2e_7 = Number(gwp_kgco2e_6)
gwp_kgco2e_m2_7 = Number(gwp_kgco2e_m2_6)
gwp_kgco2e_8 = ClusterOutput(gwp_kgco2e_7)
gwp_kgco2e_m2_8 = ClusterOutput(gwp_kgco2e_m2_7)

# ==== cluster OccupancySchedule
national_holiday = ClusterInput()
change_period = ClusterInput()
change_value = ClusterInput()
mon_fri = ClusterInput()
national_holiday_2 = Data(national_holiday)
change_period_2 = Data(change_period)
mon_fri_2 = Data(mon_fri)
change_value_2 = Data(change_value)
division = Division(A=mon_fri_2, B="100")
sort_list = SortList(Keys=mon_fri_2)  # -> Keys, ValuesValuesA
multiplication = Multiplication(A=division, B=change_value_2)
subtraction = Subtraction(A=mon_fri_2, B=multiplication)
list_length = ListLength(List=mon_fri_2)
list_item = ListItem(List=sort_list.Keys, Index="0", Wrap=True)
panel = Panel(list_item)
construct_domain = ConstructDomain(DomainStart=panel, DomainEnd="1")
panel_2 = Panel(mon_fri_2)
repeat_data = RepeatData(Data=list_item, Length=list_length)
remap_numbers = RemapNumbers(Value=subtraction, Source=construct_domain, Target=construct_domain)  # -> Mapped, Clipped
panel_3 = Panel(remap_numbers.Clipped)
weeklyschedule = HBWeeklySchedule(sun=list_item, mon=mon_fri_2, tue=mon_fri_2, wed=mon_fri_2, thu=mon_fri_2, fri=mon_fri_2, sat=list_item)  # -> out, schedule, idf_year, idf_week, idf_days; plug-in component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
weeklyschedule_2 = HBWeeklySchedule(
    sun=list_item,
    mon=remap_numbers.Clipped,
    tue=remap_numbers.Clipped,
    wed=remap_numbers.Clipped,
    thu=remap_numbers.Clipped,
    fri=remap_numbers.Clipped,
    sat=list_item)  # -> out, schedule, idf_year, idf_week, idf_days; plug-in component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
list_length_2 = ListLength(List=change_period_2)
holiday = Holiday(values=list_item, list=national_holiday_2, date=national_holiday_2)  # -> flatten(holiday), period, hoys, dates
periods = Periods(text=change_period_2)  # -> period, hoys, dates
repeat_data_2 = RepeatData(Data=weeklyschedule_2.schedule, Length=list_length_2)  # -> flatten(Data)
seasonalschedule = HBSeasonalSchedule(
    base_schedule=weeklyschedule.schedule,
    season_scheds=[repeat_data_2, holiday.holiday],
    analysis_periods=[holiday.period, periods.period])  # -> out, schedule, idf_year, idf_week, idf_days; plug-in component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
schedule = ClusterOutput(seasonalschedule.schedule)

# ==== cluster LightingSchedule
change_value__summer = ClusterInput()
change_value__winter = ClusterInput()
change_period = ClusterInput()
national_holiday = ClusterInput()
mon_fri = ClusterInput()
mon_fri_2 = Data(mon_fri)
change_value__winter_2 = Data(change_value__winter)
change_period_2 = Data(change_period)
national_holiday_2 = Data(national_holiday)
change_value__summer_2 = Data(change_value__summer)

sort_list = SortList(Keys=mon_fri_2)  # -> Keys, ValuesValuesA
list_item = ListItem(List=sort_list.Keys, Index="0", Wrap=True)
list_length = ListLength(List=mon_fri_2)
repeat_data = RepeatData(Data=list_item, Length=list_length)

division = Division(A=mon_fri_2, B="100")
multiplication = Multiplication(A=division, B=change_value__summer_2)
panel = Panel(list_item)
subtraction = Subtraction(A=mon_fri_2, B=multiplication)
construct_domain = ConstructDomain(DomainStart=panel, DomainEnd="1")
remap_numbers = RemapNumbers(Value=subtraction, Source=construct_domain, Target=construct_domain)  # -> Mapped, Clipped

panel_2 = Panel(mon_fri_2)
panel_3 = Panel(remap_numbers.Clipped)
weeklyschedule = HBWeeklySchedule(sun=repeat_data, mon=mon_fri_2, tue=mon_fri_2, wed=mon_fri_2, thu=mon_fri_2, fri=mon_fri_2, sat=repeat_data)  # -> out, schedule, idf_year, idf_week, idf_days; plug-in component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
weeklyschedule_2 = HBWeeklySchedule(
    sun=repeat_data,
    mon=remap_numbers.Clipped,
    tue=remap_numbers.Clipped,
    wed=remap_numbers.Clipped,
    thu=remap_numbers.Clipped,
    fri=remap_numbers.Clipped,
    sat=repeat_data)  # -> out, schedule, idf_year, idf_week, idf_days; plug-in component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
holiday = Holiday(values=list_item, list=national_holiday_2, date=national_holiday_2)  # -> holiday, period, hoys, dates
periods = Periods(text=change_period_2)  # -> period, hoys, dates
seasonalschedule = HBSeasonalSchedule(
    base_schedule=weeklyschedule.schedule,
    season_scheds=flatten([weeklyschedule_2.schedule, holiday.holiday]),
    analysis_periods=[periods.period, holiday.period])  # -> out, schedule, idf_year, idf_week, idf_days; plug-in component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
schedule = ClusterOutput(seasonalschedule.schedule)

# ==== cluster HotWaterSchedule
national_holiday = ClusterInput()
mon_fri = ClusterInput()
national_holiday_2 = Data(national_holiday)
mon_fri_2 = Data(mon_fri)

sort_list = SortList(Keys=mon_fri_2)  # -> Keys, ValuesValuesA
list_item = ListItem(List=sort_list.Keys, Index="0", Wrap=True)
list_length = ListLength(List=mon_fri_2)
repeat_data = RepeatData(Data=list_item, Length=list_length)

weeklyschedule = HBWeeklySchedule(sun=repeat_data, mon=mon_fri_2, tue=mon_fri_2, wed=mon_fri_2, thu=mon_fri_2, fri=mon_fri_2, sat=repeat_data)  # -> out, schedule, idf_year, idf_week, idf_days; plug-in component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
holiday = Holiday(values=list_item, list=national_holiday_2, date=national_holiday_2)  # -> holiday, period, hoys, dates
seasonalschedule = HBSeasonalSchedule(base_schedule=weeklyschedule.schedule, season_scheds=flatten(holiday.holiday), analysis_periods=holiday.period)  # -> out, schedule, idf_year, idf_week, idf_days; plug-in component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
schedule = ClusterOutput(seasonalschedule.schedule)

# ==== cluster EcquipmentSchedule
change_period = ClusterInput()
national_holiday = ClusterInput()
change_value = ClusterInput()
mon_fri = ClusterInput()
change_value_2 = Data(change_value)
national_holiday_2 = Data(national_holiday)
mon_fri_2 = Data(mon_fri)
change_period_2 = Data(change_period)

sort_list = SortList(Keys=mon_fri_2)  # -> Keys, ValuesValuesA
list_item = ListItem(List=sort_list.Keys, Index="0", Wrap=True)
list_length = ListLength(List=mon_fri_2)
repeat_data = RepeatData(Data=list_item, Length=list_length)

division = Division(A=mon_fri_2, B="100")
multiplication = Multiplication(A=division, B=change_value_2)
panel = Panel(list_item)
subtraction = Subtraction(A=mon_fri_2, B=multiplication)
construct_domain = ConstructDomain(DomainStart=panel, DomainEnd="1")
remap_numbers = RemapNumbers(Value=subtraction, Source=construct_domain, Target=construct_domain)  # -> Mapped, Clipped

weeklyschedule = HBWeeklySchedule(sun=repeat_data, mon=mon_fri_2, tue=mon_fri_2, wed=mon_fri_2, thu=mon_fri_2, fri=mon_fri_2, sat=repeat_data)  # -> out, schedule, idf_year, idf_week, idf_days; plug-in component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
weeklyschedule_2 = HBWeeklySchedule(
    sun=repeat_data,
    mon=remap_numbers.Clipped,
    tue=remap_numbers.Clipped,
    wed=remap_numbers.Clipped,
    thu=remap_numbers.Clipped,
    fri=remap_numbers.Clipped,
    sat=repeat_data)  # -> out, schedule, idf_year, idf_week, idf_days; plug-in component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
list_length_2 = ListLength(List=change_period_2)
repeat_data_2 = RepeatData(Data=weeklyschedule_2.schedule, Length=list_length_2)
periods = Periods(text=change_period_2)  # -> period, hoys, dates
holiday = Holiday(values=list_item, list=national_holiday_2, date=national_holiday_2)  # -> holiday, period, hoys, dates
seasonalschedule = HBSeasonalSchedule(
    base_schedule=weeklyschedule.schedule,
    season_scheds=flatten([repeat_data_2, holiday.holiday]),
    analysis_periods=[periods.period, holiday.period])  # -> out, schedule, idf_year, idf_week, idf_days; plug-in component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
schedule = ClusterOutput(seasonalschedule.schedule)

# ==== cluster HeatingSchedule
data = ClusterInput()
data_2 = ClusterInput()
data_3 = ClusterInput()
data_4 = Data(data)
data_5 = Data(data_2)
data_6 = Data(data_3)
units = LBUnitConverter(values=data_4, from_u="C", to_u="K")  # -> all_u, values; plug-in component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

sort_list = SortList(Keys=data_4)  # -> Keys, ValuesValuesA
list_item = ListItem(List=sort_list.Keys, Index="0", Wrap=True)
list_length = ListLength(List=data_4)
repeat_data = RepeatData(Data=list_item, Length=list_length)

typelimit = HBTypeLimit(name="Temperature", low_limit="0", unit_type="Temperature")  # -> out, type_limit; plug-in component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
weeklyschedule = HBWeeklySchedule(
    sun=repeat_data,
    mon=data_4,
    tue=data_4,
    wed=data_4,
    thu=data_4,
    fri=data_4,
    sat=repeat_data,
    type_limit=typelimit.type_limit)  # -> out, schedule, idf_year, idf_week, idf_days; plug-in component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
holiday = Holiday(values=repeat_data, list=data_5, date=data_5)  # -> holiday, period, hoys, dates
periods = Periods(text=data_6)  # -> period, hoys, dates
seasonalschedule = HBSeasonalSchedule(
    base_schedule=weeklyschedule.schedule,
    season_scheds=flatten([weeklyschedule.schedule, holiday.holiday]),
    analysis_periods=[periods.period, holiday.period])  # -> out, schedule, idf_year, idf_week, idf_days; plug-in component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
schedule = ClusterOutput(seasonalschedule.schedule)

# ==== cluster CoolingSchedule
data = ClusterInput()
data_2 = ClusterInput()
data_3 = ClusterInput()
data_4 = Data(data)
data_5 = Data(data_2)
data_6 = Data(data_3)
units = LBUnitConverter(values=data_4, from_u="C", to_u="K")  # -> all_u, values; plug-in component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
typelimit = HBTypeLimit(name="Temperature", low_limit="0", unit_type="Temperature")  # -> out, type_limit; plug-in component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

sort_list = SortList(Keys=data_4)  # -> Keys, ValuesValuesA
list_item = ListItem(List=sort_list.Keys, Index="0", Wrap=True)
list_length = ListLength(List=data_4)
repeat_data = RepeatData(Data=list_item, Length=list_length)

weeklyschedule = HBWeeklySchedule(
    sun=repeat_data,
    mon=data_4,
    tue=data_4,
    wed=data_4,
    thu=data_4,
    fri=data_4,
    sat=repeat_data,
    type_limit=typelimit.type_limit)  # -> out, schedule, idf_year, idf_week, idf_days; plug-in component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
holiday = Holiday(values=repeat_data, list=data_6, date=data_6)  # -> holiday, period, hoys, dates
periods = Periods(text=data_5)  # -> period, hoys, dates
seasonalschedule = HBSeasonalSchedule(
    base_schedule=weeklyschedule.schedule,
    season_scheds=flatten([weeklyschedule.schedule, holiday.holiday]),
    analysis_periods=[periods.period, holiday.period])  # -> out, schedule, idf_year, idf_week, idf_days; plug-in component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
schedule = ClusterOutput(seasonalschedule.schedule)

# ==== cluster OccupancySchedule_2
mon_fri = ClusterInput()
mon_fri_2 = Data(mon_fri)
panel = Panel(mon_fri_2)
weeklyschedule = HBWeeklySchedule(sun=mon_fri_2, mon=mon_fri_2, tue=mon_fri_2, wed=mon_fri_2, thu=mon_fri_2, fri=mon_fri_2, sat=mon_fri_2)  # -> out, schedule, idf_year, idf_week, idf_days; plug-in component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
schedule = ClusterOutput(weeklyschedule.schedule)

# ==== cluster LightingSchedule_2
mon_fri = ClusterInput()
mon_fri_2 = Data(mon_fri)
weeklyschedule = HBWeeklySchedule(sun=mon_fri_2, mon=mon_fri_2, tue=mon_fri_2, wed=mon_fri_2, thu=mon_fri_2, fri=mon_fri_2, sat=mon_fri_2)  # -> out, schedule, idf_year, idf_week, idf_days; plug-in component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
schedule = ClusterOutput(weeklyschedule.schedule)

# ==== cluster HeatingSchedule_2
data = ClusterInput()
data_2 = Data(data)
units = LBUnitConverter(values=data_2, from_u="C", to_u="K")  # -> all_u, values; plug-in component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
typelimit = HBTypeLimit(name="Temperature", low_limit="0", unit_type="Temperature")  # -> out, type_limit; plug-in component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
panel = Panel(data_2)
weeklyschedule = HBWeeklySchedule(sun=data_2, mon=data_2, tue=data_2, wed=data_2, thu=data_2, fri=data_2, sat=data_2, type_limit=typelimit.type_limit)  # -> out, schedule, idf_year, idf_week, idf_days; plug-in component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
schedule = ClusterOutput(weeklyschedule.schedule)

# ==== cluster CoolingSchedule_2
data = ClusterInput()
data_2 = Data(data)
units = LBUnitConverter(values=data_2, from_u="C", to_u="K")  # -> all_u, values; plug-in component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
typelimit = HBTypeLimit(name="Temperature", low_limit="0", unit_type="Temperature")  # -> out, type_limit; plug-in component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
weeklyschedule = HBWeeklySchedule(sun=data_2, mon=data_2, tue=data_2, wed=data_2, thu=data_2, fri=data_2, sat=data_2, type_limit=typelimit.type_limit)  # -> out, schedule, idf_year, idf_week, idf_days; plug-in component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
schedule = ClusterOutput(weeklyschedule.schedule)

# ==== cluster Occupancy_sch
mon_sat = ClusterInput()
change_value = ClusterInput()
change_period = ClusterInput()
mon_sat_2 = Data(mon_sat)
change_value_2 = Data(change_value)
change_period_2 = Data(change_period)
division = Division(A=mon_sat_2, B="100")
sort_list = SortList(Keys=mon_sat_2)  # -> Keys, ValuesValuesA
multiplication = Multiplication(A=division, B=change_value_2)
subtraction = Subtraction(A=mon_sat_2, B=multiplication)
list_length = ListLength(List=mon_sat_2)
list_item = ListItem(List=sort_list.Keys, Index="0", Wrap=True)
panel = Panel(list_item)
construct_domain = ConstructDomain(DomainStart=panel, DomainEnd="1")
panel_2 = Panel(mon_sat_2)
repeat_data = RepeatData(Data=list_item, Length=list_length)
remap_numbers = RemapNumbers(Value=subtraction, Source=construct_domain, Target=construct_domain)  # -> Mapped, Clipped
panel_3 = Panel(remap_numbers.Clipped)
weeklyschedule = HBWeeklySchedule(sun=list_item, mon=mon_sat_2, tue=mon_sat_2, wed=mon_sat_2, thu=mon_sat_2, fri=mon_sat_2, sat=mon_sat_2)  # -> out, schedule, idf_year, idf_week, idf_days; plug-in component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
weeklyschedule_2 = HBWeeklySchedule(
    sun=list_item,
    mon=remap_numbers.Clipped,
    tue=remap_numbers.Clipped,
    wed=remap_numbers.Clipped,
    thu=remap_numbers.Clipped,
    fri=remap_numbers.Clipped,
    sat=remap_numbers.Clipped)  # -> out, schedule, idf_year, idf_week, idf_days; plug-in component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
national_holiday = ClusterInput()
national_holiday_2 = Data(national_holiday)
list_length_2 = ListLength(List=change_period_2)
holiday = Holiday(values=list_item, list=national_holiday_2, date=national_holiday_2)  # -> flatten(holiday), period, hoys, dates
periods = Periods_2(text=change_period_2)  # -> period, hoys, dates
repeat_data_2 = RepeatData(Data=weeklyschedule_2.schedule, Length=list_length_2)  # -> flatten(Data)
seasonalschedule = HBSeasonalSchedule(
    base_schedule=weeklyschedule.schedule,
    season_scheds=[repeat_data_2, holiday.holiday],
    analysis_periods=[holiday.period, periods.period])  # -> out, schedule, idf_year, idf_week, idf_days; plug-in component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
schedule = ClusterOutput(seasonalschedule.schedule)

# ==== cluster Heating_sch
mon_sat = ClusterInput()
change_period = ClusterInput()
mon_sat_2 = Data(mon_sat)
change_period_2 = Data(change_period)
division = Division(A=mon_sat_2, B="100")
sort_list = SortList(Keys=mon_sat_2)  # -> Keys, ValuesValuesA
multiplication = Multiplication(A=division)
subtraction = Subtraction(A=mon_sat_2, B=multiplication)
list_length = ListLength(List=mon_sat_2)
list_item = ListItem(List=sort_list.Keys, Index="0", Wrap=True)
panel = Panel(list_item)
construct_domain = ConstructDomain(DomainStart=panel, DomainEnd="1")
panel_2 = Panel(mon_sat_2)
repeat_data = RepeatData(Data=list_item, Length=list_length)
remap_numbers = RemapNumbers(Value=subtraction, Source=construct_domain, Target=construct_domain)  # -> Mapped, Clipped
units = LBUnitConverter(values=mon_sat_2, from_u="C", to_u="K")  # -> all_u, values; plug-in component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
panel_3 = Panel(remap_numbers.Clipped)
typelimit = HBTypeLimit(name="Temperature", low_limit="0", unit_type="Temperature")  # -> out, type_limit; plug-in component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
weeklyschedule = HBWeeklySchedule(
    sun=list_item,
    mon=mon_sat_2,
    tue=mon_sat_2,
    wed=mon_sat_2,
    thu=mon_sat_2,
    fri=mon_sat_2,
    sat=mon_sat_2,
    type_limit=typelimit.type_limit)  # -> out, schedule, idf_year, idf_week, idf_days; plug-in component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
weeklyschedule_2 = HBWeeklySchedule(
    sun=list_item,
    mon=remap_numbers.Clipped,
    tue=remap_numbers.Clipped,
    wed=remap_numbers.Clipped,
    thu=remap_numbers.Clipped,
    fri=remap_numbers.Clipped,
    sat=remap_numbers.Clipped,
    type_limit=typelimit.type_limit)  # -> out, schedule, idf_year, idf_week, idf_days; plug-in component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
national_holiday = ClusterInput()
national_holiday_2 = Data(national_holiday)
list_length_2 = ListLength(List=change_period_2)
holiday = Holiday(values=list_item, list=national_holiday_2, date=national_holiday_2)  # -> flatten(holiday), period, hoys, dates
periods = Periods_2(text=change_period_2)  # -> period, hoys, dates
repeat_data_2 = RepeatData(Data=weeklyschedule_2.schedule, Length=list_length_2)  # -> flatten(Data)
seasonalschedule = HBSeasonalSchedule(
    base_schedule=weeklyschedule.schedule,
    season_scheds=[repeat_data_2, holiday.holiday],
    analysis_periods=[holiday.period, periods.period])  # -> out, schedule, idf_year, idf_week, idf_days; plug-in component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
schedule = ClusterOutput(seasonalschedule.schedule)

# ==== cluster Holiday
date = ClusterInput()
values = ClusterInput()

deconstruct_date = DeconstructDate(Date=date)  # -> Year, Month, Day, Hour, Minute, Second
panel = Panel(deconstruct_date.Month)
panel_2 = Panel(deconstruct_date.Day)
analysisperiod = LBAnalysisPeriod(
    start_month=deconstruct_date.Month,
    start_day=deconstruct_date.Day,
    start_hour=0,
    end_month=deconstruct_date.Month,
    end_day=deconstruct_date.Day)  # -> period, hoys, dates; plug-in component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

panel_3 = Panel(values)
list = ClusterInput()

constantschedule = HBConstantSchedule(values=values, name="festività nazionali")  # -> out, schedule, idf_text; plug-in component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
list_length = ListLength(List=list)
repeat_data = RepeatData(Data=constantschedule.schedule, Length=list_length)

panel_4 = Panel(repeat_data)
holiday = ClusterOutput(repeat_data)
hoys = ClusterOutput(analysisperiod.hoys)
dates = ClusterOutput(analysisperiod.dates)
period = ClusterOutput(analysisperiod.period)

# ==== cluster Periods
text = ClusterInput()
replace_text = ReplaceText(Text=text, Find=" to ", Replace=" ", RecursiveReplace=False)
text_split = TextSplit(Text=replace_text, Separators=" ")  # -> simplify(Result)
panel = Panel(text_split)
list_item = ListItem(List=panel, Index="2", Wrap=True)  # -> flatten(Item)
list_item_2 = ListItem(List=panel, Index="0", Wrap=True)  # -> flatten(Item)
series = Series(Start="1", Step=1, Count="12")  # -> flatten(Series)
panel_2 = Panel(series)
panel_3 = Panel("""Jan
Feb
Mar
Apr
May
Jun
Jul
Aug
Sep
Oct
Nov
Dec""")
replace_members = ReplaceMembers(Set=list_item, Find=panel_3, Replace=series)  # -> flatten(Result)
replace_members_2 = ReplaceMembers(Set=list_item_2, Find=panel_3, Replace=series)  # -> flatten(Result)
list_item_3 = ListItem(List=panel, Index="1", Wrap=True)  # -> flatten(Item)
list_item_4 = ListItem(List=panel, Index="3", Wrap=True)  # -> flatten(Item)
analysisperiod = LBAnalysisPeriod(start_month=replace_members_2, start_day=list_item_3, start_hour=0, end_month=replace_members, end_day=list_item_4)  # -> period, hoys, dates; plug-in component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
period = ClusterOutput(analysisperiod.period)
dates = ClusterOutput(analysisperiod.dates)
hoys = ClusterOutput(analysisperiod.hoys)

# ==== cluster Periods_2
text = ClusterInput()
replace_text = ReplaceText(Text=text, Find=" to ", Replace=" ", RecursiveReplace=False)
text_split = TextSplit(Text=replace_text, Separators=" ")  # -> simplify(Result)
panel = Panel(text_split)
list_item = ListItem(List=panel, Index="0", Wrap=False)  # -> flatten(Item)
list_item_2 = ListItem(List=panel, Index="0", Wrap=False)  # -> flatten(Item)
series = Series(Start="1", Step=1, Count="12")  # -> flatten(Series)
panel_2 = Panel(list_item)
panel_3 = Panel("""Jan
Feb
Mar
Apr
May
Jun
Jul
Aug
Sep
Oct
Nov
Dec""")
panel_4 = Panel(series)
replace_members = ReplaceMembers(Set=list_item, Find=panel_3, Replace=series)  # -> flatten(Result)
replace_members_2 = ReplaceMembers(Set=list_item_2, Find=panel_3, Replace=series)  # -> flatten(Result)
list_item_3 = ListItem(List=panel, Index="1", Wrap=True)  # -> flatten(Item)
list_item_4 = ListItem(List=panel, Index="1", Wrap=True)  # -> flatten(Item)
analysisperiod = LBAnalysisPeriod(start_month=replace_members_2, start_day=list_item_3, start_hour=0, end_month=replace_members, end_day=list_item_4)  # -> period, hoys, dates; plug-in component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
period = ClusterOutput(analysisperiod.period)
dates = ClusterOutput(analysisperiod.dates)
hoys = ClusterOutput(analysisperiod.hoys)
