# Grasshopper definition calcolo CO2.gh (Grasshopper 1.0.7)
# plug-ins: eleFront, LunchBox

list = ValueList({"Analysis Buildings", "Analysis Buildings::Non Residential", "Predefinito"}, selected="Analysis Buildings::Non Residential")
reflay = ReferenceByLayer(LayerName=list, lightweight=False)
list_2 = ValueList({"a_Building name", "b_Wall_Stratigrafy", "c_Wall_u_fac", "d_Roof_Stratigrafy", "e_Roof_u_fac", "f_Floor_Stratigrafy", "g_Floor_u_fac", "h_Enviromental Cobenefit", "i_Social Cobenefit", "l_Economic Cobenefit", "m_GWP(kgCO2e/m2)", "n_GWP(kgCO2)", "o_DF_String"}, selected="n_GWP(kgCO2)")
brep = Brep([<brep referenced from the Rhino model> x3])
getuv = GetUserValue(Geometry=brep, Key=list_2)
division = Division(A=getuv, B=1000)
num = Number(expr("Round(x,2)", division))
ma = MassAddition(Input=flatten(num))  # -> Result, PartialResults
tco2e_buildings = Panel(ma.Result)
tco2e_paved_areas = Number(Slider(300, range=0..1000))
tco2e_buildings_2 = Number(tco2e_buildings)

# ----
# TITLE
panel = Panel(" tCO2eq")
co2_paved_areas = Number(tco2e_paved_areas)
co2_buildings = Number(tco2e_buildings_2)
addition = Addition(A=co2_buildings, B=co2_paved_areas)
concat = Concatenate(FragmentA="Embodied Carbon [tCO2eq]", FragmentB="Total = ", FragmentC=addition, FragmentD=panel)
title = Panel(concat)

merge = Merge(Data1=tco2e_buildings_2, Data2=tco2e_paved_areas)
txt = Text(panel)
txt_2 = Text(panel)
concat_2 = Concatenate(FragmentA="Buildings = ", FragmentB=tco2e_buildings_2, FragmentC=txt)
graft = GraftTree(Tree=merge, IncludeEmptyLists=True, IncludeNullItems=True)
concat_3 = Concatenate(FragmentA="Paved Areas = ", FragmentB=tco2e_paved_areas, FragmentC=txt_2)
panel_2 = Panel(concat_2)
panel_3 = Panel(concat_3)
merge_2 = Merge(Data1=concat_2, Data2=concat_3)
txt_3 = Text(merge_2)
chart = CreateChart(ChartName=title, ChartSeries=txt_3, ValueTree=graft, Chart_Theme="Bright Pastel", Chart_Type="Column")
