# Grasshopper definition soluation _version_11.4_test.gh (Grasshopper 1.0.7)
# plug-ins: LadybugGrasshopper

# ---- group: test geometries
geometry = Geometry([<brep referenced from the Rhino model> x5])

# ----
buildings = Geometry([<brep referenced from the Rhino model> x5])
context = Geometry([<brep referenced from the Rhino model> x63])
geometry_2 = Geometry([<brep referenced from the Rhino model> x5])
buildings_2 = Geometry([<brep referenced from the Rhino model> x5])
context_2 = Geometry()
epw = FilePath("D:\Progetti\Tesi\Modelli e simulazioni\epw\ITA_CM_Caserta.162880_TMYx.epw")
epw_2 = FilePath("D:\Progetti\Tesi\Modelli e simulazioni\epw\ITA_CM_Caserta.162880_TMYx.epw")
pv_panel = Data_Collector(buildings=buildings, context=context, epw_file=epw)  # -> roofs, context, required_data, location_epw, direct_rad, diffuse_rad; inputs buildings: list of Brep, context: list of Brep
# ---------- pv_panel: Python ----------
import ghpythonlib.components as gh
import ghpythonlib.component as ghc
import ladybug.epw as epw 
from ladybug_rhino.grasshopper import all_required_inputs
import ladybug_rhino.grasshopper as lady
from ladybug.datacollection import BaseCollection
                
# decription of the inputs 
ghenv.Component.Params.Input[0].Description = 'Rhino Breps representing for which PV panel output will be calculated'
ghenv.Component.Params.Input[1].Description = 'Rhino Breps representing the context that can block solar radiation to the building(s)'
ghenv.Component.Params.Input[2].Description = 'An epw file path on your system as a string'
        
ghenv.Component.Params.Output[0].Description = 'Picked roof(s) for which PV panel output will be calculated'
ghenv.Component.Params.Output[1].Description = 'Context that can block solar radiation to the building(s)'
ghenv.Component.Params.Output[2].Description = 'A package of data including essential information that should be connected to a calculator component'
ghenv.Component.Params.Output[3].Description = 'Location data for LB Cumulative Sky Matrix'
ghenv.Component.Params.Output[4].Description = 'Direct_rad for LB Cumulative Sky Matrix'
ghenv.Component.Params.Output[5].Description = 'Diffuse_rad data for LB Cumulative Sky Matrix'
         
                
#componenet introducation 
                
ghenv.Component.Name = 'Data_Collector'
ghenv.Component.NickName = 'PV_Panel'
ghenv.Component.Message = '11.4.2024'
ghenv.Component.Category = 'PV_panel_horizontal'
ghenv.Component.Description = 'This component offers information based on input and systematizes all inputs to prevent confusion.'
                
#required information
location_info = []
location_epw = []
_direct_rad = []
_diffuse_rad = []
global_horizontal_rad = []
modelyear_list_bound = []
roofs = []
context = []
roofs_area = []
required_data = [((location_info), (global_horizontal_rad), (modelyear_list_bound), roofs_area)]
                
#ladybug libarary is called here 
def all_required_inputs(EPW):
    if (_epw_file):
        epw_data = epw.EPW(_epw_file)
        #the information related to the location for information provider
        location = epw_data.location
        location_epw.append(location)
        #extracting data
        name = location.city
        latitude = location.latitude
        longitude = location.longitude
        #location info is an output
        location_info.append((name ,latitude, longitude))
        #the model year should be extracted from the information provided from EPW
        modelyear_list_bound.append(str(gh.Bounds((epw_data.years.values))))
        #the sum of GHI value 
        global_horizontal_rad.append((round(gh.MassAddition(epw_data.global_horizontal_radiation.values)[0]/1000)))
        # the data needed for simulation
        _direct_rad.append(epw_data.direct_normal_radiation)
        _diffuse_rad.append(epw_data.diffuse_horizontal_radiation)
    else:
        ghc.add_warning('EPW File is not inserted !')
                
#take the roof as object on whom the simulation will be done and take the building also by two following condition , if the geometery 
#as context building is inserted with user , the inputted geometries are context, whereas the building for simulation must be considered 
#shade producer source  
                
def roof_picker(BUI): 
        for brep in BUI:
            dec = gh.DeconstructBrep(brep)
            for i in range(len(dec[0])):
                cent = gh.Area(dec[0][i])[1]
                norm = gh.EvaluateSurface((dec[0][i]) ,cent)[1]
                if norm[2]==1:
                    if cent[2] > 0 :
                        roofs.append(dec[0][i])
                        roofs_area.append(gh.Area(dec[0][i])[0])
                if norm[2]==-1 and cent[2] > 0:
                    roofs.append(dec[0][i])
                    roofs_area.append(gh.Area(dec[0][i])[0])
                
# the main inputs 
                
def main():
    buil = _buildings
    if (gh.NullItem(buil)[0]) == True:
        buil = gh.CleanTree(1,1,1,buil)
        buil = ghc.add_warning('The input _building is failed to collect data !') 
    else :
        buil_len = gh.ListLength(_buildings)
        buil = _buildings
        ctx = _context_
        if (gh.NullItem(ctx)[0]) == True:
            [context.append(buil[i])  for i in range(buil_len)]
        else :
            [context.append(_context_[i])  for i in range(len(_context_))]
            [context.append(buil[i])  for i in range(len(buil))]
        roof_picker(buil)
        all_required_inputs(_epw_file != None)
                
#calling the functions 
                
main()
# ---------- end pv_panel ----------
pv_panel_2 = Data_Collector(buildings=buildings_2, context=context_2, epw_file=epw_2)  # -> roofs, context, required_data, location_epw, direct_rad, diffuse_rad; inputs buildings: list of Brep, context: list of Brep; same code as pv_panel
simulation = LBFalseStartToggle(True)
simulation_2 = LBFalseStartToggle(True)
the_accurancy_level = Panel("2")
skymatrix = LBCumulativeSkyMatrix(location=pv_panel.location_epw, direct_rad=pv_panel.direct_rad, diffuse_rad=pv_panel.diffuse_rad)  # -> report, sky_mtx; plug-in component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

the_accurancy_level_2 = Panel("2")
incidentradiation = LBIncidentRadiation(
    sky_mtx=skymatrix.sky_mtx,
    geometry=flatten(pv_panel.roofs),
    context=flatten(pv_panel.context),
    grid_size=the_accurancy_level_2,
    offset_dist="1",
    irradiance=0,
    cpu_count=simulation,
    run=simulation)  # -> report, points, results, total, mesh, legend, title, int_mtx; plug-in component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

skymatrix_2 = LBCumulativeSkyMatrix(location=pv_panel_2.location_epw, direct_rad=pv_panel_2.direct_rad, diffuse_rad=pv_panel_2.diffuse_rad)  # -> report, sky_mtx; plug-in component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
information_type = ValueList({"general information": 0, "Total energy producation in kwh/y": 1, "for each building in kwh/y": 2, "per m2 in kwh/m2": 3}, selected="Total energy producation in kwh/y")
information_type_2 = ValueList({"general information": 0, "Total energy producation in kwh/y": 1, "for each building in kwh/y": 2, "per m2 in kwh/m2": 3}, selected="Total energy producation in kwh/y")
roof_availibility = Slider(100, range=1..100)
roof_availibility_2 = Slider(100, range=1..100)
module_type = ValueList({"Mono-Si": 0, "Poly-Si": 1, "CdS / CdTe": 2, "CIS / CIGS": 3}, selected="Poly-Si")
module_type_2 = ValueList({"Mono-Si": 0, "Poly-Si": 1, "CdS / CdTe": 2, "CIS / CIGS": 3}, selected="Poly-Si")
incidentradiation_2 = LBIncidentRadiation(
    sky_mtx=skymatrix_2.sky_mtx,
    geometry=flatten(pv_panel_2.roofs),
    context=flatten(pv_panel_2.context),
    grid_size=the_accurancy_level,
    offset_dist="1",
    irradiance=0,
    cpu_count=simulation_2,
    run=simulation_2)  # -> report, points, results, total, mesh, legend, title, int_mtx; plug-in component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
pv_panel_calculation_output = Calculator(
    roofs=pv_panel.roofs,
    results=incidentradiation.results,
    points=incidentradiation.points,
    mesh=incidentradiation.mesh,
    required_data=pv_panel.required_data,
    Roof_availibility=roof_availibility,
    Module_type=module_type,
    Information_Type=information_type)  # -> information; inputs roofs: list of Brep, results: list, points: list of Point3d, mesh: Mesh, Roof_availibility: Int32
# ---------- pv_panel_calculation_output: Python ----------
import ghpythonlib.components as gh
import ghpythonlib.component as ghc

#basic descripation of the component
ghenv.Component.Name = 'calculator'
ghenv.Component.NickName = 'pv_panel_calculation_output'
ghenv.Component.Message = '11.4.2024'
ghenv.Component.Category = 'PV_panel'
                
                
# decription of the inputs and outputs  
ghenv.Component.Params.Input[0].Description = 'Picked roof(s) as Rhino brep'
ghenv.Component.Params.Input[1].Description = 'A list of numbers as result of simulation that aligns with the points.'
ghenv.Component.Params.Input[2].Description = 'The grid of points that is be used to perform the incident radiation analysis.'
ghenv.Component.Params.Input[3].Description = 'A colored mesh which demonstrates the cumulative incident radiation received by the input _geometry.\n'\
                                              'This would not affact the result of the simulation and calculation output.'
ghenv.Component.Params.Input[4].Description = 'A package of data including essential information deriven from data_collector component.'
#ghenv.Component.Params.Input[2].Description =



ghenv.Component.Params.Input[5].Description = 'The roof avalibility refers to the available area that pv panels can be installed ,'\
'the defualt value is set to 70 percentage '
ghenv.Component.Params.Input[6].Description = "Follow this list to indicate your PV panel system :"\
"where the final result will be affected by:\n"\
"0-Mono-Si = 0.2\n1-Poly-Si= 0.18\n"\
"2-CIS/CIGS= 0.14\n3-CdS/CdTe= 0.11"
ghenv.Component.Params.Input[7].Description = "The index refers to following options:\n0-General information"\
"\n1-Total energy producation in kwh/y\n"\
"2-For each building in kwh/y\n3-Per m2 in kwh/m2"
ghenv.Component.Params.Output[0].Description ='The result of the simulation based on requested data '
                
                
#Needed information trigger information 
information = []
sum_va = []

#This functions as provider data on shadow losses for each buildings 
def shadow(RES , PTS , ROF):
    for i in ROF:
        pat = []
        sum = []
        geo = gh.Extrude(i , gh.UnitZ(5))
        for x , pt  in enumerate (PTS) : 
            pat.append(gh.PointInBrep( geo , pt , True))
        for y in range(len(pat)-1):
            if pat[y] == 1:
                print RES[y]
                sum.append(RES[y])
        sum_va.append(round(gh.Average(sum)))
        
        
def requested_data_provider(Required_data, Res, Roof_ab, Type, Info):
    # General information
    solar_cells = {0: ["Mono-Si" ,0.20], 1: ["Poly-Si",0.18], 2:["CIS / CIGS",0.14] ,3: ["CdS / CdTe",0.11]}
    if Res:
        result = gh.Average(Res)
        total_area = round(gh.MassAddition(Required_data[3])[0])
        losses = (abs(Required_data[1][0] - result)/((Required_data[1][0] + result)/2)*100)/100 + 0.12
        if Info == 0:
            information.append(
                'Environemntal and Geographical data:\n'
                'location: {}\n'.format(Required_data[0][0][0]) +
                'latitude: {}\n'.format(Required_data[0][0][1]) +
                'longitude: {}\n'.format(Required_data[0][0][2]) +
                'The EPW file model year : {}-{} \n'.format((Required_data[2][0][:4]),(Required_data[2][0][5:9])) +
                'Global Horizontal Irradiance : {} KWh/m²\n'.format(Required_data[1][0]) +
                '\nPV panel(s) system data:\n'+
                'Total area of the panel {} m²\n'.format(round(total_area*Roof_ab)) +
                '{}% of the roof(s) is considered as available area\n'.format(int(Roof_ab*100)) +
                'Module type : {} with {} efficiency\n'.format(solar_cells[Type][0], solar_cells[Type][1]) +
                'Total losses value , considering an average value for the area : {:.3f}\n'.format(losses) +
                '\nThe total Estimated energy production is {:.3f} GWh/year.'.format(((total_area*Roof_ab) * (abs(losses-1)) * float(Required_data[1][0]) * float(
                    solar_cells[Type][1]))/1000000))
        #Total energy producation as a value  
        elif Info == 1:
            information.append(int((total_area*Roof_ab) * (abs(losses-1)) * float(Required_data[1][0]) * float(solar_cells[Type][1])))
        # Prod for each building
        elif Info == 2:
            for x, i in enumerate(Required_data[3]):
                loss = ((abs(Required_data[1][0] - sum_va[x])/((Required_data[1][0] + sum_va[x])/2)*100)/100) + 0.12
                information.append(int((i*Roof_ab) * float(Required_data[1][0]*(abs(1-loss))) * float(solar_cells[Type][1])))
        # Prod per m2
        else:
            information.append(int((total_area*Roof_ab) * (abs(losses-1)) * float(Required_data[1][0]) * float(solar_cells[Type][1])) / (total_area*Roof_ab)) 
                
#required_data is included location[0] , rad [1] , year[2] , area[3]
                
def main():
    #insert values 
     results = ghc.add_error('_result input  is failed to collect data !') if gh.ListLength(_results)== 0 else  _results
     points = ghc.add_error('_points input  is failed to collect data !') if gh.ListLength(_points)== 0 else  _points
     roofs = ghc.add_error('_roofs input  is failed to collect data !') if gh.ListLength(_roofs)== 0 else  _roofs
     mesh = ghc.add_warning('mesh_ input  is falied to collect data') if gh.ListLength(mesh_)== 0 else  mesh_
     required_data = ghc.add_error('required_data input is failed to collect data') if gh.ListLength(_required_data)== 0 else  _required_data
    #value in deafult 
     roof_ab = 0.7 if  Roof_availibility_ is None else (Roof_availibility_/100)
     Module_type = 0 if Module_type_ is None else Module_type_
     Info = 0 if Information_Type_ is None else Information_Type_
     #calling functions 
     shadow(results , points ,  roofs) 
     requested_data_provider(required_data, results, roof_ab, Module_type, Info)
     
     
main()
# ---------- end pv_panel_calculation_output ----------
pv_panel_calculation_output_2 = Calculator(
    roofs=pv_panel_2.roofs,
    results=incidentradiation_2.results,
    points=incidentradiation_2.points,
    mesh=incidentradiation_2.mesh,
    required_data=pv_panel_2.required_data,
    Roof_availibility=roof_availibility_2,
    Module_type=module_type_2,
    Information_Type=information_type_2)  # -> information; inputs roofs: list of Brep, results: list, points: list of Point3d, mesh: Mesh, Roof_availibility: Int32; same code as pv_panel_calculation_output
panel = Panel(pv_panel_calculation_output_2)
panel_2 = Panel(pv_panel_calculation_output)

# ---- group: perccentage difference
expression = Expression(x=pv_panel_calculation_output, y=pv_panel_calculation_output_2, Expression="abs(x-y)/((x+y)/2)*100")
panel_3 = Panel(expression)
